# Grasshopper definition Rahmen.gh (Grasshopper 1.0.8)
# plug-ins: K2Engineering (and K2E+), Human

panel = Panel("""ALLGEMEINE ERLÄUTERUNG

In dieser Datei habe ich versucht, die verschiedenen Strukturtypen darzustellen, die mit dieser Art von digitalen Tools erstellt werden können.

Das Ziel ist es, ein IT-Tool zu haben, das eine visuelle, grafische und Echtzeit-Darstellung ermöglicht, um intuitives Lernen durch Experimentieren zu ermöglichen. Der parametrische Ansatz ermöglicht dieses Lernen, wenn geeignete Beispiele entworfen und konzeptionelle Fragen gestellt werden, die durch die Untersuchung mit den interaktiven digitalen Modellen intuitiver und natürlicher verstanden werden können.

Der parametrische Ansatz ermöglicht es, die Auswirkungen jedes Parameters auf das Endergebnis zu untersuchen (Verformungen und innere Spannungen, beide eher in qualitativer Natur und in der Größenordnung angegeben, als dass eine hohe Genauigkeit angestrebt wird) und so ein intuitives Verständnis des Strukturverhaltens zu erlangen, das bei des Tragwerkentwurfs von Architekturprojekten angewendet werden kann.

Dieses Tool ermöglicht die Analyse des parametrischen Strukturmodells anhand eines Ansatzes, der auf der Entwicklung eines Partikelsystems basiert, dessen Wechselwirkungen aufgrund von Belastungen, Verbindungen und Entkopplungen sowie der Steifigkeit der Elemente selbst zur richtigen Gleichgewichtslösung konvergieren müssen.
 
Es handelt sich um einen hochgradig nichtlinearen und evolutionären Prozess, der Vor- und Nachteile hat. Der Hauptvorteil besteht darin, dass die Reaktion des Strukturmodells (und wie es zu dieser Reaktion gelangt und sich im Laufe der Zeit entwickelt) auch unter Bedingungen, die über die lineare Berechnung von Finite-Elemente-Programmen hinausgehen, visuell und nahezu in Echtzeit dargestellt werden kann: Kabel, große Bewegungen und nichtlineares Verhalten sind direkt in diesen Prozess integriert. Dieser Vorteil macht sie besonders interessant für die Vermittlung grundlegender Konzepte von Strukturen. Der größte Nachteil besteht darin, dass die Konvergenz nicht gewährleistet ist und dass sie bei Modellen mit einer großen Anzahl von Elementen im Vergleich zur direkten numerischen Lösung des Gleichungssystems, die von herkömmlichen Finite-Elemente-Programmen implementiert wird, übermäßig langsam sein kann.

Da für die Vermittlung der grundlegendsten Konzepte von Strukturen keine sehr komplexen Modelle erforderlich sind, kann dieses Tool als virtuelles Labor dienen, in dem das strukturelle Verhalten visuell und interaktiv erforscht werden kann, was für Architekturstudenten sehr gut geeignet ist.

Jedes Modell muss jedoch mit verschiedenen Parametern getestet werden, um Instabilitätsprobleme zu erkennen und diese so weit wie möglich zu vermeiden.
Diese neue Version, die fast vollständig neu programmiert wurde, hat die Stabilität und Geschwindigkeit verbessert, aber da es sich um einen nichtlinearen Prozess handelt, lässt sich das Problem einer möglichen Konvergenzschwäche oder Instabilität nicht vermeiden.


Die Hauptursache für Instabilität und mangelnde Konvergenz ist das Vorhandensein oder Auftreten von Elementen mit hoher Steifigkeit. Dies wurde in der vorherigen Version noch verstärkt, da die Strukturelemente in kleine Segmente unterteilt werden mussten, um lineare Lasten durch eine Reihe von Punktlasten zu modellieren, die ausreichend nahe beieinander lagen. Diese Unterteilung ist nun nicht mehr erforderlich, wodurch das Problem der Instabilität durch übermäßig steife kurze Stäbe verringert wird.


Die Stäbe müssen nur an den Stellen unterteilt werden, an denen sie ihre Richtung ändern, ihren Materialquerschnitt ändern oder mit anderen Stäben oder Knoten der Struktur verbunden sind. Dies ermöglicht längere Stäbe und einen schnelleren und stabileren Prozess. Bei gekrümmten Systemen (Seile und Bögen) muss jedoch die gekrümmte Geometrie durch gerade Liniensegmente modelliert werden, sodass auf die Anzahl der Unterteilungen und die Steifigkeit des Materialquerschnitts geachtet werden muss, um eine übermäßige Steifigkeit zu vermeiden, die zu einer Divergenz des iterativen Prozesses führt.


Als wichtigste Maßnahme zur Behebung der Instabilität gibt es einen globalen Steifigkeitsreduktionsfaktor, der der Verwendung eines flexibleren Materials entspricht, wobei im Gegenzug der Verstärkungsfaktor der Strukturantwort neu berechnet wird, damit das Endergebnis ähnlich ist. Es kann nicht dasselbe sein, da bei einem flexibleren Material die Verformungen zunehmen und die Ergebnisse eher einer nichtlinearen als einer linearen Analyse entsprechen. Zumindest in einigen Fällen kann die Instabilität jedoch vermieden werden. Es wurden zwei zusätzliche Parameter programmiert, mit denen die Details der axialen und der Biege-Steifigkeit unabhängig voneinander konfiguriert werden können, deren Verwendung jedoch komplex ist und weiterer Untersuchungen bedarf.

Die allgemeine Funktionsweise des Prozesses ist einfach und spiegelt die verschiedenen Teile wider, aus denen jedes Strukturmodell besteht: Geometrie, Auflager, Lasten, Materialien, Querschnitte und interne Gelenke. Mit all diesen Informationen kann der „Solver” nach der Lösung suchen. Und die programmierten Komponenten ermöglichen es, die Ergebnisse ohne zusätzlichen Aufwand darzustellen. 

Man muss lediglich Zeit in die Definition des Modells investieren, insbesondere in die Geometrie, die den größten Arbeitsaufwand darstellt, da der Rest auf den vielen programmierten Komponenten basiert, die den Prozess der Erstellung neuer Modelle vereinfachen und beschleunigen.


Die Geometrie kann auf zwei Arten erzeugt werden. Sie kann mit Rhino (oder Autocad oder einem anderen CAD-Programm) gezeichnet und in Rhino importiert werden und dann in Grasshopper (GH) durch Internalisierung („Internalise data”) LINE-Elementen zugewiesen werden. 
Der Nachteil dieses Ansatzes ist, dass die Geometrie fest und nicht parametrisch ist. Sie ermöglicht eine einfachere Analyse jeder Geometrie, da sie innerhalb der CAD-Umgebung gezeichnet wird, aber die Möglichkeit, mit geometrischen Parametern zu experimentieren, geht verloren.
 


Der bevorzugte Ansatz (aufgrund seiner besseren Erklärungskraft) besteht darin, die Geometrie parametrisch in GH zu generieren. Dazu muss man lernen, in GH mit geometrischen Komponenten und Operationen zu programmieren. Dieser Teil ist bei der Erstellung von Modellen am zeitaufwändigsten.
Auf die erzeugte parametrische Geometrie müssen Stützen, Lasten, Materialien und Querschnitte zugewiesen werden, und vor allem muss ausgewählt werden, welcher der drei Strukturtypen für die Darstellung des Modells am besten geeignet ist, je nach der Art der Kräfte, denen das Element standhalten muss.


Der allgemeinste Strukturtyp ist der Stab mit 6 Freiheitsgraden („Beam+“), mit dem Stäbe modelliert werden können, die axiale Zug- und Druckkräfte, Querkräfte und Biegemomente aufnehmen können. Mit diesem Typ werden in der Regel fast alle Stäbe in konventionellen Konstruktionen (Stützen, Träger, Rahmen, Bögen usw.) modelliert, mit Ausnahme von Seilen und Fachwerken.
 Für Fachwerke kann ebenfalls der Strukturtyp „Beam+“ verwendet werden, indem an den entsprechenden Enden Gelenke zugewiesen werden. 
Für Fachwerke mit allen Gelenken ist jedoch der Typ „Bar+“ vorzuziehen, bei dem es sich um einen „Pendelstab“ handelt, der nur axial arbeiten kann (Zugstab und Druckstab oder Pendelstab). Das Problem bei dieser Art von Struktur ist, dass sie in entsprechend dreieckigen Konfigurationen verwendet werden muss, um stabil zu sein, da sie sich sonst in eine Kette von Gelenkgliedern verwandeln kann, die in ihrer ursprünglichen geometrischen Konfiguration nicht stabil ist.

Für Kabel sollte der Strukturtyp „Kabel+“ verwendet werden, der nur Zugkräften standhält und seine Form anpasst, um in einem stark nichtlinearen Prozess mit großen Verformungen ein Gleichgewicht zu erreichen.


Ausführlichere Erläuterungen finden Sie neben den einzelnen Beispielen in dieser Beispieldatei.""")  # disabled

# ---- group: ALLGEMEINES
# Das manchmal auftretende Darstellungsproblem liegt daran, dass die Kamera in Rhino einen "near-clipping-plane" und einen "far-clipping-plane" (https://discourse.mcneel.com/t/modify-camera-near-clipping-plane/190327/3) automatisch definiert um alles zu zeigen was zu zeigen ist.
# 
# Dazu betrachtet Rhino nur die Geometrie die von GH erstellt wurde und die nicht ausgeblendet (preview = off) ist.
# 
# Mit meiner neuen Komponente, die die Linienstärke und Farbe definieren läst, wir leider keine Geometrie in GH dargestellt (alles wird ausgeblendet mit preview = off), denn die neue Komponente zeichnet die Geometrie, anstatt GH, wie üblicherweise.
# 
# Deshalb kann Rhino nicht wissen was für eine Geometrie er darstellen soll, und definiert die "near" und "far" "clipping planes" für eine sehr kleine Geometrie um den Ursprung. Man muss nur einen einzigen Punkt weit weg vom Ursprung erstellen, so dass die Pläne die ganze Geometrie zeigen.
# 
# Deshalb wird hier ein Punkt in (100,100,100) erstellt.
# Mit diesem Teil, den ich aus dem Internet runtergeladen habe, kann man den Typ „wire“ automatisch in „faint“ für die ausgewählten Komponente ändern.
# 
# Ich hab den Code aus dem Internet geändert, damit die „wire“, die manuell auf „hidden“ gesetzt wurden, nicht auf „faint“ geändert werden.
# 
# Das heißt, nur die, die auf ‚default‘ waren, werden auf „faint“ geändert.
# Diese kleine Komponente sorgt dafür, dass das GH-Fenster sofort nach dem Start des Modells minimiert wird.
# 
# Auf diese Weise sehen die Studenten den Code nicht.
# Das Fenster ist nicht geschlossen, nur minimiert. Wenn also jemand den Code sehen (oder sogar ändern) will, können wir nicht verhindern, dass das GH-Fenster über das Symbol in der unteren Leiste der laufenden Programme geöffnet wird.
# 
# Mit dem Schalter kannst man verhindern, dass das Fenster während der Programmierung minimiert wird („debug = true“), aber wenn man mit der Definition des Modells fertig wird, muss man das Modell mit diesem Schalter auf „false“ speichern.
# When Selected = True, only currently selected parameters will be adjusted. There will be no undo record for this operation.
toggle = BooleanToggle(False)  # disabled
startup = Python3Script(debug=toggle)  # -> out; disabled
# ---------- startup: Python ----------
import Rhino
from Rhino.UI import Panels
from System import Guid
import Grasshopper
from System import Windows

Grasshopper.Instances.ShowRemotePanel()

if debug == True:
    Panels.OpenPanel(Guid('b45a29b1-4343-4035-989e-044e8580d9cf'))

    PanelIds = []
    PanelIds = Panels.GetOpenPanelIds()
    for x in PanelIds:
        name = Panels.GetPanel(x, Rhino.RhinoDoc.ActiveDoc)
        print(x)
        print(name)

if debug == False:
    Grasshopper.Instances.ShowRemotePanel()

    if (Grasshopper.Instances.DocumentEditor.WindowState != Windows.Forms.FormWindowState.Minimized):
        Grasshopper.Instances.DocumentEditor.WindowState = Windows.Forms.FormWindowState.Minimized
# ---------- end startup ----------
panel_2 = Panel(startup)  # disabled
panel_3 = Panel("100")  # disabled
pt = ConstructPoint(XCoordinate=panel_3, YCoordinate=panel_3, ZCoordinate=panel_3)  # disabled
list = ValueList({"Normal": 1, "Faint": 2, "Hidden": 3}, selected="Faint")  # disabled
toggle_2 = BooleanToggle(True)  # disabled
vb = VBScript(wire=list, selected=toggle_2)  # -> out, A; disabled
# ---------- vb: VB usings ----------
Imports System.IO
Imports System.Linq
Imports System.Data
Imports System.Drawing
Imports System.Reflection
Imports System.Windows.Forms
Imports System.Xml
Imports System.Xml.Linq
Imports System.Runtime.InteropServices

Imports Rhino.DocObjects
Imports Rhino.Collections
Imports GH_IO
Imports GH_IO.Serialization
# ---------- vb: VB ----------
    Dim document As GH_Document = owner.OnPingDocument()
    If (document Is Nothing) Then Return

    For Each att As IGH_Attributes In document.Attributes
        Dim param As IGH_Param = TryCast(att.DocObject, IGH_Param)
        If (param Is Nothing) Then Continue For

        If (selected And Not param.Attributes.GetTopLevel.Selected ) Then Continue For

        If param.WireDisplay = GH_ParamWireDisplay.Default Then
            Select Case wire
            Case 2
            param.WireDisplay = GH_ParamWireDisplay.faint
            Case 3
            param.WireDisplay = GH_ParamWireDisplay.hidden
            End Select
        ElseIf param.WireDisplay = GH_ParamWireDisplay.faint Then
            Select Case wire
            Case 3
            param.WireDisplay = GH_ParamWireDisplay.hidden
            End Select
        End If

    Next
# ---------- end vb ----------

# ----
# Mit diesen beiden ersten Kontrollen kann man die Instabilität des iterativen Prozesses ausgleichen. Diese Instabilität kommt vor allem durch die hohe Steifigkeit der Gebäudestrukturen.
# Wenn der iterative Prozess divergiert (nicht konvergiert), kann das höchstwahrscheinlich daran liegen, dass ein oder mehrere Elemente zu steif sind (weil sie ein sehr steifes Material oder einen sehr steifen Querschnitt haben oder sehr kurz sind).
# Die Konvergenz (Stabilität) des iterativen Prozesses kann verbessert werden, indem die Steifigkeit (Faktor „Stiffness“) reduziert wird. Dieser Faktor muss mit allen Stäben der Struktur verknüpft sein („CtrlK“).
# Durch die Flexibilisierung der Struktur nehmen die Verformungen zu, aber die Ergebnisse werden mit dem umgekehrten Effekt korrigiert, sodass korrekte Endergebnisse erzielt werden.
# Wenn die Struktur flexibler gemacht wird, kann es nötig sein, den „Threshold“ zu verringern, wenn die Struktur sehr langsam konvergiert und nie fertig wird.
# Außerdem gibt es bei jedem Stab eine Steuerung (CtrlA) für die „Weighting“ gegenüber dem axialen Verhalten und eine Steuerung (CtrlB) für die „Weighting“ gegenüber dem Biegeverhalten, aber diese Parameter sind bei Konvergenzproblemen schwieriger einzustellen.
# Alle Parameter der Konfiguration werden in diesem Komponente zusammengestellt, so dass andere Komponente ganz einfach auf alle Werte zugreifen dürfen.
# 
# Symmetrisch zu dieser Komponente, die alle Parameter versammelt, gibt es die inverse Komponente die alle Parameter wieder zur Verfügung stellt, so dass nur eine Verbindung ("wire") nötig ist, und alles sauberer asusieht.
stiffnessratio = Slider(1, range=0.001..1)  # disabled
_3d_modell_darstellung = BooleanToggle(False)  # disabled
gelenke_darstellen = BooleanToggle(True)  # disabled
verformung = BooleanToggle(False)  # disabled
_3d_modell_verformung = BooleanToggle(False)  # disabled
_3d_verformung_vereinfacht = BooleanToggle(False)  # disabled
faktor_verformung = Slider(100, range=1..200)  # disabled
bewegungswerte_darstellen = BooleanToggle(False)  # disabled
normalkraft_n_kn = BooleanToggle(False)  # disabled
querkraft_vy_kn = BooleanToggle(False)  # disabled
querkraft_vz_kn = BooleanToggle(False)  # disabled
moment_my_knm = BooleanToggle(True)  # disabled
moment_mz_knm = BooleanToggle(False)  # disabled
reduktion_m = Slider(50, range=1..1000)  # disabled
schnittgrössenwerte_darstellen = BooleanToggle(True)  # disabled
diagramme_auf_die_verformte_struktur = BooleanToggle(False)  # disabled
lasten_darstellen = BooleanToggle(False)  # disabled
lasten_in_der_verformte_struktur = BooleanToggle(True)  # disabled
kräfte_zerlegt_dargestellt = BooleanToggle(True)  # disabled
pfeil_zum_punkt = BooleanToggle(True)  # disabled
_3d_auflager_darstellung = BooleanToggle(True)  # disabled
grössenfaktor_für_auflagerdarstellung = Slider(0.6, range=0..1)  # disabled
farbe_auflager = ColourSwatch(SwatchColor=RGB(16, 74, 125))  # disabled
auflager_kraftreaktionen = BooleanToggle(False)  # disabled
auflager_momentreaktionen = BooleanToggle(False)  # disabled
auflagerreaktionen_werte = BooleanToggle(False)  # disabled
# Ich habe die gesamte Konfiguration neu programmiert, um sie mit weniger Kabelverbindungen in der Datei zugänglich zu machen. Dadurch wird sie übersichtlicher und einfacher zu handhaben.
# In dieser Gruppe sind alle Konfigurationsoptionen enthalten. Nur eine kleine Auswahl dieser Optionen sollte dem Benutzer im „Control Panel” (CP) angeboten werden.
# Der Entwickler der Modelle kann jedoch viele Parameter ändern, die die Anzeige des Modells und der Ergebnisse steuern.
# Es ist ratsam, alle verfügbaren Optionen zu prüfen, sie nach Ihren Wünschen zu konfigurieren und dann dieselbe Datei für nachfolgende Modelle wiederzuverwenden, damit Sie nicht später dieselben Parameter in allen Modellen ändern müssen.
# 
# Im unteren Bereich befindet sich eine Schaltfläche zum Zurücksetzen aller Konfigurationsparameter auf die ursprünglichen Standardwerte. Diese Werte sind in den gelben Textfeldern neben den drei Komponenten zur Verwaltung der Standardwerte definiert.
# Früher gab es nur eine Komponente, aber jetzt habe ich drei Komponenten programmiert: eine für numerische Werte, eine für „Toggle”-Werte („True or False”) und eine für Farben.
# An anderen Stellen des Modells ist ein Ergebnisausgang („param”) zu sehen, der als Parameter verwendet werden kann, um den „Solver”-Prozess neu zu starten. Ich werde das später noch genauer erklären, zum Beispiel in der Geometrie.
# 
# Der Code für die Darstellung der „Auflager“ wurde stark vereinfacht. Trotzdem habe ich eine sehr vielseitige Funktion programmiert. Links sind die 16 Fälle von Auflagern, die wir für möglich gehalten haben (Achtung, dZ und rZ können nicht deaktiviert werden).
# Jede der 16 Komponenten hat die Geometrie der Auflager intern gespeichert. Wenn du das Design ändern möchtest, musst du nur ein neues Design in Rhino zeichnen und jedem die Geometrie mit „Internalise Data“ zuweisen, und das System funktioniert auch mit dem neuen Design.
# Du kannst den Maßstab der Darstellung ändern, die Darstellung aktivieren oder deaktivieren und die Farbe ändern. Übrigens werden die Auflager an der Position der Verformung dargestellt. Das kannst du sehen, wenn du zum Beispiel dX freigibst.
# 
# Die Darstellung der Lasten ist intern in einer Komponente programmiert, aber du kannst die Farbe, den Maßstab hier einstellen. Für andere Parameter (den Radius des Kegels, die Höhe des Kegels und den Radius des Zylinders), gibt es die Moglichkeit in der Gruppe für die Darstellung von Punktlasten. Außerdem habe ich die Option hinzugefügt, die Lasten in der verformten oder unverformten Struktur darzustellen, die Pfeile zum Angriffspunkt oder vom Angriffspunkt darzustellen, und wenn mehrere Lasten auf dem selben Punkt vorkommen, als Resultierende oder in die 3 globalen Komponente darstellen. Ausserdem, habe ich neu programmiert dass die Momente auch mit Pfeilen (aber mit doppelten Kegeln) und ein bisschen dunkler dargestellt werden (nicht nur in Auflagerreaktionen, aber auch als Lasten).
# Das heisst, jetzt kann man auch Punktmomente, sowie Punktlasnten einbringen.
spannungsratio = BooleanToggle(False)  # disabled
threshold = Slider(15, range=10..20)  # disabled
nachkommastellen = Slider(0, range=0..3)  # disabled
linienstärke = Slider(4, range=0..10)  # disabled
farbe_modelllinie = ColourSwatch(SwatchColor=RGB(64, 64, 64))  # disabled
liniengrösse_für_die_gelenke = Slider(5, range=0..10)  # disabled
grösse_der_kreise_für_die_gelenke = Slider(0.03, range=0..0.2)  # disabled
farbe_für_die_gelenke = ColourSwatch(SwatchColor=RGB(255, 255, 255))  # disabled
farbe_verformung = ColourSwatch(SwatchColor=RGB(207, 207, 207))  # disabled
farbe_bewegungswerte = ColourSwatch(SwatchColor=RGB(0, 0, 0))  # disabled
reduktion_n = Slider(200, range=1..1000)  # disabled
reduktion_v = Slider(50, range=1..1000)  # disabled
farbe_n = ColourSwatch(SwatchColor=RGBA(255, 255, 11, 100))  # disabled
farbe_n_2 = ColourSwatch(SwatchColor=RGBA(222, 11, 11, 100))  # disabled
farbe_v = ColourSwatch(SwatchColor=RGBA(27, 133, 0, 100))  # disabled
farbe_m = ColourSwatch(SwatchColor=RGBA(11, 67, 222, 100))  # disabled
farbe_schnittgrössenwerte = ColourSwatch(SwatchColor=RGB(255, 255, 255))  # disabled
farbe_lasten = ColourSwatch(SwatchColor=RGB(255, 163, 0))  # disabled
lastendarstellungsgrösse = Slider(0.15, range=0..1)  # disabled
farbe_reaktionen = ColourSwatch(SwatchColor=RGB(199, 26, 26))  # disabled
farbe_reaktionswerte = ColourSwatch(SwatchColor=RGB(255, 255, 255))  # disabled
and = GateAnd(A=verformung, B=_3d_modell_verformung)  # disabled
multiplication = Multiplication(Stiffness=stiffnessratio, FaktorVerformung=faktor_verformung)  # disabled
reset_konfiguration = Button()  # disabled
eval = Evaluate(E="10^(-x)", x=threshold)  # disabled
_0 = Geometry([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])  # disabled
dx = Geometry([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])  # disabled
dy = Geometry([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])  # disabled
rx = Geometry([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])  # disabled
dyrx = Geometry([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])  # disabled
dyrxry = Geometry([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])  # disabled
_0_00 = ColourSwatch(SwatchColor=RGB(0, 0, 255))  # disabled
_25_0 = ColourSwatch(SwatchColor=RGB(0, 255, 128))  # disabled
_37_5 = ColourSwatch(SwatchColor=RGB(128, 255, 0))  # disabled
_50_0 = ColourSwatch(SwatchColor=RGB(255, 255, 0))  # disabled
_75_0 = ColourSwatch(SwatchColor=RGB(255, 128, 0))  # disabled
_100 = ColourSwatch(SwatchColor=RGB(200, 0, 200))  # disabled
dxdy = Geometry([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])  # disabled
dxrx = Geometry([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])  # disabled
dxdyrx = Geometry([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])  # disabled
ry = Geometry([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])  # disabled
dxry = Geometry([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])  # disabled
dyry = Geometry([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])  # disabled
dxdyry = Geometry([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])  # disabled
rxry = Geometry([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])  # disabled
dxrxry = Geometry([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])  # disabled
dxdyrxry = Geometry([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])  # disabled
_12_5 = ColourSwatch(SwatchColor=RGB(0, 170, 255))  # disabled
_62_5 = ColourSwatch(SwatchColor=RGB(255, 212, 0))  # disabled
_87_5 = ColourSwatch(SwatchColor=RGB(255, 0, 0))  # disabled
panel_4 = Panel("""64, 64, 64, 255
255, 255, 255, 255
207, 207, 207, 255
0, 0, 0, 255
255, 255, 11, 100
222, 11, 11, 100
27, 133, 0, 100
11, 67, 222, 100
255, 255, 255, 255
255, 163, 0, 255
16, 74, 125, 255
199, 26, 26, 255
255, 255, 255, 255""")  # disabled
panel_5 = Panel("""1.0
15
0
4
5
0.03
100
200
50
50
0.15
0.6""")  # disabled
panel_6 = Panel("""False
True
True
False
False
False
False
False
False
False
False
False
False
True
True
True
False
False
False
False""")  # disabled
auflager_darstellung = Entwine(
    Branch00=_0,
    Branch01=dx,
    Branch02=dy,
    Branch03=dxdy,
    Branch04=rx,
    Branch05=dxrx,
    Branch06=dyrx,
    Branch07=dxdyrx,
    Branch08=ry,
    Branch09=dxry,
    Branch010=dyry,
    Branch011=dxdyry,
    Branch012=rxry,
    Branch013=dxrxry,
    Branch014=dyrxry,
    Branch015=dxdyrxry,
    FlattenInputs=True)  # -> simplify(Result); disabled
merge = Merge(Data1=_0_00, Data2=_12_5, Data3=_25_0, Data4=_37_5, Data5=_50_0, Data6=_62_5, Data7=_75_0, Data8=_87_5, Data9=_100)  # -> flatten(Result); disabled
reset_values = CSharpScript(
    Reset=reset_konfiguration,
    Parameters=[stiffnessratio, threshold, nachkommastellen, linienstärke, liniengrösse_für_die_gelenke, grösse_der_kreise_für_die_gelenke, faktor_verformung, reduktion_n, reduktion_v, reduktion_m, lastendarstellungsgrösse, grössenfaktor_für_auflagerdarstellung],
    Values=panel_5)  # -> flatten(out); inputs Reset: Boolean, Parameters: list, Values: list of Double; disabled
# ---------- reset_values: C# ----------
// Grasshopper Script Instance
#region Usings
using System;
using System.Linq;
using System.Collections;
using System.Collections.Generic;
using System.Drawing;

using Rhino;
using Rhino.Geometry;

using Grasshopper;
using Grasshopper.Kernel;
using Grasshopper.Kernel.Data;
using Grasshopper.Kernel.Types;
#endregion

public class Script_Instance : GH_ScriptInstance
{
    #region Notes
    /* 
      Members:
        RhinoDoc RhinoDocument
        GH_Document GrasshopperDocument
        IGH_Component Component
        int Iteration

      Methods (Virtual & overridable):
        Print(string text)
        Print(string format, params object[] args)
        Reflect(object obj)
        Reflect(object obj, string method_name)
    */
    #endregion

    private void RunScript(bool Reset, List<object> Parameters, List<double> Values)
    {
        Grasshopper.Kernel.Special.GH_NumberSlider slider;

        int num_sliders = Parameters.Count();
        int num_values = Values.Count();

        if (num_sliders != num_values)
            Print("Error: Parameters and Values should match in number of elements");
        else
        {    
            int i;

            if (Reset == true)
            {
                Print("Reseting to default values");

                for (i = 0; i < num_sliders ; i++)
                {
                    slider = Component.Params.Input[1].Sources[i] as Grasshopper.Kernel.Special.GH_NumberSlider; //try to cast that thing as a slider

                    if (slider != null)
                    {
                        slider.TrySetSliderValue((decimal) Values[i]);
                    }
                }
            }
        }
    }
}
# ---------- end reset_values ----------
reset_toggles = CSharpScript(
    Reset=reset_konfiguration,
    Parameters=[_3d_modell_darstellung, gelenke_darstellen, verformung, _3d_modell_verformung, _3d_verformung_vereinfacht, bewegungswerte_darstellen, normalkraft_n_kn, querkraft_vy_kn, querkraft_vz_kn, moment_my_knm, moment_mz_knm, schnittgrössenwerte_darstellen, diagramme_auf_die_verformte_struktur, lasten_darstellen, lasten_in_der_verformte_struktur, _3d_auflager_darstellung, auflager_kraftreaktionen, auflager_momentreaktionen, auflagerreaktionen_werte, spannungsratio],
    Values=panel_6)  # -> flatten(out); inputs Reset: Boolean, Parameters: list, Values: list of Boolean; disabled
# ---------- reset_toggles: C# ----------
// Grasshopper Script Instance
#region Usings
using System;
using System.Linq;
using System.Collections;
using System.Collections.Generic;
using System.Drawing;

using Rhino;
using Rhino.Geometry;

using Grasshopper;
using Grasshopper.Kernel;
using Grasshopper.Kernel.Data;
using Grasshopper.Kernel.Types;
#endregion

public class Script_Instance : GH_ScriptInstance
{
    #region Notes
    /* 
      Members:
        RhinoDoc RhinoDocument
        GH_Document GrasshopperDocument
        IGH_Component Component
        int Iteration

      Methods (Virtual & overridable):
        Print(string text)
        Print(string format, params object[] args)
        Reflect(object obj)
        Reflect(object obj, string method_name)
    */
    #endregion

    private void RunScript(bool Reset, List<object> Parameters, List<bool> Values)
    {
        Grasshopper.Kernel.Special.GH_BooleanToggle toggle;

        int num_toggles = Parameters.Count();
        int num_values = Values.Count();

        if (num_toggles != num_values)
            Print("Error: Parameters and Values should match in number of elements");
        else
        {    
            int i;

            if (Reset == true)
            {
                Print("Reseting to default values");

                for (i = 0; i < num_toggles ; i++)
                {
                    toggle = Component.Params.Input[1].Sources[i] as Grasshopper.Kernel.Special.GH_BooleanToggle; //try to cast that thing as a toggle

                    if (toggle != null)
                    {
                        toggle.Value = Values[i];
                        toggle.ExpireSolution(true);
                    }
                }
            }
        }
    }
}
# ---------- end reset_toggles ----------
reset_colors = CSharpScript(
    Reset=reset_konfiguration,
    Parameters=[farbe_modelllinie, farbe_für_die_gelenke, farbe_verformung, farbe_bewegungswerte, farbe_n, farbe_n_2, farbe_v, farbe_m, farbe_schnittgrössenwerte, farbe_lasten, farbe_auflager, farbe_reaktionen, farbe_reaktionswerte],
    Values=panel_4)  # -> flatten(out); inputs Reset: Boolean, Parameters: list, Values: list of Color; disabled
# ---------- reset_colors: C# ----------
// Grasshopper Script Instance
#region Usings
using System;
using System.Linq;
using System.Collections;
using System.Collections.Generic;
using System.Drawing;

using Rhino;
using Rhino.Geometry;

using Grasshopper;
using Grasshopper.Kernel;
using Grasshopper.Kernel.Data;
using Grasshopper.Kernel.Types;
#endregion

public class Script_Instance : GH_ScriptInstance
{
    #region Notes
    /* 
      Members:
        RhinoDoc RhinoDocument
        GH_Document GrasshopperDocument
        IGH_Component Component
        int Iteration

      Methods (Virtual & overridable):
        Print(string text)
        Print(string format, params object[] args)
        Reflect(object obj)
        Reflect(object obj, string method_name)
    */
    #endregion

    private void RunScript(bool Reset, List<object> Parameters, List<Color> Values)
    {
        Grasshopper.Kernel.Special.GH_ColourSwatch color;

        int num_colors = Parameters.Count();
        int num_values = Values.Count();

        if (num_colors != num_values)
            Print("Error: Parameters and Values should match in number of elements");
        else
        {    
            int i;

            if (Reset == true)
            {
                Print("Reseting to default values");

                for (i = 0; i < num_colors ; i++)
                {
                    color = Component.Params.Input[1].Sources[i] as Grasshopper.Kernel.Special.GH_ColourSwatch; //try to cast that thing as a colour swatch

                    if (color != null)
                    {
                        color.SwatchColour = Values[i];
                        color.ExpireSolution(true);
                    }
                }
            }
        }
    }
}
# ---------- end reset_colors ----------
cfg = ConfigurationPlus(
    StiffnessRatio=stiffnessratio,
    Threshold=eval,
    NumberOfDecimals=nachkommastellen,
    LineThickness=linienstärke,
    ModelColor=farbe_modelllinie,
    _3DModel=_3d_modell_darstellung,
    Hinges=gelenke_darstellen,
    HingeThickness=liniengrösse_für_die_gelenke,
    HingeSize=grösse_der_kreise_für_die_gelenke,
    HingeColor=farbe_für_die_gelenke,
    Deformation=verformung,
    _3DDeformation=_3d_modell_verformung,
    Simplified3DDeformation=_3d_verformung_vereinfacht,
    DeformationColor=farbe_verformung,
    ScaleDeformation=faktor_verformung,
    Displacements=bewegungswerte_darstellen,
    DisplacementColor=farbe_bewegungswerte,
    AxialDiagram=normalkraft_n_kn,
    ScaleAxial=reduktion_n,
    ShearDiagramYSecondary=querkraft_vy_kn,
    ShearDiagramZPrincipal=querkraft_vz_kn,
    ScaleShear=reduktion_v,
    MomentDiagramYPrincipal=moment_my_knm,
    MomentDiagramZSecondary=moment_mz_knm,
    ScaleMoment=reduktion_m,
    PositiveAxialColor=farbe_n,
    NegativeAxialColor=farbe_n_2,
    ShearColor=farbe_v,
    MomentColor=farbe_m,
    DiagramValues=schnittgrössenwerte_darstellen,
    ValuesColor=farbe_schnittgrössenwerte,
    DiagramsOnDeformedShape=diagramme_auf_die_verformte_struktur,
    LoadRepresentation=lasten_darstellen,
    LoadColor=farbe_lasten,
    LoadSize=lastendarstellungsgrösse,
    LoadsOnDeformedShape=lasten_in_der_verformte_struktur,
    LoadsDecomposed=kräfte_zerlegt_dargestellt,
    TipOnPoint=pfeil_zum_punkt,
    SupportRepresentation=_3d_auflager_darstellung,
    SupportSize=grössenfaktor_für_auflagerdarstellung,
    SupportColor=farbe_auflager,
    ForceReactionRepresentation=auflager_kraftreaktionen,
    MomentReactionRepresentation=auflager_momentreaktionen,
    ReactionColor=farbe_reaktionen,
    ReactionValues=auflagerreaktionen_werte,
    ReactionValueColor=farbe_reaktionswerte,
    SaturationRatio=spannungsratio,
    SaturationRatioColors=merge,
    MinimumSegmentLengthInBeams=0.1,
    MaximumSegmentLengthInBeams=1)  # disabled
panel_7 = Panel(reset_toggles)  # disabled
panel_8 = Panel(reset_colors)  # disabled
panel_9 = Panel(reset_values)  # disabled

panel_10 = Panel("""ALLGEMEINE ERLÄUTERUNG

In dieser Datei habe ich versucht, die verschiedenen Strukturtypen darzustellen, die mit dieser Art von digitalen Tools erstellt werden können.

Das Ziel ist es, ein IT-Tool zu haben, das eine visuelle, grafische und Echtzeit-Darstellung ermöglicht, um intuitives Lernen durch Experimentieren zu ermöglichen. Der parametrische Ansatz ermöglicht dieses Lernen, wenn geeignete Beispiele entworfen und konzeptionelle Fragen gestellt werden, die durch die Untersuchung mit den interaktiven digitalen Modellen intuitiver und natürlicher verstanden werden können.

Der parametrische Ansatz ermöglicht es, die Auswirkungen jedes Parameters auf das Endergebnis zu untersuchen (Verformungen und innere Spannungen, beide eher in qualitativer Natur und in der Größenordnung angegeben, als dass eine hohe Genauigkeit angestrebt wird) und so ein intuitives Verständnis des Strukturverhaltens zu erlangen, das bei des Tragwerkentwurfs von Architekturprojekten angewendet werden kann.

Dieses Tool ermöglicht die Analyse des parametrischen Strukturmodells anhand eines Ansatzes, der auf der Entwicklung eines Partikelsystems basiert, dessen Wechselwirkungen aufgrund von Belastungen, Verbindungen und Entkopplungen sowie der Steifigkeit der Elemente selbst zur richtigen Gleichgewichtslösung konvergieren müssen.
 
Es handelt sich um einen hochgradig nichtlinearen und evolutionären Prozess, der Vor- und Nachteile hat. Der Hauptvorteil besteht darin, dass die Reaktion des Strukturmodells (und wie es zu dieser Reaktion gelangt und sich im Laufe der Zeit entwickelt) auch unter Bedingungen, die über die lineare Berechnung von Finite-Elemente-Programmen hinausgehen, visuell und nahezu in Echtzeit dargestellt werden kann: Kabel, große Bewegungen und nichtlineares Verhalten sind direkt in diesen Prozess integriert. Dieser Vorteil macht sie besonders interessant für die Vermittlung grundlegender Konzepte von Strukturen. Der größte Nachteil besteht darin, dass die Konvergenz nicht gewährleistet ist und dass sie bei Modellen mit einer großen Anzahl von Elementen im Vergleich zur direkten numerischen Lösung des Gleichungssystems, die von herkömmlichen Finite-Elemente-Programmen implementiert wird, übermäßig langsam sein kann.

Da für die Vermittlung der grundlegendsten Konzepte von Strukturen keine sehr komplexen Modelle erforderlich sind, kann dieses Tool als virtuelles Labor dienen, in dem das strukturelle Verhalten visuell und interaktiv erforscht werden kann, was für Architekturstudenten sehr gut geeignet ist.

Jedes Modell muss jedoch mit verschiedenen Parametern getestet werden, um Instabilitätsprobleme zu erkennen und diese so weit wie möglich zu vermeiden.
Diese neue Version, die fast vollständig neu programmiert wurde, hat die Stabilität und Geschwindigkeit verbessert, aber da es sich um einen nichtlinearen Prozess handelt, lässt sich das Problem einer möglichen Konvergenzschwäche oder Instabilität nicht vermeiden.


Die Hauptursache für Instabilität und mangelnde Konvergenz ist das Vorhandensein oder Auftreten von Elementen mit hoher Steifigkeit. Dies wurde in der vorherigen Version noch verstärkt, da die Strukturelemente in kleine Segmente unterteilt werden mussten, um lineare Lasten durch eine Reihe von Punktlasten zu modellieren, die ausreichend nahe beieinander lagen. Diese Unterteilung ist nun nicht mehr erforderlich, wodurch das Problem der Instabilität durch übermäßig steife kurze Stäbe verringert wird.


Die Stäbe müssen nur an den Stellen unterteilt werden, an denen sie ihre Richtung ändern, ihren Materialquerschnitt ändern oder mit anderen Stäben oder Knoten der Struktur verbunden sind. Dies ermöglicht längere Stäbe und einen schnelleren und stabileren Prozess. Bei gekrümmten Systemen (Seile und Bögen) muss jedoch die gekrümmte Geometrie durch gerade Liniensegmente modelliert werden, sodass auf die Anzahl der Unterteilungen und die Steifigkeit des Materialquerschnitts geachtet werden muss, um eine übermäßige Steifigkeit zu vermeiden, die zu einer Divergenz des iterativen Prozesses führt.


Als wichtigste Maßnahme zur Behebung der Instabilität gibt es einen globalen Steifigkeitsreduktionsfaktor, der der Verwendung eines flexibleren Materials entspricht, wobei im Gegenzug der Verstärkungsfaktor der Strukturantwort neu berechnet wird, damit das Endergebnis ähnlich ist. Es kann nicht dasselbe sein, da bei einem flexibleren Material die Verformungen zunehmen und die Ergebnisse eher einer nichtlinearen als einer linearen Analyse entsprechen. Zumindest in einigen Fällen kann die Instabilität jedoch vermieden werden. Es wurden zwei zusätzliche Parameter programmiert, mit denen die Details der axialen und der Biege-Steifigkeit unabhängig voneinander konfiguriert werden können, deren Verwendung jedoch komplex ist und weiterer Untersuchungen bedarf.

Die allgemeine Funktionsweise des Prozesses ist einfach und spiegelt die verschiedenen Teile wider, aus denen jedes Strukturmodell besteht: Geometrie, Auflager, Lasten, Materialien, Querschnitte und interne Gelenke. Mit all diesen Informationen kann der „Solver” nach der Lösung suchen. Und die programmierten Komponenten ermöglichen es, die Ergebnisse ohne zusätzlichen Aufwand darzustellen. 

Man muss lediglich Zeit in die Definition des Modells investieren, insbesondere in die Geometrie, die den größten Arbeitsaufwand darstellt, da der Rest auf den vielen programmierten Komponenten basiert, die den Prozess der Erstellung neuer Modelle vereinfachen und beschleunigen.


Die Geometrie kann auf zwei Arten erzeugt werden. Sie kann mit Rhino (oder Autocad oder einem anderen CAD-Programm) gezeichnet und in Rhino importiert werden und dann in Grasshopper (GH) durch Internalisierung („Internalise data”) LINE-Elementen zugewiesen werden. 
Der Nachteil dieses Ansatzes ist, dass die Geometrie fest und nicht parametrisch ist. Sie ermöglicht eine einfachere Analyse jeder Geometrie, da sie innerhalb der CAD-Umgebung gezeichnet wird, aber die Möglichkeit, mit geometrischen Parametern zu experimentieren, geht verloren.
 


Der bevorzugte Ansatz (aufgrund seiner besseren Erklärungskraft) besteht darin, die Geometrie parametrisch in GH zu generieren. Dazu muss man lernen, in GH mit geometrischen Komponenten und Operationen zu programmieren. Dieser Teil ist bei der Erstellung von Modellen am zeitaufwändigsten.
Auf die erzeugte parametrische Geometrie müssen Stützen, Lasten, Materialien und Querschnitte zugewiesen werden, und vor allem muss ausgewählt werden, welcher der drei Strukturtypen für die Darstellung des Modells am besten geeignet ist, je nach der Art der Kräfte, denen das Element standhalten muss.


Der allgemeinste Strukturtyp ist der Stab mit 6 Freiheitsgraden („Beam+“), mit dem Stäbe modelliert werden können, die axiale Zug- und Druckkräfte, Querkräfte und Biegemomente aufnehmen können. Mit diesem Typ werden in der Regel fast alle Stäbe in konventionellen Konstruktionen (Stützen, Träger, Rahmen, Bögen usw.) modelliert, mit Ausnahme von Seilen und Fachwerken.
 Für Fachwerke kann ebenfalls der Strukturtyp „Beam+“ verwendet werden, indem an den entsprechenden Enden Gelenke zugewiesen werden. 
Für Fachwerke mit allen Gelenken ist jedoch der Typ „Bar+“ vorzuziehen, bei dem es sich um einen „Pendelstab“ handelt, der nur axial arbeiten kann (Zugstab und Druckstab oder Pendelstab). Das Problem bei dieser Art von Struktur ist, dass sie in entsprechend dreieckigen Konfigurationen verwendet werden muss, um stabil zu sein, da sie sich sonst in eine Kette von Gelenkgliedern verwandeln kann, die in ihrer ursprünglichen geometrischen Konfiguration nicht stabil ist.

Für Kabel sollte der Strukturtyp „Kabel+“ verwendet werden, der nur Zugkräften standhält und seine Form anpasst, um in einem stark nichtlinearen Prozess mit großen Verformungen ein Gleichgewicht zu erreichen.


Ausführlichere Erläuterungen finden Sie neben den einzelnen Beispielen in dieser Beispieldatei.""")

# ---- group: LOGOS ON VIEWPORT
bitmap = BitmapFromFile(BitmapPath="C:\Logos\Logos.png")  # -> Bitmap, Width, Height

# Das ist nur, um die Logos zu zeigen.
logos = BooleanToggle(True)  # disabled
str2img = DeserializeImageFromString(ImageString=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)  # disabled
trigger = Trigger(Interval=2000, TimerInterval=2000, Target=c_script)  # disabled
c_script = CSharpScript()  # -> out, a, W, H; disabled
# ---------- c_script: C# ----------
// Grasshopper Script Instance
#region Usings
using System;
using System.Linq;
using System.Collections;
using System.Collections.Generic;
using System.Drawing;

using Rhino;
using Rhino.Geometry;

using Grasshopper;
using Grasshopper.Kernel;
using Grasshopper.Kernel.Data;
using Grasshopper.Kernel.Types;
#endregion

using System.IO;
using System.Data;
using System.Reflection;
using System.Windows.Forms;
using System.Xml;
using System.Xml.Linq;
using System.Runtime.InteropServices;

using Rhino.DocObjects;
using Rhino.Collections;

public class Script_Instance : GH_ScriptInstance
{
    #region Notes
    /* 
      Members:
        RhinoDoc RhinoDocument
        GH_Document GrasshopperDocument
        IGH_Component Component
        int Iteration

      Methods (Virtual & overridable):
        Print(string text)
        Print(string format, params object[] args)
        Reflect(object obj)
        Reflect(object obj, string method_name)
    */
    #endregion

    private void RunScript(ref object a, ref object W, ref object H)
    {
        var view = RhinoDoc.ActiveDoc.Views.ActiveView;
        H = view.ActiveViewport.Bounds.Height;
        W = view.ActiveViewport.Bounds.Width;
    }
}
# ---------- end c_script ----------
panel_11 = Panel("30")  # disabled
panel_12 = Panel(".12")  # disabled
filter = StreamFilter(Gate=logos, Stream1=bitmap.Bitmap)  # disabled
subtraction = Subtraction(A=c_script.W, B=panel_11)  # disabled
subtraction_2 = Subtraction(A=c_script.H, B=panel_11)  # disabled
multiplication_2 = Multiplication(A=c_script.W, B=panel_12)  # disabled
pt_2 = ConstructPoint(XCoordinate=subtraction, YCoordinate=subtraction_2, ZCoordinate=0)  # disabled
c_script_2 = CSharpScript(Tx=filter, P=pt_2, w=multiplication_2)  # -> out, a; inputs P: Point3d, w: Double; disabled
# ---------- c_script_2: C# ----------
// Grasshopper Script Instance
#region Usings
using System;
using System.Linq;
using System.Collections;
using System.Collections.Generic;
using System.Drawing;

using Rhino;
using Rhino.Geometry;
using Rhino.DocObjects;
using Rhino.Collections;

using Grasshopper;
using Grasshopper.Kernel;
using Grasshopper.Kernel.Data;
using Grasshopper.Kernel.Types;
#endregion

using System;
using System.Drawing;
using System.Drawing.Drawing2D;
using System.Drawing.Imaging;
using System.IO;

public class Script_Instance : GH_ScriptInstance
{
    #region Notes
    /* 
      Members:
        RhinoDoc RhinoDocument
        GH_Document GrasshopperDocument
        IGH_Component Component
        int Iteration

      Methods (Virtual & overridable):
        Print(string text)
        Print(string format, params object[] args)
        Reflect(object obj)
        Reflect(object obj, string method_name)
    */
    #endregion

    private void RunScript(object Tx, Point3d P, double w, ref object a)
    {
        Bitmap texture = Tx as Bitmap;
        if (texture == null) return;

        int width = texture.Width;
        int height = texture.Height;

        double scale = w / ((double) width);

        texture = ResizeImage(texture, (int) (scale * width), (int) (scale * height));

        if (_bitmap == null)
            _bitmap = new Rhino.Display.DisplayBitmap(texture);

        _point.X = P.X - scale * width;
        _point.Y = P.Y - scale * height;
        _point.Z = 0.0;
    }

    private Rhino.Display.DisplayBitmap _bitmap;
    private Point3d _point;    
 
    public override void BeforeRunScript()
    {
        if (_bitmap != null)
        {
            _bitmap.Dispose();
            _bitmap = null;
        }
    }

    //Draw all meshes in this method.
    public override void DrawViewportMeshes(IGH_PreviewArgs args)
    {
        if (_bitmap == null) return;
 
        int x = (int) (_point.X);
        int y = (int) (_point.Y);
        args.Display.DrawBitmap(_bitmap, x, y);
    }

    /// Resize the image to the specified width and height.
    /// </summary>
    /// <param name="image">The image to resize.</param>
    /// <param name="width">The width to resize to.</param>
    /// <param name="height">The height to resize to.</param>
    /// <returns>The resized image.</returns>
    public static Bitmap ResizeImage(Image image, int width, int height)
    {
        var destRect = new Rectangle(0, 0, width, height);
        var destImage = new Bitmap(width, height);

        destImage.SetResolution(image.HorizontalResolution, image.VerticalResolution);

        using (var graphics = Graphics.FromImage(destImage))
        {
            graphics.CompositingMode = CompositingMode.SourceCopy;
            graphics.CompositingQuality = CompositingQuality.HighQuality;
            graphics.InterpolationMode = InterpolationMode.HighQualityBicubic;
            graphics.SmoothingMode = SmoothingMode.HighQuality;
            graphics.PixelOffsetMode = PixelOffsetMode.HighQuality;

            using (var wrapMode = new ImageAttributes())
            {
                wrapMode.SetWrapMode(WrapMode.TileFlipXY);
                graphics.DrawImage(image, destRect, 0, 0, image.Width,image.Height, GraphicsUnit.Pixel, wrapMode);
            }
        }

        return destImage;
    }    
}
# ---------- end c_script_2 ----------

# ---- group: ALLGEMEINES
# When Selected = True, only currently selected parameters will be adjusted. There will be no undo record for this operation.
toggle_3 = BooleanToggle(False)
startup_2 = Python3Script(debug=toggle_3)  # -> out; same code as startup
panel_13 = Panel(startup_2)
pt_3 = ConstructPoint(XCoordinate="100", YCoordinate="100", ZCoordinate="100")
list_2 = ValueList({"Normal": 1, "Faint": 2, "Hidden": 3}, selected="Faint")
vb_2 = VBScript(wire=list_2, selected=Toggle(True))  # -> out, A; same code as vb

# ----
stiffnessratio_2 = Slider(1, range=0.001..1)
_3d_modell_darstellung_2 = BooleanToggle(False)
gelenke_darstellen_2 = BooleanToggle(True)
verformung_2 = BooleanToggle(True)
_3d_modell_verformung_2 = BooleanToggle(False)
_3d_verformung_vereinfacht_2 = BooleanToggle(False)
faktor_verformung_2 = Slider(100, range=1..200)
bewegungswerte_darstellen_2 = BooleanToggle(False)
normalkraft_n_kn_2 = BooleanToggle(False)
querkraft_vy_kn_2 = BooleanToggle(False)
querkraft_vz_kn_2 = BooleanToggle(False)
moment_my_knm_2 = BooleanToggle(True)
moment_mz_knm_2 = BooleanToggle(False)
reduktion_m_2 = Slider(50, range=1..1000)
schnittgrössenwerte_darstellen_2 = BooleanToggle(True)
diagramme_auf_die_verformte_struktur_2 = BooleanToggle(False)
lasten_darstellen_2 = BooleanToggle(True)
lasten_in_der_verformte_struktur_2 = BooleanToggle(True)
kräfte_zerlegt_dargestellt_2 = BooleanToggle(True)
pfeil_zum_punkt_2 = BooleanToggle(True)
_3d_auflager_darstellung_2 = BooleanToggle(True)
grössenfaktor_für_auflagerdarstellung_2 = Slider(0.6, range=0..1)
farbe_auflager_2 = ColourSwatch(SwatchColor=RGB(16, 74, 125))
auflager_kraftreaktionen_2 = BooleanToggle(False)
auflager_momentreaktionen_2 = BooleanToggle(False)
auflagerreaktionen_werte_2 = BooleanToggle(False)
spannungsratio_2 = BooleanToggle(True)
threshold_2 = Slider(15, range=10..20)
nachkommastellen_2 = Slider(0, range=0..3)
linienstärke_2 = Slider(4, range=0..10)
farbe_modelllinie_2 = ColourSwatch(SwatchColor=RGB(64, 64, 64))
liniengrösse_für_die_gelenke_2 = Slider(5, range=0..10)
grösse_der_kreise_für_die_gelenke_2 = Slider(0.03, range=0..0.2)
farbe_für_die_gelenke_2 = ColourSwatch(SwatchColor=RGB(255, 255, 255))
farbe_verformung_2 = ColourSwatch(SwatchColor=RGB(207, 207, 207))
farbe_bewegungswerte_2 = ColourSwatch(SwatchColor=RGB(0, 0, 0))
reduktion_n_2 = Slider(200, range=1..1000)
reduktion_v_2 = Slider(50, range=1..1000)
farbe_n_3 = ColourSwatch(SwatchColor=RGBA(255, 255, 11, 100))
farbe_n_4 = ColourSwatch(SwatchColor=RGBA(222, 11, 11, 100))
farbe_v_2 = ColourSwatch(SwatchColor=RGBA(27, 133, 0, 100))
farbe_m_2 = ColourSwatch(SwatchColor=RGBA(11, 67, 222, 100))
farbe_schnittgrössenwerte_2 = ColourSwatch(SwatchColor=RGB(255, 255, 255))
farbe_lasten_2 = ColourSwatch(SwatchColor=RGB(255, 163, 0))
lastendarstellungsgrösse_2 = Slider(0.15, range=0..1)
farbe_reaktionen_2 = ColourSwatch(SwatchColor=RGB(199, 26, 26))
farbe_reaktionswerte_2 = ColourSwatch(SwatchColor=RGB(255, 255, 255))
and_2 = GateAnd(A=verformung_2, B=_3d_modell_verformung_2)
multiplication_3 = Multiplication(Stiffness=stiffnessratio_2, FaktorVerformung=faktor_verformung_2)
reset_konfiguration_2 = Button()
eval_2 = Evaluate(E="10^(-x)", x=threshold_2)
_0_2 = Geometry([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])
dx_2 = Geometry([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])
dy_2 = Geometry([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])
rx_2 = Geometry([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])
dyrx_2 = Geometry([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])
dyrxry_2 = Geometry([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])
_0_00_2 = ColourSwatch(SwatchColor=RGB(0, 0, 255))
_25_0_2 = ColourSwatch(SwatchColor=RGB(0, 255, 128))
_37_5_2 = ColourSwatch(SwatchColor=RGB(128, 255, 0))
_50_0_2 = ColourSwatch(SwatchColor=RGB(255, 255, 0))
_75_0_2 = ColourSwatch(SwatchColor=RGB(255, 128, 0))
_100_2 = ColourSwatch(SwatchColor=RGB(200, 0, 200))
dxdy_2 = Geometry([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])
dxrx_2 = Geometry([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])
dxdyrx_2 = Geometry([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])
ry_2 = Geometry([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])
dxry_2 = Geometry([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])
dyry_2 = Geometry([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])
dxdyry_2 = Geometry([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])
rxry_2 = Geometry([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])
dxrxry_2 = Geometry([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])
dxdyrxry_2 = Geometry([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])
_12_5_2 = ColourSwatch(SwatchColor=RGB(0, 170, 255))
_62_5_2 = ColourSwatch(SwatchColor=RGB(255, 212, 0))
_87_5_2 = ColourSwatch(SwatchColor=RGB(255, 0, 0))
panel_14 = Panel("""64, 64, 64, 255
255, 255, 255, 255
207, 207, 207, 255
0, 0, 0, 255
255, 255, 11, 100
222, 11, 11, 100
27, 133, 0, 100
11, 67, 222, 100
255, 255, 255, 255
255, 163, 0, 255
16, 74, 125, 255
199, 26, 26, 255
255, 255, 255, 255""")
panel_15 = Panel("""1.0
15
0
4
5
0.03
100
200
50
50
0.15
0.6""")
panel_16 = Panel("""False
True
True
False
False
False
False
False
False
False
False
False
False
True
True
True
False
False
False
False""")
auflager_darstellung_2 = Entwine(
    Branch00=_0_2,
    Branch01=dx_2,
    Branch02=dy_2,
    Branch03=dxdy_2,
    Branch04=rx_2,
    Branch05=dxrx_2,
    Branch06=dyrx_2,
    Branch07=dxdyrx_2,
    Branch08=ry_2,
    Branch09=dxry_2,
    Branch010=dyry_2,
    Branch011=dxdyry_2,
    Branch012=rxry_2,
    Branch013=dxrxry_2,
    Branch014=dyrxry_2,
    Branch015=dxdyrxry_2,
    FlattenInputs=True)  # -> simplify(Result)
merge_2 = Merge(
    Data1=_0_00_2,
    Data2=_12_5_2,
    Data3=_25_0_2,
    Data4=_37_5_2,
    Data5=_50_0_2,
    Data6=_62_5_2,
    Data7=_75_0_2,
    Data8=_87_5_2,
    Data9=_100_2)  # -> flatten(Result)
reset_values_2 = CSharpScript(
    Reset=reset_konfiguration_2,
    Parameters=[stiffnessratio_2, threshold_2, nachkommastellen_2, linienstärke_2, liniengrösse_für_die_gelenke_2, grösse_der_kreise_für_die_gelenke_2, faktor_verformung_2, reduktion_n_2, reduktion_v_2, reduktion_m_2, lastendarstellungsgrösse_2, grössenfaktor_für_auflagerdarstellung_2],
    Values=panel_15)  # -> flatten(out); inputs Reset: Boolean, Parameters: list, Values: list of Double; same code as reset_values
reset_toggles_2 = CSharpScript(
    Reset=reset_konfiguration_2,
    Parameters=[_3d_modell_darstellung_2, gelenke_darstellen_2, verformung_2, _3d_modell_verformung_2, _3d_verformung_vereinfacht_2, bewegungswerte_darstellen_2, normalkraft_n_kn_2, querkraft_vy_kn_2, querkraft_vz_kn_2, moment_my_knm_2, moment_mz_knm_2, schnittgrössenwerte_darstellen_2, diagramme_auf_die_verformte_struktur_2, lasten_darstellen_2, lasten_in_der_verformte_struktur_2, _3d_auflager_darstellung_2, auflager_kraftreaktionen_2, auflager_momentreaktionen_2, auflagerreaktionen_werte_2, spannungsratio_2],
    Values=panel_16)  # -> flatten(out); inputs Reset: Boolean, Parameters: list, Values: list of Boolean; same code as reset_toggles
reset_colors_2 = CSharpScript(
    Reset=reset_konfiguration_2,
    Parameters=[farbe_modelllinie_2, farbe_für_die_gelenke_2, farbe_verformung_2, farbe_bewegungswerte_2, farbe_n_3, farbe_n_4, farbe_v_2, farbe_m_2, farbe_schnittgrössenwerte_2, farbe_lasten_2, farbe_auflager_2, farbe_reaktionen_2, farbe_reaktionswerte_2],
    Values=panel_14)  # -> flatten(out); inputs Reset: Boolean, Parameters: list, Values: list of Color; same code as reset_colors
cfg_2 = ConfigurationPlus(
    StiffnessRatio=stiffnessratio_2,
    Threshold=eval_2,
    NumberOfDecimals=nachkommastellen_2,
    LineThickness=linienstärke_2,
    ModelColor=farbe_modelllinie_2,
    _3DModel=_3d_modell_darstellung_2,
    Hinges=gelenke_darstellen_2,
    HingeThickness=liniengrösse_für_die_gelenke_2,
    HingeSize=grösse_der_kreise_für_die_gelenke_2,
    HingeColor=farbe_für_die_gelenke_2,
    Deformation=verformung_2,
    _3DDeformation=_3d_modell_verformung_2,
    Simplified3DDeformation=_3d_verformung_vereinfacht_2,
    DeformationColor=farbe_verformung_2,
    ScaleDeformation=faktor_verformung_2,
    Displacements=bewegungswerte_darstellen_2,
    DisplacementColor=farbe_bewegungswerte_2,
    AxialDiagram=normalkraft_n_kn_2,
    ScaleAxial=reduktion_n_2,
    ShearDiagramYSecondary=querkraft_vy_kn_2,
    ShearDiagramZPrincipal=querkraft_vz_kn_2,
    ScaleShear=reduktion_v_2,
    MomentDiagramYPrincipal=moment_my_knm_2,
    MomentDiagramZSecondary=moment_mz_knm_2,
    ScaleMoment=reduktion_m_2,
    PositiveAxialColor=farbe_n_3,
    NegativeAxialColor=farbe_n_4,
    ShearColor=farbe_v_2,
    MomentColor=farbe_m_2,
    DiagramValues=schnittgrössenwerte_darstellen_2,
    ValuesColor=farbe_schnittgrössenwerte_2,
    DiagramsOnDeformedShape=diagramme_auf_die_verformte_struktur_2,
    LoadRepresentation=lasten_darstellen_2,
    LoadColor=farbe_lasten_2,
    LoadSize=lastendarstellungsgrösse_2,
    LoadsOnDeformedShape=lasten_in_der_verformte_struktur_2,
    LoadsDecomposed=kräfte_zerlegt_dargestellt_2,
    TipOnPoint=pfeil_zum_punkt_2,
    SupportRepresentation=_3d_auflager_darstellung_2,
    SupportSize=grössenfaktor_für_auflagerdarstellung_2,
    SupportColor=farbe_auflager_2,
    ForceReactionRepresentation=auflager_kraftreaktionen_2,
    MomentReactionRepresentation=auflager_momentreaktionen_2,
    ReactionColor=farbe_reaktionen_2,
    ReactionValues=auflagerreaktionen_werte_2,
    ReactionValueColor=farbe_reaktionswerte_2,
    SaturationRatio=spannungsratio_2,
    SaturationRatioColors=merge_2,
    MinimumSegmentLengthInBeams=0.1,
    MaximumSegmentLengthInBeams=1)
panel_17 = Panel(reset_toggles_2)
panel_18 = Panel(reset_colors_2)
panel_19 = Panel(reset_values_2)

abstraktion = BooleanToggle(False)

# ---- group: GEOMETRISCHE PARAMETER
abstand_y_zum_seil_m = Slider(10, range=0..10)  # disabled
durchhang_des_seiles_dh_m = Slider(1.2, range=0.1..5)  # disabled
abstand_y_zum_fachwerk_m = Slider(20, range=0..20)  # disabled
fachwerkhöhe_fh_m = Slider(1.2, range=0.1..5)  # disabled
segmente_n = Slider(8, range=4..12)  # disabled
spannweite_l_m = Slider(8, range=2..16)  # disabled
höhe_h_m = Slider(4, range=2..8)  # disabled
segmente_n_2 = Slider(16, range=8..32)  # disabled
abstand_y_zum_bogen_m = Slider(30, range=0..30)  # disabled
# Hier werden die Parameter für die Erzeugung der Geometrie definiert. Da jede Änderung dieser Parameter den „Solver“ dazu zwingt, die Berechnung neu zu starten, müssen alle Parameter mit der entsprechenden Komponente der Gruppe „Solver“ verknüpft werden.
# 
# Früher haben wir dies getan, indem wir jeden Parameter mit dieser Komponente in der Gruppe „Solver” verbunden haben, aber jetzt, da ich die Komponenten neu programmiert habe, um die Standardwerte wiederherzustellen, habe ich einen Ausgabeparameter „param” programmiert, der bereits alle Parameter enthält, sodass mit einem einzigen Verbindungskabel die Datei vereinfacht werden kann und alles übersichtlicher ist.
höhe_des_bogens_m = Slider(1, range=0.5..8)  # disabled
neg = Negative(Value=abstand_y_zum_seil_m)  # disabled
neg_2 = Negative(Value=durchhang_des_seiles_dh_m)  # disabled
neg_3 = Negative(Value=abstand_y_zum_fachwerk_m)  # disabled
neg_4 = Negative(Value=fachwerkhöhe_fh_m)  # disabled
division = Division(A=segmente_n, B=2)  # disabled
neg_5 = Negative(Value=abstand_y_zum_bogen_m)  # disabled
Y = UnitY(Factor=neg_3)  # disabled
Y_2 = UnitY(Factor=neg)  # disabled
Z = UnitZ(Factor=neg_4)  # disabled
Y_3 = UnitY(Factor=neg_5)  # disabled

# ----
relative_position_mittleres_gelenk_im_tr = Slider(0.5, range=0.1..0.9)  # "Relative Position mittleres Gelenk im Träger"; disabled

# ---- group: GEOMETRISCHE PARAMETER - RESET
reset_geometrie = Button()  # disabled
panel_20 = Panel("""8.0
4.0
10.0
1.2
20.0
1.2
8
0.33
30.0
1.0""")  # disabled
reset_values_3 = CSharpScript(
    Reset=reset_geometrie,
    Parameters=[spannweite_l_m, höhe_h_m, abstand_y_zum_seil_m, durchhang_des_seiles_dh_m, abstand_y_zum_fachwerk_m, fachwerkhöhe_fh_m, segmente_n, relative_position_mittleres_gelenk_im_tr, abstand_y_zum_bogen_m, höhe_des_bogens_m],
    Values=panel_20)  # -> flatten(out), flatten(param); inputs Reset: Boolean, Parameters: list, Values: list of Double; disabled
# ---------- reset_values_3: C# ----------
// Grasshopper Script Instance
#region Usings
using System;
using System.Linq;
using System.Collections;
using System.Collections.Generic;
using System.Drawing;

using Rhino;
using Rhino.Geometry;

using Grasshopper;
using Grasshopper.Kernel;
using Grasshopper.Kernel.Data;
using Grasshopper.Kernel.Types;
#endregion

public class Script_Instance : GH_ScriptInstance
{
    #region Notes
    /* 
      Members:
        RhinoDoc RhinoDocument
        GH_Document GrasshopperDocument
        IGH_Component Component
        int Iteration

      Methods (Virtual & overridable):
        Print(string text)
        Print(string format, params object[] args)
        Reflect(object obj)
        Reflect(object obj, string method_name)
    */
    #endregion

    private void RunScript(
		bool Reset,
		List<object> Parameters,
		List<double> Values,
		ref object param)
    {
        Grasshopper.Kernel.Special.GH_NumberSlider slider;
        param = Parameters;
        
        int num_sliders = Parameters.Count();
        int num_values = Values.Count();

        if (num_sliders != num_values)
            Print("Error: Parameters and Values should match in number of elements");
        else
        {    
            int i;

            if (Reset == true)
            {
                Print("Reseting to default values");

                for (i = 0; i < num_sliders ; i++)
                {
                    slider = Component.Params.Input[1].Sources[i] as Grasshopper.Kernel.Special.GH_NumberSlider; //try to cast that thing as a slider

                    if (slider != null)
                    {
                        slider.TrySetSliderValue((decimal) Values[i]);
                    }
                }
            }
        }
    }
}
# ---------- end reset_values_3 ----------
panel_21 = Panel(reset_values_3.out)  # disabled

# ---- group: RAHMEN
A = ConstructPoint(XCoordinate=0, YCoordinate=0, ZCoordinate=0)  # disabled
B = ConstructPoint(XCoordinate=spannweite_l_m, YCoordinate=0, ZCoordinate=0)  # disabled
C = ConstructPoint(XCoordinate=0, YCoordinate=0, ZCoordinate=höhe_h_m)  # disabled
D = ConstructPoint(XCoordinate=spannweite_l_m, YCoordinate=0, ZCoordinate=höhe_h_m)  # disabled
vec2pt = Vector2Pt(PointA=C, PointB=D, Unitize=False)  # -> Vector, Length; disabled
multiplication_4 = Multiplication(A=vec2pt.Vector, B=relative_position_mittleres_gelenk_im_tr)  # disabled
gelenk = Addition(A=C, B=multiplication_4)  # disabled
stl = Line(StartPoint=A, EndPoint=C)  # disabled
str = Line(StartPoint=B, EndPoint=D)  # disabled
trl = Line(StartPoint=C, EndPoint=gelenk)  # disabled
stützen = Merge(Data1=stl, Data2=str)  # -> flatten(Result); disabled

# ---- group: SEIL
G = ConstructPoint(XCoordinate=expr("x/2", spannweite_l_m), YCoordinate=neg, ZCoordinate=neg_2)  # disabled
E = Move(Geometry=A, Motion=Y_2)  # -> Geometry, Transform; disabled
F = Move(Geometry=B, Motion=Y_2)  # -> Geometry, Transform; disabled
merge_3 = Merge(Data1=E.Geometry, Data2=G, Data3=F.Geometry)  # -> flatten(Result); disabled
intcrv = Interpolate(Vertices=merge_3, Degree=2, Periodic=False, KnotStyle=0)  # -> Curve, Length, Domain; disabled
cat = Catenary(PointA=E.Geometry, PointB=F.Geometry, Length=intcrv.Length, Gravity=Vector(0, 0, -1))  # disabled
divide = DivideCurve(Curve=cat, Count=segmente_n_2, Kinks=False)  # -> Points, Tangents, Parameters; disabled
pline = PolyLine(Vertices=divide.Points, Closed=False)  # disabled
explode = Explode(Curve=pline, Recursive=True)  # -> Segments, Vertices; disabled
seil_segmente = Line(explode.Segments)  # disabled
seil_punkte = Point(explode.Vertices)  # disabled

# ---- group: FACHWERK
H = Move(Geometry=A, Motion=Y)  # -> Geometry, Transform; disabled
I = Move(Geometry=B, Motion=Y)  # -> Geometry, Transform; disabled
ln = Line(StartPoint=H.Geometry, EndPoint=I.Geometry)  # disabled
divide_2 = DivideCurve(Curve=ln, Count=segmente_n, Kinks=False)  # -> Points, Tangents, Parameters; disabled
move = Move(Geometry=divide_2.Points, Motion=Z)  # -> Geometry, Transform; disabled
cull_i = CullIndex(List=divide_2.Points, Indices=0, Wrap=True)  # disabled
split = SplitList(List=divide_2.Points, Index=division)  # -> ListA, ListB; disabled
cull_i_2 = CullIndex(List=move.Geometry, Indices=0, Wrap=True)  # disabled
cull_i_3 = CullIndex(List=split.ListB, Indices=0, Wrap=True)  # disabled
cull_i_4 = CullIndex(List=cull_i, Indices=-1, Wrap=True)  # disabled
cull_i_5 = CullIndex(List=cull_i_2, Indices=-1, Wrap=True)  # disabled
rev = ReverseList(List=cull_i_3)  # disabled
rev_2 = ReverseList(List=cull_i_5)  # disabled
short = ShortestList(ListA=split.ListA, ListB=cull_i_5, TrimMode=2)  # -> ListA, ListB; disabled
pline_2 = PolyLine(Vertices=divide_2.Points, Closed=False)  # disabled
pline_3 = PolyLine(Vertices=cull_i_5, Closed=False)  # disabled
short_2 = ShortestList(ListA=rev_2, ListB=rev, TrimMode=2)  # -> ListA, ListB; disabled
explode_2 = Explode(Curve=pline_2, Recursive=True)  # -> Segments, Vertices; disabled
explode_3 = Explode(Curve=pline_3, Recursive=True)  # -> Segments, Vertices; disabled
ln_2 = Line(StartPoint=short.ListA, EndPoint=short.ListB)  # disabled
ln_3 = Line(StartPoint=cull_i_4, EndPoint=cull_i_5)  # disabled
ln_4 = Line(StartPoint=short_2.ListA, EndPoint=short_2.ListB)  # disabled
merge_4 = Merge(Data1=ln_2, Data2=ln_4)  # -> flatten(Result); disabled
untere_gurt = Line(explode_3.Segments)  # disabled
obere_gurt = Line(explode_2.Segments)  # disabled
gürte = Merge(Data1=obere_gurt, Data2=untere_gurt)  # -> flatten(Result); disabled
diagonale = Line(merge_4)  # disabled
vertikale = Line(ln_3)  # disabled

# ---- group: BOGEN
# Mit K2E+ musst du nur Linien erstellen, die die Stäbe der Struktur zeigen. Du musst sie nicht in kleinere Segmente aufteilen (das macht die Beam+ Komponente automatisch). Du musst aber jede Linie an den Verbindungen mit anderen Linien aufteilen (z. B. muss ein „Durchlaufträger“ für jeden Abschnitt zwischen den Auflagern in Linien aufgeteilt werden) und wenn die Richtung wechselt (oder eine Kurve dargestellt wird), oder wenn der Querschnitt oder Material sich ändert.
# 
# Bei Pendelstäbe (Bar+) und Kabeln (Cable+) werden keine Unterteilungen automatisch generiert, nur bei Beam+ Elemente.
L = ConstructPoint(XCoordinate=expr("x/2", spannweite_l_m), YCoordinate=neg_5, ZCoordinate=höhe_des_bogens_m)  # disabled
K = Move(Geometry=A, Motion=Y_3)  # -> Geometry, Transform; disabled
J = Move(Geometry=B, Motion=Y_3)  # -> Geometry, Transform; disabled
merge_5 = Merge(Data1=K.Geometry, Data2=L, Data3=J.Geometry)  # -> flatten(Result); disabled
# Wie man in dieser Beispiel-Datei sehen kann, gibt's einen „Rahmen“, ein Seil oder Kabel, einen Fachwerkträger und einen Bogen.
# So kann man sehen, wie man jedes dieser Elemente am besten modelliert.
intcrv_2 = Interpolate(Vertices=merge_5, Degree=2, Periodic=False, KnotStyle=0)  # -> Curve, Length, Domain; disabled
divide_3 = DivideCurve(Curve=intcrv_2.Curve, Count=segmente_n_2, Kinks=False)  # -> Points, Tangents, Parameters; disabled
pline_4 = PolyLine(Vertices=divide_3.Points, Closed=False)  # disabled
explode_4 = Explode(Curve=pline_4, Recursive=True)  # -> Segments, Vertices; disabled
bogen_segmente = Line(explode_4.Segments)  # disabled
bogen_punkte = Point(explode_4.Vertices)  # disabled

# ---- group: GEOMETRISCHE PARAMETER
träger_innenkante_breite = Slider(9.68, range=5..25)
panel_22 = Panel("""1.21
1.21
2.42
2.42
2.42""")
stützen_innenkante_höhe = Slider(8.66, range=5..20)
ma = MassAddition(Input=panel_22)  # -> Result, PartialResults
panel_23 = Panel("""2.5
3.13
3.03""")
division_2 = Division(A=panel_22, B=ma.Result)
ma_2 = MassAddition(Input=panel_23)  # -> Result, PartialResults
multiplication_5 = Multiplication(A=träger_innenkante_breite, B=division_2)
division_3 = Division(A=panel_23, B=ma_2.Result)
multiplication_6 = Multiplication(A=stützen_innenkante_höhe, B=division_3)
panel_24 = Panel(multiplication_5)
panel_25 = Panel(multiplication_6)
item = ListItem(List=panel_24, Index=0, Wrap=True)
item_2 = ListItem(List=panel_24, Index=1, Wrap=True)
item_3 = ListItem(List=panel_24, Index=2, Wrap=True)
item_4 = ListItem(List=panel_24, Index=3, Wrap=True)
item_5 = ListItem(List=panel_24, Index=4, Wrap=True)
stützen_fw_breite = Slider(1.2, range=0.5..3)
item_6 = ListItem(List=panel_25, Index=0, Wrap=True)
item_7 = ListItem(List=panel_25, Index=1, Wrap=True)
item_8 = ListItem(List=panel_25, Index=2, Wrap=True)
träger_fw_höhe = Slider(2.09, range=0.5..6)
addition = Addition(A=stützen_fw_breite, B=item, C=item_2, D=item_3, E=item_4, F=item_5)
merge_6 = Merge(Data1=stützen_fw_breite, Data2=item, Data3=item_2, Data4=item_3, Data5=item_4, Data6=item_5)  # -> reverse(Result)
addition_2 = Addition(A=item_6, B=item_7, C=item_8, D=träger_fw_höhe)
multiplication_7 = Multiplication(A=addition, B=2)
panel_26 = Panel([panel_25, träger_fw_höhe])
panel_27 = Panel("0.9")
panel_28 = Panel([stützen_fw_breite, item, item_2, item_3, item_4, item_5, merge_6])

ganze_breite = Number(multiplication_7)
ganze_höhe = Number(addition_2)
item_9 = ListItem(List=panel_26, Index=3, Wrap=True)
trägerfwhöhe = Number(item_9)
item_10 = ListItem(List=panel_28, Index=0, Wrap=True)
stützenfwhöhe = Number(item_10)
subtraction_3 = Subtraction(A=ganze_breite, B=stützenfwhöhe)
modellbreite_oder_modellspannweite_l = Number(subtraction_3)
division_4 = Division(A=trägerfwhöhe, B=2)
tiefe = Number(panel_27)
subtraction_4 = Subtraction(A=ganze_höhe, B=division_4)
division_5 = Division(A=stützenfwhöhe, B=2)
division_6 = Division(A=tiefe, B=2)
modellhöhe_h = Number(subtraction_4)
addition_3 = Addition(A=division_5, B=modellbreite_oder_modellspannweite_l)
A_2 = ConstructPoint(XCoordinate=division_6, YCoordinate=division_5, ZCoordinate=0)
D_2 = ConstructPoint(XCoordinate=division_6, YCoordinate=addition_3, ZCoordinate=0)
Z_2 = UnitZ(Factor=modellhöhe_h)
B_2 = Move(Geometry=A_2, Motion=Z_2)  # -> Geometry, Transform
C_2 = Move(Geometry=D_2, Motion=Z_2)  # -> Geometry, Transform

# ----
trr = Line(StartPoint=gelenk, EndPoint=D)  # disabled

# ---- group: Geometrie
pt_4 = ConstructPoint(XCoordinate=0, YCoordinate=0, ZCoordinate=0)
Y_4 = UnitY(Factor=1)
division_7 = Division(A=panel_28, B=multiplication_7)
ma_3 = MassAddition(Input=division_7)  # -> Result, PartialResults
line = LineSDL(Start=pt_4, Direction=Y_4, Length=multiplication_7)
shatter = Shatter(Curve=line, Parameters=ma_3.PartialResults)
Z_3 = UnitZ(Factor=addition_2)
move_2 = Move(Geometry=shatter, Motion=Z_3)  # -> Geometry, Transform
item_11 = ListItem(List=panel_26, Index=3, Wrap=True)
X = UnitX(Factor=panel_27)
Z_4 = UnitZ(Factor=expr("-x", item_11))
move_3 = Move(Geometry=move_2.Geometry, Motion=X)  # -> Geometry, Transform
move_4 = Move(Geometry=[move_3.Geometry, move_2.Geometry], Motion=Z_4)  # -> Geometry, Transform
split_2 = SplitList(List=move_4.Geometry, Index=12)  # -> ListA, ListB
entwine = Entwine(Branch00=move_2.Geometry, Branch01=move_3.Geometry, Branch02=split_2.ListA, Branch03=split_2.ListB, FlattenInputs=True)

pt_5 = ConstructPoint(XCoordinate=0, YCoordinate=0, ZCoordinate=0)
Z_5 = UnitZ(Factor=1)
division_8 = Division(A=panel_26, B=addition_2)
ma_4 = MassAddition(Input=division_8)  # -> Result, PartialResults
line_2 = LineSDL(Start=pt_5, Direction=Z_5, Length=addition_2)
shatter_2 = Shatter(Curve=line_2, Parameters=ma_4.PartialResults)
cull_i_6 = CullIndex(List=shatter_2, Indices=0, Wrap=True)
item_12 = ListItem(List=panel_28, Index=0, Wrap=True)
X_2 = UnitX(Factor=panel_27)
move_5 = Move(Geometry=cull_i_6, Motion=X_2)  # -> Geometry, Transform
Y_5 = UnitY(Factor=item_12)
move_6 = Move(Geometry=[move_5.Geometry, cull_i_6], Motion=Y_5)  # -> Geometry, Transform
split_3 = SplitList(List=move_6.Geometry, Index=3)  # -> ListA, ListB
entwine_2 = Entwine(Branch00=cull_i_6, Branch01=move_5.Geometry, Branch02=split_3.ListA, Branch03=split_3.ListB, FlattenInputs=True)

# ---- group: AUFLAGER BEIM RAHMEN
rahmenauflager_links_verschieblich = BooleanToggle(False)  # disabled
rahmenauflager_links_gelenkig = BooleanToggle(True)  # disabled
rahmenauflager_rechts_verschieblich = BooleanToggle(False)  # disabled
rahmenauflager_rechts_gelenkig = BooleanToggle(True)  # disabled
not = GateNot(A=rahmenauflager_rechts_verschieblich)  # disabled
not_2 = GateNot(A=rahmenauflager_rechts_gelenkig)  # disabled
not_3 = GateNot(A=rahmenauflager_links_verschieblich)  # disabled
not_4 = GateNot(A=rahmenauflager_links_gelenkig)  # disabled
support6dof = Support6DOFPlus(SupportPt=A, XFixed=not_3, YFixed=True, ZFixed=True, RXFixed=True, RYFixed=not_4, RZFixed=True, Strength=1000000000)  # disabled
support6dof_2 = Support6DOFPlus(SupportPt=B, XFixed=not, YFixed=True, ZFixed=True, RXFixed=True, RYFixed=not_2, RZFixed=True, Strength=1000000000)  # disabled
rahmen_auflager = Merge(Data1=support6dof, Data2=support6dof_2)  # -> flatten(Result); disabled

# ---- group: AUFLAGER BEIM BOGEN
# Ich hab die Komponente neu programmiert und jetzt heißt sie „Support6DOF+“. Sie funktioniert genauso wie die entsprechende Komponente von K2Engineering, aber ich musste die internen Daten ändern, damit die „Auflager“ und die Reaktionen richtig dargestellt werden.
# 
# Du kannst die Bewegungen (Verschiebungen und Drehungen) in den drei Achsen (X, Y, Z) fixieren oder freigeben. Deshalb brauchst du keine anderen „Auflager“, weil der „Auflager“, der nur Verschiebungen fixiert und Drehungen freigibt, auch mit dieser Komponente modelliert werden kann. Das heißt, du könntest in allen Fällen nur diese Komponente verwenden.
# 
# Trotzdem, habe ich auch einen einfachen (3DOF) Auflager programmiert, der nur die Verschiebungen betrachtet, und alle Drehungen frei lässt.
# 
# Grundsätzlich ist es nicht vorgesehen, dass die Bewegungen in Z (dZ und RZ) freigegeben werden können. Die Komponente lässt das zwar zu, aber die Darstellung wäre nicht korrekt. Deshalb rate ich davon ab, sie zu verwenden.
eingespannte_auflager_am_bogen = BooleanToggle(False)  # disabled
support6dof_3 = Support6DOFPlus(
    SupportPt=[K.Geometry, J.Geometry],
    XFixed=True,
    YFixed=True,
    ZFixed=True,
    RXFixed=eingespannte_auflager_am_bogen,
    RYFixed=eingespannte_auflager_am_bogen,
    RZFixed=eingespannte_auflager_am_bogen,
    Strength=1000000000)  # disabled
bogen_auflager = Merge(Data1=support6dof_3)  # -> flatten(Result); disabled

# ---- group: Geometrie
midpt = CurveMiddle(Curve=line)
Z_6 = UnitZ(Factor=1)
pl = ConstructPlane(Origin=midpt, XAxis=Vector(1, 0, 0), YAxis=Z_6)
mirror = Mirror(Geometry=entwine_2, Plane=pl)  # -> Geometry, Transform
merge_7 = Merge(Data1=entwine_2, Data2=mirror.Geometry)

bang = ExplodeTree(Data=entwine)  # -> Branch0, Branch1, Branch2, Branch3
flip = FlipMatrix(Data=[bang.Branch0, bang.Branch3])
flip_2 = FlipMatrix(Data=[bang.Branch1, bang.Branch2])
end = EndPoints(Curve=simplify(flip))  # -> Start, End
end_2 = EndPoints(Curve=simplify(flip_2))  # -> Start, End
shift = ShiftList(List=end.End, Shift=1, Wrap=True)
shift_2 = ShiftList(List=end_2.End, Shift=1, Wrap=True)
ln_5 = Line(StartPoint=end.Start, EndPoint=shift)
ln_6 = Line(StartPoint=end_2.Start, EndPoint=shift_2)
flip_3 = FlipMatrix(Data=ln_5)
flip_4 = FlipMatrix(Data=ln_6)
split_4 = SplitList(List=flip_3, Index=6)  # -> ListA, ListB
split_5 = SplitList(List=flip_4, Index=6)  # -> ListA, ListB
merge_8 = Merge(Data1=split_4.ListA, Data2=split_5.ListA)
merge_9 = Merge(Data1=split_4.ListB, Data2=split_5.ListB)
flip_5 = FlipMatrix(Data=merge_8)
flip_6 = FlipMatrix(Data=merge_9)
cull_i_7 = CullIndex(List=flip_6, Indices=0, Wrap=True)
cull_i_8 = CullIndex(List=flip_5, Indices=1, Wrap=True)
merge_10 = Merge(Data1=cull_i_8, Data2=cull_i_7)

flip_7 = FlipMatrix(Data=entwine)
end_3 = EndPoints(Curve=flip_7)  # -> flatten(Start), flatten(End)
cullpt = CullDuplicates(Points=[end_3.Start, end_3.End], Tolerance=0.1, CullMode=3)  # -> Points, Indices, Valence
partition = PartitionList(List=cullpt.Points, Size=4)
shift_3 = ShiftList(List=partition, Shift=1, Wrap=True)
ln_7 = Line(StartPoint=partition, EndPoint=shift_3)
panel_29 = Panel("""1
3""")
cull_i_9 = CullIndex(List=ln_7, Indices=panel_29, Wrap=True)

entwine_3 = Entwine(Branch00=move_2.Geometry, Branch01=move_3.Geometry, FlattenInputs=True)
flip_8 = FlipMatrix(Data=entwine_3)
end_4 = EndPoints(Curve=simplify(flip_8))  # -> Start, End
shift_4 = ShiftList(List=end_4.End, Shift=1, Wrap=True)
ln_8 = Line(StartPoint=end_4.Start, EndPoint=shift_4)
bang_2 = ExplodeTree(Data=ln_8)  # -> Branch0, Branch1, Branch2, Branch3, Branch4, Branch5, Branch6, Branch7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
entwine_4 = Entwine(
    Branch00=bang_2.Branch1,
    Branch01=bang_2.Branch2,
    Branch02=bang_2.Branch3,
    Branch03=bang_2.Branch4,
    Branch04=bang_2.Branch5,
    Branch05=bang_2.Branch11,
    FlattenInputs=True)
entwine_5 = Entwine(
    Branch00=bang_2.Branch0,
    Branch01=bang_2.Branch6,
    Branch02=bang_2.Branch7,
    Branch03=bang_2.Branch8,
    Branch04=bang_2.Branch9,
    Branch05=bang_2.Branch10,
    FlattenInputs=True)
cull_i_10 = CullIndex(List=entwine_4, Indices=0, Wrap=True)
cull_i_11 = CullIndex(List=entwine_5, Indices=1, Wrap=True)
merge_11 = Merge(Data1=flatten(cull_i_10), Data2=flatten(cull_i_11))

panel_30 = Panel("""0
1
11""")
cull_i_12 = CullIndex(List=entwine, Indices=panel_30, Wrap=True)
end_5 = EndPoints(Curve=cull_i_12)  # -> Start, End
flip_9 = FlipMatrix(Data=end_5.Start)
item_13 = ListItem(List=flip_9, Index=0, Wrap=True)
item_14 = ListItem(List=flip_9, Index=3, Wrap=True)
item_15 = ListItem(List=flip_9, Index=1, Wrap=True)
item_16 = ListItem(List=flip_9, Index=2, Wrap=True)
ln_9 = Line(StartPoint=item_13, EndPoint=item_14)
ln_10 = Line(StartPoint=item_15, EndPoint=item_16)
merge_12 = Merge(Data1=ln_9, Data2=ln_10)

panel_31 = Panel("""0
11
12
23""")
cull_i_13 = CullIndex(List=move_4.Geometry, Indices=panel_31, Wrap=True)
split_6 = SplitList(List=cull_i_13, Index=12)  # -> ListA, ListB
entwine_6 = Entwine(Branch00=move_2.Geometry, Branch01=move_3.Geometry, Branch02=split_6.ListA, Branch03=split_6.ListB, FlattenInputs=True)

flip_10 = FlipMatrix(Data=merge_7)
end_6 = EndPoints(Curve=flip_10)  # -> flatten(Start), flatten(End)
cullpt_2 = CullDuplicates(Points=[end_6.Start, end_6.End], Tolerance=0.1, CullMode=3)  # -> Points, Indices, Valence
partition_2 = PartitionList(List=cullpt_2.Points, Size=4)
shift_5 = ShiftList(List=partition_2, Shift=1, Wrap=True)
ln_11 = Line(StartPoint=partition_2, EndPoint=shift_5)
panel_32 = Panel("""1
3""")
cull_i_14 = CullIndex(List=ln_11, Indices=panel_32, Wrap=True)  # -> simplify(List)
flip_11 = FlipMatrix(Data=cull_i_14)
panel_33 = Panel("""3
4
6
7""")
cull_i_15 = CullIndex(List=flip_11, Indices=panel_33, Wrap=True)

end_7 = EndPoints(Curve=merge_7)  # -> Start, End
flip_12 = FlipMatrix(Data=end_7.Start)
item_17 = ListItem(List=flip_12, Index=0, Wrap=True)
item_18 = ListItem(List=flip_12, Index=1, Wrap=True)
item_19 = ListItem(List=flip_12, Index=2, Wrap=True)
item_20 = ListItem(List=flip_12, Index=3, Wrap=True)
ln_12 = Line(StartPoint=item_17, EndPoint=item_20)
ln_13 = Line(StartPoint=item_18, EndPoint=item_19)
merge_13 = Merge(Data1=ln_12, Data2=ln_13)
bang_3 = ExplodeTree(Data=merge_13)  # -> Branch0, Branch1, Branch2, Branch3, Branch4, Branch5
merge_14 = Merge(Data1=bang_3.Branch1, Data2=bang_3.Branch2, Data3=bang_3.Branch4, Data4=bang_3.Branch5)
merge_15 = Merge(Data1=bang_3.Branch0, Data2=bang_3.Branch3, Data3=bang_3.Branch1, Data4=bang_3.Branch4)
merge_16 = Merge(Data1=bang_3.Branch0, Data2=bang_3.Branch3)

# Wie man in dieser Beispiel-Datei sehen kann, gibt's einen „Rahmen“, ein Seil oder Kabel, einen Fachwerkträger und einen Bogen.
# So kann man sehen, wie man jedes dieser Elemente am besten modelliert.
end_8 = EndPoints(Curve=flip_10)  # -> Start, End
shift_6 = ShiftList(List=end_8.Start, Shift=1, Wrap=True)
ln_14 = Line(StartPoint=end_8.End, EndPoint=shift_6)
panel_34 = Panel("""1
3""")
cull_i_16 = CullIndex(List=ln_14, Indices=panel_34, Wrap=True)  # -> simplify(List)
bang_4 = ExplodeTree(Data=cull_i_16)  # -> Branch0, Branch1, Branch2, Branch3, Branch4, Branch5
split_7 = SplitList(List=[bang_4.Branch2, bang_4.Branch5], Index=1)  # -> ListA, ListB
midpt_2 = CurveMiddle(Curve=split_7.ListB)
Z_7 = UnitZ(Factor=1)
pl_2 = ConstructPlane(Origin=midpt_2, XAxis=Z_7, YAxis=Vector(0, 1, 0))
mirror_2 = Mirror(Geometry=split_7.ListB, Plane=pl_2)  # -> Geometry, Transform
merge_17 = Merge(
    Data1=bang_4.Branch0,
    Data2=bang_4.Branch1,
    Data3=split_7.ListA,
    Data4=bang_4.Branch3,
    Data5=bang_4.Branch4,
    Data6=mirror_2.Geometry)

# ---- group: STRECKENLASTEN IM RAHMEN (AUF BEAM+ ELEMENTE)
eigengewicht_bei_beam = BooleanToggle(False)  # disabled
streckenlast_stützen_qy_kn_m = Slider(0, range=-50..50)  # disabled
streckenlast_träger_qz_kn_m = Slider(20, range=-50..50)  # disabled
neg_6 = Negative(Value=streckenlast_träger_qz_kn_m)  # disabled

# ---- group: ZUSÄTZLICHE PUNKTLASTEN AM PUNKT C DES RAHMENS
py_kn = Slider(0, range=-5..5)  # disabled
px_kn = Slider(0, range=-50..50)  # disabled
X_3 = UnitX(Factor=px_kn)  # disabled
Y_6 = UnitY(Factor=py_kn)  # disabled
merge_18 = Merge(Data1=X_3, Data2=Y_6)  # disabled
load = LoadPlus(Point=C, NodalForce=merge_18, IsMoment=False)  # disabled

# ---- group: LASTEN AM FACHWERK
streckenlast_fachwerk_q_kn_m = Slider(15, range=-50..50)  # disabled
multiplication_8 = Multiplication(A=spannweite_l_m, B=streckenlast_fachwerk_q_kn_m)  # disabled
merge_19 = Merge(Data1=H.Geometry, Data2=I.Geometry)  # -> flatten(Result); disabled
division_9 = Division(A=multiplication_8, B=segmente_n)  # disabled
division_10 = Division(A=division_9, B=2)  # disabled
neg_7 = Negative(Value=division_9)  # disabled
neg_8 = Negative(Value=division_10)  # disabled
Z_8 = UnitZ(Factor=neg_7)  # disabled
Z_9 = UnitZ(Factor=neg_8)  # disabled
load_2 = LoadPlus(Point=cull_i_4, NodalForce=Z_8, IsMoment=False)  # disabled
load_3 = LoadPlus(Point=merge_19, NodalForce=Z_9, IsMoment=False)  # disabled

# ---- group: LASTEN AM SEIL
streckenlast_kabel_q_kn_m = Slider(5, range=-50..50)  # disabled
relative_position_der_punktlast = Slider(0.3, range=0..1)  # disabled
punktlast_am_seil_kn = Slider(0, range=-200..200)  # disabled
multiplication_9 = Multiplication(A=segmente_n_2, B=relative_position_der_punktlast)  # disabled
merge_20 = Merge(Data1=E.Geometry, Data2=F.Geometry)  # -> flatten(Result); disabled
multiplication_10 = Multiplication(A=intcrv.Length, B=streckenlast_kabel_q_kn_m)  # disabled
eval_3 = Evaluate(E="Int(x)", x=multiplication_9)  # disabled
item_21 = ListItem(List=seil_punkte, Index=eval_3, Wrap=True)  # disabled
division_11 = Division(A=multiplication_10, B=segmente_n_2)  # disabled
cull_i_17 = CullIndex(List=seil_punkte, Indices=-1, Wrap=True)  # disabled
neg_9 = Negative(Value=division_11)  # disabled
division_12 = Division(A=neg_9, B=2)  # disabled
neg_10 = Negative(Value=punktlast_am_seil_kn)  # disabled
cull_i_18 = CullIndex(List=cull_i_17, Indices=0, Wrap=True)  # disabled
Z_10 = UnitZ(Factor=neg_9)  # disabled
Z_11 = UnitZ(Factor=neg_10)  # disabled
Z_12 = UnitZ(Factor=division_12)  # disabled
load_4 = LoadPlus(Point=cull_i_18, NodalForce=Z_10, IsMoment=False)  # disabled
load_5 = LoadPlus(Point=item_21, NodalForce=Z_11, IsMoment=False)  # disabled
load_6 = LoadPlus(Point=merge_20, NodalForce=Z_12, IsMoment=False)  # disabled

# ---- group: LASTEN AM BOGEN
streckenlast_bogen_hor_pro_q_kn_m = Slider(10, range=-50..50)  # disabled
# Zusätzlich zu den linearen Lasten auf Stäben kannst du Punktlasten an Knoten wie immer hinzufügen (mit der neuen Komponente Load+). Hier musst du darauf achten, dass die Einheiten, die diese Komponente erwartet, N und nicht kN sind.
# 
# Ausserdem, habe ich es programmiert, so dass auch Punktmomente möglich sind (der Parameter M?, der als "False", das heisst, Kraft, "by default" steht".
# 
# Die Streckenlasten auf "Beam+" Elemente werden jetzt nicht mehr als eine Reihe von nahliegenden Punktlasten modelliert, sondern als echte Streckenlasten. So wrden sie auch anders dargesetellt. Das ist komplett neu programmiert worden.
end_9 = EndPoints(Curve=bogen_segmente)  # -> Start, End; disabled
pdecon = Deconstruct(Point=end_9.Start)  # -> XComponent, YComponent, ZComponent; disabled
pdecon_2 = Deconstruct(Point=end_9.End)  # -> XComponent, YComponent, ZComponent; disabled
pt_6 = ConstructPoint(XCoordinate=pdecon.XComponent, YCoordinate=pdecon.YComponent, ZCoordinate=0)  # disabled
pt_7 = ConstructPoint(XCoordinate=pdecon_2.XComponent, YCoordinate=pdecon_2.YComponent, ZCoordinate=0)  # disabled
vec2pt_2 = Vector2Pt(PointA=pt_6, PointB=pt_7, Unitize=False)  # -> Vector, Length; disabled
vlen = VectorLength(Vector=vec2pt_2.Vector)  # disabled
len = Length(Curve=bogen_segmente)  # disabled
multiplication_11 = Multiplication(A=streckenlast_bogen_hor_pro_q_kn_m, B=vlen)  # disabled
division_13 = Division(A=multiplication_11, B=len)  # disabled
neg_11 = Negative(Value=division_13)  # disabled

# ---- group: LASTEN RESET
reset_lasten = Button()  # disabled
panel_35 = Panel("""0
20
25
0
5
0
0.3
15
10""")  # disabled
reset_values_4 = CSharpScript(
    Reset=reset_lasten,
    Parameters=[streckenlast_stützen_qy_kn_m, streckenlast_träger_qz_kn_m, px_kn, py_kn, streckenlast_kabel_q_kn_m, punktlast_am_seil_kn, relative_position_der_punktlast, streckenlast_fachwerk_q_kn_m, streckenlast_bogen_hor_pro_q_kn_m],
    Values=panel_35)  # -> flatten(out), flatten(param); inputs Reset: Boolean, Parameters: list, Values: list of Double; disabled; same code as reset_values_3
panel_36 = Panel("False")  # disabled
reset_toggles_3 = CSharpScript(Reset=reset_lasten, Parameters=eigengewicht_bei_beam, Values=panel_36)  # -> flatten(out), flatten(param); inputs Reset: Boolean, Parameters: list, Values: list of Boolean; disabled
# ---------- reset_toggles_3: C# ----------
// Grasshopper Script Instance
#region Usings
using System;
using System.Linq;
using System.Collections;
using System.Collections.Generic;
using System.Drawing;

using Rhino;
using Rhino.Geometry;

using Grasshopper;
using Grasshopper.Kernel;
using Grasshopper.Kernel.Data;
using Grasshopper.Kernel.Types;
#endregion

public class Script_Instance : GH_ScriptInstance
{
    #region Notes
    /* 
      Members:
        RhinoDoc RhinoDocument
        GH_Document GrasshopperDocument
        IGH_Component Component
        int Iteration

      Methods (Virtual & overridable):
        Print(string text)
        Print(string format, params object[] args)
        Reflect(object obj)
        Reflect(object obj, string method_name)
    */
    #endregion

    private void RunScript(
		bool Reset,
		List<object> Parameters,
		List<bool> Values,
		ref object param)
    {
        Grasshopper.Kernel.Special.GH_BooleanToggle toggle;
        param = Parameters;
        
        int num_toggles = Parameters.Count();
        int num_values = Values.Count();

        if (num_toggles != num_values)
            Print("Error: Parameters and Values should match in number of elements");
        else
        {    
            int i;

            if (Reset == true)
            {
                Print("Reseting to default values");

                for (i = 0; i < num_toggles ; i++)
                {
                    toggle = Component.Params.Input[1].Sources[i] as Grasshopper.Kernel.Special.GH_BooleanToggle; //try to cast that thing as a toggle

                    if (toggle != null)
                    {
                        toggle.Value = Values[i];
                        toggle.ExpireSolution(true);
                    }
                }
            }
        }
    }
}
# ---------- end reset_toggles_3 ----------
panel_37 = Panel(reset_values_4.out)  # disabled
panel_38 = Panel(reset_toggles_3.out)  # disabled

# ---- group: Geometrie
end_10 = EndPoints(Curve=merge_16)  # -> Start, End
midpt_3 = CurveMiddle(Curve=merge_16)
pdecon_3 = Deconstruct(Point=midpt_3)  # -> XComponent, YComponent, ZComponent
pt_8 = ConstructPoint(XCoordinate=pdecon_3.XComponent, YCoordinate=pdecon_3.YComponent, ZCoordinate=0)
ln_15 = Line(StartPoint=end_10.Start, EndPoint=pt_8)
ln_16 = Line(StartPoint=end_10.End, EndPoint=pt_8)
merge_21 = Merge(Data1=ln_15, Data2=ln_16)  # -> flatten(Result)

end_11 = EndPoints(Curve=merge_14)  # -> Start, End
midpt_4 = CurveMiddle(Curve=merge_14)
ln_17 = Line(StartPoint=end_11.Start, EndPoint=midpt_4)
ln_18 = Line(StartPoint=end_11.End, EndPoint=midpt_4)
merge_22 = Merge(Data1=ln_17, Data2=ln_18)

shift_7 = ShiftList(List=midpt_4, Shift=2, Wrap=True)
end_12 = EndPoints(Curve=merge_15)  # -> Start, End
ln_19 = Line(StartPoint=end_12.Start, EndPoint=shift_7)
ln_20 = Line(StartPoint=end_12.End, EndPoint=shift_7)
merge_23 = Merge(Data1=ln_19, Data2=ln_20)

# ----
flatten = FlattenTree(Tree=[end_10.Start, end_10.End], Path="{0}")
pdecon_4 = Deconstruct(Point=flatten)  # -> XComponent, YComponent, ZComponent
pt_9 = ConstructPoint(XCoordinate=pdecon_4.XComponent, YCoordinate=pdecon_4.YComponent, ZCoordinate=0)
ln_21 = Line(StartPoint=flatten, EndPoint=pt_9)
end_13 = EndPoints(Curve=ln_21)  # -> Start, End
shift_8 = ShiftList(List=end_13.End, Shift=-2, Wrap=True)
shift_9 = ShiftList(List=end_13.End, Shift=2, Wrap=True)
ln_22 = Line(StartPoint=end_13.Start, EndPoint=shift_8)
ln_23 = Line(StartPoint=end_13.Start, EndPoint=shift_9)
panel_39 = Panel("""0
1
10
11""")
panel_40 = Panel("""4
5
14
15""")
item_22 = ListItem(List=[ln_23, ln_22], Index=panel_39, Wrap=True)
item_23 = ListItem(List=[ln_23, ln_22], Index=panel_40, Wrap=True)

# ---- group: Geometrie
flip_13 = FlipMatrix(Data=merge_10)  # -> simplify(Data)
bang_5 = ExplodeTree(Data=flip_13)  # -> Branch0, Branch1
panel_41 = Panel("""0
6""")
panel_42 = Panel("""5
11""")
cull_i_19 = CullIndex(List=bang_5.Branch0, Indices=panel_41, Wrap=True)
cull_i_20 = CullIndex(List=bang_5.Branch1, Indices=panel_42, Wrap=True)
item_24 = ListItem(List=bang_5.Branch0, Index=panel_41, Wrap=True)
item_25 = ListItem(List=bang_5.Branch1, Index=panel_42, Wrap=True)
merge_24 = Merge(Data1=cull_i_19, Data2=cull_i_20)  # -> flatten(Result)
merge_25 = Merge(Data1=item_24, Data2=item_25)  # -> flatten(Result)

bang_6 = ExplodeTree(Data=merge_22)  # -> Branch0, Branch1, Branch2, Branch3
merge_26 = Merge(Data1=bang_6.Branch0, Data2=bang_6.Branch2)
merge_27 = Merge(Data1=bang_6.Branch1, Data2=bang_6.Branch3)
line_3 = Line(entwine_6)
line_4 = Line(merge_16)
merge_28 = Merge(Data1=line_4, Data2=merge_26)  # -> flatten(Result)
merge_29 = Merge(Data1=line_3, Data2=merge_27)  # -> flatten(Result)

# ---- group: MATERIAL UND QUERSCHNITT DES RAHMENS
number_slider = Slider(400, range=50..400)  # disabled
number_slider_2 = Slider(300, range=50..400)  # disabled
number_slider_3 = Slider(20, range=4..30)  # disabled
number_slider_4 = Slider(300, range=50..400)  # disabled
number_slider_5 = Slider(500, range=50..600)  # disabled
drehungswinkel_der_stützen_º = Slider(0, range=0..180)  # disabled
# Das Material der Struktur muss festgelegt werden: Stahl (4 Stufen), Beton (7 Stufen) oder Holz (4 Stufen). Das Material muss dann unabhängig voneinander mit jedem Stab verbunden werden, sodass in derselben Struktur mehrere Materialien gleichzeitig verwendet werden können, die mit verschiedenen Stäben verbunden sind, wenn man das will.
# 
# Die Komponente Material+ geht standardmäßig von Stahl (S275) aus. Wenn du also nicht genau angeben willst, um welches Material es sich handelt, kannst du einfach die Komponente Material+ einfügen und musst nichts weiter definieren.
# 
# Das habe ich diesmal nicht geändert. Das heisst, es bleibt wie in der letzten Version.
material = Slider(0, range=0..2)  # disabled
material_grad = Slider(1, range=0..6)  # disabled
mat = MaterialsPlus(MaterialIndex=material, GradeIndex=material_grad)  # -> MaterialName, MaterialProperties, MaterialNames; disabled
number_slider_6 = Slider(20, range=4..30)  # disabled
number_slider_7 = Slider(12, range=4..20)  # disabled
drehungswinkel_des_trägers_º = Slider(0, range=0..180)  # disabled
panel_43 = Panel("STÜTZEN")  # disabled
panel_44 = Panel("TRÄGER")  # disabled
panel_45 = Panel(mat.MaterialNames)  # disabled
panel_46 = Panel(mat.MaterialName)  # disabled
hollow_rectangle = RectangularHollowSectionProperties(Width_mm=number_slider_2, Height_mm=number_slider, Thickness_mm=number_slider_3, Torsion=False)  # -> Properties, WidthW_m, HeightH_m, GeometryPolylineOfTheCrossSection; disabled
profile_h = HProfileSectionProperties(
    Width_mm=number_slider_4,
    Height_mm=number_slider_5,
    FlangeThickness_mm=number_slider_6,
    WebThickness_mm=number_slider_7,
    Torsion=False)  # -> Properties, WidthW_m, HeightH_m, GeometryPolylineOfTheCrossSection; disabled

# ---- group: MATERIAL UND QUERSCHNITT DES SEILES
mat_2 = MaterialsPlus(MaterialIndex=0, GradeIndex=1)  # -> MaterialName, MaterialProperties, MaterialNames; disabled
seil_durchmesser_mm = Slider(35, range=10..50)  # disabled
panel_47 = Panel(mat_2.MaterialName)  # disabled
circle = CircularSectionProperties(Diameter_mm=seil_durchmesser_mm, Torsion=False)  # -> Properties, WidthW_m, HeightH_m, GeometryPolylineOfTheCrossSection; disabled

# ---- group: MATERIAL UND QUERSCHNITT DES FACHWERKS
mat_3 = MaterialsPlus(MaterialIndex=0, GradeIndex=1)  # -> MaterialName, MaterialProperties, MaterialNames; disabled
wandstärke_beim_fachwerk_mm = Slider(8, range=5..20)  # disabled
breite_wrect_mm = Slider(50, range=5..400)  # disabled
durchmesser_hcir = Slider(50, range=5..400)  # disabled
höhe_hrect_mm = Slider(50, range=5..400)  # disabled
panel_48 = Panel("GÜRTE")  # disabled
breite_wrect_mm_2 = Slider(50, range=5..400)  # disabled
höhe_hrect_mm_2 = Slider(100, range=5..400)  # disabled
panel_49 = Panel("VERTIKALE")  # disabled
panel_50 = Panel("DIAGONALE")  # disabled
panel_51 = Panel(mat_3.MaterialName)  # disabled
hollow_rectangle_2 = RectangularHollowSectionProperties(Width_mm=breite_wrect_mm_2, Height_mm=höhe_hrect_mm_2, Thickness_mm=wandstärke_beim_fachwerk_mm, Torsion=False)  # -> Properties, WidthW_m, HeightH_m, GeometryPolylineOfTheCrossSection; disabled
hollow_rectangle_3 = RectangularHollowSectionProperties(Width_mm=breite_wrect_mm, Height_mm=höhe_hrect_mm, Thickness_mm=wandstärke_beim_fachwerk_mm, Torsion=False)  # -> Properties, WidthW_m, HeightH_m, GeometryPolylineOfTheCrossSection; disabled
holow_circle = CircularHollowSectionProperties(Diameter_mm=durchmesser_hcir, Thickness_mm=wandstärke_beim_fachwerk_mm, Torsion=False)  # -> Properties, WidthW_m, HeightH_m, GeometryPolylineOfTheCrossSection; disabled

# ---- group: MATERIAL UND QUERSCHNITT DES BOGENS
material_2 = Slider(1, range=0..2)  # disabled
material_grad_2 = Slider(2, range=0..6)  # disabled
mat_4 = MaterialsPlus(MaterialIndex=material_2, GradeIndex=material_grad_2)  # -> MaterialName, MaterialProperties, MaterialNames; disabled
# Die Materialität der Stäbe der Struktur wird durch das Material selbst und die Form des Querschnitts bestimmt. Jeder Stab muss mit einem Material und einem Querschnitt verknüpft werden.
# 
# Ich habe 6 Querschnittstypen programmiert: generisch (dient zur manuellen Eingabe der 4 Berechnungsparameter: A (mm2), Iy (mm4), Iz (mm4) und It (mm4)), rechteckig, rechteckiges Hohlrohr, rund, rundes Hohlrohr und IPE- oder HEB-Profil.
# 
# Grundsätzlich kann man jedes Material mit jeder Querschnittsform mischen, aber natürlich sind manche Kombinationen nicht sinnvoll.
# 
# Jeder Querschnitt erzeugt die gleichen Ausgabeparameter: die Abmessungen der rechteckigen Umhüllung (BxH), die Geometrie des Querschnitts als im globalen Koordinatenursprung gezeichnete Polylinie (die deaktiviert ist und durch Übertragung auf einen aktiven Kurvenparameter aktiviert werden kann; im Beispiel ist sie inaktiv) und die 4 strukturellen Eigenschaften des Querschnitts für die Berechnung.
# 
# Der Eingabeparameter „T?“ gibt an, ob die Torsionssteifigkeit berücksichtigt werden soll oder nicht.
# 
# Mit dem Material und dem Abschnitt kann der Stab auch seine Eigenlast berechnen.
bogen_höhe_mm = Slider(400, range=100..400)  # disabled
bogen_breite_mm = Slider(200, range=100..300)  # disabled
panel_52 = Panel(mat_4.MaterialNames)  # disabled
panel_53 = Panel(mat_4.MaterialName)  # disabled
rectangle = RectangularSectionProperties(Width_mm=bogen_breite_mm, Height_mm=bogen_höhe_mm, Torsion=False)  # -> Properties, WidthW_m, HeightH_m, GeometryPolylineOfTheCrossSection; disabled

# ----
reset_querschnitte = Button()  # disabled
panel_54 = Panel("""300
400
20
300
500
20
12
0
0
35
8
50
100
50
50
50
200
400""")  # disabled
reset_values_5 = CSharpScript(
    Reset=reset_querschnitte,
    Parameters=[number_slider_2, number_slider, number_slider_3, number_slider_4, number_slider_5, number_slider_6, number_slider_7, drehungswinkel_der_stützen_º, drehungswinkel_des_trägers_º, seil_durchmesser_mm, wandstärke_beim_fachwerk_mm, breite_wrect_mm_2, höhe_hrect_mm_2, breite_wrect_mm, höhe_hrect_mm, durchmesser_hcir, bogen_breite_mm, bogen_höhe_mm],
    Values=panel_54)  # -> flatten(out), flatten(param); inputs Reset: Boolean, Parameters: list, Values: list of Double; disabled; same code as reset_values_3
panel_55 = Panel(reset_values_5.out)  # disabled

# ---- group: INNERE GELENKE IM BEAM+
mittlerer_gelenk = BooleanToggle(True)  # disabled
träger_gelenkig_am_anfang = BooleanToggle(False)  # disabled
träger_gelenkig_am_ende = BooleanToggle(False)  # disabled

# ----
reset_innere_gelenke = Button()  # disabled
panel_56 = Panel("""False
False
False""")  # disabled
reset_toggles_4 = CSharpScript(
    Reset=reset_innere_gelenke,
    Parameters=[träger_gelenkig_am_anfang, mittlerer_gelenk, träger_gelenkig_am_ende],
    Values=panel_56)  # -> flatten(out), flatten(param); inputs Reset: Boolean, Parameters: list, Values: list of Boolean; disabled; same code as reset_toggles_3
panel_57 = Panel(reset_toggles_4.out)  # disabled

# ---- group: AUFLAGER - RESET
reset_auflager = Button()
reset_toggles_5 = CSharpScript(Reset=reset_auflager, Values="True")  # -> flatten(out), flatten(param); inputs Reset: Boolean, Parameters: list, Values: list of Boolean; same code as reset_toggles_3
panel_58 = Panel(reset_toggles_5.out)

# ----
beam_träger_links = BeamPlus(
    Line=trl,
    Material=mat.MaterialProperties,
    Properties=profile_h.Properties,
    Width=profile_h.WidthW_m,
    Height=profile_h.HeightH_m,
    CrossSection=profile_h.GeometryPolylineOfTheCrossSection,
    Angle=drehungswinkel_des_trägers_º,
    I_Connection=träger_gelenkig_am_anfang,
    J_Connection=mittlerer_gelenk,
    LoadQX=0,
    LoadQY=0,
    LoadQZ=neg_6,
    SelfWeight=eigengewicht_bei_beam,
    ControlAxial=1e+10,
    ControlBending=1e+10,
    Config=cfg)  # -> StartPlane, EndPlane, flatten(Beam), flatten(FeLoads), _3DGeometry; disabled

# ---- group: RAHMEN - BEAM+ ELEMENTE
# Der wichtigste Bauteil des Modells ist der Stab. Im Stab kommen das Material, die Querschnittsform, der Drehwinkel um die eigene Achse, die Gelenkbedingungen an jedem Ende und die aufgebrachten Linienlasten (sogar das Eigengewicht) zusammen.
# 
# Damit das Bauteil funktioniert, brauchst du ein paar Eingabedaten: die Modelllinien, die mit diesem Stabtyp dargestellt werden sollen, das Material, die Abmessungen des Querschnitts (für die Berechnung der Spannungen) und die strukturellen Eigenschaften des Querschnitts. Mit diesen Parametern funktioniert der Stab schon im Modell.
# 
# Es gibt aber noch viele andere Parameter, mit denen du ihr Verhalten einstellen kannst. Mit den Parametern „endI“ und „endJ“ kannst du am Anfang und am Ende Gelenke einfügen. Jeder Parameter kann 4 verschiedene Werte annehmen: 0 = fest, 1 = gelenkig für beide Biegungen, 2 = gelenkig für die Hauptbiegung, 3 = gelenkig für die Nebenbiegung. Wenn ein binärer Schalter verwendet wird, ist 0 (false) „eingespannt“ und 1 (true) „gelenkig“ für beide Biegungen. Das heißt, diese Parameter können mit einem Schalter mit der Bezeichnung „Gelenkig?“ verwendet werden. Die Standardoption ist „fest mit dem Knoten verbunden“.
# 
# Anschließend kann eine lineare Lastverteilung in den drei globalen Richtungen (qX, qY, qZ) angewendet werden. Das Eigengewicht kann automatisch hinzugefügt werden, wenn die Option SW aktiviert ist, die standardmäßig deaktiviert ist.
# 
# Der letzte Parameter „Ctrl“ ermöglicht eine gewisse Anpassung der Konvergenzgeschwindigkeit, befindet sich jedoch noch in der Testphase und scheint noch nicht richtig zu funktionieren.
# 
# Dieser Komponente wurde neu komplett reprogrammiert. Denn jetzt wird der Stab nicht mehr in kleinen Stäben unterteilt (was zu Konvergenzproblemen leichter führen konnte), sonder als einziger Stab, aber die Ergebnisse werden doch in mehrere internen Punkte dargestellt.
# 
# Es ist echt wichtig, dass du die „feLoads+“ mit einem „Merge“ zur "Solver" hinzufügst. Sonst sind die Ergebnisse falsch. Diese „feLoads“-Lasten sind die perfekten Einlagerungskräfte an beiden Enden jedes Balkens, und das ermöglicht lineare Lasten auf Balken, ohne dass die Balken in Segmente aufgeteilt werden müssen und ohne dass die Genauigkeit der Ergebnisse beeinträchtigt wird.
beam_stützen = BeamPlus(
    Line=stützen,
    Material=mat.MaterialProperties,
    Properties=hollow_rectangle.Properties,
    Width=hollow_rectangle.WidthW_m,
    Height=hollow_rectangle.HeightH_m,
    CrossSection=hollow_rectangle.GeometryPolylineOfTheCrossSection,
    Angle=drehungswinkel_der_stützen_º,
    I_Connection=0,
    J_Connection=0,
    LoadQX=0,
    LoadQY=streckenlast_stützen_qy_kn_m,
    LoadQZ=0,
    SelfWeight=eigengewicht_bei_beam,
    ControlAxial=1e+10,
    ControlBending=1e+10,
    Config=cfg)  # -> StartPlane, EndPlane, flatten(Beam), flatten(FeLoads), _3DGeometry; disabled
beam_träger_rechts = BeamPlus(
    Line=trr,
    Material=mat.MaterialProperties,
    Properties=profile_h.Properties,
    Width=profile_h.WidthW_m,
    Height=profile_h.HeightH_m,
    CrossSection=profile_h.GeometryPolylineOfTheCrossSection,
    Angle=drehungswinkel_des_trägers_º,
    I_Connection=0,
    J_Connection=träger_gelenkig_am_ende,
    LoadQX=0,
    LoadQY=0,
    LoadQZ=neg_6,
    SelfWeight=eigengewicht_bei_beam,
    ControlAxial=1e+10,
    ControlBending=1e+10,
    Config=cfg)  # -> StartPlane, EndPlane, flatten(Beam), flatten(FeLoads), _3DGeometry; disabled
rahmen_beam_rahmenelemente = Merge(Data1=beam_stützen.Beam, Data2=beam_träger_links.Beam, Data3=beam_träger_rechts.Beam)  # -> flatten(Result); disabled

# ---- group: BOGEN - BEAM+ ELEMENTE
beam = BeamPlus(
    Line=bogen_segmente,
    Material=mat_4.MaterialProperties,
    Properties=rectangle.Properties,
    Width=rectangle.WidthW_m,
    Height=rectangle.HeightH_m,
    CrossSection=rectangle.GeometryPolylineOfTheCrossSection,
    Angle=0,
    I_Connection=0,
    J_Connection=0,
    LoadQX=0,
    LoadQY=0,
    LoadQZ=neg_11,
    SelfWeight=False,
    ControlAxial=1e+10,
    ControlBending=1e+10,
    Config=cfg)  # -> StartPlane, EndPlane, flatten(Beam), flatten(FeLoads), _3DGeometry; disabled
bogen_beam_bogenelemente = Merge(Data1=beam.Beam)  # -> flatten(Result); disabled

# ---- group: SEIL - CABLE+ ELEMENTE
cable_seil = CablePlus(
    Line=seil_segmente,
    Material=mat_2.MaterialProperties,
    Properties=circle.Properties,
    Width=circle.WidthW_m,
    Height=circle.HeightH_m,
    CrossSection=circle.GeometryPolylineOfTheCrossSection,
    PreTension=0,
    ControlAxial=1e+10,
    ControlStiffness=stiffnessratio)  # -> flatten(StartPlane), flatten(EndPlane), flatten(Cable), _3DGeometry; disabled
seil_cable_kabelelemente = Merge(Data1=cable_seil.Cable)  # -> flatten(Result); disabled

# ---- group: FACHWERK - BAR+ ELEMENTE
bar_gürte = BarPlus(
    Line=gürte,
    Material=mat_3.MaterialProperties,
    Properties=hollow_rectangle_2.Properties,
    Width=hollow_rectangle_2.WidthW_m,
    Height=hollow_rectangle_2.HeightH_m,
    CrossSection=hollow_rectangle_2.GeometryPolylineOfTheCrossSection,
    ControlAxial=1e+10,
    ControlStiffness=stiffnessratio)  # -> flatten(StartPlane), flatten(EndPlane), flatten(Bar), _3DGeometry; disabled
bar_vertikale = BarPlus(
    Line=vertikale,
    Material=mat_3.MaterialProperties,
    Properties=hollow_rectangle_3.Properties,
    Width=hollow_rectangle_3.WidthW_m,
    Height=hollow_rectangle_3.HeightH_m,
    CrossSection=hollow_rectangle_3.GeometryPolylineOfTheCrossSection,
    ControlAxial=1e+10,
    ControlStiffness=stiffnessratio)  # -> flatten(StartPlane), flatten(EndPlane), flatten(Bar), _3DGeometry; disabled
bar_diagonale = BarPlus(
    Line=diagonale,
    Material=mat_3.MaterialProperties,
    Properties=holow_circle.Properties,
    Width=holow_circle.WidthW_m,
    Height=holow_circle.HeightH_m,
    CrossSection=holow_circle.GeometryPolylineOfTheCrossSection,
    ControlAxial=1e+10,
    ControlStiffness=stiffnessratio)  # -> flatten(StartPlane), flatten(EndPlane), flatten(Bar), _3DGeometry; disabled
# Das Problem bei der Verwendung von Bar+ allein ist, dass, wie wir im Museum von Alfredo Payá gesehen haben, virtuelle Bewegungsbeschränkungen hinzugefügt werden müssen, damit es nicht instabil wird. Diese „fiktiven Stützen” (z. B. damit sich die Struktur nur in der vertikalen Ebene bewegt) müssen über eine vom Rest der Stützen unabhängige Verbindung mit dem „Solver” verbunden werden, damit die 3D-Symbole der Stützen nicht gezeichnet werden.
# 
# Außerdem kann es bei „Fachwerk” vorkommen, dass einige Stäbe Momente haben oder dass wir dem oberen Gurt eine lineare Last zuweisen wollen. In diesen Fällen kann man Beam+ für die Gurte und Bar+ für die Diagonalen und vertikalen Pendelstäbe kombinieren.
fachwerk_bar_stabelemente = Merge(Data1=bar_gürte.Bar, Data2=bar_vertikale.Bar, Data3=bar_diagonale.Bar)  # -> flatten(Result); disabled

# ---- group: STRECKENLASTEN IM FACHWERK (AUF BEAM+ ELEMENTE)
streckenlast_träger_qz_kn_m_2 = Slider(5, range=-50..50)
streckenlast_wind_qy_kn_m = Slider(0, range=-50..50)
neg_12 = Negative(Value=streckenlast_träger_qz_kn_m_2)

# ---- group: LASTEN RESET
reset_lasten_2 = Button()
panel_59 = Panel("""0
5""")
reset_values_6 = CSharpScript(Reset=reset_lasten_2, Parameters=[streckenlast_wind_qy_kn_m, streckenlast_träger_qz_kn_m_2], Values=panel_59)  # -> flatten(out), flatten(param); inputs Reset: Boolean, Parameters: list, Values: list of Double; same code as reset_values_3
reset_toggles_6 = CSharpScript(Reset=reset_lasten_2, Values="False")  # -> flatten(out), flatten(param); inputs Reset: Boolean, Parameters: list, Values: list of Boolean; same code as reset_toggles_3
panel_60 = Panel(reset_toggles_6.out)
panel_61 = Panel(reset_values_6.out)

# ---- group: 3D GEO DARSTELLUNG
merge_30 = Merge(
    Data1=beam_stützen._3DGeometry,
    Data2=beam_träger_links._3DGeometry,
    Data3=beam_träger_rechts._3DGeometry,
    Data4=cable_seil._3DGeometry,
    Data5=bar_gürte._3DGeometry,
    Data6=bar_vertikale._3DGeometry,
    Data7=bar_diagonale._3DGeometry,
    Data8=beam._3DGeometry)  # -> flatten(Result); disabled
filter_2 = StreamFilter(Gate=_3d_modell_darstellung, Stream1=merge_30)  # disabled
preview = CustomPreview(Geometry=filter_2, Material=farbe_modelllinie)  # disabled

# ----
expression = Expression(x=streckenlast_wind_qy_kn_m, Expression="if(x=0, 0, 1)")

# ---- group: MATERIAL UND QUERSCHNITT DES RAHMENS
number_slider_8 = Slider(90, range=50..400)
width_height_mm = Slider(90, range=50..400)
number_slider_9 = Slider(4, range=4..30)
number_slider_10 = Slider(125, range=50..400)
number_slider_11 = Slider(7, range=4..30)
number_slider_12 = Slider(80, range=50..400)
number_slider_13 = Slider(4, range=4..30)
width_height_mm_2 = Slider(125, range=50..400)
width_height_mm_3 = Slider(80, range=50..400)
number_slider_14 = Slider(100, range=50..400)
number_slider_15 = Slider(8, range=4..30)
panel_62 = Panel("90.4 Orange")
width_height_mm_4 = Slider(100, range=50..400)
panel_63 = Panel("125.7 Rot")
panel_64 = Panel("80.3 Gelb")
material_3 = Slider(0, range=0..2)
material_grad_3 = Slider(1, range=0..6)
mat_5 = MaterialsPlus(MaterialIndex=material_3, GradeIndex=material_grad_3)  # -> MaterialName, MaterialProperties, MaterialNames
panel_65 = Panel("100.8 Rosa")
panel_66 = Panel(mat_5.MaterialNames)
panel_67 = Panel(mat_5.MaterialName)
hollow_rectangle_4 = RectangularHollowSectionProperties(Width_mm=width_height_mm, Height_mm=width_height_mm, Thickness_mm=number_slider_9, Torsion=False)  # -> Properties, WidthW_m, HeightH_m, GeometryPolylineOfTheCrossSection
hollow_rectangle_5 = RectangularHollowSectionProperties(Width_mm=width_height_mm_2, Height_mm=width_height_mm_2, Thickness_mm=number_slider_11, Torsion=False)  # -> Properties, WidthW_m, HeightH_m, GeometryPolylineOfTheCrossSection
hollow_rectangle_6 = RectangularHollowSectionProperties(Width_mm=width_height_mm_3, Height_mm=width_height_mm_3, Thickness_mm=number_slider_13, Torsion=False)  # -> Properties, WidthW_m, HeightH_m, GeometryPolylineOfTheCrossSection
hollow_rectangle_7 = RectangularHollowSectionProperties(Width_mm=width_height_mm_4, Height_mm=width_height_mm_4, Thickness_mm=number_slider_15, Torsion=False)  # -> Properties, WidthW_m, HeightH_m, GeometryPolylineOfTheCrossSection

# ----
reset_querschnitte_2 = Button()
panel_68 = Panel("""100
100
8
125
125
7
80
80
3
90
90
4""")
reset_values_7 = CSharpScript(
    Reset=reset_querschnitte_2,
    Parameters=[width_height_mm_4, number_slider_14, number_slider_15, width_height_mm_2, number_slider_10, number_slider_11, width_height_mm_3, number_slider_12, number_slider_13, width_height_mm, number_slider_8, number_slider_9],
    Values=panel_68)  # -> flatten(out), flatten(param); inputs Reset: Boolean, Parameters: list, Values: list of Double; same code as reset_values_3
panel_69 = Panel(reset_values_7.out)

rectangle_stützen_rosa = RectangularCS(Width=width_height_mm_4, Height=number_slider_14, Thickness=number_slider_15)  # -> A, Iy, Iz, It
rectangle_träger_orange = RectangularCS(Width=width_height_mm, Height=number_slider_8, Thickness=number_slider_9)  # -> A, Iy, Iz, It
is_mm4 = Evaluate(E="2*(H*H*A/4)*1e6", H=stützenfwhöhe, A=rectangle_stützen_rosa.A)
is_mm4_2 = Evaluate(E="2*(H*H*A/4)*1e6", H=trägerfwhöhe, A=rectangle_träger_orange.A)
generic = GenericSectionProperties(
    Area_mm2=rectangle_stützen_rosa.A,
    PrincipalInertia_mm4=is_mm4,
    SecondaryInertia_mm4=30000000,
    TorsionalInertia_mm4=1e-12)  # -> Properties, WidthW_m, HeightH_m, GeometryPolylineOfTheCrossSection
generic_2 = GenericSectionProperties(
    Area_mm2=rectangle_träger_orange.A,
    PrincipalInertia_mm4=is_mm4_2,
    SecondaryInertia_mm4=30000000,
    TorsionalInertia_mm4=1e-12)  # -> Properties, WidthW_m, HeightH_m, GeometryPolylineOfTheCrossSection

reset_innere_gelenke_2 = Button()
reset_toggles_7 = CSharpScript(Reset=reset_innere_gelenke_2)  # -> flatten(out), flatten(param); inputs Reset: Boolean, Parameters: list, Values: list of Boolean; same code as reset_toggles_3
panel_70 = Panel(reset_toggles_7.out)

drehungswinkel_des_trägers_º_2 = Slider(0, range=0..180)
drehungswinkel_der_stützen_º_2 = Slider(90, range=0..180)

# ---- group: PUNKTLASTEN DARSTELLUNG
cfg_3 = ConfigurationPlusTunnel(Config=cfg)  # -> StiffnessRatio, Threshold, NumberOfDecimals, LineThickness, ModelColor, _3DModel, Hinges, HingeThickness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; disabled

# ---- group: BEAM+ UND STRECKENLASTEN DARSTELLUNG
cfg_4 = ConfigurationPlusTunnel(Config=cfg)  # -> StiffnessRatio, Threshold, NumberOfDecimals, LineThickness, ModelColor, _3DModel, Hinges, HingeThickness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; disabled
and_3 = GateAnd(A=cfg_4.Deformation, B=cfg_4._3DDeformation)  # disabled

# ---- group: AUFLAGER UND AUFLAGERREAKTIONEN DARSTELLUNG
cfg_5 = ConfigurationPlusTunnel(Config=cfg)  # -> StiffnessRatio, Threshold, NumberOfDecimals, LineThickness, ModelColor, _3DModel, Hinges, HingeThickness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; disabled

multiplication_12 = Multiplication(Stiffness=cfg_5.StiffnessRatio, FaktorVerformung=cfg_5.ScaleDeformation)  # disabled
ahsl = SplitAHSL(Colour=cfg_5.ReactionColor)  # -> Alpha, Hue, Saturation, Luminance; disabled
hsl = ColourHSL(Alpha=ahsl.Alpha, Hue=ahsl.Hue, Saturation=ahsl.Saturation, Luminance=expr("0.67*x", ahsl.Luminance))  # disabled

# ---- group: PUNKTLASTEN DARSTELLUNG
multiplication_13 = Multiplication(Stiffness=cfg_3.StiffnessRatio, FaktorVerformung=cfg_3.ScaleDeformation)  # disabled
ahsl_2 = SplitAHSL(Colour=cfg_3.LoadColor)  # -> Alpha, Hue, Saturation, Luminance; disabled
hsl_2 = ColourHSL(Alpha=ahsl_2.Alpha, Hue=ahsl_2.Hue, Saturation=ahsl_2.Saturation, Luminance=expr("0.67*x", ahsl_2.Luminance))  # disabled

# ----
merge_31 = Merge()  # -> flatten(Result)

# ---- group: CABLE+ DARSTELLUNG
cfg_6 = ConfigurationPlusTunnel(Config=cfg_2)  # -> StiffnessRatio, Threshold, NumberOfDecimals, LineThickness, ModelColor, _3DModel, Hinges, HingeThickness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
cableoutput = CableOutputPlus(CableData=merge_31, Config=cfg_6.Config_2)  # -> IP0, IP1, P0, P1, N, Deformation, AxialDiagramTension, TextPositionD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
saturationratio = CSharpScript(Lines=cableoutput.LineS, satRatio=cableoutput.TensionRatio, b=cfg_6.SaturationRatio)  # -> out, p, l, t, i; inputs Lines: Line, satRatio: Double, b: Boolean
# ---------- saturationratio: C# ----------
// Grasshopper Script Instance
#region Usings
using System;
using System.Linq;
using System.Collections;
using System.Collections.Generic;
using System.Drawing;

using Rhino;
using Rhino.Geometry;
using Rhino.Display;

using Grasshopper;
using Grasshopper.Kernel;
using Grasshopper.Kernel.Data;
using Grasshopper.Kernel.Types;
#endregion

public class Script_Instance : GH_ScriptInstance
{
    #region Notes
    /* 
      Members:
        RhinoDoc RhinoDocument
        GH_Document GrasshopperDocument
        IGH_Component Component
        int Iteration

      Methods (Virtual & overridable):
        Print(string text)
        Print(string format, params object[] args)
        Reflect(object obj)
        Reflect(object obj, string method_name)
    */
    #endregion

    private void RunScript(
		Line Lines,
		double satRatio,
		bool b,
		ref object p,
		ref object l,
		ref object t,
		ref object i)
    {
        if (b == false)
            return;

        if (Lines.Length < 0.1)
            return;

        l = Lines;
                    
        Point3d pm;

        pm = 0.5 * (Lines.From + Lines.To);

        p = pm;

        t = Math.Round(satRatio * 100.0,0).ToString();

        if (satRatio < 0.0)
            i = 0;
        else
            i = Math.Min(8, Math.Floor(satRatio / 0.125));
    }
}
# ---------- end saturationratio ----------
preview_def = CSharpScript(L=flatten(cableoutput.Deformation), T=cfg_6.LineThickness, C=cfg_6.DeformationColor, b=cfg_6._3DDeformation)  # inputs L: list of Line, T: Int32, C: Color, b: Boolean
# ---------- preview_def: C# ----------
// Grasshopper Script Instance
#region Usings
using System;
using System.Linq;
using System.Collections;
using System.Collections.Generic;
using System.Drawing;

using Rhino;
using Rhino.Geometry;

using Grasshopper;
using Grasshopper.Kernel;
using Grasshopper.Kernel.Data;
using Grasshopper.Kernel.Types;
#endregion

public class Script_Instance : GH_ScriptInstance
{
    Color c;
    int t;
    List <Line> l;
    bool draw_it;

    #region Notes
    /* 
      Members:
        RhinoDoc RhinoDocument
        GH_Document GrasshopperDocument
        IGH_Component Component
        int Iteration

      Methods (Virtual & overridable):
        Print(string text)
        Print(string format, params object[] args)
        Reflect(object obj)
        Reflect(object obj, string method_name)
    */
    #endregion

    private void RunScript(List<Line> L, int T, Color C, bool b)
    {
        draw_it = !b;     // Die 3D Darstellung soll nicht gleichzeitig gezeigt werden...
        
        if (L == null || L.Count() < 1)
        {
            draw_it = false;
            return;
        }

        int n = L.Count();
        
        l = new List<Line>();
        l.Clear();

        for (int i = 0; i < n; i++)
            l.Add(L[i]);

        c = C;
        t = T;
    }

    public override BoundingBox ClippingBox => BoundingBox.Empty;

    public override void DrawViewportMeshes(IGH_PreviewArgs args)
    {
        base.DrawViewportWires(args);
        
        if (draw_it == false)
            return;
            
        int n = l.Count();

        for (int i = 0; i < n; i++)
            args.Display.DrawLine(l[i], c, t);
    }

    public override void DrawViewportWires(IGH_PreviewArgs args)
    {

    }
}
# ---------- end preview_def ----------
colors_for_saturation_grade = ListItem(List=cfg_6.SaturationRatioColors, Index=saturationratio.i, Wrap=True)
previewaxial = CustomPreview(Geometry=cableoutput.AxialDiagramTension, Material=cfg_6.PositiveAxialColor)
and_4 = GateAnd(A=cfg_6.Deformation, B=cfg_6._3DDeformation)
bnd = Bounds(Numbers=flatten(cableoutput.TensionRatio))
filter_3 = StreamFilter(Gate=cfg_6.SaturationRatio, Stream1=saturationratio.t)
filter_4 = StreamFilter(Gate=cfg_6.Displacements, Stream1=cableoutput.TextD)
filter_5 = StreamFilter(Gate=cfg_6.DiagramValues, Stream1=cableoutput.TextF)
filter_6 = StreamFilter(Gate=and_4, Stream1=cableoutput._3DGeometry)
ln_24 = Line(StartPoint=cableoutput.IP0, EndPoint=cableoutput.IP1)
not_5 = GateNot(A=cfg_6.SaturationRatio)
filter_7 = StreamFilter(Gate=not_5, Stream1=ln_24)
dedomain = DeconstructDomain(Domain=bnd)  # -> Start, End
tag = TextTag(Location=saturationratio.p, Text=filter_3, Colour=colors_for_saturation_grade)
preview_geo = CSharpScript(L=flatten(filter_7), T=cfg_6.LineThickness, C=cfg_6.ModelColor, b=cfg_6._3DModel)  # inputs L: list of Line, T: Int32, C: Color, b: Boolean
# ---------- preview_geo: C# ----------
// Grasshopper Script Instance
#region Usings
using System;
using System.Linq;
using System.Collections;
using System.Collections.Generic;
using System.Drawing;

using Rhino;
using Rhino.Geometry;

using Grasshopper;
using Grasshopper.Kernel;
using Grasshopper.Kernel.Data;
using Grasshopper.Kernel.Types;
#endregion

public class Script_Instance : GH_ScriptInstance
{
    Color c;
    int t;
    List <Line> l;
    bool draw_it;

    #region Notes
    /* 
      Members:
        RhinoDoc RhinoDocument
        GH_Document GrasshopperDocument
        IGH_Component Component
        int Iteration

      Methods (Virtual & overridable):
        Print(string text)
        Print(string format, params object[] args)
        Reflect(object obj)
        Reflect(object obj, string method_name)
    */
    #endregion

    private void RunScript(List<Line> L, int T, Color C, bool b)
    {
        draw_it = !b;     // Die 3D Darstellung soll nicht gleichzeitig gezeigt werden...

        if (L == null || L.Count() < 1)
        {
            draw_it = false;
            return;
        }

        int n = L.Count();
        
        l = new List<Line>();
        l.Clear();
        
        for (int i = 0; i < n; i++)
            l.Add(L[i]);

        c = C;
        t = T;
    }

    public override BoundingBox ClippingBox => BoundingBox.Empty;

    public override void DrawViewportMeshes(IGH_PreviewArgs args)
    {
        base.DrawViewportWires(args);
        
        if (draw_it == false)
            return;
            
        int n = l.Count();

        for (int i = 0; i < n; i++)
            args.Display.DrawLine(l[i], c, t);
    }

    public override void DrawViewportWires(IGH_PreviewArgs args)
    {

    }
}
# ---------- end preview_geo ----------
preview_def3d = CustomPreview(Geometry=filter_6, Material=cfg_6.DeformationColor)
preview_saturation = CustomPreview(Geometry=saturationratio.l, Material=colors_for_saturation_grade)
defvalues = TextTag(Location=cableoutput.TextPositionD, Text=filter_4, Colour=cfg_6.DisplacementColor)
intforcevalues = TextTag(Location=cableoutput.TextPositionF, Text=filter_5, Colour=cfg_6.ValuesColor)

# ---- group: PUNKTLASTEN DARSTELLUNG
cfg_7 = ConfigurationPlusTunnel(Config=cfg_2)  # -> StiffnessRatio, Threshold, NumberOfDecimals, LineThickness, ModelColor, _3DModel, Hinges, HingeThickness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

# ---- group: BEAM+ UND STRECKENLASTEN DARSTELLUNG
cfg_8 = ConfigurationPlusTunnel(Config=cfg_2)  # -> StiffnessRatio, Threshold, NumberOfDecimals, LineThickness, ModelColor, _3DModel, Hinges, HingeThickness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
and_5 = GateAnd(A=cfg_8.Deformation, B=cfg_8._3DDeformation)

# ---- group: AUFLAGER UND AUFLAGERREAKTIONEN DARSTELLUNG
cfg_9 = ConfigurationPlusTunnel(Config=cfg_2)  # -> StiffnessRatio, Threshold, NumberOfDecimals, LineThickness, ModelColor, _3DModel, Hinges, HingeThickness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

multiplication_14 = Multiplication(Stiffness=cfg_9.StiffnessRatio, FaktorVerformung=cfg_9.ScaleDeformation)
ahsl_3 = SplitAHSL(Colour=cfg_9.ReactionColor)  # -> Alpha, Hue, Saturation, Luminance
hsl_3 = ColourHSL(Alpha=ahsl_3.Alpha, Hue=ahsl_3.Hue, Saturation=ahsl_3.Saturation, Luminance=expr("0.67*x", ahsl_3.Luminance))

# ---- group: PUNKTLASTEN DARSTELLUNG
multiplication_15 = Multiplication(Stiffness=cfg_7.StiffnessRatio, FaktorVerformung=cfg_7.ScaleDeformation)
ahsl_4 = SplitAHSL(Colour=cfg_7.LoadColor)  # -> Alpha, Hue, Saturation, Luminance
hsl_4 = ColourHSL(Alpha=ahsl_4.Alpha, Hue=ahsl_4.Hue, Saturation=ahsl_4.Saturation, Luminance=expr("0.67*x", ahsl_4.Luminance))

# ----
not_6 = GateNot(A=abstraktion)
and_6 = GateAnd(A=not_6, B=gelenke_darstellen_2)

and_7 = GateAnd(A=abstraktion, B=gelenke_darstellen_2)

# ----
# Das ist nur, um die Logos zu zeigen.
str2img_2 = DeserializeImageFromString(ImageString=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)
logos_2 = BooleanToggle(True)
trigger_2 = Trigger(Interval=2000, TimerInterval=2000, Target=c_script_3)
bitmap_2 = BitmapFromFile(BitmapPath=str2img_2)  # -> Bitmap, Width, Height
c_script_3 = CSharpScript()  # -> out, a, W, H; same code as c_script
filter_8 = StreamFilter(Gate=logos_2, Stream1=bitmap_2.Bitmap)
subtraction_5 = Subtraction(A=c_script_3.W, B="30")
subtraction_6 = Subtraction(A=c_script_3.H, B="30")
multiplication_16 = Multiplication(A=c_script_3.W, B=".12")
pt_10 = ConstructPoint(XCoordinate=subtraction_5, YCoordinate=subtraction_6, ZCoordinate=0)
c_script_4 = CSharpScript(Tx=filter_8, P=pt_10, w=multiplication_16)  # -> out, a; inputs P: Point3d, w: Double; same code as c_script_2

int = Integer(c_script_3.H)
vp_height = Integer(int)

# ---- group: GEOMETRISCHE PARAMETER - RESET
reset_geometrie_2 = Button()
panel_71 = Panel("""1.2
2.09""")
panel_72 = Panel([panel_71, ma.Result, ma_2.Result, modellhöhe_h, modellbreite_oder_modellspannweite_l, "0.5"])

# ---- group: AUFLAGER BEIM FACHWERK
rechte_fachwerkauflager_verschieblich = BooleanToggle(False)  # disabled
support3dof = Support3DOFPlus(SupportPt=H.Geometry, XFixed=True, YFixed=True, ZFixed=True, Strength=1000000000)  # disabled

# ----
not_7 = GateNot(A=rechte_fachwerkauflager_verschieblich)  # disabled

# ---- group: AUFLAGER BEIM FACHWERK (continued)
support3dof_2 = Support3DOFPlus(SupportPt=I.Geometry, XFixed=not_7, YFixed=True, ZFixed=True, Strength=1000000000)  # disabled
fachwerk_auflager = Merge(Data1=support3dof, Data2=support3dof_2)  # -> flatten(Result); disabled

# ---- group: AUFLAGER BEIM SEIL
rechte_seilauflager_verschieblich = BooleanToggle(False)  # disabled
support3dof_3 = Support3DOFPlus(SupportPt=E.Geometry, XFixed=True, YFixed=True, ZFixed=True, Strength=1000000000)  # disabled

# ---- group: AUFLAGER - RESET
reset_auflager_2 = Button()  # disabled
panel_73 = Panel("""False
False
False
False
False
True
False""")  # disabled
reset_toggles_8 = CSharpScript(
    Reset=reset_auflager_2,
    Parameters=[rahmenauflager_links_verschieblich, rahmenauflager_links_gelenkig, rahmenauflager_rechts_verschieblich, rahmenauflager_rechts_gelenkig, rechte_seilauflager_verschieblich, rechte_fachwerkauflager_verschieblich, eingespannte_auflager_am_bogen],
    Values=panel_73)  # -> flatten(out), flatten(param); inputs Reset: Boolean, Parameters: list, Values: list of Boolean; disabled; same code as reset_toggles_3
panel_74 = Panel(reset_toggles_8.out)  # disabled

# ----
not_8 = GateNot(A=rechte_seilauflager_verschieblich)  # disabled

# ---- group: AUFLAGER BEIM SEIL (continued)
support3dof_4 = Support3DOFPlus(SupportPt=F.Geometry, XFixed=not_8, YFixed=True, ZFixed=True, Strength=1000000000)  # disabled
seil_auflager = Merge(Data1=support3dof_3, Data2=support3dof_4)  # -> flatten(Result); disabled

# ---- group: ZUSAMMENSETZUNG AUFLAGER UND KRÄFTE
merge_supports = Merge(Data1=rahmen_auflager, Data2=seil_auflager, Data3=fachwerk_auflager, Data4=bogen_auflager)  # -> flatten(Result); disabled
merge_point_loads = Merge(Data1=load, Data2=load_4, Data3=load_5, Data4=load_6, Data5=load_2, Data6=load_3)  # -> flatten(Result); disabled
# Sowohl die „Auflager“ als auch die Lasten müssen mit einem „Merge“ mit einem Ausgang mit „Flatten“ verbunden werden.
# 
# Die neuen feLoads+ ("Fixed End Loads") auch.
merge_fixed_end_loads = Merge(Data1=beam_stützen.FeLoads, Data2=beam_träger_links.FeLoads, Data3=beam_träger_rechts.FeLoads, Data4=beam.FeLoads)  # -> flatten(Result); disabled

# ---- group: SOLVER MODUL
# Der Py3 Komponente hat die Verantwortung den "solver" nochmals zu starten, immer wenn ein Parameter geändert wurde. Jetzt ist es leichter und sauber progtammiert, so dass nicht jedes Parameter hier kommnt, sonder wird aus den "Reset" Komponenten zusammengestellt.
# SOLVER MODUL (KANGAROO)
# 
# Hier werden alle Daten, die das Berechnungsmodell definieren, kombiniert und in den Kangaroo-Solver eingegeben, dessen Ergebnisse (Ausgang "O") für die individuelle Verarbeitung aufgeschlüsselt werden.
# 
# 
# Die Komponente "Entwine" erhält alle Eingabedaten und kombiniert sie, damit der Solver sie empfängt („GoalObjects“). Die Reihenfolge ist unerheblich, aber die Ergebnisse werden in derselben Reihenfolge empfangen, in der sie eingegeben wurden.
# 
# Ich empfehle, den ersten Knoten für die „Auflager“ zu verwenden. Wenn es mehrere "Auflager" gibt, solltest du am Ausgang einen „Merge“ mit „Flatten“ machen.
# 
# Die „fiktiven Auflager (z. B. damit sich die Struktur nur in der vertikalen Ebene bewegt) müssen über eine vom Rest der Auflager unabhängige Verbindung mit dem „Solver” verbunden werden, damit die 3D-Symbole der Stützen nicht gezeichnet werden.
# 
# Der zweite Knoten sollte für alle externe Punktlasten (Kräfte und/oder Momente) verwendet werden. Sie müssen mit „Merge“+„Flatten“ kombiniert werden.
# 
# Der dritte Knoten dient es, um die interne "Fixed End Forces+Moments" zu betrachten. Diese interne Lasten müusen auch dem "solver" weiterleiten, enn sonst werden die Ergebnisse falsch sein. Jedes Beam+ Element der Streckenlasten besitzt, generieret diese interne Lasten, die den "solver" braucht um die Analyse korrekt durchführen zu können.
# 
# Von hier aus kannst du Verbindungen zu weiteren Knoten der Komponente „Entwine“ hinzufügen, je nach Anzahl der verschiedenen Stabtypen (unterschiedliches Material, Querschnittstyp, Drehwinkel, Gelenkbedingungen an den Enden, aufgebrachte Lasten usw.). Es ist besser, so viele wie nötig hinzuzufügen, da die Ausgabe der Ergebnisse bereits direkt nach verschiedenen Typen unterteilt ist und die Darstellung der Ergebnisse vereinfacht wird.
# 
# Der "Solver" führt den iterativen Prozess durch, der zur Gleichgewichtslösung konvergieren sollte. Dazu wird ein "Threshold" verwendet. Die Toleranz dient dazu, nahe beieinander liegende Punkte zusammenzuführen. Der Solver kann mit dem entsprechenden Schalter angehalten werden (zugänglich über das Benutzersteuerfeld).
# 
# Die Schaltfläche „RESET“ startet die Berechnung des „Solver“ neu. Dies muss bei jeder Änderung erfolgen. Um Änderungen zu erkennen, wird ein in Python programmierter Baustein verwendet, der die Daten aller veränderbaren Parameter empfängt und sie vorübergehend speichert, um bei Erkennung einer Änderung eine Neuberechnung des „Solver“ auszulösen. Die Neuberechnung kann auch durch Drücken der Schaltfläche „RESET“ ausgelöst werden.
merge_32 = Merge(
    Data1=reset_values_3.param,
    Data2=reset_toggles_8.param,
    Data3=reset_values_4.param,
    Data4=reset_toggles_3.param,
    Data5=reset_values_5.param,
    Data6=reset_toggles_4.param)  # disabled
py3 = Python3Script(CurrentValue=merge_32)  # -> out, SavedValue, isNewValue; inputs CurrentValue: list; disabled
# ---------- py3: Python ----------
# Instantiate or reset persistent data 
if "savedValue" not in globals():
    savedValue = CurrentValue

# Check current value persistent data
if CurrentValue == savedValue:
    isNewValue = False
else:
    isNewValue = True
    savedValue = CurrentValue
    ghenv.Component.ExpireSolution(True)

# Output to GH
SavedValue = savedValue
# ---------- end py3 ----------
entwine_7 = Entwine(
    Branch00=merge_supports,
    Branch01=merge_point_loads,
    Branch02=merge_fixed_end_loads,
    Branch03=rahmen_beam_rahmenelemente,
    Branch04=seil_cable_kabelelemente,
    Branch05=fachwerk_bar_stabelemente,
    Branch06=bogen_beam_bogenelemente,
    FlattenInputs=True)  # disabled
reset = Button()  # disabled
or = GateOr(A=py3.isNewValue, B=reset)  # disabled
pause = BooleanToggle(False)  # disabled
not_9 = GateNot(A=pause)  # disabled
solver = Solver(GoalObjects=entwine_7, Reset=or, Threshold=eval, Tolerance=1e-05, On=not_9)  # -> I, V, O; disabled
# Für die Berechnung der Ergebnisse musst du einfach jeden Ausgang von „Explode” mit der richtigen Gruppe verbinden. So werden die Stützen mit der Gruppe für Stützen und Reaktionen verbunden. Die Punktlasten werden mit der Gruppe für Lasten (Kräfte und Momente) verbunden.
# 
# Und vor allem werden die Beam+ mit der Darstellung der Beam+-Ergebnisse (Axialkräfte, Schnittkräfte, Momente, lineare Lasten, Verformungen usw.) verbunden, die „Bar+“ mit den Darstellungsergebnissen von „Bar+“ und dasselbe gilt für die „Cable+“.
# 
# Mit der neuen Programmierung wurden die Verbindungen vereinfacht. Jetzt musst du nur noch das Ergebnis des „Solvers” und die Konfiguration verbinden. Da ich die Konfiguration bereits verbunden gelassen habe, musst du nur noch den Ausgang der Ergebnisse des „Solvers” verbinden. Wenn es mehrere Ausgänge desselben Typs gibt, kannst du sie mit „Merge”+„Flatten” zusammenführen.
bang_7 = ExplodeTree(Data=solver.O)  # -> Branch0, Branch1, Branch2, Branch3, Branch4, Branch5, Branch6; disabled

# ----
merge_33 = Merge(Data1=bang_7.Branch3, Data2=bang_7.Branch6)  # -> flatten(Result); disabled
merge_34 = Merge(Data1=bang_7.Branch4)  # -> flatten(Result); disabled
merge_35 = Merge(Data1=bang_7.Branch5)  # -> flatten(Result); disabled

# ---- group: BAR+ DARSTELLUNG
cfg_10 = ConfigurationPlusTunnel(Config=cfg)  # -> StiffnessRatio, Threshold, NumberOfDecimals, LineThickness, ModelColor, _3DModel, Hinges, HingeThickness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; disabled
baroutput = BarOutputPlus(BarData=merge_35, Config=cfg_10.Config_2)  # -> IP0, IP1, P0, P1, N, Deformation, AxialDiagramCompression, AxialDiagramTension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; disabled
saturationratio_2 = CSharpScript(Lines=baroutput.LineS, satRatio=baroutput.TensionRatio, b=cfg_10.SaturationRatio)  # -> out, p, l, t, i; inputs Lines: Line, satRatio: Double, b: Boolean; disabled
# ---------- saturationratio_2: C# ----------
// Grasshopper Script Instance
#region Usings
using System;
using System.Linq;
using System.Collections;
using System.Collections.Generic;
using System.Drawing;

using Rhino;
using Rhino.Geometry;
using Rhino.Display;

using Grasshopper;
using Grasshopper.Kernel;
using Grasshopper.Kernel.Data;
using Grasshopper.Kernel.Types;
#endregion

public class Script_Instance : GH_ScriptInstance
{
    #region Notes
    /* 
      Members:
        RhinoDoc RhinoDocument
        GH_Document GrasshopperDocument
        IGH_Component Component
        int Iteration

      Methods (Virtual & overridable):
        Print(string text)
        Print(string format, params object[] args)
        Reflect(object obj)
        Reflect(object obj, string method_name)
    */
    #endregion

    private void RunScript(
		Line Lines,
		double satRatio,
		bool b,
		ref object p,
		ref object l,
		ref object t,
		ref object i)
    {
        if (b == false)
            return;

        l = Lines;
                    
        Point3d pm;

        pm = 0.5 * (Lines.From + Lines.To);

        p = pm;

        t = Math.Round(satRatio *100.0, 0).ToString();

        if (satRatio < 0.0)
            i = 0;
        else
            i = Math.Min(8, Math.Floor(satRatio / 0.125));
    }
}
# ---------- end saturationratio_2 ----------
bnd_2 = Bounds(Numbers=flatten(baroutput.TensionRatio))  # disabled
preview_def_2 = CSharpScript(L=flatten(baroutput.Deformation), T=cfg_10.LineThickness, C=cfg_10.DeformationColor, b=cfg_10._3DDeformation)  # inputs L: list of Line, T: Int32, C: Color, b: Boolean; disabled
# ---------- preview_def_2: C# ----------
// Grasshopper Script Instance
#region Usings
using System;
using System.Linq;
using System.Collections;
using System.Collections.Generic;
using System.Drawing;

using Rhino;
using Rhino.Geometry;

using Grasshopper;
using Grasshopper.Kernel;
using Grasshopper.Kernel.Data;
using Grasshopper.Kernel.Types;
#endregion

public class Script_Instance : GH_ScriptInstance
{
    Color c;
    int t;
    List <Line> l;
    bool draw_it;

    #region Notes
    /* 
      Members:
        RhinoDoc RhinoDocument
        GH_Document GrasshopperDocument
        IGH_Component Component
        int Iteration

      Methods (Virtual & overridable):
        Print(string text)
        Print(string format, params object[] args)
        Reflect(object obj)
        Reflect(object obj, string method_name)
    */
    #endregion

    private void RunScript(List<Line> L, int T, Color C, bool b)
    {
        draw_it = !b;     // Die 3D Darstellung soll nicht gleichzeitig gezeigt werden...

        int n = L.Count();
        
        l = new List<Line>();

        for (int i = 0; i < n; i++)
            l.Add(L[i]);

        c = C;
        t = T;
    }

    public override BoundingBox ClippingBox => BoundingBox.Empty;

    public override void DrawViewportMeshes(IGH_PreviewArgs args)
    {
        base.DrawViewportWires(args);
        
        if (draw_it == false)
            return;
            
        int n = l.Count();

        for (int i = 0; i < n; i++)
            args.Display.DrawLine(l[i], c, t);
    }

    public override void DrawViewportWires(IGH_PreviewArgs args)
    {

    }
}
# ---------- end preview_def_2 ----------
previewaxial_2 = CustomPreview(Geometry=baroutput.AxialDiagramCompression, Material=cfg_10.NegativeAxialColor)  # disabled
previewaxial_3 = CustomPreview(Geometry=baroutput.AxialDiagramTension, Material=cfg_10.PositiveAxialColor)  # disabled
dedomain_2 = DeconstructDomain(Domain=bnd_2)  # -> Start, End; disabled
colors_for_saturation_grade_2 = ListItem(List=cfg_10.SaturationRatioColors, Index=saturationratio_2.i, Wrap=True)  # disabled
not_10 = GateNot(A=cfg_10.SaturationRatio)  # disabled
ln_25 = Line(StartPoint=baroutput.IP0, EndPoint=baroutput.IP1)  # disabled
and_8 = GateAnd(A=cfg_10.Deformation, B=cfg_10._3DDeformation)  # disabled
filter_9 = StreamFilter(Gate=cfg_10.Displacements, Stream1=baroutput.TextD)  # disabled
filter_10 = StreamFilter(Gate=cfg_10.DiagramValues, Stream1=baroutput.TextF)  # disabled
filter_11 = StreamFilter(Gate=cfg_10.SaturationRatio, Stream1=saturationratio_2.t)  # disabled
filter_12 = StreamFilter(Gate=not_10, Stream1=ln_25)  # disabled
filter_13 = StreamFilter(Gate=and_8, Stream1=baroutput._3DGeometry)  # disabled
tag_2 = TextTag(Location=saturationratio_2.p, Text=filter_11, Colour=colors_for_saturation_grade_2)  # disabled
hingedraw = CSharpScript(
    x=baroutput.IP0,
    y=baroutput.IP1,
    color=cfg_10.HingeColor,
    thickness=cfg_10.HingeThickness,
    size=cfg_10.HingeSize,
    b=cfg_10.Hinges)  # inputs x: list of Plane, y: list of Plane, color: Color, thickness: Int32, size: Double, b: Boolean; disabled
# ---------- hingedraw: C# ----------
// Grasshopper Script Instance
#region Usings
using System;
using System.Linq;
using System.Collections;
using System.Collections.Generic;
using System.Drawing;

using Rhino;
using Rhino.Geometry;

using Grasshopper;
using Grasshopper.Kernel;
using Grasshopper.Kernel.Data;
using Grasshopper.Kernel.Types;
#endregion

public class Script_Instance : GH_ScriptInstance
{
    Color c;
    double s;
    int t;
    List <Plane> p; 
    bool draw_it;
    
    #region Notes
    /* 
      Members:
        RhinoDoc RhinoDocument
        GH_Document GrasshopperDocument
        IGH_Component Component
        int Iteration

      Methods (Virtual & overridable):
        Print(string text)
        Print(string format, params object[] args)
        Reflect(object obj)
        Reflect(object obj, string method_name)
    */
    #endregion

    private void RunScript(
		List<Plane> x,
		List<Plane> y,
		Color color,
		int thickness,
		double size,
		bool b)
    {
        if (x == null || y == null)
        {
            return;
        }

        draw_it = b;

        int n = x.Count();

        if (n != y.Count())
        {
            return;
        }
        p = new List<Plane>();

        for (int i = 0; i < n; i++)
        {
            p.Add(new Plane(x[i].Origin, x[i].XAxis));
            p.Add(new Plane(y[i].Origin, y[i].XAxis));
            p.Add(new Plane(x[i].Origin, x[i].YAxis));
            p.Add(new Plane(y[i].Origin, y[i].YAxis));
        }

        c = color;
        s = size;
        t = thickness;
    }

    public override BoundingBox ClippingBox => BoundingBox.Empty;

    public override void DrawViewportMeshes(IGH_PreviewArgs args)
    {
        base.DrawViewportMeshes(args);

        if (draw_it == false)
            return;

        int n = p.Count();

        Circle ci;

        for (int i = 0; i < n; i++)
        {
            ci = new Circle(p[i], s);
            args.Display.DrawCircle(ci, c, t);
        }
    }

    public override void DrawViewportWires(IGH_PreviewArgs args)
    {
    }
}
# ---------- end hingedraw ----------
preview_geo_2 = CSharpScript(L=flatten(filter_12), T=cfg_10.LineThickness, C=cfg_10.ModelColor, b=cfg_10._3DModel)  # inputs L: list of Line, T: Int32, C: Color, b: Boolean; disabled; same code as preview_def_2
preview_saturation_2 = CustomPreview(Geometry=saturationratio_2.l, Material=colors_for_saturation_grade_2)  # disabled
defvalues_2 = TextTag(Location=baroutput.TextPositionD, Text=filter_9, Colour=cfg_10.DisplacementColor)  # disabled
preview_def3d_2 = CustomPreview(Geometry=filter_13, Material=cfg_10.DeformationColor)  # disabled
intforcevalues_2 = TextTag(Location=baroutput.TextPositionF, Text=filter_10, Colour=cfg_10.ValuesColor)  # disabled

# ---- group: CABLE+ DARSTELLUNG
cfg_11 = ConfigurationPlusTunnel(Config=cfg)  # -> StiffnessRatio, Threshold, NumberOfDecimals, LineThickness, ModelColor, _3DModel, Hinges, HingeThickness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; disabled
cableoutput_2 = CableOutputPlus(CableData=merge_34, Config=cfg_11.Config_2)  # -> IP0, IP1, P0, P1, N, Deformation, AxialDiagramTension, TextPositionD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; disabled
saturationratio_3 = CSharpScript(Lines=cableoutput_2.LineS, satRatio=cableoutput_2.TensionRatio, b=cfg_11.SaturationRatio)  # -> out, p, l, t, i; inputs Lines: Line, satRatio: Double, b: Boolean; disabled
# ---------- saturationratio_3: C# ----------
// Grasshopper Script Instance
#region Usings
using System;
using System.Linq;
using System.Collections;
using System.Collections.Generic;
using System.Drawing;

using Rhino;
using Rhino.Geometry;
using Rhino.Display;

using Grasshopper;
using Grasshopper.Kernel;
using Grasshopper.Kernel.Data;
using Grasshopper.Kernel.Types;
#endregion

public class Script_Instance : GH_ScriptInstance
{
    #region Notes
    /* 
      Members:
        RhinoDoc RhinoDocument
        GH_Document GrasshopperDocument
        IGH_Component Component
        int Iteration

      Methods (Virtual & overridable):
        Print(string text)
        Print(string format, params object[] args)
        Reflect(object obj)
        Reflect(object obj, string method_name)
    */
    #endregion

    private void RunScript(
		Line Lines,
		double satRatio,
		bool b,
		ref object p,
		ref object l,
		ref object t,
		ref object i)
    {
        if (b == false)
            return;

        l = Lines;
                    
        Point3d pm;

        pm = 0.5 * (Lines.From + Lines.To);

        p = pm;

        t = Math.Round(satRatio * 100.0,0).ToString();

        if (satRatio < 0.0)
            i = 0;
        else
            i = Math.Min(8, Math.Floor(satRatio / 0.125));
    }
}
# ---------- end saturationratio_3 ----------
preview_def_3 = CSharpScript(L=flatten(cableoutput_2.Deformation), T=cfg_11.LineThickness, C=cfg_11.DeformationColor, b=cfg_11._3DDeformation)  # inputs L: list of Line, T: Int32, C: Color, b: Boolean; disabled; same code as preview_def_2
colors_for_saturation_grade_3 = ListItem(List=cfg_11.SaturationRatioColors, Index=saturationratio_3.i, Wrap=True)  # disabled
previewaxial_4 = CustomPreview(Geometry=cableoutput_2.AxialDiagramTension, Material=cfg_11.PositiveAxialColor)  # disabled
and_9 = GateAnd(A=cfg_11.Deformation, B=cfg_11._3DDeformation)  # disabled
bnd_3 = Bounds(Numbers=flatten(cableoutput_2.TensionRatio))  # disabled
filter_14 = StreamFilter(Gate=cfg_11.SaturationRatio, Stream1=saturationratio_3.t)  # disabled
filter_15 = StreamFilter(Gate=cfg_11.Displacements, Stream1=cableoutput_2.TextD)  # disabled
filter_16 = StreamFilter(Gate=cfg_11.DiagramValues, Stream1=cableoutput_2.TextF)  # disabled
filter_17 = StreamFilter(Gate=and_9, Stream1=cableoutput_2._3DGeometry)  # disabled
ln_26 = Line(StartPoint=cableoutput_2.IP0, EndPoint=cableoutput_2.IP1)  # disabled
not_11 = GateNot(A=cfg_11.SaturationRatio)  # disabled
filter_18 = StreamFilter(Gate=not_11, Stream1=ln_26)  # disabled
dedomain_3 = DeconstructDomain(Domain=bnd_3)  # -> Start, End; disabled
tag_3 = TextTag(Location=saturationratio_3.p, Text=filter_14, Colour=colors_for_saturation_grade_3)  # disabled
preview_geo_3 = CSharpScript(L=flatten(filter_18), T=cfg_11.LineThickness, C=cfg_11.ModelColor, b=cfg_11._3DModel)  # inputs L: list of Line, T: Int32, C: Color, b: Boolean; disabled; same code as preview_def_2
preview_def3d_3 = CustomPreview(Geometry=filter_17, Material=cfg_11.DeformationColor)  # disabled
preview_saturation_3 = CustomPreview(Geometry=saturationratio_3.l, Material=colors_for_saturation_grade_3)  # disabled
defvalues_3 = TextTag(Location=cableoutput_2.TextPositionD, Text=filter_15, Colour=cfg_11.DisplacementColor)  # disabled
intforcevalues_3 = TextTag(Location=cableoutput_2.TextPositionF, Text=filter_16, Colour=cfg_11.ValuesColor)  # disabled

# ---- group: BEAM+ UND STRECKENLASTEN DARSTELLUNG / BEAM+ DARSTELLUNG
beamoutput = BeamOutputPlus(BeamData=merge_33, Config=cfg_4.Config_2)  # -> IP0, IP1, P0, P1, N, Vy, Vz, Mt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; disabled
saturationratio_4 = CSharpScript(Lines=beamoutput.LineS, satRatio=beamoutput.TensionRatio, b=cfg_4.SaturationRatio)  # -> out, p, l, t, i; inputs Lines: Line, satRatio: Double, b: Boolean; disabled
# ---------- saturationratio_4: C# ----------
// Grasshopper Script Instance
#region Usings
using System;
using System.Linq;
using System.Collections;
using System.Collections.Generic;
using System.Drawing;

using Rhino;
using Rhino.Geometry;
using Rhino.Display;

using Grasshopper;
using Grasshopper.Kernel;
using Grasshopper.Kernel.Data;
using Grasshopper.Kernel.Types;
#endregion

public class Script_Instance : GH_ScriptInstance
{
    #region Notes
    /* 
      Members:
        RhinoDoc RhinoDocument
        GH_Document GrasshopperDocument
        IGH_Component Component
        int Iteration

      Methods (Virtual & overridable):
        Print(string text)
        Print(string format, params object[] args)
        Reflect(object obj)
        Reflect(object obj, string method_name)
    */
    #endregion

    private void RunScript(
		Line Lines,
		double satRatio,
		bool b,
		ref object p,
		ref object l,
		ref object t,
		ref object i)
    {
        if (b == false)
            return;

        l = Lines;
                    
        Point3d pm;

        pm = 0.5 * (Lines.From + Lines.To);

        p = pm;

        t = Math.Round(satRatio * 100.0, 0).ToString();

        if (satRatio < 0.0)
            i = 0;
        else
            i = Math.Min(8, Math.Floor(satRatio / 0.125));
    }
}
# ---------- end saturationratio_4 ----------
bnd_4 = Bounds(Numbers=flatten(beamoutput.TensionRatio))  # disabled
preview_def_4 = CSharpScript(L=flatten(beamoutput.Deformation), T=cfg_4.LineThickness, C=cfg_4.DeformationColor, b=cfg_4._3DDeformation)  # inputs L: list of Line, T: Int32, C: Color, b: Boolean; disabled; same code as preview_def_2
dedomain_4 = DeconstructDomain(Domain=bnd_4)  # -> Start, End; disabled
colors_for_saturation_grade_4 = ListItem(List=cfg_4.SaturationRatioColors, Index=saturationratio_4.i, Wrap=True)  # disabled
previewaxial_5 = CustomPreview(Geometry=beamoutput.AxialDiagramCompression, Material=cfg_4.NegativeAxialColor)  # disabled
previewaxial_6 = CustomPreview(Geometry=beamoutput.AxialDiagramTension, Material=cfg_4.PositiveAxialColor)  # disabled
previewshear = CustomPreview(Geometry=[beamoutput.ShearDiagramYSecondary, beamoutput.ShearDiagramZPrincipal], Material=cfg_4.ShearColor)  # disabled
previewmoment = CustomPreview(Geometry=[beamoutput.MomentDiagramYPrincipal, beamoutput.MomentDiagramZSecondary], Material=cfg_4.MomentColor)  # disabled
filter_19 = StreamFilter(Gate=cfg_4.SaturationRatio, Stream1=saturationratio_4.t)  # disabled
not_12 = GateNot(A=cfg_4.SaturationRatio)  # disabled
ln_27 = Line(StartPoint=beamoutput.IP0, EndPoint=beamoutput.IP1)  # disabled
filter_20 = StreamFilter(Gate=not_12, Stream1=ln_27)  # disabled
tag_4 = TextTag(Location=saturationratio_4.p, Text=filter_19, Colour=colors_for_saturation_grade_4)  # disabled
filter_21 = StreamFilter(Gate=cfg_4.Displacements, Stream1=beamoutput.TextD)  # disabled
filter_22 = StreamFilter(Gate=cfg_4.DiagramValues, Stream1=beamoutput.TextF)  # disabled
filter_23 = StreamFilter(Gate=and_3, Stream1=beamoutput._3DGeometry)  # disabled
hingedraw_2 = CSharpScript(
    x=beamoutput.IP0,
    y=beamoutput.IP1,
    color=cfg_4.HingeColor,
    thickness=cfg_4.HingeThickness,
    size=cfg_4.HingeSize,
    b=cfg_4.Hinges,
    iEnd=beamoutput.IEnd,
    jEnd=beamoutput.JEnd)  # inputs x: list of Plane, y: list of Plane, color: Color, thickness: Int32, size: Double, b: Boolean, iEnd: list of Int32, jEnd: list of Int32; disabled
# ---------- hingedraw_2: C# ----------
// Grasshopper Script Instance
#region Usings
using System;
using System.Linq;
using System.Collections;
using System.Collections.Generic;
using System.Drawing;

using Rhino;
using Rhino.Geometry;

using Grasshopper;
using Grasshopper.Kernel;
using Grasshopper.Kernel.Data;
using Grasshopper.Kernel.Types;
#endregion

public class Script_Instance : GH_ScriptInstance
{
    Color c;
    double s;
    int t;
    List <Plane> p; 
    bool draw_it;
    
    #region Notes
    /* 
      Members:
        RhinoDoc RhinoDocument
        GH_Document GrasshopperDocument
        IGH_Component Component
        int Iteration

      Methods (Virtual & overridable):
        Print(string text)
        Print(string format, params object[] args)
        Reflect(object obj)
        Reflect(object obj, string method_name)
    */
    #endregion

    private void RunScript(
		List<Plane> x,
		List<Plane> y,
		Color color,
		int thickness,
		double size,
		bool b,
		List<int> iEnd,
		List<int> jEnd)
    {
        if (x == null || y == null)
        {
            return;
        }

        draw_it = b;

        int n = x.Count();

        if (n != y.Count() || n!= iEnd.Count() || n!= jEnd.Count())
        {
            return;
        }
        p = new List<Plane>();

        for (int i = 0; i < n; i++)
        {
            switch(iEnd[i])
            {
                case 0:
                    break;
                case 1:
                    p.Add(new Plane(x[i].Origin, x[i].XAxis));
                    p.Add(new Plane(x[i].Origin, x[i].YAxis));
                    break;
                case 2:
                    p.Add(new Plane(x[i].Origin, x[i].XAxis));
                    break;
                case 3:
                    p.Add(new Plane(x[i].Origin, x[i].YAxis));
                    break;
            }
            
            switch(jEnd[i])
            {
                case 0:
                    break;
                case 1:
                    p.Add(new Plane(y[i].Origin, y[i].XAxis));
                    p.Add(new Plane(y[i].Origin, y[i].YAxis));
                    break;
                case 2:
                    p.Add(new Plane(y[i].Origin, y[i].XAxis));
                    break;
                case 3:
                    p.Add(new Plane(y[i].Origin, y[i].YAxis));
                    break;
            }
        }

        c = color;
        s = size;
        t = thickness;
    }

    public override BoundingBox ClippingBox => BoundingBox.Empty;

    public override void DrawViewportMeshes(IGH_PreviewArgs args)
    {
        base.DrawViewportMeshes(args);

        if (draw_it == false)
            return;

        int n = p.Count();

        Circle ci;

        for (int i = 0; i < n; i++)
        {
            ci = new Circle(p[i], s);
            args.Display.DrawCircle(ci, c, t);
        }
    }

    public override void DrawViewportWires(IGH_PreviewArgs args)
    {
    }
}
# ---------- end hingedraw_2 ----------
preview_geo_4 = CSharpScript(L=flatten(filter_20), T=cfg_4.LineThickness, C=cfg_4.ModelColor, b=cfg_4._3DModel)  # inputs L: list of Line, T: Int32, C: Color, b: Boolean; disabled; same code as preview_def_2
preview_def3d_4 = CustomPreview(Geometry=filter_23, Material=cfg_4.DeformationColor)  # disabled
preview_saturation_4 = CustomPreview(Geometry=saturationratio_4.l, Material=colors_for_saturation_grade_4)  # disabled
intforcevalues_4 = TextTag(Location=beamoutput.TextPositionF, Text=filter_22, Colour=cfg_4.ValuesColor)  # disabled
defvalues_4 = TextTag(Location=beamoutput.TextPositionD, Text=filter_21, Colour=cfg_4.DisplacementColor)  # disabled

# ---- group: AUFLAGER UND AUFLAGERREAKTIONEN DARSTELLUNG / AUFLAGER DARSTELLUNG
# Die Darstellung ist im GH-Code ganz einfach, weil die Komponente in C# anhand der festgelegten Bewegungen an jedem Stützpunkt entscheidet, welches 3D-Stützmodell dargestellt werden soll, es entsprechend dem Parameter skaliert und in der verformten Struktur mit der in den Einstellungen gewählten Farbe darstellt.
supportoutput = Support6DOFOutputPlus(Support6DOFData=bang_7.Branch0)  # -> SupportPlaneIni, SupportPlaneDef, ReactionForce, ReactionMoment, FixedComponents; disabled
geo = Geometry(auflager_darstellung)  # disabled
c_script_5 = CSharpScript(
    pI=supportoutput.SupportPlaneIni,
    pD=supportoutput.SupportPlaneDef,
    k=multiplication_12,
    s=supportoutput.FixedComponents,
    x=geo)  # -> out, pt, simplify(i); inputs pI: Plane, pD: Plane, k: Double, s: String, x: tree; disabled
# ---------- c_script_5: C# ----------
// Grasshopper Script Instance
#region Usings
using System;
using System.Linq;
using System.Collections;
using System.Collections.Generic;
using System.Drawing;

using Rhino;
using Rhino.Geometry;

using Grasshopper;
using Grasshopper.Kernel;
using Grasshopper.Kernel.Data;
using Grasshopper.Kernel.Types;

#endregion

public class Script_Instance : GH_ScriptInstance
{
    #region Notes
    /* 
      Members:
        RhinoDoc RhinoDocument
        GH_Document GrasshopperDocument
        IGH_Component Component
        int Iteration

      Methods (Virtual & overridable):
        Print(string text)
        Print(string format, params object[] args)
        Reflect(object obj)
        Reflect(object obj, string method_name)
    */
    #endregion

    private void RunScript(
		Plane pI,
		Plane pD,
		double k,
		string s,
		DataTree<object> x,
		ref object pt,
		ref object i)
    {
        // Write your logic here
        i = null;
        
        // b = [dx, dy, dz, rx, ry, rz]
        // The visualization supposes an array of 16 differente
        // types of support, considering always dz=true and rz = true.
        // Only dx, dy, rx and ry are relevant.
        
        // The index is calculated from the binary values of
        // the corresponing indices
        
        int[] v = new int[4];

        if (s[0] == '1')
            v[0] = 1;
        else
            v[0] = 0;
        if (s[1] == '1')
            v[1] = 1;
        else
            v[1] = 0;
       if (s[3] == '1')
            v[2] = 1;
        else
            v[2] = 0;
       if (s[4] == '1')
            v[3] = 1;
        else
            v[3] = 0;
              
        int n = (int) (1 * v[0] + 2 * v[1] + 4 * v[2] + 8 * v[3]);
        i = x.Branch(n);

        Vector3d def = pD.Origin - pI.Origin;
        def *= k;
        pt = pI.Origin + def;
    }


}
# ---------- end c_script_5 ----------
scale = Scale(Geometry=c_script_5.i, Center=Point(0, 0, 0), Factor=cfg_5.SupportSize)  # -> Geometry, Transform; disabled
move_7 = Move(Geometry=scale.Geometry, Motion=graft(c_script_5.pt))  # -> Geometry, Transform; disabled
filter_24 = StreamFilter(Gate=cfg_5.SupportRepresentation, Stream1=move_7.Geometry)  # disabled
preview_2 = CustomPreview(Geometry=filter_24, Material=cfg_5.SupportColor)  # disabled

# ---- group: PUNKTLASTEN DARSTELLUNG / PUNKTLASTEN (KRÄFTE UND MOMENTE) DARSTELLUNG
# Die Darstellung der Lasten ist echt einfach. Fast die ganze Arbeit macht die Komponente „LoadDisplay+“. Um das so zu vereinfachen, musste ich die Komponente „Load“ neu programmieren.
loadoutput = LoadOutputPlus(LoadData=bang_7.Branch1)  # -> InitialPosition, FinalPosition, Load, IsMoment, IsVisible; disabled
and_10 = GateAnd(A=cfg_3.Deformation, B=cfg_3.LoadsOnDeformedShape)  # disabled
c_script_6 = CSharpScript(
    pI=loadoutput.InitialPosition,
    pF=loadoutput.FinalPosition,
    L=loadoutput.Load,
    isM=loadoutput.IsMoment,
    kStiff=multiplication_13,
    bOnDef=and_10,
    bDecom=cfg_3.LoadsDecomposed,
    bVis=loadoutput.IsVisible)  # -> out, pt, load, bM, num; inputs pI: list of Point3d, pF: list of Point3d, L: list of Vector3d, isM: list of Boolean, kStiff: Double, bOnDef: Boolean, bDecom: Boolean, bVis: list of Boolean; disabled
# ---------- c_script_6: C# ----------
// Grasshopper Script Instance
#region Usings
using System;
using System.Linq;
using System.Collections;
using System.Collections.Generic;
using System.Drawing;

using Rhino;
using Rhino.Geometry;

using Grasshopper;
using Grasshopper.Kernel;
using Grasshopper.Kernel.Data;
using Grasshopper.Kernel.Types;
#endregion

public class Script_Instance : GH_ScriptInstance
{
    #region Notes
    /* 
      Members:
        RhinoDoc RhinoDocument
        GH_Document GrasshopperDocument
        IGH_Component Component
        int Iteration

      Methods (Virtual & overridable):
        Print(string text)
        Print(string format, params object[] args)
        Reflect(object obj)
        Reflect(object obj, string method_name)
    */
    #endregion

    private void RunScript(
		List<Point3d> pI,
		List<Point3d> pF,
		List<Vector3d> L,
		List<bool> isM,
		double kStiff,
		bool bOnDef,
		bool bDecom,
		List<bool> bVis,
		ref object pt,
		ref object load,
		ref object bM,
		ref object num)
    {
        int numLoads = pI.Count();
        Vector3d def;
        int i, j;
        int n = 0;
        int nf = 0;
        int nm = 0;
        int naf = 0;
        int nam = 0;
        Point3d ap;
        Vector3d af;
        Vector3d afd;
        Vector3d am;
        Vector3d amd;

        if (numLoads < 1)
            return;

        if (pF.Count() == numLoads && L.Count() == numLoads && isM.Count() == numLoads && bVis.Count() == numLoads)
        {
            // First of all, divide the list in forces and moments
            Point3d[] pIf = new Point3d[numLoads];
            Point3d[] pIm = new Point3d[numLoads];
            Point3d[] pFf = new Point3d[numLoads];
            Point3d[] pFm = new Point3d[numLoads];
            Vector3d[] lf = new Vector3d[numLoads];
            Vector3d[] lm = new Vector3d[numLoads];

            // Copy the input points and loads (in separate arrays), to manage later the accummulation of loads
            for (i = 0; i < numLoads; i++)
            {
                if (bVis[i])
                {
                    if (isM[i] == true)
                    {
                        pIm[nm] = pI[i];
                        pFm[nm] = pF[i];
                        lm[nm] = L[i];
                        nm += 1;
                    }
                    else
                    {
                        pIf[nf] = pI[i];
                        pFf[nf] = pF[i];
                        lf[nf] = L[i];
                        nf += 1;
                    }                
                }
            }

            // Now, let's accummulate all the forces acting on the same point
            naf = 0;
            for (i = 0; i < nf; i++)
            {
                // The load lf may be null, if it is already accummulated on previous point
                if (lf[i].Length > 0.1)     // 0.1kN is the minimum force to consider
                {
                    ap = pIf[i];
                    
                    for (j = i + 1; j < nf; j++)
                    {
                        if (ap.DistanceTo(pIf[j]) < 0.01)    // 1cm tolerance
                        {
                            lf[i] = lf[i] + lf[j];

                            // As it has been already accummulated, make it null
                            lf[j].X = 0.0;
                            lf[j].Y = 0.0;
                            lf[j].Z = 0.0;
                            
                            // Increment one accummulation
                            naf += 1;
                        }
                    }
                }
            }

            // Now, let's accummulate all the moments acting on the same point
            nam = 0;
            for (i = 0; i < nm; i++)
            {
                // The load lf may be null, if it is already accummulated on previous point
                if (lm[i].Length > 0.1)     // 0.1kN is the minimum force to consider
                {
                    ap = pIm[i];

                    for (j = i + 1; j < nm; j++)
                    {
                        if (ap.DistanceTo(pIm[j]) < 0.01)    // 1cm tolerance
                        {
                            lm[i] = lm[i] + lm[j];

                            // As it has been already accummulated, make it null
                            lm[j].X = 0.0;
                            lm[j].Y = 0.0;
                            lm[j].Z = 0.0;

                            // Increment one accummulation
                            nam += 1;
                        }
                    }
                }
            }

            Print("nF " + (nf-naf).ToString());
            Print("nM " + (nm-nam).ToString());

            for (i = 0; i < nf; i++)
                Print("F(" + i + ") = " + lf[i]);

            // Now, we have all the forces accummulated in nf points, and all the moments accummulated in nm points

            List<Point3d> pts = new List<Point3d>();
            List<Vector3d> loads = new List<Vector3d>();
            List<bool> isMoment = new List<bool>();
            
            // Generate the forces, and when decomposed, generate the necessary components
            for (i = 0; i < nf; i++)
            {
                if (lf[i].Length > 0.1)     // 0.1kN is the minimum force to consider
                {
                    if (bOnDef)
                    {
                        // Draw Load at deformed shape
                        def = pFf[i] - pIf[i];
                        def = def * kStiff;
                    }
                    else
                    {
                        // Draw Load at original shape
                        def = new Vector3d(0.0, 0.0, 0.0);
                    }
                            
                    if (bDecom)
                    {
                        // Decompose vector in 3 directions,if neccesary
                        afd = lf[i];

                        if (Math.Abs(lf[i].X) > 0.1)
                        {
                            afd.X = lf[i].X;
                            afd.Y = 0.0;
                            afd.Z = 0.0;

                            pts.Add(pIf[i] + def);
                            loads.Add(afd);
                            isMoment.Add(false);
                            n = n + 1;
                        }
                        
                        if (Math.Abs(lf[i].Y) > 0.1)
                        {
                            afd.X = 0.0;
                            afd.Y = lf[i].Y;
                            afd.Z = 0.0;

                            pts.Add(pIf[i] + def);
                            loads.Add(afd);
                            isMoment.Add(false);
                            n = n + 1;
                        }

                        if (Math.Abs(lf[i].Z) > 0.1)
                        {
                            afd.X = 0.0;
                            afd.Y = 0.0;
                            afd.Z = lf[i].Z;

                            pts.Add(pIf[i] + def);
                            loads.Add(afd);
                            isMoment.Add(false);
                            n = n + 1;
                        }
                    }
                    else
                    {
                        pts.Add(pIf[i] + def);
                        loads.Add(lf[i]);
                        isMoment.Add(false);
                        n = n + 1;
                    }
                }
            }

            pt = pts;
            load = loads;

            // Generate the moments, and when decomposed, generate the necessary components
            for (i = 0; i < nm; i++)
            {
                if (lm[i].Length > 0.1)     // 0.1kNm is the minimum moment to consider
                {
                    if (bOnDef)
                    {
                        // Draw Load at deformed shape
                        def = pFm[i] - pIm[i];
                        def = def * kStiff;
                    }
                    else
                    {
                        // Draw Load at original shape
                        def = new Vector3d(0.0, 0.0, 0.0);
                    }
                            
                    if (bDecom)
                    {
                        // Decompose vector in 3 directions,if neccesary
                        amd = lm[i];

                        if (Math.Abs(lm[i].X) > 0.1)
                        {
                            amd.X = lm[i].X;
                            amd.Y = 0.0;
                            amd.Z = 0.0;

                            pts.Add(pIm[i] + def);
                            loads.Add(amd);
                            isMoment.Add(true);
                            n = n + 1;
                        }
                        
                        if (Math.Abs(lm[i].Y) > 0.1)
                        {
                            amd.X = 0.0;
                            amd.Y = lm[i].Y;
                            amd.Z = 0.0;

                            pts.Add(pIm[i] + def);
                            loads.Add(amd);
                            isMoment.Add(true);
                            n = n + 1;
                        }

                        if (Math.Abs(lm[i].Z) > 0.1)
                        {
                            amd.X = 0.0;
                            amd.Y = 0.0;
                            amd.Z = lm[i].Z;

                            pts.Add(pIm[i] + def);
                            loads.Add(amd);
                            isMoment.Add(true);
                            n = n + 1;
                        }
                    }
                    else
                    {
                        pts.Add(pIm[i] + def);
                        loads.Add(lm[i]);
                        isMoment.Add(true);
                        n = n + 1;
                    }
                }
            }

            pt = pts;
            load = loads;
            bM = isMoment;
        }

        num = n;
    }
}
# ---------- end c_script_6 ----------
loaddisplay = LoadVisualisationPlus(
    Position=c_script_6.pt,
    Load=c_script_6.load,
    Scale=cfg_3.LoadSize,
    ConeRadius=0.25,
    ConeHeight=0.5,
    CylinderRadius=0.075,
    TipOnPoint=cfg_3.TipOnPoint,
    IsMoment=c_script_6.bM)  # -> Loads, LoadsMoments; disabled
filter_25 = StreamFilter(Gate=cfg_3.LoadRepresentation, Stream1=loaddisplay.LoadsMoments)  # disabled
filter_26 = StreamFilter(Gate=cfg_3.LoadRepresentation, Stream1=loaddisplay.Loads)  # disabled
preview_3 = CustomPreview(Geometry=filter_25, Material=hsl_2)  # disabled
preview_4 = CustomPreview(Geometry=filter_26, Material=cfg_3.LoadColor)  # disabled

# ---- group: AUFLAGER UND AUFLAGERREAKTIONEN DARSTELLUNG / AUFLAGER REAKTIONEN DARSTELLUNG
# Die Darstellung der Reaktionen ist etwas aufwendiger. Zuerst musst du die Reaktion (die ein 3D-Vektor ist) in ihre drei Komponenten zerlegen, um die entsprechenden Pfeile zu zeichnen. Das Gleiche machst du mit den Momenten (siehe dazu den Hinweis in der Konfigurationsgruppe für die Darstellung).
X_4 = UnitX(Factor=1)  # disabled
Y_7 = UnitY(Factor=1)  # disabled
Z_13 = UnitZ(Factor=1)  # disabled
and_11 = GateAnd(A=cfg_5.Deformation, B=cfg_5.LoadsOnDeformedShape)  # disabled
and_12 = GateAnd(A=cfg_5.Deformation, B=cfg_5.LoadsOnDeformedShape)  # disabled
X_5 = UnitX(Factor=1)  # disabled
Y_8 = UnitY(Factor=1)  # disabled
Z_14 = UnitZ(Factor=1)  # disabled
multiplication_17 = Multiplication(A=supportoutput.ReactionMoment, B=Y_7)  # disabled
multiplication_18 = Multiplication(A=supportoutput.ReactionMoment, B=Z_13)  # disabled
multiplication_19 = Multiplication(A=supportoutput.ReactionMoment, B=X_4)  # disabled
c_script_7 = CSharpScript(pI=supportoutput.SupportPlaneIni, pF=supportoutput.SupportPlaneDef, k=multiplication_12, b=and_11)  # -> out, pt; inputs pI: Point3d, pF: Point3d, k: Double, b: Boolean; disabled
# ---------- c_script_7: C# ----------
// Grasshopper Script Instance
#region Usings
using System;
using System.Linq;
using System.Collections;
using System.Collections.Generic;
using System.Drawing;

using Rhino;
using Rhino.Geometry;

using Grasshopper;
using Grasshopper.Kernel;
using Grasshopper.Kernel.Data;
using Grasshopper.Kernel.Types;
#endregion

public class Script_Instance : GH_ScriptInstance
{
    #region Notes
    /* 
      Members:
        RhinoDoc RhinoDocument
        GH_Document GrasshopperDocument
        IGH_Component Component
        int Iteration

      Methods (Virtual & overridable):
        Print(string text)
        Print(string format, params object[] args)
        Reflect(object obj)
        Reflect(object obj, string method_name)
    */
    #endregion

    private void RunScript(Point3d pI, Point3d pF, double k, bool b, ref object pt)
    {
        if (b)
        {
            Vector3d def = pF - pI;
            def = def * k;
            pt = pI + def;
        }
        else
            pt = pI;
    }
}
# ---------- end c_script_7 ----------
c_script_8 = CSharpScript(pI=supportoutput.SupportPlaneIni, pF=supportoutput.SupportPlaneDef, k=multiplication_12, b=and_12)  # -> out, pt; inputs pI: Point3d, pF: Point3d, k: Double, b: Boolean; disabled; same code as c_script_7
multiplication_20 = Multiplication(A=supportoutput.ReactionForce, B=X_5)  # disabled
multiplication_21 = Multiplication(A=supportoutput.ReactionForce, B=Y_8)  # disabled
multiplication_22 = Multiplication(A=supportoutput.ReactionForce, B=Z_14)  # disabled
X_6 = UnitX(Factor=multiplication_19)  # disabled
Y_9 = UnitY(Factor=multiplication_17)  # disabled
Z_15 = UnitZ(Factor=multiplication_18)  # disabled
X_7 = UnitX(Factor=multiplication_20)  # disabled
Y_10 = UnitY(Factor=multiplication_21)  # disabled
Z_16 = UnitZ(Factor=multiplication_22)  # disabled
merge_36 = Merge(Data1=c_script_8.pt, Data2=c_script_8.pt, Data3=c_script_8.pt)  # disabled
merge_37 = Merge(Data1=c_script_7.pt, Data2=c_script_7.pt, Data3=c_script_7.pt)  # disabled
pdecon_5 = Deconstruct(Point=X_6)  # -> XComponent, YComponent, ZComponent; disabled
pdecon_6 = Deconstruct(Point=Y_9)  # -> XComponent, YComponent, ZComponent; disabled
pdecon_7 = Deconstruct(Point=Z_15)  # -> XComponent, YComponent, ZComponent; disabled
pdecon_8 = Deconstruct(Point=X_7)  # -> XComponent, YComponent, ZComponent; disabled
pdecon_9 = Deconstruct(Point=Y_10)  # -> XComponent, YComponent, ZComponent; disabled
pdecon_10 = Deconstruct(Point=Z_16)  # -> XComponent, YComponent, ZComponent; disabled
loaddisplay_2 = LoadVisualisationPlus(
    Position=merge_37,
    Load=[X_7, Z_16, Y_10],
    Scale=cfg_5.LoadSize,
    ConeRadius=0.25,
    ConeHeight=0.5,
    CylinderRadius=0.075,
    TipOnPoint=cfg_5.TipOnPoint,
    IsMoment=False)  # -> Loads, LoadsMoments; disabled
loaddisplay_3 = LoadVisualisationPlus(
    Position=merge_36,
    Load=[X_6, Z_15, Y_9],
    Scale=cfg_5.LoadSize,
    ConeRadius=0.25,
    ConeHeight=0.5,
    CylinderRadius=0.075,
    TipOnPoint=cfg_5.TipOnPoint,
    IsMoment=True)  # -> Loads, LoadsMoments; disabled
and_13 = GateAnd(A=cfg_5.ForceReactionRepresentation, B=cfg_5.ReactionValues)  # disabled
and_14 = GateAnd(A=cfg_5.MomentReactionRepresentation, B=cfg_5.ReactionValues)  # disabled
eval_4 = Evaluate(
    E="Format(\"[\"&If(x>0,\"+\",\"\")&Round(x,d)&\",\"&If(y>0,\"+\",\"\")&Round(y,d)&\",\"&If(z>0,\"+\",\"\")&Round(z,d)&\"]\")",
    x=pdecon_8.XComponent,
    y=pdecon_9.YComponent,
    z=pdecon_10.ZComponent,
    d=cfg_5.NumberOfDecimals)  # disabled
eval_5 = Evaluate(
    E="Format(\"[\"&If(x>0,\"+\",\"\")&Round(x,d)&\",\"&If(y>0,\"+\",\"\")&Round(y,d)&\",\"&If(z>0,\"+\",\"\")&Round(z,d)&\"]\")",
    x=pdecon_5.XComponent,
    y=pdecon_6.YComponent,
    z=pdecon_7.ZComponent,
    d=cfg_5.NumberOfDecimals)  # disabled
filter_27 = StreamFilter(Gate=and_13, Stream1=eval_4)  # disabled
filter_28 = StreamFilter(Gate=cfg_5.ForceReactionRepresentation, Stream1=loaddisplay_2.Loads)  # disabled
filter_29 = StreamFilter(Gate=cfg_5.MomentReactionRepresentation, Stream1=loaddisplay_3.LoadsMoments)  # disabled
filter_30 = StreamFilter(Gate=and_14, Stream1=eval_5)  # disabled
tag_5 = TextTag(Location=c_script_7.pt, Text=filter_27, Colour=cfg_5.ReactionValueColor)  # disabled
tag_6 = TextTag(Location=c_script_7.pt, Text=filter_30, Colour=cfg_5.ReactionValueColor)  # disabled
preview_5 = CustomPreview(Geometry=filter_28, Material=cfg_5.ReactionColor)  # disabled
preview_6 = CustomPreview(Geometry=filter_29, Material=hsl)  # disabled

# ---- group: BEAM+ UND STRECKENLASTEN DARSTELLUNG / STRECKENLASTEN BEI BEAM+ DARSTELLUNG
ahsl_5 = SplitAHSL(Colour=cfg_4.LoadColor)  # -> Alpha, Hue, Saturation, Luminance; disabled
hsl_5 = ColourHSL(Alpha=ahsl_5.Alpha, Hue=ahsl_5.Hue, Saturation=ahsl_5.Saturation, Luminance=expr("0.67*x", ahsl_5.Luminance))  # disabled
hsl_6 = ColourHSL(
    Alpha=expr("0.33*x", ahsl_5.Alpha),
    Hue=ahsl_5.Hue,
    Saturation=ahsl_5.Saturation,
    Luminance=expr("0.67*x", ahsl_5.Luminance))  # disabled
previewload_arrows = CSharpScript(L=flatten(beamoutput.ArrowsInLoadRepresentation), T=cfg_4.LineThickness, C=hsl_5)  # inputs L: list of Line, T: Int32, C: Color, b: Boolean; disabled; same code as preview_def_2
previewload_surface = CustomPreview(Geometry=beamoutput.LoadRepresentation, Material=hsl_6)  # disabled

# ---- group: SPANNUNGSRATIO
# Hier wird überprüft ob die Spannungen in irgendeinen Element zu groß sind, und deshalb die Wiederstandsfähigkeit nicht überstanden wird.
mergesaturations = Merge(Data1=dedomain_4.End, Data2=dedomain_3.End, Data3=dedomain_2.End)  # disabled
number_slider_16 = Slider(15, range=0..30)  # disabled
vp_height_2 = Integer(c_script.H)  # disabled
panel_75 = Panel("1000")  # disabled
panel_76 = Panel("""SPANNUNGEN ZU GROß!!!
Es gibt Elemente mit einem Spannungsratio über 100%. """)  # disabled
bnd_5 = Bounds(Numbers=mergesaturations)  # disabled
division_14 = Division(A=vp_height_2, B=panel_75)  # disabled
dedomain_5 = DeconstructDomain(Domain=bnd_5)  # -> Start, End; disabled
multiplication_23 = Multiplication(A=number_slider_16, B=division_14)  # disabled
textfaktor = Number(division_14)  # disabled
panel_77 = Panel("1.0")  # disabled
panel_78 = Panel("Arial Fett")  # disabled
larger = LargerThan(FirstNumber=dedomain_5.End, SecondNumber=panel_77)  # -> LargerThan, OrEqualTo; disabled
panel_79 = Panel("30")  # disabled
panel_80 = Panel("60")  # disabled
multiplication_24 = Multiplication(A=panel_79, B=textfaktor)  # disabled
multiplication_25 = Multiplication(A=panel_80, B=textfaktor)  # disabled
panel_81 = Panel(" ")  # disabled
swatch = ColourSwatch(SwatchColor=RGB(255, 255, 0))  # disabled
filter_31 = StreamFilter(Gate=larger.LargerThan, Stream0=panel_81, Stream1=panel_76)  # disabled
pt_11 = ConstructPoint(XCoordinate=multiplication_24, YCoordinate=multiplication_25, ZCoordinate=0)  # disabled
texttoscreen = RenderTextToScreen(Text=filter_31, Location=pt_11, Size=multiplication_23, Color=swatch, Font=panel_78, m_scWithvp=False)  # disabled

# ---- group: STÜTZLINIE DES RAHMENS
# Das ist um die Stützlinie des Rahmens zu zeichnen.
# 
# Ich habe es ein bisschen vereinfacht.
# 
# Guck mal, welche Eingabedaten es braucht um die Stützlinie automatisch zu zeichnen.
ptc = Point(C)  # disabled
pta = Point(A)  # disabled
ptb = Point(B)  # disabled
ptd = Point(D)  # disabled
vz = Number(beamoutput.Vz)  # disabled
my0 = Number(beamoutput.My0)  # disabled
my1 = Number(beamoutput.My1)  # disabled
streckenlast_im_träger = Number(streckenlast_träger_qz_kn_m)  # disabled
item_26 = ListItem(List=flatten(my0), Index=0, Wrap=True)  # disabled
item_27 = ListItem(List=flatten(my0), Index=1, Wrap=True)  # disabled
item_28 = ListItem(List=flatten(my1), Index=0, Wrap=True)  # disabled
item_29 = ListItem(List=flatten(my1), Index=1, Wrap=True)  # disabled
item_30 = ListItem(List=vz, Index=0, Wrap=True)  # disabled
item_31 = ListItem(List=vz, Index=1, Wrap=True)  # disabled
anzahl_von_segmente_der_stützlinie = Slider(32, range=16..64)  # disabled
quea = Number(item_30)  # disabled
queb = Number(item_31)  # disabled
neg_13 = Negative(Value=item_28)  # disabled
neg_14 = Negative(Value=item_27)  # disabled
stützlinie_darstellen = BooleanToggle(True)  # disabled
addition_4 = Addition(A=quea, B=queb)  # disabled
momb = Number(neg_14)  # disabled
momc = Number(neg_13)  # disabled
momd = Number(item_29)  # disabled
moma = Number(item_26)  # disabled
c_script_9 = CSharpScript(
    A=pta,
    B=ptb,
    C=ptc,
    D=ptd,
    sumH=addition_4,
    Ma=moma,
    Mb=momb,
    Mc=momc,
    Md=momd,
    q=streckenlast_im_träger,
    segmente=anzahl_von_segmente_der_stützlinie)  # -> out, n, lines; inputs A: Point3d, B: Point3d, C: Point3d, D: Point3d, sumH: Double, Ma: Double, Mb: Double, Mc: Double, Md: Double, q: Double, segmente: Int32; disabled
# ---------- c_script_9: C# ----------
// Grasshopper Script Instance
#region Usings
using System;
using System.Linq;
using System.Collections;
using System.Collections.Generic;
using System.Drawing;

using Rhino;
using Rhino.Geometry;

using Grasshopper;
using Grasshopper.Kernel;
using Grasshopper.Kernel.Data;
using Grasshopper.Kernel.Types;
#endregion

public class Script_Instance : GH_ScriptInstance
{
    #region Notes
    /* 
      Members:
        RhinoDoc RhinoDocument
        GH_Document GrasshopperDocument
        IGH_Component Component
        int Iteration

      Methods (Virtual & overridable):
        Print(string text)
        Print(string format, params object[] args)
        Reflect(object obj)
        Reflect(object obj, string method_name)
    */
    #endregion

    private void RunScript(
		Point3d A,
		Point3d B,
		Point3d C,
		Point3d D,
		double sumH,
		double Ma,
		double Mb,
		double Mc,
		double Md,
		double q,
		int segmente,
		ref object n,
		ref object lines)
    {
        n = null;

        if (Math.Abs(sumH) > 5.0)
        {
            n = 0;
            Print("Es kann keine Stützlinine berechnet werden, weil horizontale Lasten vorhanden sind.");
            return;
        }

        double[] x = new double[4];
        double[] y = new double[4];
        bool[] valid = new bool[4];
        double l;
        double k;
        int np = 0;
        Point3d[] px = new Point3d[4];

        // Zuerst berechnen wir der Schnittpunkt an der linken Stütze
        l = A.DistanceTo(C);
        // Wir gehen davon aus, dass Ma positiv, und Mc negativ ist
        k = Ma / (Ma - Mc);

        if (k < -0.0001 || k > 1.0001)
            valid[0] = false;
        else
        {
            px[0].X = A.X + k * (C.X - A.X);
            px[0].Y = A.Y + k * (C.Y - A.Y);
            px[0].Z = A.Z + k * (C.Z - A.Z);

            valid[0] = true;
            np = np + 1;
        }

        // Dann der Schnittpunkt an der rechten Stütze
        l = B.DistanceTo(D);
        // Wir gehen davon aus, dass Mb positiv, und Md negativ ist
        k = Mb / (Mb - Md);

        if (k < -0.0001 || k > 1.0001)
            valid[1] = false;
        else
        {
            px[1].X = B.X + k * (D.X - B.X);
            px[1].Y = B.Y + k * (D.Y - B.Y);
            px[1].Z = B.Z + k * (D.Z - B.Z);

            valid[1] = true;
            np = np + 1;
        }

        if (np < 2)
        {
            n = np;
            Print("Nicht die notwendige Schnittpunkte der Momentenlinie an den Stützen gedunden.");
            return;
        }

        // Jetzt müssen wir die Parabelformel erstellen, um die Schnittpunkte der Parabel zu berechnen
        l = C.DistanceTo(D);
        double a = 0.0;
        double b = Mc;
        double c = l / 2.0;
        double d = (Mc + Md) / 2.0 + q * l * l / 8.0;
        double e = l;
        double f = Md;

        double den1 = (a * a - a * (c + e) + c * e) * (e - c);
        double den2 = c - e;

        double x1;
        double x2;
        double pa;
        double pb;
        double pc;

        if (Math.Abs(den1) > 0.00001 && Math.Abs(den2) > 0.00001)
        {
            pa = a * (d - f) + b * (e - c) + c * f - d * e;
            pa = pa / den1;

            pb = a * a * (d - f) + b * (c + e) * (e - c) + c * c * f - d * e * e;
            pb = -pb / den1;

            pc = c * e * (a * (d - f) + b * (e - c) + c * f - d * e);
            pc = pc / den1;
            pc = pc + e * (f - d) / (c - e) + f;

            // Jetzt kann man die Nullstellen der Parabel des Momentes
            x1 = (- pb - Math.Sqrt(pb * pb - 4 * pa * pc)) / (2 * pa);
            x2 = (- pb + Math.Sqrt(pb * pb - 4 * pa * pc)) / (2 * pa);

            if (x1 > x2)
            {
                double t = x2;
                x2 = x1;
                x1 = t;
            }

            k = x1 / l;

            if (k < -0.0001 || k > 1.0001)
                valid[2] = false;
            else
            {
                px[2].X = C.X + k * (D.X - C.X);
                px[2].Y = C.Y + k * (D.Y - C.Y);
                px[2].Z = C.Z + k * (D.Z - C.Z);

                valid[2] = true;
                np = np + 1;
            }        

            k = x2 / l;

            if (k < -0.0001 || k > 1.0001)
                valid[3] = false;
            else
            {
                px[3].X = C.X + k * (D.X - C.X);
                px[3].Y = C.Y + k * (D.Y - C.Y);
                px[3].Z = C.Z + k * (D.Z - C.Z);

                valid[3] = true;
                np = np + 1;
            }        
        }
        else
        {
            n = np;
            Print("Es ist ein Fehler aufgetreten. Mann kann die Stützlinie nicht berechnen.");
            return;
        }

        // Jetzt haben wir die Schnittpunkte. Wir brauchen 3 um die Parabel der Stützlinie (Bogen) zu berechnen.

        if (np >= 3)
        {
            // Jetzt berechnen wir die Parabel der Stüzlinie
            // Wir gehen davon aus, dass der Rahmen (und deshalb, die Stützlinie) im XZ Ebene liegt
            int i = 0;
            int j = 0;

            double[] xv = new double[4];
            double[] zv = new double[4];

            double x_min = 999.99;
            double x_max = -999.99;

            // Wir brauchen die erste drei korrekte Schnittpunkte
            for (i = 0; i < 4; i++)
            {
                if (valid[i])
                {
                    // Wir gehen davon aus, dass der Rahmen (und deshalb, die Stützlinie) im XZ Ebene liegt
                    xv[j] = px[i].X;
                    zv[j] = px[i].Z;
                    j = j + 1;

                    x_min = Math.Min(x_min, xv[i]);
                    x_max = Math.Max(x_max, xv[i]);
                }
            }

            a = xv[0];
            b = zv[0];
            c = xv[1];
            d = zv[1];
            e = xv[2];
            f = zv[2];

            den1 = (a * a - a * (c + e) + c * e) * (e - c);
            den2 = c - e;

            if (Math.Abs(den1) > 0.00001 && Math.Abs(den2) > 0.00001)
            {
                pa = a * (d - f) + b * (e - c) + c * f - d * e;
                pa = pa / den1;

                pb = a * a * (d - f) + b * (c + e) * (e - c) + c * c * f - d * e * e;
                pb = -pb / den1;

                pc = c * e * (a * (d - f) + b * (e - c) + c * f - d * e);
                pc = pc / den1;
                pc = pc + e * (f - d) / (c - e) + f;

                // Das sind die Gleichungen für die Tangenten an beiden Enden der Stützlinie
                double m1 = 2.0 * pa * xv[0] + pb;
                double m2 = 2.0 * pa * xv[1] + pb;
                double b1 = zv[0] - m1 * xv[0];
                double b2 = zv[1] - m2 * xv[1];

                // Jetzt berechnen wir die "Bodenlinie", das ist die Linie die
                // beide Auflager verbindet (normallerweise der X-Achse)
                double m3 = (B.Z - A.Z) / (B.X - A.X);
                double b3 = B.Z - m3 * B.X;

                // Die Schnittpunkte zwischen den Tangenten und die Bodelinie 
                double xx1;
                double zz1;
                double xx2;
                double zz2;

                // Wir gehen davon aus, dass der Rahmen (und deshalb, die Stützlinie) im XZ Ebene liegt
                // oder parallel zur globallen XZ Ebene
                double yyy = A.Y;

                xx1 = (b3 - b1) / (m1 - m3);
                zz1 = m1 * xx1 + b1;

                xx2 = (b3 - b2) / (m2 - m3);
                zz2 = m2 * xx2 + b2;

                Line[] sLine = new Line[segmente + 2];

                sLine[0].From = new Point3d(xx1, yyy, zz1);
                sLine[0].To = new Point3d(xv[0], yyy, zv[0]);
                sLine[1].From = new Point3d(xx2, yyy, zz2);
                sLine[1].To = new Point3d(xv[1], yyy, zv[1]);

                double xxx;
                double stepX = (x_max - x_min) / segmente;

                xxx = x_min;
                for (i = 0; i < segmente; i++)
                {
                    sLine[i + 2].From = new Point3d(xxx, yyy, pa * xxx * xxx + pb * xxx + pc);
                    xxx += stepX;
                    sLine[i + 2].To = new Point3d(xxx, yyy, pa * xxx * xxx + pb * xxx + pc);
                }

                lines = sLine;
                n = np;
            }
            else
            {
                Print("Es ist ein Fehler aufgetreten. Mann kann die Stützlinie nicht berechnen.");
                n = np;
                return;
            }
        }        
    }
}
# ---------- end c_script_9 ----------
swatch_2 = ColourSwatch(SwatchColor=RGB(3, 81, 194))  # disabled
liniengrösse = Slider(5, range=0..10)  # disabled
panel_82 = Panel(c_script_9.out)  # disabled
filter_32 = StreamFilter(Gate=stützlinie_darstellen, Stream1=c_script_9.lines)  # disabled
preview_geo_5 = CSharpScript(L=flatten(filter_32), T=liniengrösse, C=swatch_2, b=False)  # inputs L: list of Line, T: Int32, C: Color, b: Boolean; disabled; same code as preview_def_2

# ---- group: Geometrie
multiplication_26 = Multiplication(A=ma_4.PartialResults, B=addition_2)
pt_12 = ConstructPoint(XCoordinate=0, YCoordinate=0, ZCoordinate=0)
Z_17 = UnitZ(Factor=multiplication_26)
move_8 = Move(Geometry=pt_12, Motion=Z_17)  # -> Geometry, Transform
multiplication_27 = Multiplication(A=ma_3.PartialResults, B=multiplication_7)
item_32 = ListItem(List=move_8.Geometry, Index=-1, Wrap=True)
Y_11 = UnitY(Factor=multiplication_27)
move_9 = Move(Geometry=item_32, Motion=Y_11)  # -> Geometry, Transform
item_33 = ListItem(List=move_8.Geometry, Index=-2, Wrap=True)
item_34 = ListItem(List=move_9.Geometry, Index=0, Wrap=True)
cull_i_21 = CullIndex(List=move_9.Geometry, Indices=-1, Wrap=True)
item_35 = ListItem(List=move_9.Geometry, Index=-1, Wrap=True)
pdecon_11 = Deconstruct(Point=item_33)  # -> XComponent, YComponent, ZComponent
pdecon_12 = Deconstruct(Point=item_34)  # -> XComponent, YComponent, ZComponent
ln_28 = Line(StartPoint=item_35, EndPoint=item_32)
pt_13 = ConstructPoint(XCoordinate=pdecon_11.XComponent, YCoordinate=pdecon_12.YComponent, ZCoordinate=pdecon_11.ZComponent)
midpt_5 = CurveMiddle(Curve=ln_28)
Z_18 = UnitZ(Factor=1)
pl_3 = ConstructPlane(Origin=midpt_5, XAxis=Vector(1, 0, 0), YAxis=Z_18)
mirror_3 = Mirror(Geometry=[move_8.Geometry, pt_13], Plane=pl_3)  # -> Geometry, Transform
merge_38 = Merge(Data1=move_8.Geometry, Data2=cull_i_21, Data3=mirror_3.Geometry, Data4=pt_13)
X_8 = UnitX(Factor=panel_27)
move_10 = Move(Geometry=merge_38, Motion=X_8)  # -> flatten(Geometry), Transform
panel_83 = Panel("""6
7
20
8""")
panel_84 = Panel("""2
3
10
9""")
panel_85 = Panel("""0
-1""")

# ----
abstraktion_breite = Slider(20.56, range=0..50)
abstraktion_höhe = Slider(9.71, range=0..30)
Y_12 = UnitY(Factor=abstraktion_breite)
move_11 = Move(Geometry=A_2, Motion=Y_12)  # -> Geometry, Transform
Z_19 = UnitZ(Factor=abstraktion_höhe)
move_12 = Move(Geometry=A_2, Motion=Z_19)  # -> Geometry, Transform
move_13 = Move(Geometry=move_11.Geometry, Motion=Z_19)  # -> Geometry, Transform
ln_29 = Line(StartPoint=A_2, EndPoint=move_12.Geometry)
ln_30 = Line(StartPoint=move_11.Geometry, EndPoint=move_13.Geometry)
ln_31 = Line(StartPoint=move_12.Geometry, EndPoint=move_13.Geometry)
abstraktion_position_gelenk = Slider(0.5, range=0.05..0.95)
shatter_3 = Shatter(Curve=ln_31, Parameters=abstraktion_position_gelenk)
split_8 = SplitList(List=shatter_3, Index=1)  # -> ListA, ListB
end_14 = EndPoints(Curve=split_8.ListB)  # -> Start, End
ln_32 = Line(StartPoint=end_14.End, EndPoint=end_14.Start)
träger = Merge(Data1=split_8.ListA, Data2=ln_32)
end_15 = EndPoints(Curve=ln_29)  # -> Start, End
end_16 = EndPoints(Curve=ln_30)  # -> Start, End

# ---- group: GEOMETRISCHE PARAMETER - RESET (continued)
reset_values_8 = CSharpScript(
    Reset=reset_geometrie_2,
    Parameters=[stützen_fw_breite, träger_fw_höhe, träger_innenkante_breite, stützen_innenkante_höhe, abstraktion_höhe, abstraktion_breite, abstraktion_position_gelenk],
    Values=panel_72)  # -> flatten(out), flatten(param); inputs Reset: Boolean, Parameters: list, Values: list of Double; same code as reset_values_3
panel_86 = Panel(reset_values_8.out)

# ----
art_der_einspannung = Slider(1, range=1..3)
panel_87 = Panel("""1 Gelenkig
2 Eingespannt
3 Dreigelenk""")
end_17 = EndPoints(Curve=ln_29)  # -> Start, End
end_18 = EndPoints(Curve=ln_30)  # -> Start, End
py3_2 = Python3Script(A=art_der_einspannung)  # -> toggle1, toggle2, toggle3
# ---------- py3_2: Python ----------
if A == 1:
    toggle1 = True
    toggle2 = False
    toggle3 = False
    number1 = 0
    number2 = 0
elif A == 2:
    toggle1 = True
    toggle2 = True
    toggle3 = False
    number1 = 0
    number2 = 0
elif A == 3:
    toggle1 = True
    toggle2 = False
    toggle3 = True
    number1 = 0
    number2 = 1
else:
    toggle1 = False
    toggle2 = False
    toggle3 = False
    number1 = 0
    number2 = 0
# ---------- end py3_2 ----------
auflager = Merge(Data1=end_17.Start, Data2=end_18.Start)
support6dof_4 = Support6DOFPlus(
    SupportPt=auflager,
    XFixed=True,
    YFixed=py3_2.toggle1,
    ZFixed=True,
    RXFixed=py3_2.toggle2,
    RYFixed=True,
    RZFixed=True,
    Strength=1000000000)

split_9 = SplitList(List=merge_21, Index=4)  # -> ListA, ListB
split_10 = SplitList(List=ln_21, Index=4)  # -> ListA, ListB
entwine_8 = Entwine(Branch00=split_10.ListB, Branch01=item_23, FlattenInputs=True)
entwine_9 = Entwine(Branch00=split_10.ListA, Branch01=item_22, FlattenInputs=True)
filter_33 = StreamFilter(Gate=py3_2.toggle2, Stream0=split_9.ListB, Stream1=entwine_8)
filter_34 = StreamFilter(Gate=py3_2.toggle2, Stream0=split_9.ListA, Stream1=entwine_9)
bang_8 = ExplodeTree(Data=filter_33)  # -> Branch0, Branch1
bang_9 = ExplodeTree(Data=filter_34)  # -> Branch0, Branch1

# ---- group: Geometrie
_90_4_orange = Line(flatten([merge_29, merge_12]))
_100_8_rosa = Line(flatten([merge_7, merge_25]))
_80_3_gelb = Line(flatten([merge_28, merge_17, merge_23, merge_11, cull_i_15, cull_i_9, merge_24, bang_9.Branch1, bang_8.Branch1]))
_125_7_rot = Line(flatten([bang_9.Branch0, bang_8.Branch0]))

lng = ListLength(List=merge_25)
split_11 = SplitList(List=_100_8_rosa, Index=lng)  # -> ListA, ListB
lng_2 = ListLength(List=cull_i_6)
partition_3 = PartitionList(List=split_11.ListB, Size=lng_2)
flip_14 = FlipMatrix(Data=partition_3)
panel_88 = Panel("""0
2""")
panel_89 = Panel("""1
3
4
5
6
7""")
item_36 = ListItem(List=flip_14, Index=panel_88, Wrap=True)  # -> flatten(Item)
item_37 = ListItem(List=flip_14, Index=panel_89, Wrap=True)  # -> flatten(Item)
_100_8_rosa_bar = Merge(Data1=split_11.ListA, Data2=item_37)  # -> flatten(Result)
filter_35 = StreamFilter(Gate=expression, Stream1=item_36)
filter_36 = StreamFilter(Gate=expression, Stream0=_100_8_rosa, Stream1=_100_8_rosa_bar)
_100_8_rosa_bar_2 = Line(flatten(filter_36))
_100_8_rosa_beam = Line(flatten(filter_35))

geometrie_anzeigen = BooleanToggle(True)
and_15 = GateAnd(A=geometrie_anzeigen)
filter_37 = StreamFilter(Gate=and_15, Stream1=_125_7_rot)
filter_38 = StreamFilter(Gate=and_15, Stream1=_80_3_gelb)
filter_39 = StreamFilter(Gate=and_15, Stream1=_100_8_rosa)
filter_40 = StreamFilter(Gate=and_15, Stream1=_90_4_orange)
preview_7 = CSharpScript(L=flatten(filter_39), T=5, C=ColourSwatch(SwatchColor=RGB(255, 0, 255)))  # inputs L: list of Line, T: Int32, C: Color, b: Boolean; disabled; same code as preview_def_2
preview_8 = CSharpScript(L=flatten(filter_37), T=5, C=ColourSwatch(SwatchColor=RGB(255, 0, 0)))  # inputs L: list of Line, T: Int32, C: Color, b: Boolean; disabled; same code as preview_def_2
preview_9 = CSharpScript(L=flatten(filter_38), T=5, C=ColourSwatch(SwatchColor=RGB(255, 255, 0)))  # inputs L: list of Line, T: Int32, C: Color, b: Boolean; disabled; same code as preview_def_2
preview_10 = CSharpScript(L=flatten(filter_40), T=5, C=ColourSwatch(SwatchColor=RGB(255, 127, 0)))  # inputs L: list of Line, T: Int32, C: Color, b: Boolean; disabled; same code as preview_def_2

lng_3 = ListLength(List=merge_29)
split_12 = SplitList(List=_90_4_orange, Index=lng_3)  # -> ListA, ListB
lng_4 = ListLength(List=split_12.ListA)  # -> expr("x/2-2", Length)
split_13 = SplitList(List=split_12.ListA, Index=lng_4)  # -> ListA, ListB
_90_4_orange_beam = Line(flatten(split_13.ListA))
_90_4_orange_bar = Merge(Data1=split_12.ListB, Data2=split_13.ListB)  # -> flatten(Result)

split_14 = SplitList(List=_125_7_rot, Index=2)  # -> ListA, ListB
filter_41 = StreamFilter(Gate=expression, Stream1=split_14.ListA)
filter_42 = StreamFilter(Gate=expression, Stream0=_125_7_rot, Stream1=split_14.ListB)
_125_7_rot_beam = Line(filter_41)
_125_7_rot_bar = Line(filter_42)

# ----
filter_43 = StreamFilter(Gate=py3_2.toggle3, Stream0=ln_31, Stream1=träger)

# ---- group: AUFLAGER BEIM FACHWERK
end_19 = EndPoints(Curve=_125_7_rot)  # -> Start, End
cullpt_3 = CullDuplicates(Points=end_19.End, Tolerance=0.1, CullMode=3)  # -> Points, Indices, Valence
lng_5 = ListLength(List=cullpt_3.Points)  # -> expr("x/2", Length)
split_15 = SplitList(List=cullpt_3.Points, Index=lng_5)  # -> ListA, ListB
support3dof_5 = Support3DOFPlus(SupportPt=split_15.ListB, XFixed=True, YFixed=True, ZFixed=True, Strength=1000000000)
support3dof_6 = Support3DOFPlus(SupportPt=split_15.ListA, XFixed=True, YFixed=True, ZFixed=True, Strength=1000000000)
fachwerk_auflager_2 = Merge(Data1=support3dof_5, Data2=support3dof_6)  # -> flatten(Result)

# ----
beam_rosa = BeamPlus(
    Line=_100_8_rosa_beam,
    Material=mat_5.MaterialProperties,
    Properties=hollow_rectangle_7.Properties,
    Width=hollow_rectangle_7.WidthW_m,
    Height=hollow_rectangle_7.HeightH_m,
    CrossSection=hollow_rectangle_7.GeometryPolylineOfTheCrossSection,
    Angle=0,
    I_Connection=0,
    J_Connection=0,
    LoadQX=0,
    LoadQY=streckenlast_wind_qy_kn_m,
    LoadQZ=0,
    SelfWeight=False,
    ControlAxial=1e+10,
    ControlBending=1e+10,
    Config=cfg_2)  # -> StartPlane, EndPlane, flatten(Beam), flatten(FeLoads), _3DGeometry
beam_rot = BeamPlus(
    Line=_125_7_rot_beam,
    Material=mat_5.MaterialProperties,
    Properties=hollow_rectangle_7.Properties,
    Width=hollow_rectangle_7.WidthW_m,
    Height=hollow_rectangle_7.HeightH_m,
    CrossSection=hollow_rectangle_7.GeometryPolylineOfTheCrossSection,
    Angle=0,
    I_Connection=0,
    J_Connection=0,
    LoadQX=0,
    LoadQY=streckenlast_wind_qy_kn_m,
    LoadQZ=0,
    SelfWeight=False,
    ControlAxial=1e+10,
    ControlBending=1e+10,
    Config=cfg_2)  # -> StartPlane, EndPlane, flatten(Beam), flatten(FeLoads), _3DGeometry
beam_orange = BeamPlus(
    Line=_90_4_orange_beam,
    Material=mat_5.MaterialProperties,
    Properties=hollow_rectangle_4.Properties,
    Width=hollow_rectangle_4.WidthW_m,
    Height=hollow_rectangle_4.HeightH_m,
    CrossSection=hollow_rectangle_4.GeometryPolylineOfTheCrossSection,
    Angle=0,
    I_Connection=0,
    J_Connection=0,
    LoadQX=0,
    LoadQY=0,
    LoadQZ=neg_12,
    SelfWeight=False,
    ControlAxial=1e+10,
    ControlBending=1e+10,
    Config=cfg_2)  # -> StartPlane, EndPlane, flatten(Beam), flatten(FeLoads), _3DGeometry
fachwerk_beam_fachwerkelemente = Merge(Data1=beam_rosa.Beam, Data2=beam_rot.Beam, Data3=beam_orange.Beam)  # -> flatten(Result)

bar_rosa = BarPlus(
    Line=_100_8_rosa_bar_2,
    Material=mat_5.MaterialProperties,
    Properties=hollow_rectangle_7.Properties,
    Width=hollow_rectangle_7.WidthW_m,
    Height=hollow_rectangle_7.HeightH_m,
    CrossSection=hollow_rectangle_7.GeometryPolylineOfTheCrossSection,
    ControlAxial=1e+10,
    ControlStiffness=stiffnessratio_2)  # -> flatten(StartPlane), flatten(EndPlane), flatten(Bar), _3DGeometry
bar_rot = BarPlus(
    Line=_125_7_rot_bar,
    Material=mat_5.MaterialProperties,
    Properties=hollow_rectangle_5.Properties,
    Width=hollow_rectangle_5.WidthW_m,
    Height=hollow_rectangle_5.HeightH_m,
    CrossSection=hollow_rectangle_5.GeometryPolylineOfTheCrossSection,
    ControlAxial=1e+10,
    ControlStiffness=stiffnessratio_2)  # -> flatten(StartPlane), flatten(EndPlane), flatten(Bar), _3DGeometry
bar_gelb = BarPlus(
    Line=_80_3_gelb,
    Material=mat_5.MaterialProperties,
    Properties=hollow_rectangle_6.Properties,
    Width=hollow_rectangle_6.WidthW_m,
    Height=hollow_rectangle_6.HeightH_m,
    CrossSection=hollow_rectangle_6.GeometryPolylineOfTheCrossSection,
    ControlAxial=1e+10,
    ControlStiffness=stiffnessratio_2)  # -> flatten(StartPlane), flatten(EndPlane), flatten(Bar), _3DGeometry
bar_orange = BarPlus(
    Line=_90_4_orange_bar,
    Material=mat_5.MaterialProperties,
    Properties=hollow_rectangle_4.Properties,
    Width=hollow_rectangle_4.WidthW_m,
    Height=hollow_rectangle_4.HeightH_m,
    CrossSection=hollow_rectangle_4.GeometryPolylineOfTheCrossSection,
    ControlAxial=1e+10,
    ControlStiffness=stiffnessratio_2)  # -> flatten(StartPlane), flatten(EndPlane), flatten(Bar), _3DGeometry
fachwerk_bar_stabelemente_2 = Merge(Data1=bar_rosa.Bar, Data2=bar_rot.Bar, Data3=bar_gelb.Bar, Data4=bar_orange.Bar)  # -> flatten(Result)

beam_träger = BeamPlus(
    Line=filter_43,
    Material=mat_5.MaterialProperties,
    Properties=generic_2.Properties,
    Width=generic_2.WidthW_m,
    Height=generic_2.HeightH_m,
    Angle=drehungswinkel_des_trägers_º_2,
    I_Connection=0,
    J_Connection=py3_2.toggle3,
    LoadQX=0,
    LoadQY=0,
    LoadQZ=neg_12,
    SelfWeight=False,
    ControlAxial=1e+10,
    ControlBending=1e+10,
    Config=cfg_2)  # -> StartPlane, EndPlane, flatten(Beam), flatten(FeLoads), _3DGeometry
beam_stütze_rechts = BeamPlus(
    Line=ln_29,
    Material=mat_5.MaterialProperties,
    Properties=generic.Properties,
    Width=generic.WidthW_m,
    Height=generic.HeightH_m,
    Angle=drehungswinkel_der_stützen_º_2,
    I_Connection=0,
    J_Connection=0,
    LoadQX=0,
    LoadQY=streckenlast_wind_qy_kn_m,
    LoadQZ=0,
    SelfWeight=False,
    ControlAxial=1e+10,
    ControlBending=1e+10,
    Config=cfg_2)  # -> StartPlane, EndPlane, flatten(Beam), flatten(FeLoads), _3DGeometry
beam_stütze_links = BeamPlus(
    Line=ln_30,
    Material=mat_5.MaterialProperties,
    Properties=generic.Properties,
    Width=generic.WidthW_m,
    Height=generic.HeightH_m,
    Angle=drehungswinkel_der_stützen_º_2,
    I_Connection=0,
    J_Connection=0,
    LoadQX=0,
    LoadQY=0,
    LoadQZ=0,
    SelfWeight=False,
    ControlAxial=1e+10,
    ControlBending=1e+10,
    Config=cfg_2)  # -> StartPlane, EndPlane, flatten(Beam), flatten(FeLoads), _3DGeometry
beam_2 = Merge(Data1=beam_stütze_links.Beam, Data2=beam_stütze_rechts.Beam, Data3=beam_träger.Beam)  # -> flatten(Result)

# ---- group: 3D GEO DARSTELLUNG
merge_39 = Merge(
    Data1=beam_rosa._3DGeometry,
    Data2=beam_rot._3DGeometry,
    Data3=beam_orange._3DGeometry,
    Data4=bar_rosa._3DGeometry,
    Data5=bar_rot._3DGeometry,
    Data6=bar_gelb._3DGeometry,
    Data7=bar_orange._3DGeometry)  # -> flatten(Result)
filter_44 = StreamFilter(Gate=_3d_modell_darstellung_2, Stream1=merge_39)

merge_40 = Merge(Data1=beam_träger._3DGeometry, Data2=beam_stütze_rechts._3DGeometry, Data3=beam_stütze_links._3DGeometry)  # -> flatten(Result)
filter_45 = StreamFilter(Gate=_3d_modell_darstellung_2, Stream1=merge_40)

# ----
filter_46 = StreamFilter(Gate=abstraktion, Stream0=filter_44, Stream1=filter_45)
preview_11 = CustomPreview(Geometry=filter_46, Material=farbe_modelllinie_2)

# ---- group: ZUSAMMENSETZUNG AUFLAGER UND KRÄFTE
merge_supports_2 = Merge(Data1=support6dof_4)  # -> flatten(Result)
merge_point_loads_2 = Merge()  # -> flatten(Result)
merge_fixed_end_loads_2 = Merge(Data1=beam_träger.FeLoads, Data2=beam_stütze_rechts.FeLoads, Data3=beam_stütze_links.FeLoads)  # -> flatten(Result)

merge_supports_3 = Merge(Data1=fachwerk_auflager_2)  # -> flatten(Result)
merge_point_loads_3 = Merge()  # -> flatten(Result)
# Sowohl die „Auflager“ als auch die Lasten müssen mit einem „Merge“ mit einem Ausgang mit „Flatten“ verbunden werden.
# 
# Die neuen feLoads+ ("Fixed End Loads") auch.
merge_fixed_end_loads_3 = Merge(Data1=beam_rosa.FeLoads, Data2=beam_rot.FeLoads, Data3=beam_orange.FeLoads)  # -> flatten(Result)

# ---- group: Fixierung in X-Richtung
merge_41 = Merge(Data1=end_16.Start, Data2=end_16.End, Data3=end_15.Start, Data4=end_15.End)
merge_42 = Merge(
    Data1=beam_rosa.StartPlane,
    Data2=beam_rosa.EndPlane,
    Data3=beam_rot.StartPlane,
    Data4=beam_rot.EndPlane,
    Data5=beam_orange.StartPlane,
    Data6=beam_orange.EndPlane,
    Data7=bar_rosa.StartPlane,
    Data8=bar_rosa.EndPlane,
    Data9=bar_rot.StartPlane,
    Data10=bar_rot.EndPlane,
    Data11=bar_gelb.StartPlane,
    Data12=bar_gelb.EndPlane,
    Data13=bar_orange.StartPlane,
    Data14=bar_orange.EndPlane,
    Data15=merge_41)
duppt = RemoveDuplicatePts(Points=merge_42, Tolerance=0.01)
support3dof_7 = Support3DOFPlus(SupportPt=duppt, XFixed=True, YFixed=False, ZFixed=False, Strength=1000000000)

# ----
filter_fixed_end_loads = StreamFilter(Gate=abstraktion, Stream0=merge_fixed_end_loads_3, Stream1=merge_fixed_end_loads_2)
filter_supports = StreamFilter(Gate=abstraktion, Stream0=merge_supports_3, Stream1=merge_supports_2)
filter_point_loads = StreamFilter(Gate=abstraktion, Stream0=merge_point_loads_3, Stream1=merge_point_loads_2)
filter_bar = StreamFilter(Gate=abstraktion, Stream0=fachwerk_bar_stabelemente_2)
filter_beam = StreamFilter(Gate=abstraktion, Stream0=fachwerk_beam_fachwerkelemente, Stream1=beam_2)

# ---- group: SOLVER MODUL
merge_43 = Merge(
    Data1=reset_values_8.param,
    Data2=reset_toggles_5.param,
    Data3=reset_values_6.param,
    Data4=reset_toggles_6.param,
    Data5=reset_values_7.param,
    Data6=reset_toggles_7.param,
    Data7=py3_2.toggle2,
    Data8=abstraktion,
    Data9=art_der_einspannung)
py3_3 = Python3Script(CurrentValue=merge_43)  # -> out, SavedValue, isNewValue; inputs CurrentValue: list; same code as py3
entwine_10 = Entwine(
    Branch00=filter_supports,
    Branch02=filter_fixed_end_loads,
    Branch03=filter_beam,
    Branch04=support3dof_7,
    Branch05=filter_bar,
    FlattenInputs=True)
reset_2 = Button()
or_2 = GateOr(A=py3_3.isNewValue, B=reset_2)
pause_2 = BooleanToggle(False)
not_13 = GateNot(A=pause_2)
solver_2 = Solver(GoalObjects=entwine_10, Reset=or_2, Threshold=eval_2, Tolerance=1e-05, On=not_13)  # -> I, V, O
bang_10 = ExplodeTree(Data=solver_2.O)  # -> Branch0, Branch1, Branch2, Branch3, Branch4, Branch5

# ----
merge_44 = Merge(Data1=bang_10.Branch2)  # -> flatten(Result)
merge_45 = Merge(Data1=bang_10.Branch4)  # -> flatten(Result)

# ---- group: BAR+ DARSTELLUNG
cfg_12 = ConfigurationPlusTunnel(Config=cfg_2)  # -> StiffnessRatio, Threshold, NumberOfDecimals, LineThickness, ModelColor, _3DModel, Hinges, HingeThickness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
baroutput_2 = BarOutputPlus(BarData=merge_45, Config=cfg_12.Config_2)  # -> IP0, IP1, P0, P1, N, Deformation, AxialDiagramCompression, AxialDiagramTension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
saturationratio_5 = CSharpScript(Lines=baroutput_2.LineS, satRatio=baroutput_2.TensionRatio, b=cfg_12.SaturationRatio)  # -> out, p, l, t, i; inputs Lines: Line, satRatio: Double, b: Boolean
# ---------- saturationratio_5: C# ----------
// Grasshopper Script Instance
#region Usings
using System;
using System.Linq;
using System.Collections;
using System.Collections.Generic;
using System.Drawing;

using Rhino;
using Rhino.Geometry;
using Rhino.Display;

using Grasshopper;
using Grasshopper.Kernel;
using Grasshopper.Kernel.Data;
using Grasshopper.Kernel.Types;
#endregion

public class Script_Instance : GH_ScriptInstance
{
    #region Notes
    /* 
      Members:
        RhinoDoc RhinoDocument
        GH_Document GrasshopperDocument
        IGH_Component Component
        int Iteration

      Methods (Virtual & overridable):
        Print(string text)
        Print(string format, params object[] args)
        Reflect(object obj)
        Reflect(object obj, string method_name)
    */
    #endregion

    private void RunScript(
		Line Lines,
		double satRatio,
		bool b,
		ref object p,
		ref object l,
		ref object t,
		ref object i)
    {
        if (b == false)
            return;

        if (Lines.Length < 0.1)
            return;

        l = Lines;
                    
        Point3d pm;

        pm = 0.5 * (Lines.From + Lines.To);

        p = pm;

        t = Math.Round(satRatio *100.0, 0).ToString();

        if (satRatio < 0.0)
            i = 0;
        else if (satRatio >= 1.0)
            i = 8;
        else
            i = Math.Min(8, Math.Floor(satRatio / 0.125));
    }
}
# ---------- end saturationratio_5 ----------
bnd_6 = Bounds(Numbers=flatten(baroutput_2.TensionRatio))
preview_def_5 = CSharpScript(L=flatten(baroutput_2.Deformation), T=cfg_12.LineThickness, C=cfg_12.DeformationColor, b=cfg_12._3DDeformation)  # inputs L: list of Line, T: Int32, C: Color, b: Boolean
# ---------- preview_def_5: C# ----------
// Grasshopper Script Instance
#region Usings
using System;
using System.Linq;
using System.Collections;
using System.Collections.Generic;
using System.Drawing;

using Rhino;
using Rhino.Geometry;

using Grasshopper;
using Grasshopper.Kernel;
using Grasshopper.Kernel.Data;
using Grasshopper.Kernel.Types;
#endregion

public class Script_Instance : GH_ScriptInstance
{
    Color c;
    int t;
    List <Line> l;
    bool draw_it;

    #region Notes
    /* 
      Members:
        RhinoDoc RhinoDocument
        GH_Document GrasshopperDocument
        IGH_Component Component
        int Iteration

      Methods (Virtual & overridable):
        Print(string text)
        Print(string format, params object[] args)
        Reflect(object obj)
        Reflect(object obj, string method_name)
    */
    #endregion

    private void RunScript(List<Line> L, int T, Color C, bool b)
    {
        draw_it = !b;     // Die 3D Darstellung soll nicht gleichzeitig gezeigt werden...

        if (L == null || L.Count() < 1)
        {
            draw_it = false;
            return;
        }

        int n = L.Count();
        
        l = new List<Line>();
        l.Clear();

        for (int i = 0; i < n; i++)
            l.Add(L[i]);

        c = C;
        t = T;
    }

    public override BoundingBox ClippingBox => BoundingBox.Empty;

    public override void DrawViewportMeshes(IGH_PreviewArgs args)
    {
        base.DrawViewportWires(args);
        
        if (draw_it == false)
            return;
            
        int n = l.Count();

        for (int i = 0; i < n; i++)
            args.Display.DrawLine(l[i], c, t);
    }

    public override void DrawViewportWires(IGH_PreviewArgs args)
    {

    }
}
# ---------- end preview_def_5 ----------
previewaxial_7 = CustomPreview(Geometry=baroutput_2.AxialDiagramCompression, Material=cfg_12.NegativeAxialColor)
previewaxial_8 = CustomPreview(Geometry=baroutput_2.AxialDiagramTension, Material=cfg_12.PositiveAxialColor)
dedomain_6 = DeconstructDomain(Domain=bnd_6)  # -> Start, End
colors_for_saturation_grade_5 = ListItem(List=cfg_12.SaturationRatioColors, Index=saturationratio_5.i, Wrap=True)
not_14 = GateNot(A=cfg_12.SaturationRatio)
ln_33 = Line(StartPoint=baroutput_2.IP0, EndPoint=baroutput_2.IP1)
and_16 = GateAnd(A=cfg_12.Deformation, B=cfg_12._3DDeformation)
filter_47 = StreamFilter(Gate=cfg_12.Displacements, Stream1=baroutput_2.TextD)
filter_48 = StreamFilter(Gate=cfg_12.DiagramValues, Stream1=baroutput_2.TextF)
filter_49 = StreamFilter(Gate=cfg_12.SaturationRatio, Stream1=saturationratio_5.t)
filter_50 = StreamFilter(Gate=not_14, Stream1=ln_33)
filter_51 = StreamFilter(Gate=and_16, Stream1=baroutput_2._3DGeometry)
tag_7 = TextTag(Location=saturationratio_5.p, Text=filter_49, Colour=colors_for_saturation_grade_5)
hingedraw_3 = CSharpScript(
    x=baroutput_2.IP0,
    y=baroutput_2.IP1,
    color=cfg_12.HingeColor,
    thickness=cfg_12.HingeThickness,
    size=cfg_12.HingeSize,
    b=and_6)  # inputs x: list of Plane, y: list of Plane, color: Color, thickness: Int32, size: Double, b: Boolean
# ---------- hingedraw_3: C# ----------
// Grasshopper Script Instance
#region Usings
using System;
using System.Linq;
using System.Collections;
using System.Collections.Generic;
using System.Drawing;

using Rhino;
using Rhino.Geometry;

using Grasshopper;
using Grasshopper.Kernel;
using Grasshopper.Kernel.Data;
using Grasshopper.Kernel.Types;
#endregion

public class Script_Instance : GH_ScriptInstance
{
    Color c;
    double s;
    int t;
    List <Plane> p; 
    bool draw_it;
    
    #region Notes
    /* 
      Members:
        RhinoDoc RhinoDocument
        GH_Document GrasshopperDocument
        IGH_Component Component
        int Iteration

      Methods (Virtual & overridable):
        Print(string text)
        Print(string format, params object[] args)
        Reflect(object obj)
        Reflect(object obj, string method_name)
    */
    #endregion

    private void RunScript(
		List<Plane> x,
		List<Plane> y,
		Color color,
		int thickness,
		double size,
		bool b)
    {
        draw_it = b;

        if (x == null || y == null)
        {
            return;
        }


        int n = x.Count();

        if (n != y.Count())
        {
            return;
        }
        p = new List<Plane>();

        for (int i = 0; i < n; i++)
        {
            p.Add(new Plane(x[i].Origin, x[i].XAxis));
            p.Add(new Plane(y[i].Origin, y[i].XAxis));
            p.Add(new Plane(x[i].Origin, x[i].YAxis));
            p.Add(new Plane(y[i].Origin, y[i].YAxis));
        }

        c = color;
        s = size;
        t = thickness;
    }

    public override BoundingBox ClippingBox => BoundingBox.Empty;

    public override void DrawViewportMeshes(IGH_PreviewArgs args)
    {
        base.DrawViewportMeshes(args);

        if (draw_it == false)
            return;

        int n = p.Count();

        Circle ci;

        for (int i = 0; i < n; i++)
        {
            ci = new Circle(p[i], s);
            args.Display.DrawCircle(ci, c, t);
        }
    }

    public override void DrawViewportWires(IGH_PreviewArgs args)
    {
    }
}
# ---------- end hingedraw_3 ----------
preview_geo_6 = CSharpScript(L=flatten(filter_50), T=cfg_12.LineThickness, C=cfg_12.ModelColor, b=cfg_12._3DModel)  # inputs L: list of Line, T: Int32, C: Color, b: Boolean; same code as preview_def_5
preview_saturation_5 = CustomPreview(Geometry=saturationratio_5.l, Material=colors_for_saturation_grade_5)
defvalues_5 = TextTag(Location=baroutput_2.TextPositionD, Text=filter_47, Colour=cfg_12.DisplacementColor)
preview_def3d_5 = CustomPreview(Geometry=filter_51, Material=cfg_12.DeformationColor)
intforcevalues_5 = TextTag(Location=baroutput_2.TextPositionF, Text=filter_48, Colour=cfg_12.ValuesColor)

# ---- group: BEAM+ UND STRECKENLASTEN DARSTELLUNG / BEAM+ DARSTELLUNG
beamoutput_2 = BeamOutputPlus(BeamData=merge_44, Config=cfg_8.Config_2)  # -> IP0, IP1, P0, P1, N, Vy, Vz, Mt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
saturationratio_6 = CSharpScript(Lines=beamoutput_2.LineS, satRatio=beamoutput_2.TensionRatio, b=cfg_8.SaturationRatio)  # -> out, p, l, t, i; inputs Lines: Line, satRatio: Double, b: Boolean
# ---------- saturationratio_6: C# ----------
// Grasshopper Script Instance
#region Usings
using System;
using System.Linq;
using System.Collections;
using System.Collections.Generic;
using System.Drawing;

using Rhino;
using Rhino.Geometry;
using Rhino.Display;

using Grasshopper;
using Grasshopper.Kernel;
using Grasshopper.Kernel.Data;
using Grasshopper.Kernel.Types;
#endregion

public class Script_Instance : GH_ScriptInstance
{
    #region Notes
    /* 
      Members:
        RhinoDoc RhinoDocument
        GH_Document GrasshopperDocument
        IGH_Component Component
        int Iteration

      Methods (Virtual & overridable):
        Print(string text)
        Print(string format, params object[] args)
        Reflect(object obj)
        Reflect(object obj, string method_name)
    */
    #endregion

    private void RunScript(
		Line Lines,
		double satRatio,
		bool b,
		ref object p,
		ref object l,
		ref object t,
		ref object i)
    {
        if (b == false)
            return;

        if (Lines.Length < 0.1)
            return;

        l = Lines;
                    
        Point3d pm;

        pm = 0.5 * (Lines.From + Lines.To);

        p = pm;

        t = Math.Round(satRatio * 100.0, 0).ToString();

        if (satRatio < 0.0)
            i = 0;
        else if (satRatio >= 1.0)
            i = 8;
        else
            i = Math.Min(8, Math.Floor(satRatio / 0.125));
    }
}
# ---------- end saturationratio_6 ----------
bnd_7 = Bounds(Numbers=flatten(beamoutput_2.TensionRatio))
preview_def_6 = CSharpScript(L=flatten(beamoutput_2.Deformation), T=cfg_8.LineThickness, C=cfg_8.DeformationColor, b=cfg_8._3DDeformation)  # inputs L: list of Line, T: Int32, C: Color, b: Boolean
# ---------- preview_def_6: C# ----------
// Grasshopper Script Instance
#region Usings
using System;
using System.Linq;
using System.Collections;
using System.Collections.Generic;
using System.Drawing;

using Rhino;
using Rhino.Geometry;

using Grasshopper;
using Grasshopper.Kernel;
using Grasshopper.Kernel.Data;
using Grasshopper.Kernel.Types;
#endregion

public class Script_Instance : GH_ScriptInstance
{
    Color c;
    int t;
    List <Line> l;
    bool draw_it;

    #region Notes
    /* 
      Members:
        RhinoDoc RhinoDocument
        GH_Document GrasshopperDocument
        IGH_Component Component
        int Iteration

      Methods (Virtual & overridable):
        Print(string text)
        Print(string format, params object[] args)
        Reflect(object obj)
        Reflect(object obj, string method_name)
    */
    #endregion

    private void RunScript(List<Line> L, int T, Color C, bool b)
    {
        draw_it = !b;     // Die 3D Darstellung soll nicht gleichzeitig gezeigt werden...

        if (L == null || L.Count() < 1)
        {
            draw_it = false;
            return;
        }
        
        int n = L.Count();
        
        l = new List<Line>();
        l.Clear();

        for (int i = 0; i < n; i++)
            l.Add(L[i]);

        c = C;
        t = T;
    }

    public override BoundingBox ClippingBox => BoundingBox.Empty;

    public override void DrawViewportMeshes(IGH_PreviewArgs args)
    {
        base.DrawViewportWires(args);
        
        if (draw_it == false)
            return;
            
        int n = l.Count();

        for (int i = 0; i < n; i++)
            args.Display.DrawLine(l[i], c, t);
    }

    public override void DrawViewportWires(IGH_PreviewArgs args)
    {

    }
}
# ---------- end preview_def_6 ----------
dedomain_7 = DeconstructDomain(Domain=bnd_7)  # -> Start, End
colors_for_saturation_grade_6 = ListItem(List=cfg_8.SaturationRatioColors, Index=saturationratio_6.i, Wrap=True)
previewaxial_9 = CustomPreview(Geometry=beamoutput_2.AxialDiagramCompression, Material=cfg_8.NegativeAxialColor)
previewaxial_10 = CustomPreview(Geometry=beamoutput_2.AxialDiagramTension, Material=cfg_8.PositiveAxialColor)
previewshear_2 = CustomPreview(Geometry=[beamoutput_2.ShearDiagramYSecondary, beamoutput_2.ShearDiagramZPrincipal], Material=cfg_8.ShearColor)
previewmoment_2 = CustomPreview(Geometry=[beamoutput_2.MomentDiagramYPrincipal, beamoutput_2.MomentDiagramZSecondary], Material=cfg_8.MomentColor)
filter_52 = StreamFilter(Gate=cfg_8.SaturationRatio, Stream1=saturationratio_6.t)
not_15 = GateNot(A=cfg_8.SaturationRatio)
ln_34 = Line(StartPoint=beamoutput_2.IP0, EndPoint=beamoutput_2.IP1)
filter_53 = StreamFilter(Gate=not_15, Stream1=ln_34)
tag_8 = TextTag(Location=saturationratio_6.p, Text=filter_52, Colour=colors_for_saturation_grade_6)
filter_54 = StreamFilter(Gate=cfg_8.Displacements, Stream1=beamoutput_2.TextD)
filter_55 = StreamFilter(Gate=cfg_8.DiagramValues, Stream1=beamoutput_2.TextF)
filter_56 = StreamFilter(Gate=and_5, Stream1=beamoutput_2._3DGeometry)
hingedraw_4 = CSharpScript(
    x=beamoutput_2.IP0,
    y=beamoutput_2.IP1,
    color=cfg_8.HingeColor,
    thickness=cfg_8.HingeThickness,
    size=cfg_8.HingeSize,
    b=and_7,
    iEnd=beamoutput_2.IEnd,
    jEnd=beamoutput_2.JEnd)  # inputs x: list of Plane, y: list of Plane, color: Color, thickness: Int32, size: Double, b: Boolean, iEnd: list of Int32, jEnd: list of Int32
# ---------- hingedraw_4: C# ----------
// Grasshopper Script Instance
#region Usings
using System;
using System.Linq;
using System.Collections;
using System.Collections.Generic;
using System.Drawing;

using Rhino;
using Rhino.Geometry;

using Grasshopper;
using Grasshopper.Kernel;
using Grasshopper.Kernel.Data;
using Grasshopper.Kernel.Types;
#endregion

public class Script_Instance : GH_ScriptInstance
{
    Color c;
    double s;
    int t;
    List <Plane> p; 
    bool draw_it;
    
    #region Notes
    /* 
      Members:
        RhinoDoc RhinoDocument
        GH_Document GrasshopperDocument
        IGH_Component Component
        int Iteration

      Methods (Virtual & overridable):
        Print(string text)
        Print(string format, params object[] args)
        Reflect(object obj)
        Reflect(object obj, string method_name)
    */
    #endregion

    private void RunScript(
		List<Plane> x,
		List<Plane> y,
		Color color,
		int thickness,
		double size,
		bool b,
		List<int> iEnd,
		List<int> jEnd)
    {
        draw_it = b;

        if (x == null || y == null)
        {
            return;
        }


        int n = x.Count();

        if (n != y.Count() || n!= iEnd.Count() || n!= jEnd.Count())
        {
            return;
        }
        p = new List<Plane>();

        for (int i = 0; i < n; i++)
        {
            switch(iEnd[i])
            {
                case 0:
                    break;
                case 1:
                    p.Add(new Plane(x[i].Origin, x[i].XAxis));
                    p.Add(new Plane(x[i].Origin, x[i].YAxis));
                    break;
                case 2:
                    p.Add(new Plane(x[i].Origin, x[i].XAxis));
                    break;
                case 3:
                    p.Add(new Plane(x[i].Origin, x[i].YAxis));
                    break;
            }
            
            switch(jEnd[i])
            {
                case 0:
                    break;
                case 1:
                    p.Add(new Plane(y[i].Origin, y[i].XAxis));
                    p.Add(new Plane(y[i].Origin, y[i].YAxis));
                    break;
                case 2:
                    p.Add(new Plane(y[i].Origin, y[i].XAxis));
                    break;
                case 3:
                    p.Add(new Plane(y[i].Origin, y[i].YAxis));
                    break;
            }
        }

        c = color;
        s = size;
        t = thickness;
    }

    public override BoundingBox ClippingBox => BoundingBox.Empty;

    public override void DrawViewportMeshes(IGH_PreviewArgs args)
    {
        base.DrawViewportMeshes(args);

        if (draw_it == false)
            return;

        int n = p.Count();

        Circle ci;

        for (int i = 0; i < n; i++)
        {
            ci = new Circle(p[i], s);
            args.Display.DrawCircle(ci, c, t);
        }
    }

    public override void DrawViewportWires(IGH_PreviewArgs args)
    {
    }
}
# ---------- end hingedraw_4 ----------
preview_geo_7 = CSharpScript(L=flatten(filter_53), T=cfg_8.LineThickness, C=cfg_8.ModelColor, b=cfg_8._3DModel)  # inputs L: list of Line, T: Int32, C: Color, b: Boolean; same code as preview_def_5
preview_def3d_6 = CustomPreview(Geometry=filter_56, Material=cfg_8.DeformationColor)
preview_saturation_6 = CustomPreview(Geometry=saturationratio_6.l, Material=colors_for_saturation_grade_6)
intforcevalues_6 = TextTag(Location=beamoutput_2.TextPositionF, Text=filter_55, Colour=cfg_8.ValuesColor)
defvalues_6 = TextTag(Location=beamoutput_2.TextPositionD, Text=filter_54, Colour=cfg_8.DisplacementColor)

# ---- group: AUFLAGER UND AUFLAGERREAKTIONEN DARSTELLUNG / AUFLAGER DARSTELLUNG
supportoutput_2 = Support6DOFOutputPlus(Support6DOFData=bang_10.Branch0)  # -> SupportPlaneIni, SupportPlaneDef, ReactionForce, ReactionMoment, FixedComponents
geo_2 = Geometry(auflager_darstellung_2)
c_script_10 = CSharpScript(
    pI=supportoutput_2.SupportPlaneIni,
    pD=supportoutput_2.SupportPlaneDef,
    k=multiplication_14,
    s=supportoutput_2.FixedComponents,
    x=geo_2)  # -> out, pt, simplify(i); inputs pI: Plane, pD: Plane, k: Double, s: String, x: tree; same code as c_script_5
scale_2 = Scale(Geometry=c_script_10.i, Center=Point(0, 0, 0), Factor=cfg_9.SupportSize)  # -> Geometry, Transform
move_14 = Move(Geometry=scale_2.Geometry, Motion=graft(c_script_10.pt))  # -> Geometry, Transform
filter_57 = StreamFilter(Gate=cfg_9.SupportRepresentation, Stream1=move_14.Geometry)
preview_12 = CustomPreview(Geometry=filter_57, Material=cfg_9.SupportColor)

# ---- group: PUNKTLASTEN DARSTELLUNG / PUNKTLASTEN (KRÄFTE UND MOMENTE) DARSTELLUNG
# Die Darstellung der Lasten ist echt einfach. Fast die ganze Arbeit macht die Komponente „LoadDisplay+“. Um das so zu vereinfachen, musste ich die Komponente „Load“ neu programmieren.
loadoutput_2 = LoadOutputPlus(LoadData=bang_10.Branch1)  # -> InitialPosition, FinalPosition, Load, IsMoment, IsVisible
and_17 = GateAnd(A=cfg_7.Deformation, B=cfg_7.LoadsOnDeformedShape)
c_script_11 = CSharpScript(
    pI=loadoutput_2.InitialPosition,
    pF=loadoutput_2.FinalPosition,
    L=loadoutput_2.Load,
    isM=loadoutput_2.IsMoment,
    kStiff=multiplication_15,
    bOnDef=and_17,
    bDecom=cfg_7.LoadsDecomposed,
    bVis=loadoutput_2.IsVisible)  # -> out, pt, load, bM, num; inputs pI: list of Point3d, pF: list of Point3d, L: list of Vector3d, isM: list of Boolean, kStiff: Double, bOnDef: Boolean, bDecom: Boolean, bVis: list of Boolean; same code as c_script_6
loaddisplay_4 = LoadVisualisationPlus(
    Position=c_script_11.pt,
    Load=c_script_11.load,
    Scale=cfg_7.LoadSize,
    ConeRadius=0.25,
    ConeHeight=0.5,
    CylinderRadius=0.075,
    TipOnPoint=cfg_7.TipOnPoint,
    IsMoment=c_script_11.bM)  # -> Loads, LoadsMoments
filter_58 = StreamFilter(Gate=cfg_7.LoadRepresentation, Stream1=loaddisplay_4.LoadsMoments)
filter_59 = StreamFilter(Gate=cfg_7.LoadRepresentation, Stream1=loaddisplay_4.Loads)
preview_13 = CustomPreview(Geometry=filter_58, Material=hsl_4)
preview_14 = CustomPreview(Geometry=filter_59, Material=cfg_7.LoadColor)

# ---- group: AUFLAGER UND AUFLAGERREAKTIONEN DARSTELLUNG / AUFLAGER REAKTIONEN DARSTELLUNG
X_9 = UnitX(Factor=1)
Y_13 = UnitY(Factor=1)
Z_20 = UnitZ(Factor=1)
and_18 = GateAnd(A=cfg_9.Deformation, B=cfg_9.LoadsOnDeformedShape)
and_19 = GateAnd(A=cfg_9.Deformation, B=cfg_9.LoadsOnDeformedShape)
X_10 = UnitX(Factor=1)
Y_14 = UnitY(Factor=1)
Z_21 = UnitZ(Factor=1)
multiplication_28 = Multiplication(A=supportoutput_2.ReactionMoment, B=Y_13)
multiplication_29 = Multiplication(A=supportoutput_2.ReactionMoment, B=Z_20)
multiplication_30 = Multiplication(A=supportoutput_2.ReactionMoment, B=X_9)
c_script_12 = CSharpScript(pI=supportoutput_2.SupportPlaneIni, pF=supportoutput_2.SupportPlaneDef, k=multiplication_14, b=and_18)  # -> out, pt; inputs pI: Point3d, pF: Point3d, k: Double, b: Boolean; same code as c_script_7
c_script_13 = CSharpScript(pI=supportoutput_2.SupportPlaneIni, pF=supportoutput_2.SupportPlaneDef, k=multiplication_14, b=and_19)  # -> out, pt; inputs pI: Point3d, pF: Point3d, k: Double, b: Boolean; same code as c_script_7
multiplication_31 = Multiplication(A=supportoutput_2.ReactionForce, B=X_10)
multiplication_32 = Multiplication(A=supportoutput_2.ReactionForce, B=Y_14)
multiplication_33 = Multiplication(A=supportoutput_2.ReactionForce, B=Z_21)
X_11 = UnitX(Factor=multiplication_30)
Y_15 = UnitY(Factor=multiplication_28)
Z_22 = UnitZ(Factor=multiplication_29)
X_12 = UnitX(Factor=multiplication_31)
Y_16 = UnitY(Factor=multiplication_32)
Z_23 = UnitZ(Factor=multiplication_33)
merge_46 = Merge(Data1=c_script_13.pt, Data2=c_script_13.pt, Data3=c_script_13.pt)
merge_47 = Merge(Data1=c_script_12.pt, Data2=c_script_12.pt, Data3=c_script_12.pt)
pdecon_13 = Deconstruct(Point=X_11)  # -> XComponent, YComponent, ZComponent
pdecon_14 = Deconstruct(Point=Y_15)  # -> XComponent, YComponent, ZComponent
pdecon_15 = Deconstruct(Point=Z_22)  # -> XComponent, YComponent, ZComponent
pdecon_16 = Deconstruct(Point=X_12)  # -> XComponent, YComponent, ZComponent
pdecon_17 = Deconstruct(Point=Y_16)  # -> XComponent, YComponent, ZComponent
pdecon_18 = Deconstruct(Point=Z_23)  # -> XComponent, YComponent, ZComponent
loaddisplay_5 = LoadVisualisationPlus(
    Position=merge_47,
    Load=[X_12, Z_23, Y_16],
    Scale=cfg_9.LoadSize,
    ConeRadius=0.25,
    ConeHeight=0.5,
    CylinderRadius=0.075,
    TipOnPoint=cfg_9.TipOnPoint,
    IsMoment=False)  # -> Loads, LoadsMoments
loaddisplay_6 = LoadVisualisationPlus(
    Position=merge_46,
    Load=[X_11, Z_22, Y_15],
    Scale=cfg_9.LoadSize,
    ConeRadius=0.25,
    ConeHeight=0.5,
    CylinderRadius=0.075,
    TipOnPoint=cfg_9.TipOnPoint,
    IsMoment=True)  # -> Loads, LoadsMoments
and_20 = GateAnd(A=cfg_9.ForceReactionRepresentation, B=cfg_9.ReactionValues)
and_21 = GateAnd(A=cfg_9.MomentReactionRepresentation, B=cfg_9.ReactionValues)
eval_6 = Evaluate(
    E="Format(\"[\"&If(x>0,\"+\",\"\")&Round(x,d)&\",\"&If(y>0,\"+\",\"\")&Round(y,d)&\",\"&If(z>0,\"+\",\"\")&Round(z,d)&\"]\")",
    x=pdecon_16.XComponent,
    y=pdecon_17.YComponent,
    z=pdecon_18.ZComponent,
    d=cfg_9.NumberOfDecimals)
eval_7 = Evaluate(
    E="Format(\"[\"&If(x>0,\"+\",\"\")&Round(x,d)&\",\"&If(y>0,\"+\",\"\")&Round(y,d)&\",\"&If(z>0,\"+\",\"\")&Round(z,d)&\"]\")",
    x=pdecon_13.XComponent,
    y=pdecon_14.YComponent,
    z=pdecon_15.ZComponent,
    d=cfg_9.NumberOfDecimals)
filter_60 = StreamFilter(Gate=and_20, Stream1=eval_6)
filter_61 = StreamFilter(Gate=cfg_9.ForceReactionRepresentation, Stream1=loaddisplay_5.Loads)
filter_62 = StreamFilter(Gate=cfg_9.MomentReactionRepresentation, Stream1=loaddisplay_6.LoadsMoments)
filter_63 = StreamFilter(Gate=and_21, Stream1=eval_7)
tag_9 = TextTag(Location=c_script_12.pt, Text=filter_60, Colour=cfg_9.ReactionValueColor)
tag_10 = TextTag(Location=c_script_12.pt, Text=filter_63, Colour=cfg_9.ReactionValueColor)
preview_15 = CustomPreview(Geometry=filter_61, Material=cfg_9.ReactionColor)
preview_16 = CustomPreview(Geometry=filter_62, Material=hsl_3)

# ---- group: BEAM+ UND STRECKENLASTEN DARSTELLUNG / STRECKENLASTEN BEI BEAM+ DARSTELLUNG
ahsl_6 = SplitAHSL(Colour=cfg_8.LoadColor)  # -> Alpha, Hue, Saturation, Luminance
hsl_7 = ColourHSL(Alpha=ahsl_6.Alpha, Hue=ahsl_6.Hue, Saturation=ahsl_6.Saturation, Luminance=expr("0.67*x", ahsl_6.Luminance))
hsl_8 = ColourHSL(
    Alpha=expr("0.33*x", ahsl_6.Alpha),
    Hue=ahsl_6.Hue,
    Saturation=ahsl_6.Saturation,
    Luminance=expr("0.67*x", ahsl_6.Luminance))
previewload_arrows_2 = CSharpScript(L=flatten(beamoutput_2.ArrowsInLoadRepresentation), T=cfg_8.LineThickness, C=hsl_7)  # inputs L: list of Line, T: Int32, C: Color, b: Boolean; same code as preview_def_2
previewload_surface_2 = CustomPreview(Geometry=beamoutput_2.LoadRepresentation, Material=hsl_8)

# ---- group: SPANNUNGSRATIO
# Hier wird überprüft ob die Spannungen in irgendeinen Element zu groß sind, und deshalb die Wiederstandsfähigkeit nicht überstanden wird.
mergesaturations_2 = Merge(Data1=dedomain_7.End, Data2=dedomain.End, Data3=dedomain_6.End)
panel_90 = Panel("""SPANNUNGEN ZU GROß!!!
Es gibt Elemente mit einem Spannungsratio über 100%. """)
bnd_8 = Bounds(Numbers=mergesaturations_2)
division_15 = Division(A=vp_height, B="1000")
dedomain_8 = DeconstructDomain(Domain=bnd_8)  # -> Start, End
multiplication_34 = Multiplication(A=Slider(15, range=0..30), B=division_15)
textfaktor_2 = Number(division_15)
panel_91 = Panel("Arial Fett")
larger_2 = LargerThan(FirstNumber=dedomain_8.End, SecondNumber="1.0")  # -> LargerThan, OrEqualTo
multiplication_35 = Multiplication(A="30", B=textfaktor_2)
multiplication_36 = Multiplication(A="60", B=textfaktor_2)
swatch_3 = ColourSwatch(SwatchColor=RGB(255, 255, 0))
filter_64 = StreamFilter(Gate=larger_2.LargerThan, Stream0=" ", Stream1=panel_90)
pt_14 = ConstructPoint(XCoordinate=multiplication_35, YCoordinate=multiplication_36, ZCoordinate=0)
texttoscreen_2 = RenderTextToScreen(Text=filter_64, Location=pt_14, Size=multiplication_34, Color=swatch_3, Font=panel_91, m_scWithvp=False)

# ----
panel_92 = Panel("""AUF ABSTAKTION WECHSELN!!!
Diese Option ist nicht beim Bespiel verwendbar. Es wird der Zweigelenkbogen angezeigt.""")
not_16 = GateNot(A=abstraktion)
and_22 = GateAnd(A=py3_2.toggle3, B=not_16)
filter_65 = StreamFilter(Gate=and_22, Stream0=" ", Stream1=panel_92)
texttoscreen_3 = RenderTextToScreen(Text=filter_65, Location=pt_14, Size=multiplication_34, Color=swatch_3, Font=panel_91, m_scWithvp=False)

# ---- group: STÜTZLINIE DES RAHMENS
# Das ist um die Stützlinie des Rahmens zu zeichnen.
# 
# Ich habe es ein bisschen vereinfacht.
# 
# Guck mal, welche Eingabedaten es braucht um die Stützlinie automatisch zu zeichnen.
my0_2 = Number(beamoutput_2.My0)  # disabled
vz_2 = Number(beamoutput_2.Vz)  # disabled
my1_2 = Number(beamoutput_2.My1)  # disabled
streckenlast_im_träger_2 = Number(streckenlast_träger_qz_kn_m_2)  # disabled
ptc_2 = Point(end_15.End)  # disabled
pta_2 = Point(end_15.Start)  # disabled
ptb_2 = Point(end_16.Start)  # disabled
ptd_2 = Point(end_16.End)  # disabled
item_38 = ListItem(List=flatten(my0_2), Index=0, Wrap=True)  # disabled
item_39 = ListItem(List=flatten(my0_2), Index=1, Wrap=True)  # disabled
item_40 = ListItem(List=flatten(my1_2), Index=0, Wrap=True)  # disabled
item_41 = ListItem(List=flatten(my1_2), Index=1, Wrap=True)  # disabled
item_42 = ListItem(List=vz_2, Index=0, Wrap=True)  # disabled
item_43 = ListItem(List=vz_2, Index=1, Wrap=True)  # disabled
anzahl_von_segmente_der_stützlinie_2 = Slider(32, range=16..64)  # disabled
quea_2 = Number(item_42)  # disabled
queb_2 = Number(item_43)  # disabled
neg_15 = Negative(Value=item_38)  # disabled
neg_16 = Negative(Value=item_41)  # disabled
stützlinie_darstellen_2 = BooleanToggle(True)  # disabled
addition_5 = Addition(A=quea_2, B=queb_2)  # disabled
momb_2 = Number(item_39)  # disabled
momc_2 = Number(item_40)  # disabled
momd_2 = Number(neg_16)  # disabled
moma_2 = Number(neg_15)  # disabled
c_stützlinie_in_xz_ebene = CSharpScript(
    A=pta_2,
    B=ptb_2,
    C=ptc_2,
    D=ptd_2,
    sumH=addition_5,
    Ma=moma_2,
    Mb=momb_2,
    Mc=momc_2,
    Md=momd_2,
    q=streckenlast_im_träger_2,
    segmente=anzahl_von_segmente_der_stützlinie_2)  # -> out, n, lines; inputs A: Point3d, B: Point3d, C: Point3d, D: Point3d, sumH: Double, Ma: Double, Mb: Double, Mc: Double, Md: Double, q: Double, segmente: Int32; disabled
# ---------- c_stützlinie_in_xz_ebene: C# ----------
// Grasshopper Script Instance
#region Usings
using System;
using System.Linq;
using System.Collections;
using System.Collections.Generic;
using System.Drawing;

using Rhino;
using Rhino.Geometry;

using Grasshopper;
using Grasshopper.Kernel;
using Grasshopper.Kernel.Data;
using Grasshopper.Kernel.Types;
#endregion

public class Script_Instance : GH_ScriptInstance
{
    #region Notes
    /* 
      Members:
        RhinoDoc RhinoDocument
        GH_Document GrasshopperDocument
        IGH_Component Component
        int Iteration

      Methods (Virtual & overridable):
        Print(string text)
        Print(string format, params object[] args)
        Reflect(object obj)
        Reflect(object obj, string method_name)
    */
    #endregion

    private void RunScript(
		Point3d A,
		Point3d B,
		Point3d C,
		Point3d D,
		double sumH,
		double Ma,
		double Mb,
		double Mc,
		double Md,
		double q,
		int segmente,
		ref object n,
		ref object lines)
    {
        n = null;

        if (Math.Abs(sumH) > 5.0)
        {
            n = 0;
            Print("Es kann keine Stützlinine berechnet werden, weil horizontale Lasten vorhanden sind.");
            return;
        }
        
        if (Math.Abs(Ma) < 1.0)
            Ma = 0.0;
        
        if (Math.Abs(Mb) < 1.0)
            Mb = 0.0;

        double[] x = new double[4];
        double[] y = new double[4];
        bool[] valid = new bool[4];
        double l;
        double k;
        int np = 0;
        Point3d[] px = new Point3d[4];

        // Zuerst berechnen wir der Schnittpunkt an der linken Stütze
        l = A.DistanceTo(C);
        // Wir gehen davon aus, dass Ma positiv, und Mc negativ ist
        k = Ma / (Ma - Mc);

        if (k < -0.0001 || k > 1.0001)
            valid[0] = false;
        else
        {
            px[0].X = A.X + k * (C.X - A.X);
            px[0].Y = A.Y + k * (C.Y - A.Y);
            px[0].Z = A.Z + k * (C.Z - A.Z);

            valid[0] = true;
            np = np + 1;
        }

        // Dann der Schnittpunkt an der rechten Stütze
        l = B.DistanceTo(D);
        // Wir gehen davon aus, dass Mb positiv, und Md negativ ist
        k = Mb / (Mb - Md);

        if (k < -0.0001 || k > 1.0001)
            valid[1] = false;
        else
        {
            px[1].X = B.X + k * (D.X - B.X);
            px[1].Y = B.Y + k * (D.Y - B.Y);
            px[1].Z = B.Z + k * (D.Z - B.Z);

            valid[1] = true;
            np = np + 1;
        }

        if (np < 2)
        {
            n = np;
            Print("Nicht die notwendige Schnittpunkte der Momentenlinie an den Stützen gedunden.");
            return;
        }

        // Jetzt müssen wir die Parabelformel erstellen, um die Schnittpunkte der Parabel zu berechnen
        l = C.DistanceTo(D);
        double a = 0.0;
        double b = Mc;
        double c = l / 2.0;
        double d = (Mc + Md) / 2.0 + q * l * l / 8.0;
        double e = l;
        double f = Md;

        double den1 = (a * a - a * (c + e) + c * e) * (e - c);
        double den2 = c - e;

        double x1;
        double x2;
        double pa;
        double pb;
        double pc;

        if (Math.Abs(den1) > 0.00001 && Math.Abs(den2) > 0.00001)
        {
            pa = a * (d - f) + b * (e - c) + c * f - d * e;
            pa = pa / den1;

            pb = a * a * (d - f) + b * (c + e) * (e - c) + c * c * f - d * e * e;
            pb = -pb / den1;

            pc = c * e * (a * (d - f) + b * (e - c) + c * f - d * e);
            pc = pc / den1;
            pc = pc + e * (f - d) / (c - e) + f;

            // Jetzt kann man die Nullstellen der Parabel des Momentes
            x1 = (- pb - Math.Sqrt(pb * pb - 4 * pa * pc)) / (2 * pa);
            x2 = (- pb + Math.Sqrt(pb * pb - 4 * pa * pc)) / (2 * pa);

            if (x1 > x2)
            {
                double t = x2;
                x2 = x1;
                x1 = t;
            }

            k = x1 / l;

            if (k < -0.0001 || k > 1.0001)
                valid[2] = false;
            else
            {
                px[2].X = C.X + k * (D.X - C.X);
                px[2].Y = C.Y + k * (D.Y - C.Y);
                px[2].Z = C.Z + k * (D.Z - C.Z);

                valid[2] = true;
                np = np + 1;
            }        

            k = x2 / l;

            if (k < -0.0001 || k > 1.0001)
                valid[3] = false;
            else
            {
                px[3].X = C.X + k * (D.X - C.X);
                px[3].Y = C.Y + k * (D.Y - C.Y);
                px[3].Z = C.Z + k * (D.Z - C.Z);

                valid[3] = true;
                np = np + 1;
            }        
        }
        else
        {
            n = np;
            Print("Es ist ein Fehler aufgetreten. Mann kann die Stützlinie nicht berechnen.");
            return;
        }

        // Jetzt haben wir die Schnittpunkte. Wir brauchen 3 um die Parabel der Stützlinie (Bogen) zu berechnen.

        if (np >= 3)
        {
            // Jetzt berechnen wir die Parabel der Stüzlinie
            // Wir gehen davon aus, dass der Rahmen (und deshalb, die Stützlinie) im XZ Ebene liegt
            int i = 0;
            int j = 0;

            double[] xv = new double[4];
            double[] zv = new double[4];

            double x_min = 999.99;
            double x_max = -999.99;

            // Wir brauchen die erste drei korrekte Schnittpunkte
            for (i = 0; i < 4; i++)
            {
                if (valid[i])
                {
                    // Wir gehen davon aus, dass der Rahmen (und deshalb, die Stützlinie) im XZ Ebene liegt
                    xv[j] = px[i].X;
                    zv[j] = px[i].Z;
                    j = j + 1;

                    x_min = Math.Min(x_min, xv[i]);
                    x_max = Math.Max(x_max, xv[i]);
                }
            }

            a = xv[0];
            b = zv[0];
            c = xv[1];
            d = zv[1];
            e = xv[2];
            f = zv[2];

            den1 = (a * a - a * (c + e) + c * e) * (e - c);
            den2 = c - e;

            if (Math.Abs(den1) > 0.00001 && Math.Abs(den2) > 0.00001)
            {
                pa = a * (d - f) + b * (e - c) + c * f - d * e;
                pa = pa / den1;

                pb = a * a * (d - f) + b * (c + e) * (e - c) + c * c * f - d * e * e;
                pb = -pb / den1;

                pc = c * e * (a * (d - f) + b * (e - c) + c * f - d * e);
                pc = pc / den1;
                pc = pc + e * (f - d) / (c - e) + f;

                // Das sind die Gleichungen für die Tangenten an beiden Enden der Stützlinie
                double m1 = 2.0 * pa * xv[0] + pb;
                double m2 = 2.0 * pa * xv[1] + pb;
                double b1 = zv[0] - m1 * xv[0];
                double b2 = zv[1] - m2 * xv[1];

                // Jetzt berechnen wir die "Bodenlinie", das ist die Linie die
                // beide Auflager verbindet (normallerweise der X-Achse)
                double m3 = (B.Z - A.Z) / (B.X - A.X);
                double b3 = B.Z - m3 * B.X;

                // Die Schnittpunkte zwischen den Tangenten und die Bodelinie 
                double xx1;
                double zz1;
                double xx2;
                double zz2;

                // Wir gehen davon aus, dass der Rahmen (und deshalb, die Stützlinie) im XZ Ebene liegt
                // oder parallel zur globallen XZ Ebene
                double yyy = A.Y;

                xx1 = (b3 - b1) / (m1 - m3);
                zz1 = m1 * xx1 + b1;

                xx2 = (b3 - b2) / (m2 - m3);
                zz2 = m2 * xx2 + b2;

                Line[] sLine = new Line[segmente + 2];

                sLine[0].From = new Point3d(xx1, yyy, zz1);
                sLine[0].To = new Point3d(xv[0], yyy, zv[0]);
                sLine[1].From = new Point3d(xx2, yyy, zz2);
                sLine[1].To = new Point3d(xv[1], yyy, zv[1]);

                double xxx;
                double stepX = (x_max - x_min) / segmente;

                xxx = x_min;
                for (i = 0; i < segmente; i++)
                {
                    sLine[i + 2].From = new Point3d(xxx, yyy, pa * xxx * xxx + pb * xxx + pc);
                    xxx += stepX;
                    sLine[i + 2].To = new Point3d(xxx, yyy, pa * xxx * xxx + pb * xxx + pc);
                }

                lines = sLine;
                n = np;
            }
            else
            {
                Print("Es ist ein Fehler aufgetreten. Mann kann die Stützlinie nicht berechnen.");
                n = np;
                return;
            }
        }        
    }
}
# ---------- end c_stützlinie_in_xz_ebene ----------
swatch_4 = ColourSwatch(SwatchColor=RGB(3, 81, 194))  # disabled
liniengrösse_2 = Slider(5, range=0..10)  # disabled
panel_93 = Panel(c_stützlinie_in_xz_ebene.out)  # disabled
filter_66 = StreamFilter(Gate=stützlinie_darstellen_2, Stream1=c_stützlinie_in_xz_ebene.lines)  # disabled
preview_geo_8 = CSharpScript(L=flatten(filter_66), T=liniengrösse_2, C=swatch_4, b=False)  # inputs L: list of Line, T: Int32, C: Color, b: Boolean; disabled; same code as preview_def_2

# Das ist um die Stützlinie des Rahmens zu zeichnen.
# 
# Ich habe es ein bisschen vereinfacht.
# 
# Guck mal, welche Eingabedaten es braucht um die Stützlinie automatisch zu zeichnen.
vz_3 = Number(beamoutput_2.Vz)
my0_3 = Number(beamoutput_2.My0)
my1_3 = Number(beamoutput_2.My1)
streckenlast_im_träger_3 = Number(streckenlast_träger_qz_kn_m_2)
pta_3 = Point(end_15.Start)
ptb_3 = Point(end_16.Start)
ptc_3 = Point(end_15.End)
ptd_3 = Point(end_16.End)
item_44 = ListItem(List=flatten(my0_3), Index=0, Wrap=True)
item_45 = ListItem(List=flatten(my0_3), Index=1, Wrap=True)
item_46 = ListItem(List=flatten(my1_3), Index=0, Wrap=True)
item_47 = ListItem(List=flatten(my1_3), Index=1, Wrap=True)
item_48 = ListItem(List=vz_3, Index=0, Wrap=True)
item_49 = ListItem(List=vz_3, Index=1, Wrap=True)
anzahl_von_segmente_der_stützlinie_3 = Slider(32, range=16..64)
queb_3 = Number(item_49)
quea_3 = Number(item_48)
neg_17 = Negative(Value=item_44)
neg_18 = Negative(Value=item_47)
stützlinie_darstellen_3 = BooleanToggle(True)
addition_6 = Addition(A=quea_3, B=queb_3)
momc_3 = Number(item_46)
momb_3 = Number(item_45)
momd_3 = Number(neg_18)
moma_3 = Number(neg_17)
c_stützlinie_in_yz_ebene = CSharpScript(
    A=pta_3,
    B=ptb_3,
    C=ptc_3,
    D=ptd_3,
    sumH=addition_6,
    Ma=moma_3,
    Mb=momb_3,
    Mc=momc_3,
    Md=momd_3,
    q=streckenlast_im_träger_3,
    segmente=anzahl_von_segmente_der_stützlinie_3)  # -> out, n, lines; inputs A: Point3d, B: Point3d, C: Point3d, D: Point3d, sumH: Double, Ma: Double, Mb: Double, Mc: Double, Md: Double, q: Double, segmente: Int32
# ---------- c_stützlinie_in_yz_ebene: C# ----------
// Grasshopper Script Instance
#region Usings
using System;
using System.Linq;
using System.Collections;
using System.Collections.Generic;
using System.Drawing;

using Rhino;
using Rhino.Geometry;

using Grasshopper;
using Grasshopper.Kernel;
using Grasshopper.Kernel.Data;
using Grasshopper.Kernel.Types;
#endregion

public class Script_Instance : GH_ScriptInstance
{
    #region Notes
    /* 
      Members:
        RhinoDoc RhinoDocument
        GH_Document GrasshopperDocument
        IGH_Component Component
        int Iteration

      Methods (Virtual & overridable):
        Print(string text)
        Print(string format, params object[] args)
        Reflect(object obj)
        Reflect(object obj, string method_name)
    */
    #endregion

    private void RunScript(
		Point3d A,
		Point3d B,
		Point3d C,
		Point3d D,
		double sumH,
		double Ma,
		double Mb,
		double Mc,
		double Md,
		double q,
		int segmente,
		ref object n,
		ref object lines)
    {
        n = null;

        if (Math.Abs(sumH) > 5.0)
        {
            n = 0;
            Print("Es kann keine Stützlinine berechnet werden, weil horizontale Lasten vorhanden sind.");
            return;
        }

        double[] x = new double[4];
        double[] y = new double[4];
        bool[] valid = new bool[4];
        double l;
        double k;
        int np = 0;
        Point3d[] px = new Point3d[4];

        if (Math.Abs(Ma) < 1.0)
            Ma = 0.0;
        
        if (Math.Abs(Mb) < 1.0)
            Mb = 0.0;

        // Zuerst berechnen wir der Schnittpunkt an der linken Stütze
        l = A.DistanceTo(C);
        // Wir gehen davon aus, dass Ma positiv, und Mc negativ ist
        k = Ma / (Ma - Mc);

        if (k < -0.0001 || k > 1.0001)
            valid[0] = false;
        else
        {
            px[0].X = A.X + k * (C.X - A.X);
            px[0].Y = A.Y + k * (C.Y - A.Y);
            px[0].Z = A.Z + k * (C.Z - A.Z);

            valid[0] = true;
            np = np + 1;
        }

        // Dann der Schnittpunkt an der rechten Stütze
        l = B.DistanceTo(D);
        // Wir gehen davon aus, dass Mb positiv, und Md negativ ist
        k = Mb / (Mb - Md);

        if (k < -0.0001 || k > 1.0001)
            valid[1] = false;
        else
        {
            px[1].X = B.X + k * (D.X - B.X);
            px[1].Y = B.Y + k * (D.Y - B.Y);
            px[1].Z = B.Z + k * (D.Z - B.Z);

            valid[1] = true;
            np = np + 1;
        }

        if (np < 2)
        {
            n = np;
            Print("Nicht die notwendige Schnittpunkte der Momentenlinie an den Stützen gedunden.");
            return;
        }

        // Jetzt müssen wir die Parabelformel erstellen, um die Schnittpunkte der Parabel zu berechnen
        l = C.DistanceTo(D);
        double a = 0.0;
        double b = Mc;
        double c = l / 2.0;
        double d = (Mc + Md) / 2.0 + q * l * l / 8.0;
        double e = l;
        double f = Md;

        double den1 = (a * a - a * (c + e) + c * e) * (e - c);
        double den2 = c - e;

        double x1;
        double x2;
        double pa;
        double pb;
        double pc;

        if (Math.Abs(den1) > 0.00001 && Math.Abs(den2) > 0.00001)
        {
            pa = a * (d - f) + b * (e - c) + c * f - d * e;
            pa = pa / den1;

            pb = a * a * (d - f) + b * (c + e) * (e - c) + c * c * f - d * e * e;
            pb = -pb / den1;

            pc = c * e * (a * (d - f) + b * (e - c) + c * f - d * e);
            pc = pc / den1;
            pc = pc + e * (f - d) / (c - e) + f;

            // Jetzt kann man die Nullstellen der Parabel des Momentes
            x1 = (- pb - Math.Sqrt(pb * pb - 4 * pa * pc)) / (2 * pa);
            x2 = (- pb + Math.Sqrt(pb * pb - 4 * pa * pc)) / (2 * pa);

            if (x1 > x2)
            {
                double t = x2;
                x2 = x1;
                x1 = t;
            }

            k = x1 / l;

            if (k < -0.0001 || k > 1.0001)
                valid[2] = false;
            else
            {
                px[2].X = C.X + k * (D.X - C.X);
                px[2].Y = C.Y + k * (D.Y - C.Y);
                px[2].Z = C.Z + k * (D.Z - C.Z);

                valid[2] = true;
                np = np + 1;
            }        

            k = x2 / l;

            if (k < -0.0001 || k > 1.0001)
                valid[3] = false;
            else
            {
                px[3].X = C.X + k * (D.X - C.X);
                px[3].Y = C.Y + k * (D.Y - C.Y);
                px[3].Z = C.Z + k * (D.Z - C.Z);

                valid[3] = true;
                np = np + 1;
            }        
        }
        else
        {
            n = np;
            Print("Es ist ein Fehler aufgetreten. Mann kann die Stützlinie nicht berechnen.");
            return;
        }

        // Jetzt haben wir die Schnittpunkte. Wir brauchen 3 um die Parabel der Stützlinie (Bogen) zu berechnen.

        if (np >= 3)
        {
            // Jetzt berechnen wir die Parabel der Stüzlinie
            // Wir gehen davon aus, dass der Rahmen (und deshalb, die Stützlinie) im YZ Ebene liegt
            int i = 0;
            int j = 0;

            double[] yv = new double[4];
            double[] zv = new double[4];

            double y_min = 999.99;
            double y_max = -999.99;

            // Wir brauchen die erste drei korrekte Schnittpunkte
            for (i = 0; i < 4; i++)
            {
                if (valid[i])
                {
                    // Wir gehen davon aus, dass der Rahmen (und deshalb, die Stützlinie) im XZ Ebene liegt
                    yv[j] = px[i].Y;
                    zv[j] = px[i].Z;
                    j = j + 1;

                    y_min = Math.Min(y_min, yv[i]);
                    y_max = Math.Max(y_max, yv[i]);
                }
            }

            a = yv[0];
            b = zv[0];
            c = yv[1];
            d = zv[1];
            e = yv[2];
            f = zv[2];

            den1 = (a * a - a * (c + e) + c * e) * (e - c);
            den2 = c - e;

            if (Math.Abs(den1) > 0.00001 && Math.Abs(den2) > 0.00001)
            {
                pa = a * (d - f) + b * (e - c) + c * f - d * e;
                pa = pa / den1;

                pb = a * a * (d - f) + b * (c + e) * (e - c) + c * c * f - d * e * e;
                pb = -pb / den1;

                pc = c * e * (a * (d - f) + b * (e - c) + c * f - d * e);
                pc = pc / den1;
                pc = pc + e * (f - d) / (c - e) + f;

                // Das sind die Gleichungen für die Tangenten an beiden Enden der Stützlinie
                double m1 = 2.0 * pa * yv[0] + pb;
                double m2 = 2.0 * pa * yv[1] + pb;
                double b1 = zv[0] - m1 * yv[0];
                double b2 = zv[1] - m2 * yv[1];

                // Jetzt berechnen wir die "Bodenlinie", das ist die Linie die
                // beide Auflager verbindet (normallerweise der X-Achse)
                double m3 = (B.Z - A.Z) / (B.Y - A.Y);
                double b3 = B.Z - m3 * B.Y;

                // Die Schnittpunkte zwischen den Tangenten und die Bodelinie 
                double yy1;
                double zz1;
                double yy2;
                double zz2;

                // Wir gehen davon aus, dass der Rahmen (und deshalb, die Stützlinie) im YZ Ebene liegt
                // oder parallel zur globallen YZ Ebene
                double xxx = A.X;

                yy1 = (b3 - b1) / (m1 - m3);
                zz1 = m1 * yy1 + b1;

                yy2 = (b3 - b2) / (m2 - m3);
                zz2 = m2 * yy2 + b2;

                Line[] sLine = new Line[segmente + 2];

                sLine[0].From = new Point3d(xxx, yy1, zz1);
                sLine[0].To = new Point3d(xxx, yv[0], zv[0]);
                sLine[1].From = new Point3d(xxx, yy2, zz2);
                sLine[1].To = new Point3d(xxx, yv[1], zv[1]);

                double yyy;
                double stepY = (y_max - y_min) / segmente;

                yyy = y_min;
                for (i = 0; i < segmente; i++)
                {
                    sLine[i + 2].From = new Point3d(xxx, yyy, pa * yyy * yyy + pb * yyy + pc);
                    yyy += stepY;
                    sLine[i + 2].To = new Point3d(xxx, yyy, pa * yyy * yyy + pb * yyy + pc);
                }

                lines = sLine;
                n = np;
            }
            else
            {
                Print("Es ist ein Fehler aufgetreten. Mann kann die Stützlinie nicht berechnen.");
                n = np;
                return;
            }
        }        
    }
}
# ---------- end c_stützlinie_in_yz_ebene ----------
liniengrösse_3 = Slider(5, range=0..10)
panel_94 = Panel(c_stützlinie_in_yz_ebene.out)
filter_67 = StreamFilter(Gate=stützlinie_darstellen_3, Stream1=c_stützlinie_in_yz_ebene.lines)
preview_geo_9 = CSharpScript(L=flatten(filter_67), T=liniengrösse_3, C=ColourSwatch(SwatchColor=RGB(3, 81, 194)), b=False)  # inputs L: list of Line, T: Int32, C: Color, b: Boolean; same code as preview_def_2

# ---- group: Geometrie
panel_95 = Panel("""0
1
2
3""")
panel_96 = Panel("""4
5
6
7""")
panel_97 = Panel("""1
2
3""")
panel_98 = Panel("""3
7
21
22
23
24
25
26
27
28
29
30
31""")
item_50 = ListItem(List=division_8, Index=panel_97, Wrap=True)
ma_5 = MassAddition(Input=item_50)  # -> Result, PartialResults
multiplication_37 = Multiplication(A=ma_5.Result, B=addition_2)
Z_24 = UnitZ(Factor=expr("-x", multiplication_37))
division_16 = Division(A=panel_27, B=2)
Z_25 = UnitZ(Factor=1)

abstand = Slider(6, range=0..10)
geometrie_komplett = BooleanToggle(False)
X_13 = UnitX(Factor=abstand)
X_14 = UnitX(Factor=abstand)
arrlinear = LinearArray(Geometry=[_100_8_rosa, _125_7_rot, _80_3_gelb, _90_4_orange], Direction=X_13, Count=10)  # -> Geometry, Transform
and_23 = GateAnd(A=geometrie_komplett)
cull_i_22 = CullIndex(List=arrlinear.Geometry, Indices=0, Wrap=True)

subtraction_7 = Subtraction(A=abstand, B=panel_27)
X_15 = UnitX(Factor=subtraction_7)
move_15 = Move(Geometry=move_10.Geometry, Motion=X_15)  # -> Geometry, Transform
ln_35 = Line(StartPoint=move_10.Geometry, EndPoint=move_15.Geometry)
item_51 = ListItem(List=ln_35, Index=panel_84, Wrap=True)
item_52 = ListItem(List=ln_35, Index=panel_83, Wrap=True)
shift_10 = ShiftList(List=item_52, Shift=1, Wrap=True)
divide_4 = DivideCurve(Curve=item_52, Count=4, Kinks=False)  # -> Points, Tangents, Parameters
divide_5 = DivideCurve(Curve=shift_10, Count=4, Kinks=False)  # -> Points, Tangents, Parameters
cull_i_23 = CullIndex(List=divide_4.Points, Indices=panel_85, Wrap=True)
cull_i_24 = CullIndex(List=divide_5.Points, Indices=panel_85, Wrap=True)
ln_36 = Line(StartPoint=cull_i_23, EndPoint=cull_i_24)
mirror_4 = Mirror(Geometry=ln_36, Plane=pl_3)  # -> Geometry, Transform
merge_48 = Merge(Data1=ln_35, Data2=ln_36, Data3=mirror_4.Geometry)

len_2 = Length(Curve=ln_35)
division_17 = Division(A=len_2, B=4)
X_16 = UnitX(Factor=expr("-x", division_17))
move_16 = Move(Geometry=merge_38, Motion=X_16)  # -> Geometry, Transform
ln_37 = Line(StartPoint=merge_38, EndPoint=move_16.Geometry)
item_53 = ListItem(List=flatten(move_16.Geometry), Index=panel_95, Wrap=True)
item_54 = ListItem(List=flatten(move_16.Geometry), Index=panel_96, Wrap=True)
item_55 = ListItem(List=flatten(move_16.Geometry), Index=panel_98, Wrap=True)
ln_38 = Line(StartPoint=item_53, EndPoint=item_54)
move_17 = Move(Geometry=item_55, Motion=Z_24)  # -> Geometry, Transform
ln_39 = Line(StartPoint=item_55, EndPoint=move_17.Geometry)
merge_49 = Merge(Data1=ln_37, Data2=ln_38, Data3=ln_39)
a_4_5 = Multiplication(A=abstand, _45=4.5)
addition_7 = Addition(A=a_4_5, B=division_16)
pt_15 = ConstructPoint(XCoordinate=addition_7, YCoordinate=0, ZCoordinate=0)
pl_4 = ConstructPlane(Origin=pt_15, XAxis=Z_25, YAxis=Vector(0, 1, 0))
mirror_5 = Mirror(Geometry=merge_49, Plane=pl_4)  # -> Geometry, Transform
merge_50 = Merge(Data1=merge_49, Data2=mirror_5.Geometry)

arrlinear_2 = LinearArray(Geometry=merge_48, Direction=X_14, Count=9)  # -> Geometry, Transform
filter_68 = StreamFilter(Gate=and_23, Stream1=[cull_i_22, arrlinear_2.Geometry, merge_50])
preview_17 = CSharpScript(L=flatten(filter_68), T=5, C=ColourSwatch(SwatchColor=RGB(255, 254, 255)))  # inputs L: list of Line, T: Int32, C: Color, b: Boolean; same code as preview_def_2
