# Grasshopper definition Test.gh (Grasshopper 1.0.8)
# plug-ins: K2Engineering (and K2E+), Human

# DIESE KLEINE KOMPONENTE SORGT DAFÜR, DASS DAS GH-FENSTER SOFORT NACH DEM START DES MODELLS MINIMIERT WIRD.
# AUF DIESE WEISE SEHEN DIE SCHÜLER DEN CODE NICHT.
# DAS FENSTER IST NICHT GESCHLOSSEN, NUR MINIMIERT. WENN ALSO JEMAND DEN CODE SEHEN (ODER SOGAR ÄNDERN) WILL, KÖNNEN WIR NICHT VERHINDERN, DASS DAS GH-FENSTER ÜBER DAS SYMBOL IN DER UNTEREN LEISTE DER LAUFENDEN PROGRAMME GEÖFFNET WIRD.
# MIT DEM SCHALTER KANNST DU VERHINDERN, DASS DAS FENSTER WÄHREND DER PROGRAMMIERUNG MINIMIERT WIRD („DEBUG = TRUE“), ABER WENN DU MIT DER DEFINITION DES MODELLS FERTIG BIST, MUSST DU DAS MODELL MIT DIESEM SCHALTER AUF „FALSE“ SPEICHERN.
toggle = BooleanToggle(False)
startup = Python3Script(debug=toggle)  # -> out
# ---------- startup: Python ----------
import Rhino
from Rhino.UI import Panels
from System import Guid
import Grasshopper
from System import Windows

Grasshopper.Instances.ShowRemotePanel()

if debug == True:
    Panels.OpenPanel(Guid('b45a29b1-4343-4035-989e-044e8580d9cf'))

    PanelIds = []
    PanelIds = Panels.GetOpenPanelIds()
    for x in PanelIds:
        name = Panels.GetPanel(x, Rhino.RhinoDoc.ActiveDoc)
        print(x)
        print(name)

if debug == False:
    Grasshopper.Instances.ShowRemotePanel()

    if (Grasshopper.Instances.DocumentEditor.WindowState != Windows.Forms.FormWindowState.Minimized):
        Grasshopper.Instances.DocumentEditor.WindowState = Windows.Forms.FormWindowState.Minimized
# ---------- end startup ----------
panel = Panel(startup)
# DAS DARSTELLUNGSPROBLEM LIEGT DARAN, DASS DIE KAMERA IN RHINO EINEN "NEAR-CLIPPING-PLANE" UND EINEN "FAR-CLIPPING-PLANE" (https://discourse.mcneel.com/t/modify-camera-near-clipping-plane/190327/3) AUTOMATISCH DEFINIERT UM ALLES ZU ZEIGEN WAS ZU ZEIGEN IST.
# DAZU BETRACHTET RHINO NUR DIE GEOMETRIE DIE VON GH ERSTELLT WURDE UND DIE NICHT AUSGEBLENDET (PREVIEW = OFF) IST.
# MIT MEINER NEUEN KOMPONENTE, DIE DIE LINIENSTÄRKE UND FARBE DEFINIEREN LÄST, WIR LEIDER KEINE GEOMETRIE IN GH DARGESTELLT (ALLES WIRD AUSGEBLENDET MIT PREVIEW = OFF), DENN DIE NEUE KOMPONENTE ZEICHNET DIE GEOMETRIE, ANSTATT GH, WIE ÜBLICHERWEISE.
# DESHALB KANN RHINO NICHT WISSEN WAS FÜR EINE GEOMETRIE ER DARSTELLEN SOLL, UND DEFINIERT DIE "NEAR" UND "FAR" "CLIPPING PLANES" FÜR EINE SEHR KLEINE GEOMETRIE UM DEN URSPRUNG.
# MAN MUSS NUR EINEN EINZIGEN PUNKT WEIT WEG VOM URSPRUNG ERSTELLEN, SO DASS DIE PLÄNE DIE GANZE GEOMETRIE ZEIGEN
panel_2 = Panel("100")
pt = ConstructPoint(XCoordinate=panel_2, YCoordinate=panel_2, ZCoordinate=panel_2)

# ---- group: MATERIAL
# Das Material der Struktur muss festgelegt werden: Stahl (4 Stufen), Beton (7 Stufen) oder Holz (4 Stufen). Das Material muss dann unabhängig voneinander mit jedem Stab verbunden werden, sodass in derselben Struktur mehrere Materialien gleichzeitig verwendet werden können, die mit verschiedenen Stäben verbunden sind, wenn man das will.
# 
# Die Komponente Material+ geht standardmäßig von Stahl (S275) aus. Wenn du also nicht genau angeben willst, um welches Material es sich handelt, kannst du einfach die Komponente Material+ einfügen und musst nichts weiter definieren.
material = Slider(0, range=0..2)
material_grad = Slider(1, range=0..6)
mat = MaterialsPlus(MaterialIndex=material, GradeIndex=material_grad)  # -> MaterialName, MaterialProperties, MaterialNames
panel_3 = Panel(mat.MaterialName)
panel_4 = Panel(mat.MaterialNames)

# ---- group: KONVERGENZ UND STABILITÄT
# Mit diesen beiden Kontrollen kann man die Instabilität des iterativen Prozesses ausgleichen. Diese Instabilität kommt vor allem durch die hohe Steifigkeit der Gebäudestrukturen.
# Wenn der iterative Prozess divergiert (nicht konvergiert), kann das höchstwahrscheinlich daran liegen, dass ein oder mehrere Elemente zu steif sind (weil sie ein sehr steifes Material oder einen sehr steifen Querschnitt haben oder sehr kurz sind).
# Die Konvergenz (Stabilität) des iterativen Prozesses kann verbessert werden, indem die Steifigkeit (Faktor „Stiffness“) reduziert wird. Dieser Faktor muss mit allen Stäben der Struktur verknüpft sein („CtrlK“).
# Durch die Flexibilisierung der Struktur nehmen die Verformungen zu, aber die Ergebnisse werden mit dem umgekehrten Effekt korrigiert, sodass korrekte Endergebnisse erzielt werden.
# Wenn die Struktur flexibler gemacht wird, kann es nötig sein, den „Threshold“ zu verringern, wenn die Struktur sehr langsam konvergiert und nie fertig wird.
# Außerdem gibt es bei jedem Stab eine Steuerung (CtrlA) für die „Weighting“ gegenüber dem axialen Verhalten und eine Steuerung (CtrlB) für die „Weighting“ gegenüber dem Biegeverhalten, aber diese Parameter sind bei Konvergenzproblemen schwieriger einzustellen.
reset_kontrollparameter = Button()
panel_5 = Panel("""1.0
15.0""")
threshold = Slider(15, range=10..20)
stiffnessratio = Slider(1, range=0.001..1)
reset = CSharpScript(Reset=reset_kontrollparameter, Parameters=[stiffnessratio, threshold], Values=panel_5)  # -> flatten(out); inputs Reset: Boolean, Parameters: list, Values: list of Double
# ---------- reset: C# ----------
// Grasshopper Script Instance
#region Usings
using System;
using System.Linq;
using System.Collections;
using System.Collections.Generic;
using System.Drawing;

using Rhino;
using Rhino.Geometry;

using Grasshopper;
using Grasshopper.Kernel;
using Grasshopper.Kernel.Data;
using Grasshopper.Kernel.Types;
#endregion

public class Script_Instance : GH_ScriptInstance
{
    #region Notes
    /* 
      Members:
        RhinoDoc RhinoDocument
        GH_Document GrasshopperDocument
        IGH_Component Component
        int Iteration

      Methods (Virtual & overridable):
        Print(string text)
        Print(string format, params object[] args)
        Reflect(object obj)
        Reflect(object obj, string method_name)
    */
    #endregion

    private void RunScript(bool Reset, List<object> Parameters, List<double> Values)
    {
        Grasshopper.Kernel.Special.GH_NumberSlider slider;

        int num_sliders = Parameters.Count();
        int num_values = Values.Count();

        if (num_sliders != num_values)
            Print("Error: Parameters and Values should match in number of elements");
        else
        {    
            int i;

            if (Reset == true)
            {
                Print("Reseting to default values");

                for (i = 0; i < num_sliders ; i++)
                {
                    slider = Component.Params.Input[1].Sources[i] as Grasshopper.Kernel.Special.GH_NumberSlider; //try to cast that thing as a slider

                    if (slider != null)
                    {
                        slider.TrySetSliderValue((decimal) Values[i]);
                    }
                }
            }
        }
    }
}
# ---------- end reset ----------
eval = Evaluate(E="10^(-x)", x=threshold)
panel_6 = Panel(reset)

# ----
# When Selected = True, only currently selected parameters will be adjusted. There will be no undo record for this operation.
toggle_2 = BooleanToggle(True)
list = ValueList({"Normal": 1, "Faint": 2, "Hidden": 3}, selected="Faint")
# MIT DIESEM TEIL, DEN ICH AUS DEM INTERNET RUNTERGELADEN HABE, KANNST DU DEN TYP „WIRE“ AUTOMATISCH IN „FAINT“ FÜR DIE VON DIR AUSGEWÄHLTEN TEILE ÄNDERN. ICH HAB DEN CODE AUS DEM INTERNET GEÄNDERT, DAMIT DIE „WIRE“, DIE MANUELL AUF „HIDDEN“ GESETZT WURDEN, NICHT AUF „FAINT“ GEÄNDERT WERDEN. DAS HEIßT, NUR DIE, DIE AUF ‚DEFAULT‘ WAREN, WERDEN AUF „FAINT“ GEÄNDERT.
vb = VBScript(wire=list, selected=toggle_2)  # -> out, A
# ---------- vb: VB usings ----------
Imports System.IO
Imports System.Linq
Imports System.Data
Imports System.Drawing
Imports System.Reflection
Imports System.Windows.Forms
Imports System.Xml
Imports System.Xml.Linq
Imports System.Runtime.InteropServices

Imports Rhino.DocObjects
Imports Rhino.Collections
Imports GH_IO
Imports GH_IO.Serialization
# ---------- vb: VB ----------
    Dim document As GH_Document = owner.OnPingDocument()
    If (document Is Nothing) Then Return

    For Each att As IGH_Attributes In document.Attributes
        Dim param As IGH_Param = TryCast(att.DocObject, IGH_Param)
        If (param Is Nothing) Then Continue For

        If (selected And Not param.Attributes.GetTopLevel.Selected ) Then Continue For

        If param.WireDisplay = GH_ParamWireDisplay.Default Then
            Select Case wire
            Case 2
            param.WireDisplay = GH_ParamWireDisplay.faint
            Case 3
            param.WireDisplay = GH_ParamWireDisplay.hidden
            Case Else
            param.WireDisplay = GH_ParamWireDisplay.Default
            End Select
        End If

    Next
# ---------- end vb ----------
streckenlast_stützen_q_kn_m = Slider(0, range=-50..50)
number_slider = Slider(12, range=0..16)
drehungswinkel_des_trägers_º = Slider(0, range=0..180)

# ---- group: LOGOS ON VIEWPORT
# Das ist nur, um die Logos zu zeigen.
logos = BooleanToggle(True)
str2img = DeserializeImageFromString(ImageString=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)
trigger = Trigger(Interval=2000, TimerInterval=2000, Target=c_script)
bitmap = BitmapFromFile(BitmapPath=str2img)  # -> Bitmap, Width, Height
c_script = CSharpScript()  # -> out, a, W, H
# ---------- c_script: C# ----------
// Grasshopper Script Instance
#region Usings
using System;
using System.Linq;
using System.Collections;
using System.Collections.Generic;
using System.Drawing;

using Rhino;
using Rhino.Geometry;

using Grasshopper;
using Grasshopper.Kernel;
using Grasshopper.Kernel.Data;
using Grasshopper.Kernel.Types;
#endregion

using System.IO;
using System.Data;
using System.Reflection;
using System.Windows.Forms;
using System.Xml;
using System.Xml.Linq;
using System.Runtime.InteropServices;

using Rhino.DocObjects;
using Rhino.Collections;

public class Script_Instance : GH_ScriptInstance
{
    #region Notes
    /* 
      Members:
        RhinoDoc RhinoDocument
        GH_Document GrasshopperDocument
        IGH_Component Component
        int Iteration

      Methods (Virtual & overridable):
        Print(string text)
        Print(string format, params object[] args)
        Reflect(object obj)
        Reflect(object obj, string method_name)
    */
    #endregion

    private void RunScript(ref object a, ref object W, ref object H)
    {
        var view = RhinoDoc.ActiveDoc.Views.ActiveView;
        H = view.ActiveViewport.Bounds.Height;
        W = view.ActiveViewport.Bounds.Width;
    }
}
# ---------- end c_script ----------
filter = StreamFilter(Gate=logos, Stream1=bitmap.Bitmap)
subtraction = Subtraction(A=c_script.W, B="30")
subtraction_2 = Subtraction(A=c_script.H, B="30")
multiplication = Multiplication(A=c_script.W, B=".12")
pt_2 = ConstructPoint(XCoordinate=subtraction, YCoordinate=subtraction_2, ZCoordinate=0)
c_script_2 = CSharpScript(Tx=filter, P=pt_2, w=multiplication)  # -> out, a; inputs P: Point3d, w: Double
# ---------- c_script_2: C# ----------
// Grasshopper Script Instance
#region Usings
using System;
using System.Linq;
using System.Collections;
using System.Collections.Generic;
using System.Drawing;

using Rhino;
using Rhino.Geometry;
using Rhino.DocObjects;
using Rhino.Collections;

using Grasshopper;
using Grasshopper.Kernel;
using Grasshopper.Kernel.Data;
using Grasshopper.Kernel.Types;
#endregion

using System;
using System.Drawing;
using System.Drawing.Drawing2D;
using System.Drawing.Imaging;
using System.IO;

public class Script_Instance : GH_ScriptInstance
{
    #region Notes
    /* 
      Members:
        RhinoDoc RhinoDocument
        GH_Document GrasshopperDocument
        IGH_Component Component
        int Iteration

      Methods (Virtual & overridable):
        Print(string text)
        Print(string format, params object[] args)
        Reflect(object obj)
        Reflect(object obj, string method_name)
    */
    #endregion

    private void RunScript(object Tx, Point3d P, double w, ref object a)
    {
        Bitmap texture = Tx as Bitmap;
        if (texture == null) return;

        int width = texture.Width;
        int height = texture.Height;

        double scale = w / ((double) width);

        texture = ResizeImage(texture, (int) (scale * width), (int) (scale * height));

        if (_bitmap == null)
            _bitmap = new Rhino.Display.DisplayBitmap(texture);

        _point.X = P.X - scale * width;
        _point.Y = P.Y - scale * height;
        _point.Z = 0.0;
    }

    private Rhino.Display.DisplayBitmap _bitmap;
    private Point3d _point;    
 
    public override void BeforeRunScript()
    {
        if (_bitmap != null)
        {
            _bitmap.Dispose();
            _bitmap = null;
        }
    }

    //Draw all meshes in this method.
    public override void DrawViewportMeshes(IGH_PreviewArgs args)
    {
        if (_bitmap == null) return;
 
        int x = (int) (_point.X);
        int y = (int) (_point.Y);
        args.Display.DrawBitmap(_bitmap, x, y);
    }

    /// Resize the image to the specified width and height.
    /// </summary>
    /// <param name="image">The image to resize.</param>
    /// <param name="width">The width to resize to.</param>
    /// <param name="height">The height to resize to.</param>
    /// <returns>The resized image.</returns>
    public static Bitmap ResizeImage(Image image, int width, int height)
    {
        var destRect = new Rectangle(0, 0, width, height);
        var destImage = new Bitmap(width, height);

        destImage.SetResolution(image.HorizontalResolution, image.VerticalResolution);

        using (var graphics = Graphics.FromImage(destImage))
        {
            graphics.CompositingMode = CompositingMode.SourceCopy;
            graphics.CompositingQuality = CompositingQuality.HighQuality;
            graphics.InterpolationMode = InterpolationMode.HighQualityBicubic;
            graphics.SmoothingMode = SmoothingMode.HighQuality;
            graphics.PixelOffsetMode = PixelOffsetMode.HighQuality;

            using (var wrapMode = new ImageAttributes())
            {
                wrapMode.SetWrapMode(WrapMode.TileFlipXY);
                graphics.DrawImage(image, destRect, 0, 0, image.Width,image.Height, GraphicsUnit.Pixel, wrapMode);
            }
        }

        return destImage;
    }    
}
# ---------- end c_script_2 ----------

# ----
liniengrösse_für_die_gelenke = Slider(5, range=0..10)
grösse_der_kreise_für_die_gelenke = Slider(0.03, range=0..0.2)
gelenke_darstellen = BooleanToggle(True)
farbe_für_die_gelenke = ColourSwatch(SwatchColor=RGB(255, 255, 255))

# ---- group: GEOMETRISCHE PARAMETER
spannweite_l_m = Slider(8, range=2..16)
höhe_h_m = Slider(4, range=2..8)
panel_7 = Panel("""GEOMETRIE
PARAMETER""")
reset_geometrie = Button()
panel_8 = Panel("""8.0
4.0
8.0
1.2
20.0
1.2
8""")

# ---- group: GEOMETRIE ERSTELLUNG
# Mit K2E+ musst du nur Linien erstellen, die die Stäbe der Struktur zeigen. Du musst sie nicht in Segmente aufteilen (das macht die Beam+ Komponente automatisch). Du musst aber jede Linie an den Verbindungen mit anderen Linien aufteilen (z. B. muss ein „Durchlaufträger“ für jeden Abschnitt zwischen den Auflagern in Linien aufgeteilt werden) und wenn die Richtung wechselt (oder eine Kurve dargestellt wird).
A = ConstructPoint(XCoordinate=0, YCoordinate=0, ZCoordinate=0)
B = ConstructPoint(XCoordinate=spannweite_l_m, YCoordinate=0, ZCoordinate=0)
C = ConstructPoint(XCoordinate=0, YCoordinate=0, ZCoordinate=höhe_h_m)
D = ConstructPoint(XCoordinate=spannweite_l_m, YCoordinate=0, ZCoordinate=höhe_h_m)
stl = Line(StartPoint=A, EndPoint=C)
str = Line(StartPoint=B, EndPoint=D)
trg = Line(StartPoint=C, EndPoint=D)

# ---- group: GEOMETRIE
abstand_y_zum_seil_m = Slider(8, range=0..10)
durchhang_des_seiles_dh_m = Slider(1.2, range=0.1..5)
segmente_n = Slider(16, range=8..32)
neg = Negative(Value=abstand_y_zum_seil_m)
neg_2 = Negative(Value=durchhang_des_seiles_dh_m)
Y = UnitY(Factor=neg)
G = ConstructPoint(XCoordinate=expr("x/2", spannweite_l_m), YCoordinate=neg, ZCoordinate=neg_2)
E = Move(Geometry=A, Motion=Y)  # -> Geometry, Transform
F = Move(Geometry=B, Motion=Y)  # -> Geometry, Transform
merge = Merge(Data1=E.Geometry, Data2=G, Data3=F.Geometry)  # -> flatten(Result)
intcrv = Interpolate(Vertices=merge, Degree=2, Periodic=False, KnotStyle=0)  # -> Curve, Length, Domain
cat = Catenary(PointA=E.Geometry, PointB=F.Geometry, Length=intcrv.Length, Gravity=Vector(0, 0, -1))
divide = DivideCurve(Curve=cat, Count=segmente_n, Kinks=False)  # -> Points, Tangents, Parameters
pline = PolyLine(Vertices=divide.Points, Closed=False)
# In diesem Teil habe ich ein Beispiel für ein Kabel entwickelt.
# Die Funktionsweise ist ganz einfach. Die Komponente zum Modellieren der Kabel ist anders („Kabel+“), weil sie nur mit Zugkräften arbeiten kann und es keine Momente oder Querkräfte gibt.
# Die Eingabeparameter sind die notwendigen: die Geometrie (Linien), das Material, die Eigenschaften des Querschnitts und dessen Geometrie.
# Man kann eine Vorspannkraft (P) verwenden. Und es werden die Konvergenzsteuerungskoeffizienten verwendet.
# Ich habe auch den einfachen Auflager (3DOF) hinzugefügt, die Drehungen zulässt, aber die gewünschten Bewegungen fixiert.
explode = Explode(Curve=pline, Recursive=True)  # -> Segments, Vertices

# ---- group: MATERIAL UND QUERSCHNITT
seil_durchmesser_mm = Slider(35, range=10..50)
mat_2 = MaterialsPlus(MaterialIndex=0, GradeIndex=1)  # -> MaterialName, MaterialProperties, MaterialNames
circle = CircularSectionProperties(Diameter_mm=seil_durchmesser_mm, Torsion=False)  # -> Properties, WidthW_m, HeightH_m, GeometryPolylineOfTheCrossSection
cable = CablePlus(
    Line=explode.Segments,
    Material=mat_2.MaterialProperties,
    Properties=circle.Properties,
    Width=circle.WidthW_m,
    Height=circle.HeightH_m,
    CrossSection=circle.GeometryPolylineOfTheCrossSection,
    PreTension=0,
    ControlAxial=1e+10,
    ControlStiffness=stiffnessratio)  # -> flatten(StartPlane), flatten(EndPlane), flatten(Cable), _3DGeometry

# ---- group: LASTEN
streckenlast_kabel_q_kn_m = Slider(5, range=-50..50)
relative_position_der_punktlast = Slider(0.3, range=0..1)
punktlast_am_seil_kn = Slider(0, range=-200..200)
multiplication_2 = Multiplication(A=segmente_n, B=relative_position_der_punktlast)
eval_2 = Evaluate(E="Int(x)", x=multiplication_2)
item = ListItem(List=explode.Vertices, Index=eval_2, Wrap=True)
multiplication_3 = Multiplication(A=intcrv.Length, B=streckenlast_kabel_q_kn_m)
division = Division(A=multiplication_3, B=segmente_n)
cull_i = CullIndex(List=explode.Vertices, Indices=-1, Wrap=True)
cull_i_2 = CullIndex(List=cull_i, Indices=0, Wrap=True)
neg_3 = Negative(Value=division)
Z = UnitZ(Factor=neg_3)
neg_4 = Negative(Value=punktlast_am_seil_kn)
Z_2 = UnitZ(Factor=neg_4)
load = LoadPlus(Point=item, NodalForce=Z_2)
load_2 = LoadPlus(Point=cull_i_2, NodalForce=Z)

# ----
abstand_y_zum_fachwerk_m = Slider(20, range=0..20)
fachwerkhöhe_fh_m = Slider(1.2, range=0.1..5)
segmente_n_2 = Slider(8, range=4..32)
division_2 = Division(A=segmente_n_2, B=2)
neg_5 = Negative(Value=abstand_y_zum_fachwerk_m)
neg_6 = Negative(Value=fachwerkhöhe_fh_m)
Y_2 = UnitY(Factor=neg_5)
H = Move(Geometry=A, Motion=Y_2)  # -> Geometry, Transform
I = Move(Geometry=B, Motion=Y_2)  # -> Geometry, Transform
ln = Line(StartPoint=H.Geometry, EndPoint=I.Geometry)
Z_3 = UnitZ(Factor=neg_6)
divide_2 = DivideCurve(Curve=ln, Count=segmente_n_2, Kinks=False)  # -> Points, Tangents, Parameters
move = Move(Geometry=divide_2.Points, Motion=Z_3)  # -> Geometry, Transform
cull_i_3 = CullIndex(List=divide_2.Points, Indices=0, Wrap=True)
split = SplitList(List=divide_2.Points, Index=division_2)  # -> ListA, ListB
cull_i_4 = CullIndex(List=move.Geometry, Indices=0, Wrap=True)
cull_i_5 = CullIndex(List=split.ListB, Indices=0, Wrap=True)
cull_i_6 = CullIndex(List=cull_i_3, Indices=-1, Wrap=True)
cull_i_7 = CullIndex(List=cull_i_4, Indices=-1, Wrap=True)
rev = ReverseList(List=cull_i_5)
rev_2 = ReverseList(List=cull_i_7)
short = ShortestList(ListA=split.ListA, ListB=cull_i_7, TrimMode=2)  # -> ListA, ListB
pline_2 = PolyLine(Vertices=divide_2.Points, Closed=False)
pline_3 = PolyLine(Vertices=cull_i_7, Closed=False)
short_2 = ShortestList(ListA=rev_2, ListB=rev, TrimMode=2)  # -> ListA, ListB
explode_2 = Explode(Curve=pline_2, Recursive=True)  # -> Segments, Vertices
explode_3 = Explode(Curve=pline_3, Recursive=True)  # -> Segments, Vertices
ln_2 = Line(StartPoint=short.ListA, EndPoint=short.ListB)
ln_3 = Line(StartPoint=cull_i_6, EndPoint=cull_i_7)
ln_4 = Line(StartPoint=short_2.ListA, EndPoint=short_2.ListB)
merge_2 = Merge(Data1=ln_2, Data2=ln_4)  # -> flatten(Result)
untere_gurt = Line(explode_3.Segments)
obere_gurt = Line(explode_2.Segments)
diagonale = Line(merge_2)
vertikale = Line(ln_3)
merge_3 = Merge(Data1=obere_gurt, Data2=untere_gurt)  # -> flatten(Result)

# ---- group: GEOMETRISCHE PARAMETER (continued)
reset_2 = CSharpScript(
    Reset=reset_geometrie,
    Parameters=[spannweite_l_m, höhe_h_m, abstand_y_zum_seil_m, durchhang_des_seiles_dh_m, abstand_y_zum_fachwerk_m, fachwerkhöhe_fh_m, segmente_n_2],
    Values=panel_8)  # -> flatten(out); inputs Reset: Boolean, Parameters: list, Values: list of Double; same code as reset
panel_9 = Panel(reset_2)

# ---- group: LASTEN
streckenlast_fachwerk_q_kn_m = Slider(15, range=-50..50)
multiplication_4 = Multiplication(A=spannweite_l_m, B=streckenlast_fachwerk_q_kn_m)
division_3 = Division(A=multiplication_4, B=segmente_n_2)
neg_7 = Negative(Value=division_3)
Z_4 = UnitZ(Factor=neg_7)
load_3 = LoadPlus(Point=cull_i_6, NodalForce=Z_4)

# ----
mat_3 = MaterialsPlus(MaterialIndex=0, GradeIndex=1)  # -> MaterialName, MaterialProperties, MaterialNames
wandstärke_beim_fachwerk_mm = Slider(8, range=5..20)
breite_wrect_mm = Slider(50, range=5..400)
höhe_hrect_mm = Slider(50, range=5..400)
durchmesser_hcir = Slider(50, range=5..400)
breite_wrect_mm_2 = Slider(50, range=5..400)
höhe_hrect_mm_2 = Slider(100, range=5..400)
holow_circle = CircularHollowSectionProperties(Diameter_mm=durchmesser_hcir, Thickness_mm=wandstärke_beim_fachwerk_mm, Torsion=False)  # -> Properties, WidthW_m, HeightH_m, GeometryPolylineOfTheCrossSection
hollow_rectangle = RectangularHollowSectionProperties(Width_mm=breite_wrect_mm, Height_mm=höhe_hrect_mm, Thickness_mm=wandstärke_beim_fachwerk_mm, Torsion=False)  # -> Properties, WidthW_m, HeightH_m, GeometryPolylineOfTheCrossSection
hollow_rectangle_2 = RectangularHollowSectionProperties(Width_mm=breite_wrect_mm_2, Height_mm=höhe_hrect_mm_2, Thickness_mm=wandstärke_beim_fachwerk_mm, Torsion=False)  # -> Properties, WidthW_m, HeightH_m, GeometryPolylineOfTheCrossSection
bar = BarPlus(
    Line=merge_3,
    Material=mat_3.MaterialProperties,
    Properties=hollow_rectangle_2.Properties,
    Width=hollow_rectangle_2.WidthW_m,
    Height=hollow_rectangle_2.HeightH_m,
    CrossSection=hollow_rectangle_2.GeometryPolylineOfTheCrossSection,
    ControlAxial=1e+10,
    ControlStiffness=stiffnessratio)  # -> flatten(StartPlane), flatten(EndPlane), flatten(Bar), _3DGeometry
bar_2 = BarPlus(
    Line=vertikale,
    Material=mat_3.MaterialProperties,
    Properties=hollow_rectangle.Properties,
    Width=hollow_rectangle.WidthW_m,
    Height=hollow_rectangle.HeightH_m,
    CrossSection=hollow_rectangle.GeometryPolylineOfTheCrossSection,
    ControlAxial=1e+10,
    ControlStiffness=stiffnessratio)  # -> flatten(StartPlane), flatten(EndPlane), flatten(Bar), _3DGeometry
bar_3 = BarPlus(
    Line=diagonale,
    Material=mat_3.MaterialProperties,
    Properties=holow_circle.Properties,
    Width=holow_circle.WidthW_m,
    Height=holow_circle.HeightH_m,
    CrossSection=holow_circle.GeometryPolylineOfTheCrossSection,
    ControlAxial=1e+10,
    ControlStiffness=stiffnessratio)  # -> flatten(StartPlane), flatten(EndPlane), flatten(Bar), _3DGeometry
merge_4 = Merge(Data1=bar.Bar, Data2=bar_2.Bar, Data3=bar_3.Bar)  # -> flatten(Result)

# ---- group: AUFLAGER
rechte_seilauflager_fest = BooleanToggle(True)
support3dof = Support3DOFPlus(SupportPt=E.Geometry, XFixed=True, YFixed=True, ZFixed=True, Strength=1000000000)
support3dof_2 = Support3DOFPlus(SupportPt=F.Geometry, XFixed=rechte_seilauflager_fest, YFixed=True, ZFixed=True, Strength=1000000000)
merge_5 = Merge(Data1=support3dof, Data2=support3dof_2)  # -> flatten(Result)

rechte_fachwerkauflager_fest = BooleanToggle(False)
support3dof_3 = Support3DOFPlus(SupportPt=I.Geometry, XFixed=rechte_fachwerkauflager_fest, YFixed=True, ZFixed=True, Strength=1000000000)
support3dof_4 = Support3DOFPlus(SupportPt=H.Geometry, XFixed=True, YFixed=True, ZFixed=True, Strength=1000000000)
merge_6 = Merge(Data1=support3dof_4, Data2=support3dof_3)  # -> flatten(Result)

# ----
merge_7 = Merge(Data1=obere_gurt, Data2=untere_gurt, Data3=vertikale, Data4=diagonale)  # -> flatten(Result)

# ---- group: AUFLAGER
# Ich hab die Komponente neu programmiert und jetzt heißt sie „Support6DOF+“. Sie funktioniert genauso wie die entsprechende Komponente von K2Engineering, aber ich musste die internen Daten ändern, damit die „Auflager“ und die Reaktionen richtig dargestellt werden.
# Du kannst die Bewegungen (Verschiebungen und Drehungen) in den drei Achsen (X, Y, Z) fixieren oder freigeben. Deshalb brauchst du keine anderen „Auflager“, weil der „Auflager“, der nur Verschiebungen fixiert und Drehungen freigibt, auch mit dieser Komponente modelliert werden kann. Das heißt, du kannst in allen Fällen nur diese Komponente verwenden.
# Grundsätzlich ist es nicht vorgesehen, dass die Bewegungen in Z (dZ und RZ) freigegeben werden können. Die Komponente lässt das zwar zu, aber die Darstellung wäre nicht korrekt. Deshalb rate ich davon ab, sie zu verwenden.
rahmenauflager_links_dx = BooleanToggle(True)
rahmenauflager_links_ry = BooleanToggle(True)
rahmenauflager_rechts_dx = BooleanToggle(True)
rahmenauflager_rechts_ry = BooleanToggle(True)
reset_auflager = Button()
panel_10 = Panel("""True
True
True
True""")
reset_3 = CSharpScript(
    Reset=reset_auflager,
    Parameters=[rahmenauflager_links_dx, rahmenauflager_links_ry, rahmenauflager_rechts_dx, rahmenauflager_rechts_ry],
    Values=panel_10)  # -> flatten(out); inputs Reset: Boolean, Parameters: list, Values: list of Double
# ---------- reset_3: C# ----------
// Grasshopper Script Instance
#region Usings
using System;
using System.Linq;
using System.Collections;
using System.Collections.Generic;
using System.Drawing;

using Rhino;
using Rhino.Geometry;

using Grasshopper;
using Grasshopper.Kernel;
using Grasshopper.Kernel.Data;
using Grasshopper.Kernel.Types;
#endregion

public class Script_Instance : GH_ScriptInstance
{
    #region Notes
    /* 
      Members:
        RhinoDoc RhinoDocument
        GH_Document GrasshopperDocument
        IGH_Component Component
        int Iteration

      Methods (Virtual & overridable):
        Print(string text)
        Print(string format, params object[] args)
        Reflect(object obj)
        Reflect(object obj, string method_name)
    */
    #endregion

    private void RunScript(bool Reset, List<object> Parameters, List<double> Values)
    {
        Grasshopper.Kernel.Special.GH_BooleanToggle button;
        int num_buttons = Parameters.Count();
        int num_values = Values.Count();

        if (num_buttons != num_values)
            Print("Error: Parameters and Values should match in number of elements");
        else
        {
            int i;

            if (Reset == true)
            {
                Print("Reseting to default values");
                
                for (i = 0; i < num_buttons ; i++)
                {
                    button = Component.Params.Input[1].Sources[i] as Grasshopper.Kernel.Special.GH_BooleanToggle; //try to cast that thing as a boolean toggle

                    if (button != null)
                    {
                        button.Value = true;
                        button.ExpireSolution(true);
                    }
                }
            }
        }
    }
}
# ---------- end reset_3 ----------
panel_11 = Panel(reset_3)
support6dof_links = Support6DOFPlus(
    SupportPt=A,
    XFixed=rahmenauflager_links_dx,
    YFixed=True,
    ZFixed=True,
    RXFixed=True,
    RYFixed=rahmenauflager_links_ry,
    RZFixed=True,
    Strength=1000000000)
support6dof_rechts = Support6DOFPlus(
    SupportPt=B,
    XFixed=rahmenauflager_rechts_dx,
    YFixed=True,
    ZFixed=True,
    RXFixed=True,
    RYFixed=rahmenauflager_rechts_ry,
    RZFixed=True,
    Strength=1000000000)

# ---- group: KONFIGURATION DER DARSTELLUNG
# Mit dieser Komponente kannst du fast alle Einstellungen für die Ergebnisausgabe zusammenfassen, sodass weniger Kabel zu den „BeamOutput+“-Komponenten nötig sind.
# Die verformte Struktur kann durch die Achsenlinie oder mit einer 3D-Darstellung gezeigt werden. Du kannst den Verstärkungsfaktor, die Farbe der Verformung und der Texte ändern, die die Bewegungen angeben (in mm).
# Die Schnittgrößen kannst du so darstellen, wie wir es immer gemacht haben. Du kannst die Farbe für jede Kraft einstellen (und die axiale Kraft kannst du zwischen Zug und Druck unterscheiden) und die Skala für jedes Diagramm anpassen.
# Die Darstellung der Lasten ist intern in einer Komponente programmiert, aber du kannst die Farbe, den Maßstab, den Radius des Kegels, die Höhe des Kegels und den Radius des Zylinders einstellen.
# Außerdem habe ich die Option hinzugefügt, die Lasten in der verformten oder unverformten Struktur darzustellen.
# Die Geometrie des Strukturmodells wird als Linien („Modelllinie“) oder in 3D (rechteckiger Querschnitt, der dem tatsächlich zugewiesenen Querschnitt des Stabes entspricht) dargestellt. Die Farbe kann eingestellt werden, ist aber für beide Darstellungen gleich.
# Die Darstellung des Sättigungsgrades (Prozentsatz) ist ganz einfach, weil die Komponente BeamOutput+ diesen Prozentsatz schon für jeden Balken angibt. Die passende Farbe für den Balken (und den Text) kannst du ganz einfach aus dieser 8-stufigen Skala auswählen.
# Da die Farbe direkt auf der Linie angezeigt wird, musst du die Linien des ursprünglichen Drahtmodells (Modelllinie) der Struktur deaktivieren.
# Der Code für die Darstellung der „Auflager“ wurde stark vereinfacht. Trotzdem habe ich eine sehr vielseitige Funktion programmiert. Links sind die 16 Fälle von Auflagern, die wir für möglich gehalten haben (Achtung, dZ und rZ können nicht deaktiviert werden).
# Jede der 16 Komponenten hat die Geometrie der Auflager intern gespeichert. Wenn du das Design ändern möchtest, musst du nur ein neues Design in Rhino zeichnen und jedem die Geometrie mit „Internalise Data“ zuweisen, und das System funktioniert auch mit dem neuen Design.
# Du kannst den Maßstab der Darstellung ändern, die Darstellung aktivieren oder deaktivieren und die Farbe ändern. Übrigens werden die Auflager an der Position der Verformung dargestellt. Das kannst du sehen, wenn du zum Beispiel dX freigibst.
# Für die Darstellung der Reaktionen habe ich den bereits programmierten Code für die Darstellung der Lasten verwendet. Die Pfeile ändern ihren Maßstab (normalerweise sind die Reaktionen größer als die auf die Struktur ausgeübten Lasten) und ich habe sie auch etwas dicker gestaltet. Da die in C# programmierte Komponente zur Darstellung der Last jedoch konfigurierbare Parameter für den Radius des Kegels, die Höhe des Kegels und den Radius des Zylinders hat, kannst du die Parameter cr, ch und yr ändern, wenn du sie anpassen möchtest.
# Du kannst die Farbe der Kräfte, der Momente und des Textes, der den Wert der Reaktionen angibt, anpassen und die Darstellung jedes dieser Ergebnisse aktivieren oder deaktivieren.
# Um die Momentreaktionen darzustellen, habe ich auch gerade Pfeile verwendet, allerdings in einer anderen Farbe. Die Richtung des Pfeils zeigt die Achse an, um die sich das Moment der Reaktion dreht. Das Zeichnen von gekrümmten Pfeilen war im Code ziemlich kompliziert. Das kann in Zukunft vielleicht noch verbessert werden.
# Ich glaube, Katja will, dass die „Systemlinie“ dicker dargestellt wird, als abstraktere Darstellung des Strukturmodells. Mit diesem Code kannst du Linien in der gewünschten Dicke und Farbe zeichnen. Normalerweise kannst du in GH die Farbe der generierten Linien anpassen, aber nicht die Dicke. Mit der C#-Komponente, die du bearbeiten kannst, siehst du, wie sie in „DrawViewportMeshes“ gezeichnet wird. Du kannst die Dicke und Farbe einstellen und wählen, ob die „Systemlinie“ angezeigt oder ausgeblendet werden soll.
diagramme_auf_die_verformte_struktur = BooleanToggle(False)
lasten_darstellen = BooleanToggle(True)
lasten_in_der_verformte_struktur = BooleanToggle(True)
farbe_modelllinie = ColourSwatch(SwatchColor=RGB(71, 64, 64))
_3d_modell_darstellung = BooleanToggle(False)
_0 = Geometry([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])
dx = Geometry([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])
dy = Geometry([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])
dxdy = Geometry([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])
rx = Geometry([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])
dxrx = Geometry([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])
dyrx = Geometry([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])
dxdyrx = Geometry([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])
dxry = Geometry([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])
dyry = Geometry([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])
rxry = Geometry([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])
dyrxry = Geometry([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])
verformung = BooleanToggle(True)
farbe_verformung = ColourSwatch(SwatchColor=RGB(207, 207, 207))
bewegungswerte_darstellen = BooleanToggle(False)
faktor_verformung = Slider(57, range=1..200)
lastendarstellungsgrösse = Slider(0.15, range=0..1)
linienstärke = Slider(4, range=0..10)
ry = Geometry([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])
dxdyry = Geometry([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])
dxrxry = Geometry([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])
dxdyrxry = Geometry([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])
farbe_n = ColourSwatch(SwatchColor=RGBA(255, 255, 11, 100))
farbe_n_2 = ColourSwatch(SwatchColor=RGBA(222, 11, 11, 100))
farbe_v = ColourSwatch(SwatchColor=RGBA(27, 133, 0, 101))
farbe_m = ColourSwatch(SwatchColor=RGBA(11, 67, 222, 101))
systemlinie_verdeutlichen = BooleanToggle(False)
auflager_darstellung = Entwine(
    Branch00=_0,
    Branch01=dx,
    Branch02=dy,
    Branch03=dxdy,
    Branch04=rx,
    Branch05=dxrx,
    Branch06=dyrx,
    Branch07=dxdyrx,
    Branch08=ry,
    Branch09=dxry,
    Branch010=dyry,
    Branch011=dxdyry,
    Branch012=rxry,
    Branch013=dxrxry,
    Branch014=dyrxry,
    Branch015=dxdyrxry,
    FlattenInputs=True)  # -> simplify(Result)
normalkraft_n_kn = BooleanToggle(False)
querkraft_vy_kn = BooleanToggle(False)
querkraft_vz_kn = BooleanToggle(False)
moment_my_knm = BooleanToggle(True)
moment_mz_knm = BooleanToggle(False)
farbe_lasten = ColourSwatch(SwatchColor=RGB(255, 163, 0))
_3d_verformung_vereinfacht = BooleanToggle(False)
_3d_modell_verformung = BooleanToggle(False)
farbe_bewegungen = ColourSwatch(SwatchColor=RGB(0, 0, 0))
_3d_auflager_darstellung = BooleanToggle(True)
auflager_kraftreaktionen = BooleanToggle(False)
auflager_momentreaktionen = BooleanToggle(False)
auflagerreaktionen_werte = BooleanToggle(False)
grössenfaktor_für_auflagerdarstellung = Slider(0.6, range=0.1..2)
farbe_auflager = ColourSwatch(SwatchColor=RGB(16, 74, 125))
farbe_kraftreaktionen = ColourSwatch(SwatchColor=RGB(199, 26, 26))
farbe_momentreaktionen = ColourSwatch(SwatchColor=RGB(138, 26, 199))
farbe_reaktionswerte = ColourSwatch(SwatchColor=RGB(255, 255, 255))
reduktion_n = Slider(217, range=1..1000)
reduktion_v = Slider(42, range=1..1000)
reduktion_m = Slider(52, range=1..1000)
nachkommastellen = Slider(0, range=0..3)
spannungsratio = BooleanToggle(False)
_0_00 = ColourSwatch(SwatchColor=RGB(0, 0, 255))
_12_5 = ColourSwatch(SwatchColor=RGB(0, 170, 255))
_25_0 = ColourSwatch(SwatchColor=RGB(0, 255, 128))
_37_5 = ColourSwatch(SwatchColor=RGB(128, 255, 0))
_50_0 = ColourSwatch(SwatchColor=RGB(255, 255, 0))
_62_5 = ColourSwatch(SwatchColor=RGB(255, 212, 0))
_75_0 = ColourSwatch(SwatchColor=RGB(255, 128, 0))
_87_5 = ColourSwatch(SwatchColor=RGB(255, 0, 0))
_100 = ColourSwatch(SwatchColor=RGB(200, 0, 200))
and = GateAnd(A=verformung, B=_3d_modell_verformung)
multiplication_5 = Multiplication(FVerf=stiffnessratio, CtrlK=faktor_verformung)
schnittgrössenwerte_darstellen = BooleanToggle(False)
farbe_schnittgrössenwerte = ColourSwatch(SwatchColor=RGB(255, 255, 255))
c_script_3 = CSharpScript(
    lines=flatten([stl, str, trg, explode.Segments, merge_7]),
    thickness=Slider(10, range=5..20),
    color=ColourSwatch(SwatchColor=RGB(0, 0, 0)),
    b=systemlinie_verdeutlichen)  # -> out, a; inputs lines: list of Line, thickness: Int32, color: Color, b: Boolean
# ---------- c_script_3: C# ----------
// Grasshopper Script Instance
#region Usings
using System;
using System.Linq;
using System.Collections;
using System.Collections.Generic;
using System.Drawing;

using Rhino;
using Rhino.Geometry;

using Grasshopper;
using Grasshopper.Kernel;
using Grasshopper.Kernel.Data;
using Grasshopper.Kernel.Types;
#endregion

public class Script_Instance : GH_ScriptInstance
{
    Color c;
    int t;
    List <Line> l; 
    bool draw_it;

    #region Notes
    /* 
      Members:
        RhinoDoc RhinoDocument
        GH_Document GrasshopperDocument
        IGH_Component Component
        int Iteration

      Methods (Virtual & overridable):
        Print(string text)
        Print(string format, params object[] args)
        Reflect(object obj)
        Reflect(object obj, string method_name)
    */
    #endregion

    private void RunScript(
		List<Line> lines,
		int thickness,
		Color color,
		bool b,
		ref object a)
    {
        draw_it = b;

        int n = lines.Count();
        a = n;
        
        l = new List<Line>();

        for (int i = 0; i < n; i++)
            l.Add(lines[i]);

        c = color;
        t = thickness;
    }

    public override BoundingBox ClippingBox => BoundingBox.Empty;

    public override void DrawViewportMeshes(IGH_PreviewArgs args)
    {
        base.DrawViewportWires(args);
        
        if (draw_it == false)
            return;

        int n = l.Count();

        for (int i = 0; i < n; i++)
            args.Display.DrawLine(l[i], c, t);
    }

    public override void DrawViewportWires(IGH_PreviewArgs args)
    {

    }
}
# ---------- end c_script_3 ----------
outcfg = OutputConfigurationPlus(
    Deformation=verformung,
    ScaleDeformation=faktor_verformung,
    AxialDiagram=normalkraft_n_kn,
    ScaleAxial=reduktion_n,
    ShearDiagramYSecondary=querkraft_vy_kn,
    ShearDiagramZPrincipal=querkraft_vz_kn,
    ScaleShear=reduktion_v,
    MomentDiagramYPrincipal=moment_my_knm,
    MomentDiagramZSecondary=moment_mz_knm,
    ScaleMoment=reduktion_m,
    SaturationRatio=spannungsratio,
    NumberOfDecimals=nachkommastellen,
    Simplified3DRectangularEnvelope=_3d_verformung_vereinfacht,
    DiagramsOnDeformedShape=diagramme_auf_die_verformte_struktur)
merge_8 = Merge(Data1=_0_00, Data2=_12_5, Data3=_25_0, Data4=_37_5, Data5=_50_0, Data6=_62_5, Data7=_75_0, Data8=_87_5, Data9=_100)  # -> flatten(Result)

# ---- group: QUERSCHNITTE
# Die Materialität der Stäbe der Struktur wird durch das Material selbst und die Form des Querschnitts bestimmt. Jeder Stab muss mit einem Material und einem Querschnitt verknüpft werden.
# 
# Ich habe 6 Querschnittstypen programmiert: generisch (dient zur manuellen Eingabe der 4 Berechnungsparameter: A (mm2), Iy (mm4), Iz (mm4) und It (mm4)), rechteckig, rechteckiges Hohlrohr, rund, rundes Hohlrohr und IPE- oder HEB-Profil.
# 
# Grundsätzlich kann man jedes Material mit jeder Querschnittsform mischen, aber natürlich sind manche Kombinationen nicht sinnvoll.
# 
# Jeder Querschnitt erzeugt die gleichen Ausgabeparameter: die Abmessungen der rechteckigen Umhüllung (BxH), die Geometrie des Querschnitts als im globalen Koordinatenursprung gezeichnete Polylinie (die deaktiviert ist und durch Übertragung auf einen aktiven Kurvenparameter aktiviert werden kann; im Beispiel ist sie inaktiv) und die 4 strukturellen Eigenschaften des Querschnitts für die Berechnung.
# 
# Der Eingabeparameter „T?“ gibt an, ob die Torsionssteifigkeit berücksichtigt werden soll oder nicht.
# 
# Mit dem Material und dem Abschnitt kann der Stab auch seine Eigenlast berechnen.
number_slider_2 = Slider(300, range=50..400)
number_slider_3 = Slider(8, range=4..20)
number_slider_4 = Slider(150, range=50..400)
number_slider_5 = Slider(200, range=50..400)
number_slider_6 = Slider(300, range=50..400)
number_slider_7 = Slider(15, range=4..20)
number_slider_8 = Slider(8, range=4..20)
reset_querschnitte = Button()
panel_12 = Panel("""150
300
8
200
300
15
8
0
0
35
8""")

# ----
hollow_rectangle_3 = RectangularHollowSectionProperties(Width_mm=number_slider_4, Height_mm=number_slider_2, Thickness_mm=number_slider_3, Torsion=False)  # -> Properties, WidthW_m, HeightH_m, GeometryPolylineOfTheCrossSection
profile_h = HProfileSectionProperties(
    Width_mm=number_slider_5,
    Height_mm=number_slider_6,
    FlangeThickness_mm=number_slider_7,
    WebThickness_mm=number_slider_8,
    Torsion=False)  # -> Properties, WidthW_m, HeightH_m, GeometryPolylineOfTheCrossSection

# ---- group: STÄBE - BEAMS
# Der wichtigste Bauteil des Modells ist der Stab. Im Stab kommen das Material, die Querschnittsform, der Drehwinkel um die eigene Achse, die Gelenkbedingungen an jedem Ende und die aufgebrachten Linienlasten (sogar das Eigengewicht) zusammen.
# 
# Damit das Bauteil funktioniert, brauchst du ein paar Eingabedaten: die Modelllinien, die mit diesem Stabtyp dargestellt werden sollen, das Material, die Abmessungen des Querschnitts (für die Berechnung der Spannungen) und die strukturellen Eigenschaften des Querschnitts. Mit diesen Parametern funktioniert der Stab schon im Modell.
# 
# Es gibt aber noch viele andere Parameter, mit denen du ihr Verhalten einstellen kannst. Mit dem Parameter „div“ kannst du die Anzahl der Unterteilungen festlegen. Wenn du nichts angibst, wird das automatisch berechnet (z. B. bei einer verteilten Last wird der Stab in kleinere Teile geteilt). Mit den Parametern „endI“ und „endJ“ kannst du am Anfang und am Ende Gelenke einfügen. Jeder Parameter kann 4 verschiedene Werte annehmen: 0 = fest, 1 = gelenkig für beide Biegungen, 2 = gelenkig für die Hauptbiegung, 3 = gelenkig für die Nebenbiegung. Wenn ein binärer Schalter verwendet wird, ist 0 (false) „eingespannt“ und 1 (true) „gelenkig“ für beide Biegungen. Das heißt, diese Parameter können mit einem Schalter mit der Bezeichnung „Gelenkig?“ verwendet werden. Die Standardoption ist „fest mit dem Knoten verbunden“.
# 
# Anschließend kann eine lineare Lastverteilung in den drei globalen Richtungen (qX, qY, qZ) angewendet werden. Das Eigengewicht kann automatisch hinzugefügt werden, wenn die Option SW aktiviert ist, die standardmäßig deaktiviert ist.
# 
# Der letzte Parameter „Ctrl“ ermöglicht eine gewisse Anpassung der Konvergenzgeschwindigkeit, befindet sich jedoch noch in der Testphase und scheint noch nicht richtig zu funktionieren.
# 
# Die Komponente teilt die Linien in Segmente, berechnet die Anfangs- und Endebenen und generiert alle „Beam“- und „Load“-Komponenten, die für den Übergang zum „Solver“ erforderlich sind. Außerdem generiert sie als Ausgabeparameter die endgültige Anzahl der auf jede Linie angewendeten Unterteilungen und eine extrudierte Darstellung der Umhüllung der Stäbe, um leicht erkennen zu können, ob die Stäbe richtig ausgerichtet sind.
drehungswinkel_der_stützen_º = Slider(0, range=0..180)
eigengewicht = BooleanToggle(False)
träger_gelenkig_am_anfang = BooleanToggle(False)
träger_gelenkig_am_ende = BooleanToggle(False)
streckenlast_träger_q_kn_m = Slider(20, range=-50..50)
merge_9 = Merge(Data1=stl, Data2=str)  # -> flatten(Result)
neg_8 = Negative(Value=streckenlast_träger_q_kn_m)
beam = BeamPlus(
    Line=merge_9,
    Material=mat.MaterialProperties,
    Properties=hollow_rectangle_3.Properties,
    Width=hollow_rectangle_3.WidthW_m,
    Height=hollow_rectangle_3.HeightH_m,
    CrossSection=hollow_rectangle_3.GeometryPolylineOfTheCrossSection,
    Angle=drehungswinkel_der_stützen_º,
    I_Connection=0,
    J_Connection=0,
    LoadQX=streckenlast_stützen_q_kn_m,
    LoadQY=0,
    LoadQZ=0,
    SelfWeight=eigengewicht,
    Divisions=4,
    ControlAxial=1e+10,
    ControlBending=1e+10,
    ControlStiffness=stiffnessratio)  # -> flatten(StartPlane), flatten(EndPlane), flatten(Beams), flatten(Loads), Divisions, _3DGeometry
beam_2 = BeamPlus(
    Line=trg,
    Material=mat.MaterialProperties,
    Properties=profile_h.Properties,
    Width=profile_h.WidthW_m,
    Height=profile_h.HeightH_m,
    CrossSection=profile_h.GeometryPolylineOfTheCrossSection,
    Angle=drehungswinkel_des_trägers_º,
    I_Connection=träger_gelenkig_am_anfang,
    J_Connection=träger_gelenkig_am_ende,
    LoadQX=0,
    LoadQY=0,
    LoadQZ=neg_8,
    SelfWeight=eigengewicht,
    Divisions=number_slider,
    ControlAxial=1e+10,
    ControlBending=1e+10,
    ControlStiffness=stiffnessratio)  # -> flatten(StartPlane), flatten(EndPlane), flatten(Beams), flatten(Loads), Divisions, _3DGeometry
merge_10 = Merge(
    Data1=beam._3DGeometry,
    Data2=beam_2._3DGeometry,
    Data3=cable._3DGeometry,
    Data4=bar._3DGeometry,
    Data5=bar_2._3DGeometry,
    Data6=bar_3._3DGeometry)
filter_2 = StreamFilter(Gate=_3d_modell_darstellung, Stream1=merge_10)
preview = CustomPreview(Geometry=filter_2, Material=farbe_modelllinie)

# ---- group: QUERSCHNITTE (continued)
reset_4 = CSharpScript(
    Reset=reset_querschnitte,
    Parameters=[number_slider_4, number_slider_2, number_slider_3, number_slider_5, number_slider_6, number_slider_7, number_slider_8, drehungswinkel_der_stützen_º, drehungswinkel_des_trägers_º, seil_durchmesser_mm, wandstärke_beim_fachwerk_mm],
    Values=panel_12)  # -> flatten(out); inputs Reset: Boolean, Parameters: list, Values: list of Double; same code as reset
panel_13 = Panel(reset_4)
panel_14 = Panel(hollow_rectangle_3.Properties)
panel_15 = Panel(profile_h.Properties)
crv = Curve(hollow_rectangle_3.GeometryPolylineOfTheCrossSection)
crv_2 = Curve(profile_h.GeometryPolylineOfTheCrossSection)

# ---- group: ZUSÄTZLICHE PUNKTLASTEN
# Zusätzlich zu den linearen Lasten auf Stäben kannst du Punktlasten an Knoten wie immer hinzufügen (mit der neuen Komponente Load+). Hier musst du darauf achten, dass die Einheiten, die diese Komponente erwartet, N und nicht kN sind.
py_kn = Slider(0, range=-10..10)
px_kn = Slider(25, range=-50..50)
reset_lasten = Button()
panel_16 = Panel("""0
20
25
0
5
100
0.3
15""")
reset_5 = CSharpScript(
    Reset=reset_lasten,
    Parameters=[streckenlast_stützen_q_kn_m, streckenlast_träger_q_kn_m, px_kn, py_kn, streckenlast_kabel_q_kn_m, punktlast_am_seil_kn, relative_position_der_punktlast, streckenlast_fachwerk_q_kn_m],
    Values=panel_16)  # -> flatten(out); inputs Reset: Boolean, Parameters: list, Values: list of Double; same code as reset
X = UnitX(Factor=px_kn)
Y_3 = UnitY(Factor=py_kn)
panel_17 = Panel(reset_5)
merge_11 = Merge(Data1=X, Data2=Y_3)
load_4 = LoadPlus(Point=C, NodalForce=merge_11)

# ---- group: ZUSAMMENSETZUNG AUFLAGER UND KRÄFTE
# Sowohl die „Auflager“ als auch die Lasten müssen mit einem „Merge“ mit einem Ausgang mit „Flatten“ verbunden werden.
merge_supports = Merge(Data1=support6dof_links, Data2=support6dof_rechts, Data3=merge_5, Data4=merge_6)  # -> flatten(Result)
merge_loads = Merge(Data1=beam.Loads, Data2=beam_2.Loads, Data3=load_4, Data4=load_2, Data5=load_3, Data6=load)  # -> flatten(Result)

# ----
entwine = Entwine(
    Branch00=merge_supports,
    Branch01=merge_loads,
    Branch02=beam.Beams,
    Branch03=beam_2.Beams,
    Branch04=cable.Cable,
    Branch05=merge_4,
    FlattenInputs=True)

# ---- group: SOLVER MODUL
# SOLVER MODUL (KANGAROO)
# 
# Hier werden alle Daten, die das Berechnungsmodell definieren, kombiniert und in den Kangaroo-Solver eingegeben, dessen Ergebnisse (Ausgang "O") für die individuelle Verarbeitung aufgeschlüsselt werden.
# 
# 
# Die Komponente "Entwine" erhält alle Eingabedaten und kombiniert sie, damit der Solver sie empfängt („GoalObjects“). Die Reihenfolge ist unerheblich, aber die Ergebnisse werden in derselben Reihenfolge empfangen, in der sie eingegeben wurden.
# 
# Ich empfehle, den ersten Knoten für die „Auflager“ zu verwenden. Wenn es mehrere "Auflager" gibt, solltest du am Ausgang einen „Merge“ mit „Flatten“ machen..
# 
# Der zweite Knoten sollte für alle Lasten verwendet werden. Die Lasten, die von den Stäben kommen, und die Punktlasten an zusätzlichen Knoten. Sie müssen mit „Merge“+„Flatten“ kombiniert werden.
# 
# Von hier aus kannst du Verbindungen zu weiteren Knoten der Komponente „Entwine“ hinzufügen, je nach Anzahl der verschiedenen Stabtypen (unterschiedliches Material, Querschnittstyp, Drehwinkel, Gelenkbedingungen an den Enden, aufgebrachte Lasten usw.). Es ist besser, so viele wie nötig hinzuzufügen, da die Ausgabe der Ergebnisse bereits direkt nach verschiedenen Typen unterteilt ist und die Darstellung der Ergebnisse vereinfacht wird.
# 
# Der "Solver" führt den iterativen Prozess durch, der zur Gleichgewichtslösung konvergieren sollte. Dazu wird ein "Threshold" verwendet. Die Toleranz dient dazu, nahe beieinander liegende Punkte zusammenzuführen. Der Solver kann mit dem entsprechenden Schalter angehalten werden (zugänglich über das Benutzersteuerfeld).
# 
# Die Schaltfläche „RESET“ startet die Berechnung des „Solver“ neu. Dies muss bei jeder Änderung erfolgen. Um Änderungen zu erkennen, wird ein in Python programmierter Baustein verwendet, der die Daten aller veränderbaren Parameter empfängt und sie vorübergehend speichert, um bei Erkennung einer Änderung eine Neuberechnung des „Solver“ auszulösen. Die Neuberechnung kann auch durch Drücken der Schaltfläche „RESET“ ausgelöst werden.
py3 = Python3Script(CurrentValue=[spannweite_l_m, höhe_h_m, material, material_grad, number_slider_4, number_slider_2, number_slider_3, number_slider_5, number_slider_6, number_slider_7, number_slider_8, drehungswinkel_der_stützen_º, streckenlast_stützen_q_kn_m, number_slider, drehungswinkel_des_trägers_º, streckenlast_träger_q_kn_m, eigengewicht, träger_gelenkig_am_anfang, träger_gelenkig_am_ende, rahmenauflager_links_dx, rahmenauflager_links_ry, rahmenauflager_rechts_dx, rahmenauflager_rechts_ry, px_kn, py_kn, stiffnessratio, eval, durchhang_des_seiles_dh_m, segmente_n, seil_durchmesser_mm, streckenlast_kabel_q_kn_m, punktlast_am_seil_kn, relative_position_der_punktlast])  # -> out, SavedValue, isNewValue; inputs CurrentValue: list
# ---------- py3: Python ----------
# Instantiate or reset persistent data 
if "savedValue" not in globals():
    savedValue = CurrentValue

# Check current value persistent data
if CurrentValue == savedValue:
    isNewValue = False
else:
    isNewValue = True
    savedValue = CurrentValue
    ghenv.Component.ExpireSolution(True)

# Output to GH
SavedValue = savedValue
# ---------- end py3 ----------
reset_6 = Button()
pause = BooleanToggle(False)
or = GateOr(A=py3.isNewValue, B=reset_6)
not = GateNot(A=pause)
solver = Solver(GoalObjects=entwine, Reset=or, Threshold=eval, Tolerance=1e-05, On=not)  # -> I, V, O
bang = ExplodeTree(Data=solver.O)  # -> Branch0, Branch1, Branch2, Branch3, Branch4, Branch5

# ----
# Alle 6DOF-Balken können mit „Merge“ + „Flatten“ verbunden werden, sodass nur eine einzige Gruppe nötig ist, um alle Ergebnisse aller Balken darzustellen.
# Hier werden alle Kabel angeschlossen, um die Ergebnisse anzuzeigen.
merge_12 = Merge(Data1=bang.Branch2, Data2=bang.Branch3)  # -> flatten(Result)

# ---- group: AUFLAGER DARSTELLUNG
# Die Darstellung ist im GH-Code ganz einfach, weil die Komponente in C# anhand der festgelegten Bewegungen an jedem Stützpunkt entscheidet, welches 3D-Stützmodell dargestellt werden soll, es entsprechend dem Parameter skaliert und in der verformten Struktur mit der in den Einstellungen gewählten Farbe darstellt.
support6dofoutput = Support6DOFOutputPlus(Support6DOFData=bang.Branch0)  # -> SupportPlaneIni, SupportPlaneDef, ReactionForce, ReactionMoment, FixedComponents
c_script_4 = CSharpScript(
    pI=support6dofoutput.SupportPlaneIni,
    pD=support6dofoutput.SupportPlaneDef,
    k=multiplication_5,
    s=support6dofoutput.FixedComponents,
    x=auflager_darstellung)  # -> out, pt, simplify(i); inputs pI: Plane, pD: Plane, k: Double, s: String, x: tree
# ---------- c_script_4: C# ----------
// Grasshopper Script Instance
#region Usings
using System;
using System.Linq;
using System.Collections;
using System.Collections.Generic;
using System.Drawing;

using Rhino;
using Rhino.Geometry;

using Grasshopper;
using Grasshopper.Kernel;
using Grasshopper.Kernel.Data;
using Grasshopper.Kernel.Types;
#endregion

public class Script_Instance : GH_ScriptInstance
{
    #region Notes
    /* 
      Members:
        RhinoDoc RhinoDocument
        GH_Document GrasshopperDocument
        IGH_Component Component
        int Iteration

      Methods (Virtual & overridable):
        Print(string text)
        Print(string format, params object[] args)
        Reflect(object obj)
        Reflect(object obj, string method_name)
    */
    #endregion

    private void RunScript(
		Plane pI,
		Plane pD,
		double k,
		string s,
		DataTree<object> x,
		ref object pt,
		ref object i)
    {
        // Write your logic here
        i = null;
        
        // b = [dx, dy, dz, rx, ry, rz]
        // The visualization supposes an array of 16 differente
        // types of support, considering always dz=true and rz = true.
        // Only dx, dy, rx and ry are relevant.
        
        // The index is calculated from the binary values of
        // the corresponing indices
        
        int[] v = new int[4];

        if (s[0] == '1')
            v[0] = 1;
        else
            v[0] = 0;
        if (s[1] == '1')
            v[1] = 1;
        else
            v[1] = 0;
       if (s[3] == '1')
            v[2] = 1;
        else
            v[2] = 0;
       if (s[4] == '1')
            v[3] = 1;
        else
            v[3] = 0;
              
        int n = (int) (1 * v[0] + 2 * v[1] + 4 * v[2] + 8 * v[3]);
        i = x.Branch(n);

        Vector3d def = pD.Origin - pI.Origin;
        def *= k;
        pt = pI.Origin + def;
    }


}
# ---------- end c_script_4 ----------
scale = Scale(Geometry=c_script_4.i, Center=Point(0, 0, 0), Factor=grössenfaktor_für_auflagerdarstellung)  # -> Geometry, Transform
move_2 = Move(Geometry=scale.Geometry, Motion=graft(c_script_4.pt))  # -> Geometry, Transform
filter_3 = StreamFilter(Gate=_3d_auflager_darstellung, Stream1=move_2.Geometry)
preview_2 = CustomPreview(Geometry=filter_3, Material=farbe_auflager)

# ---- group: STAB ERGEBNIS DARSTELLUNG
beamoutput = BeamOutputPlus(BeamData=merge_12, Config=outcfg)  # -> IP0, IP1, P0, P1, N, Vy, Vz, Mt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
c_script_5 = CSharpScript(x=beamoutput.LineS, y=beamoutput.TensionRatio, b=spannungsratio)  # -> out, p, l, t, i; inputs x: Line, y: Double, b: Boolean
# ---------- c_script_5: C# ----------
// Grasshopper Script Instance
#region Usings
using System;
using System.Linq;
using System.Collections;
using System.Collections.Generic;
using System.Drawing;

using Rhino;
using Rhino.Geometry;
using Rhino.Display;

using Grasshopper;
using Grasshopper.Kernel;
using Grasshopper.Kernel.Data;
using Grasshopper.Kernel.Types;
#endregion

public class Script_Instance : GH_ScriptInstance
{
    #region Notes
    /* 
      Members:
        RhinoDoc RhinoDocument
        GH_Document GrasshopperDocument
        IGH_Component Component
        int Iteration

      Methods (Virtual & overridable):
        Print(string text)
        Print(string format, params object[] args)
        Reflect(object obj)
        Reflect(object obj, string method_name)
    */
    #endregion

    private void RunScript(
		Line x,
		double y,
		bool b,
		ref object p,
		ref object l,
		ref object t,
		ref object i)
    {
        if (b == false)
            return;

        l = x;
                    
        Point3d pm;

        pm = 0.5 * (x.From + x.To);

        p = pm;

        t = Math.Round(y*100.0,0).ToString();

        if (y < 0.0)
            i = 0;
        else
            i = Math.Min(8,Math.Floor(y / 0.125));
    }
}
# ---------- end c_script_5 ----------
item_2 = ListItem(List=merge_8, Index=c_script_5.i, Wrap=True)
preview_3 = CSharpScript(L=flatten(beamoutput.Deformation), T=linienstärke, C=[farbe_modelllinie, farbe_verformung], b=_3d_modell_verformung)  # inputs L: list of Line, T: Int32, C: Color, b: Boolean
# ---------- preview_3: C# ----------
// Grasshopper Script Instance
#region Usings
using System;
using System.Linq;
using System.Collections;
using System.Collections.Generic;
using System.Drawing;

using Rhino;
using Rhino.Geometry;

using Grasshopper;
using Grasshopper.Kernel;
using Grasshopper.Kernel.Data;
using Grasshopper.Kernel.Types;
#endregion

public class Script_Instance : GH_ScriptInstance
{
    Color c;
    int t;
    List <Line> l;
    bool draw_it;

    #region Notes
    /* 
      Members:
        RhinoDoc RhinoDocument
        GH_Document GrasshopperDocument
        IGH_Component Component
        int Iteration

      Methods (Virtual & overridable):
        Print(string text)
        Print(string format, params object[] args)
        Reflect(object obj)
        Reflect(object obj, string method_name)
    */
    #endregion

    private void RunScript(List<Line> L, int T, Color C, bool b)
    {
        draw_it = !b;     // Die 3D Darstellung soll nicht gleichzeitig gezeigt werden...

        int n = L.Count();
        
        l = new List<Line>();

        for (int i = 0; i < n; i++)
            l.Add(L[i]);

        c = C;
        t = T;
    }

    public override BoundingBox ClippingBox => BoundingBox.Empty;

    public override void DrawViewportMeshes(IGH_PreviewArgs args)
    {
        base.DrawViewportWires(args);
        
        if (draw_it == false)
            return;
            
        int n = l.Count();

        for (int i = 0; i < n; i++)
            args.Display.DrawLine(l[i], c, t);
    }

    public override void DrawViewportWires(IGH_PreviewArgs args)
    {

    }
}
# ---------- end preview_3 ----------
preview_4 = CustomPreview(Geometry=beamoutput.AxialDiagramCompression, Material=farbe_n_2)
preview_5 = CustomPreview(Geometry=beamoutput.AxialDiagramTension, Material=farbe_n)
preview_6 = CustomPreview(Geometry=[beamoutput.ShearDiagramYSecondary, beamoutput.ShearDiagramZPrincipal], Material=farbe_v)
preview_7 = CustomPreview(Geometry=[beamoutput.MomentDiagramYPrincipal, beamoutput.MomentDiagramZSecondary], Material=farbe_m)
filter_4 = StreamFilter(Gate=bewegungswerte_darstellen, Stream1=beamoutput.TextD)
filter_5 = StreamFilter(Gate=schnittgrössenwerte_darstellen, Stream1=beamoutput.TextF)
filter_6 = StreamFilter(Gate=spannungsratio, Stream1=c_script_5.t)
bnd = Bounds(Numbers=flatten(beamoutput.TensionRatio))
filter_7 = StreamFilter(Gate=and, Stream1=beamoutput._3DGeometry)
not_2 = GateNot(A=spannungsratio)
ln_5 = Line(StartPoint=beamoutput.IP0, EndPoint=beamoutput.IP1)
filter_8 = StreamFilter(Gate=not_2, Stream1=ln_5)
preview_8 = CSharpScript(L=flatten(filter_8), T=linienstärke, C=farbe_modelllinie, b=_3d_modell_darstellung)  # inputs L: list of Line, T: Int32, C: Color, b: Boolean; same code as preview_3
dedomain = DeconstructDomain(Domain=bnd)  # -> Start, End
tag = TextTag(Location=beamoutput.TextPositionD, Text=filter_4, Colour=farbe_bewegungen)
tag_2 = TextTag(Location=beamoutput.TextPositionF, Text=filter_5, Colour=farbe_schnittgrössenwerte)
preview_9 = CustomPreview(Geometry=c_script_5.l, Material=item_2)
preview_10 = CustomPreview(Geometry=filter_7, Material=farbe_verformung)
tag_3 = TextTag(Location=c_script_5.p, Text=filter_6, Colour=item_2)
# ICH HAB DIE DARSTELLUNG DER GELENKE HINZUGEFÜGT. ICH FINDE DAS WICHTIG, WEIL MAN SONST ZUM BEISPIEL EINEN „2GELENKRAHMEN“ NICHT VON EINEM „3GELENKRAHMEN“ UNTERSCHEIDEN KÖNNTE.MAN KANN EINSTELLEN, OB DIE GELENKE DARGESTELLT WERDEN, WIE GROß DIE KREISE SIND, WELCHE FARBE SIE HABEN UND WIE DICK DIE LINIEN SIND.
hingedraw = CSharpScript(
    x=beamoutput.IP0,
    y=beamoutput.IP1,
    color=farbe_für_die_gelenke,
    thickness=liniengrösse_für_die_gelenke,
    size=grösse_der_kreise_für_die_gelenke,
    b=gelenke_darstellen,
    iEnd=beamoutput.IEnd,
    jEnd=beamoutput.JEnd)  # inputs x: list of Plane, y: list of Plane, color: Color, thickness: Int32, size: Double, b: Boolean, iEnd: list of Int32, jEnd: list of Int32
# ---------- hingedraw: C# ----------
// Grasshopper Script Instance
#region Usings
using System;
using System.Linq;
using System.Collections;
using System.Collections.Generic;
using System.Drawing;

using Rhino;
using Rhino.Geometry;

using Grasshopper;
using Grasshopper.Kernel;
using Grasshopper.Kernel.Data;
using Grasshopper.Kernel.Types;
#endregion

public class Script_Instance : GH_ScriptInstance
{
    Color c;
    double s;
    int t;
    List <Plane> p; 
    bool draw_it;
    
    #region Notes
    /* 
      Members:
        RhinoDoc RhinoDocument
        GH_Document GrasshopperDocument
        IGH_Component Component
        int Iteration

      Methods (Virtual & overridable):
        Print(string text)
        Print(string format, params object[] args)
        Reflect(object obj)
        Reflect(object obj, string method_name)
    */
    #endregion

    private void RunScript(
		List<Plane> x,
		List<Plane> y,
		Color color,
		int thickness,
		double size,
		bool b,
		List<int> iEnd,
		List<int> jEnd)
    {
        if (x == null || y == null)
        {
            return;
        }

        draw_it = b;

        int n = x.Count();

        if (n != y.Count() || n!= iEnd.Count() || n!= jEnd.Count())
        {
            return;
        }
        p = new List<Plane>();

        for (int i = 0; i < n; i++)
        {
            switch(iEnd[i])
            {
                case 0:
                    break;
                case 1:
                    p.Add(new Plane(x[i].Origin, x[i].XAxis));
                    p.Add(new Plane(x[i].Origin, x[i].YAxis));
                    break;
                case 2:
                    p.Add(new Plane(x[i].Origin, x[i].XAxis));
                    break;
                case 3:
                    p.Add(new Plane(x[i].Origin, x[i].YAxis));
                    break;
            }
            
            switch(jEnd[i])
            {
                case 0:
                    break;
                case 1:
                    p.Add(new Plane(y[i].Origin, y[i].XAxis));
                    p.Add(new Plane(y[i].Origin, y[i].YAxis));
                    break;
                case 2:
                    p.Add(new Plane(y[i].Origin, y[i].XAxis));
                    break;
                case 3:
                    p.Add(new Plane(y[i].Origin, y[i].YAxis));
                    break;
            }
        }

        c = color;
        s = size;
        t = thickness;
    }

    public override BoundingBox ClippingBox => BoundingBox.Empty;

    public override void DrawViewportMeshes(IGH_PreviewArgs args)
    {
        base.DrawViewportMeshes(args);

        if (draw_it == false)
            return;

        int n = p.Count();

        Circle ci;

        for (int i = 0; i < n; i++)
        {
            ci = new Circle(p[i], s);
            args.Display.DrawCircle(ci, c, t);
        }
    }

    public override void DrawViewportWires(IGH_PreviewArgs args)
    {
    }
}
# ---------- end hingedraw ----------

# ---- group: KABEL ERGEBNIS DARSTELLUNG
cableoutput = CableOutputPlus(CableData=bang.Branch4, Config=outcfg)  # -> IP0, IP1, P0, P1, N, Deformation, AxialDiagramTension, TextPositionD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
c_script_6 = CSharpScript(x=cableoutput.LineS, y=cableoutput.TensionRatio, b=spannungsratio)  # -> out, p, l, t, i; inputs x: Line, y: Double, b: Boolean; same code as c_script_5
item_3 = ListItem(List=merge_8, Index=c_script_6.i, Wrap=True)
preview_11 = CSharpScript(L=flatten(cableoutput.Deformation), T=linienstärke, C=[farbe_modelllinie, farbe_verformung], b=_3d_modell_verformung)  # inputs L: list of Line, T: Int32, C: Color, b: Boolean; same code as preview_3
preview_12 = CustomPreview(Geometry=cableoutput.AxialDiagramTension, Material=farbe_n)
filter_9 = StreamFilter(Gate=bewegungswerte_darstellen, Stream1=cableoutput.TextD)
filter_10 = StreamFilter(Gate=schnittgrössenwerte_darstellen, Stream1=cableoutput.TextF)
filter_11 = StreamFilter(Gate=spannungsratio, Stream1=c_script_6.t)
bnd_2 = Bounds(Numbers=flatten(cableoutput.TensionRatio))
filter_12 = StreamFilter(Gate=and, Stream1=cableoutput._3DGeometry)
ln_6 = Line(StartPoint=cableoutput.IP0, EndPoint=cableoutput.IP1)
not_3 = GateNot(A=spannungsratio)
filter_13 = StreamFilter(Gate=not_3, Stream1=ln_6)
preview_13 = CSharpScript(L=flatten(filter_13), T=linienstärke, C=farbe_modelllinie, b=_3d_modell_darstellung)  # inputs L: list of Line, T: Int32, C: Color, b: Boolean; same code as preview_3
dedomain_2 = DeconstructDomain(Domain=bnd_2)  # -> Start, End
tag_4 = TextTag(Location=cableoutput.TextPositionD, Text=filter_9, Colour=farbe_bewegungen)
tag_5 = TextTag(Location=cableoutput.TextPositionF, Text=filter_10, Colour=farbe_schnittgrössenwerte)
preview_14 = CustomPreview(Geometry=c_script_6.l, Material=item_3)
preview_15 = CustomPreview(Geometry=filter_12, Material=farbe_verformung)
tag_6 = TextTag(Location=c_script_6.p, Text=filter_11, Colour=item_3)

# ---- group: PENDELSTAB ERGEBNIS DARSTELLUNG
baroutput = BarOutputPlus(BarData=bang.Branch5, Config=outcfg)  # -> IP0, IP1, P0, P1, N, Deformation, AxialDiagramCompression, AxialDiagramTension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
c_script_7 = CSharpScript(x=baroutput.LineS, y=baroutput.TensionRatio, b=spannungsratio)  # -> out, p, l, t, i; inputs x: Line, y: Double, b: Boolean; same code as c_script_5
item_4 = ListItem(List=merge_8, Index=c_script_7.i, Wrap=True)
preview_16 = CSharpScript(L=flatten(baroutput.Deformation), T=linienstärke, C=[farbe_modelllinie, farbe_verformung], b=_3d_modell_verformung)  # inputs L: list of Line, T: Int32, C: Color, b: Boolean; same code as preview_3
preview_17 = CustomPreview(Geometry=baroutput.AxialDiagramCompression, Material=farbe_n_2)
preview_18 = CustomPreview(Geometry=baroutput.AxialDiagramTension, Material=farbe_n)
preview_19 = CustomPreview(Material=farbe_v)
preview_20 = CustomPreview(Material=farbe_m)
filter_14 = StreamFilter(Gate=bewegungswerte_darstellen, Stream1=baroutput.TextD)
filter_15 = StreamFilter(Gate=schnittgrössenwerte_darstellen, Stream1=baroutput.TextF)
filter_16 = StreamFilter(Gate=spannungsratio, Stream1=c_script_7.t)
bnd_3 = Bounds(Numbers=flatten(baroutput.TensionRatio))
filter_17 = StreamFilter(Gate=and, Stream1=baroutput._3DGeometry)
ln_7 = Line(StartPoint=baroutput.IP0, EndPoint=baroutput.IP1)
not_4 = GateNot(A=spannungsratio)
filter_18 = StreamFilter(Gate=not_4, Stream1=ln_7)
preview_21 = CSharpScript(L=flatten(filter_18), T=linienstärke, C=farbe_modelllinie, b=_3d_modell_darstellung)  # inputs L: list of Line, T: Int32, C: Color, b: Boolean; same code as preview_3
dedomain_3 = DeconstructDomain(Domain=bnd_3)  # -> Start, End
tag_7 = TextTag(Location=baroutput.TextPositionD, Text=filter_14, Colour=farbe_bewegungen)
tag_8 = TextTag(Location=baroutput.TextPositionF, Text=filter_15, Colour=farbe_schnittgrössenwerte)
preview_22 = CustomPreview(Geometry=c_script_7.l, Material=item_4)
preview_23 = CustomPreview(Geometry=filter_17, Material=farbe_verformung)
tag_9 = TextTag(Location=c_script_7.p, Text=filter_16, Colour=item_4)
hingedraw_2 = CSharpScript(
    x=baroutput.IP0,
    y=baroutput.IP1,
    color=farbe_für_die_gelenke,
    thickness=liniengrösse_für_die_gelenke,
    size=grösse_der_kreise_für_die_gelenke,
    b=gelenke_darstellen)  # inputs x: list of Plane, y: list of Plane, color: Color, thickness: Int32, size: Double, b: Boolean
# ---------- hingedraw_2: C# ----------
// Grasshopper Script Instance
#region Usings
using System;
using System.Linq;
using System.Collections;
using System.Collections.Generic;
using System.Drawing;

using Rhino;
using Rhino.Geometry;

using Grasshopper;
using Grasshopper.Kernel;
using Grasshopper.Kernel.Data;
using Grasshopper.Kernel.Types;
#endregion

public class Script_Instance : GH_ScriptInstance
{
    Color c;
    double s;
    int t;
    List <Plane> p; 
    bool draw_it;
    
    #region Notes
    /* 
      Members:
        RhinoDoc RhinoDocument
        GH_Document GrasshopperDocument
        IGH_Component Component
        int Iteration

      Methods (Virtual & overridable):
        Print(string text)
        Print(string format, params object[] args)
        Reflect(object obj)
        Reflect(object obj, string method_name)
    */
    #endregion

    private void RunScript(
		List<Plane> x,
		List<Plane> y,
		Color color,
		int thickness,
		double size,
		bool b)
    {
        if (x == null || y == null)
        {
            return;
        }

        draw_it = b;

        int n = x.Count();

        if (n != y.Count())
        {
            return;
        }
        p = new List<Plane>();

        for (int i = 0; i < n; i++)
        {
            p.Add(new Plane(x[i].Origin, x[i].XAxis));
            p.Add(new Plane(y[i].Origin, y[i].XAxis));
            p.Add(new Plane(x[i].Origin, x[i].YAxis));
            p.Add(new Plane(y[i].Origin, y[i].YAxis));
        }

        c = color;
        s = size;
        t = thickness;
    }

    public override BoundingBox ClippingBox => BoundingBox.Empty;

    public override void DrawViewportMeshes(IGH_PreviewArgs args)
    {
        base.DrawViewportMeshes(args);

        if (draw_it == false)
            return;

        int n = p.Count();

        Circle ci;

        for (int i = 0; i < n; i++)
        {
            ci = new Circle(p[i], s);
            args.Display.DrawCircle(ci, c, t);
        }
    }

    public override void DrawViewportWires(IGH_PreviewArgs args)
    {
    }
}
# ---------- end hingedraw_2 ----------

# ---- group: LASTEN DARSTELLUNG
# Die Darstellung der Lasten ist echt einfach. Fast die ganze Arbeit macht die Komponente „LoadDisplay+“. Um das so zu vereinfachen, musste ich die Komponente „Load“ neu programmieren.
loadoutput = LoadOutputPlus(LoadData=bang.Branch1)  # -> InitialPosition, FinalPosition, Load
decomposed = BooleanToggle(True)
and_2 = GateAnd(A=verformung, B=lasten_in_der_verformte_struktur)
c_script_8 = CSharpScript(pI=loadoutput.InitialPosition, pF=loadoutput.FinalPosition, L=loadoutput.Load, k=multiplication_5, b=and_2, d=decomposed)  # -> out, pt, load, num; inputs pI: list of Point3d, pF: list of Point3d, L: list of Vector3d, k: Double, b: Boolean, d: Boolean
# ---------- c_script_8: C# ----------
// Grasshopper Script Instance
#region Usings
using System;
using System.Linq;
using System.Collections;
using System.Collections.Generic;
using System.Drawing;

using Rhino;
using Rhino.Geometry;

using Grasshopper;
using Grasshopper.Kernel;
using Grasshopper.Kernel.Data;
using Grasshopper.Kernel.Types;
#endregion

public class Script_Instance : GH_ScriptInstance
{
    #region Notes
    /* 
      Members:
        RhinoDoc RhinoDocument
        GH_Document GrasshopperDocument
        IGH_Component Component
        int Iteration

      Methods (Virtual & overridable):
        Print(string text)
        Print(string format, params object[] args)
        Reflect(object obj)
        Reflect(object obj, string method_name)
    */
    #endregion

    private void RunScript(
		List<Point3d> pI,
		List<Point3d> pF,
		List<Vector3d> L,
		double k,
		bool b,
		bool d,
		ref object pt,
		ref object load,
		ref object num)
    {
        int numLoads = pI.Count();
        Vector3d def;
        int i, j;
        int n = 0;
        Point3d pa;
        Vector3d la;
        Vector3d lad;

        if (numLoads < 1)
            return;

        if (pF.Count() == numLoads && L.Count() == numLoads)
        {
            Point3d[] pp = new Point3d[numLoads];
            Vector3d[] ll = new Vector3d[numLoads];

            // Copy the input points and loads, to manage later the accummulation of loads
            for (i = 0; i < numLoads; i++)
            {
                pp[i] = pI[i];
                ll[i] = L[i];
            }

            List<Point3d> pts = new List<Point3d>();
            List<Vector3d> loads = new List<Vector3d>();

            // Draw Load at deformed shape
            for (i = 0; i < numLoads; i++)
            {
                // The load ll may be null, if it is already accummulated on previous point
                if (!ll[i].IsTiny())
                {
                    pa = pp[i];
                    la = ll[i];

                    for (j = i + 1; j < numLoads; j++)
                    {
                        if (pa.DistanceTo(pp[j]) < 0.001)
                        {
                            la = la + ll[j];

                            // As it has been already accummulated, make it null
                            ll[j].X = 0.0;
                            ll[j].Y = 0.0;
                            ll[j].Z = 0.0;
                        }
                    }

                    // At this point, we have all the loads accummulated (la) on the point pa
                    if (b)
                    {
                        def = pF[i] - pI[i];
                        def = def * k;
                    }
                    else
                        def = new Vector3d(0.0, 0.0, 0.0);
                        
                    if (d)
                    {
                        lad = la;
                        // Decompose vector in 3 directions,if neccesary
                        if (Math.Abs(la.X) > 0.001)
                        {
                            lad.X = la.X;
                            lad.Y = 0.0;
                            lad.Z = 0.0;

                            pts.Add(pI[i] + def);
                            loads.Add(lad);
                            n = n + 1;
                        }
                        
                        if (Math.Abs(la.Y) > 0.001)
                        {
                            lad.X = 0.0;
                            lad.Y = la.Y;
                            lad.Z = 0.0;

                            pts.Add(pI[i] + def);
                            loads.Add(lad);
                            n = n + 1;
                        }

                        if (Math.Abs(la.Z) > 0.001)
                        {
                            lad.X = 0.0;
                            lad.Y = 0.0;
                            lad.Z = la.Z;
                            
                            pts.Add(pI[i] + def);
                            loads.Add(lad);
                            n = n + 1;
                        }
                    }
                    else
                    {
                        pts.Add(pI[i] + def);
                        loads.Add(la);
                        n = n + 1;
                    }
                }
            }

            pt = pts;
            load = loads;
        }

        num = n;
    }
}
# ---------- end c_script_8 ----------
loaddisplay = LoadVisualisationPlus(
    Position=c_script_8.pt,
    Load=c_script_8.load,
    Scale=lastendarstellungsgrösse,
    ConeRadius=0.25,
    ConeHeight=0.5,
    CylinderRadius=0.075,
    TipOnPoint=True)
filter_19 = StreamFilter(Gate=lasten_darstellen, Stream1=loaddisplay)
preview_24 = CustomPreview(Geometry=filter_19, Material=farbe_lasten)

# ---- group: AUFLAGER REAKTIONEN DARSTELLUNG
# Die Darstellung der Reaktionen ist etwas aufwendiger. Zuerst musst du die Reaktion (die ein 3D-Vektor ist) in ihre drei Komponenten zerlegen, um die entsprechenden Pfeile zu zeichnen. Das Gleiche machst du mit den Momenten (siehe dazu den Hinweis in der Konfigurationsgruppe für die Darstellung).
X_2 = UnitX(Factor=1)
Y_4 = UnitY(Factor=1)
Z_5 = UnitZ(Factor=1)
and_3 = GateAnd(A=verformung, B=lasten_in_der_verformte_struktur)
and_4 = GateAnd(A=verformung, B=lasten_in_der_verformte_struktur)
X_3 = UnitX(Factor=1)
Y_5 = UnitY(Factor=1)
Z_6 = UnitZ(Factor=1)
multiplication_6 = Multiplication(A=support6dofoutput.ReactionMoment, B=Y_4)
multiplication_7 = Multiplication(A=support6dofoutput.ReactionMoment, B=Z_5)
multiplication_8 = Multiplication(A=support6dofoutput.ReactionMoment, B=X_2)
c_script_9 = CSharpScript(pI=support6dofoutput.SupportPlaneIni, pF=support6dofoutput.SupportPlaneDef, k=faktor_verformung, b=and_3)  # -> out, pt; inputs pI: Point3d, pF: Point3d, k: Double, b: Boolean
# ---------- c_script_9: C# ----------
// Grasshopper Script Instance
#region Usings
using System;
using System.Linq;
using System.Collections;
using System.Collections.Generic;
using System.Drawing;

using Rhino;
using Rhino.Geometry;

using Grasshopper;
using Grasshopper.Kernel;
using Grasshopper.Kernel.Data;
using Grasshopper.Kernel.Types;
#endregion

public class Script_Instance : GH_ScriptInstance
{
    #region Notes
    /* 
      Members:
        RhinoDoc RhinoDocument
        GH_Document GrasshopperDocument
        IGH_Component Component
        int Iteration

      Methods (Virtual & overridable):
        Print(string text)
        Print(string format, params object[] args)
        Reflect(object obj)
        Reflect(object obj, string method_name)
    */
    #endregion

    private void RunScript(Point3d pI, Point3d pF, double k, bool b, ref object pt)
    {
        if (b)
        {
            Vector3d def = pF - pI;
            def = def * k;
            pt = pI + def;
        }
        else
            pt = pI;
    }
}
# ---------- end c_script_9 ----------
c_script_10 = CSharpScript(pI=support6dofoutput.SupportPlaneIni, pF=support6dofoutput.SupportPlaneDef, k=faktor_verformung, b=and_4)  # -> out, pt; inputs pI: Point3d, pF: Point3d, k: Double, b: Boolean; same code as c_script_9
multiplication_9 = Multiplication(A=support6dofoutput.ReactionForce, B=X_3)
multiplication_10 = Multiplication(A=support6dofoutput.ReactionForce, B=Y_5)
multiplication_11 = Multiplication(A=support6dofoutput.ReactionForce, B=Z_6)
X_4 = UnitX(Factor=multiplication_8)
Y_6 = UnitY(Factor=multiplication_6)
Z_7 = UnitZ(Factor=multiplication_7)
X_5 = UnitX(Factor=multiplication_9)
Y_7 = UnitY(Factor=multiplication_10)
Z_8 = UnitZ(Factor=multiplication_11)
merge_13 = Merge(Data1=c_script_9.pt, Data2=c_script_9.pt, Data3=c_script_9.pt)
merge_14 = Merge(Data1=c_script_10.pt, Data2=c_script_10.pt, Data3=c_script_10.pt)
pdecon = Deconstruct(Point=X_4)  # -> XComponent, YComponent, ZComponent
pdecon_2 = Deconstruct(Point=Y_6)  # -> XComponent, YComponent, ZComponent
pdecon_3 = Deconstruct(Point=Z_7)  # -> XComponent, YComponent, ZComponent
pdecon_4 = Deconstruct(Point=X_5)  # -> XComponent, YComponent, ZComponent
pdecon_5 = Deconstruct(Point=Y_7)  # -> XComponent, YComponent, ZComponent
pdecon_6 = Deconstruct(Point=Z_8)  # -> XComponent, YComponent, ZComponent
loaddisplay_2 = LoadVisualisationPlus(
    Position=merge_13,
    Load=[X_5, Y_7, Z_8],
    Scale=expr("X/4", lastendarstellungsgrösse),
    ConeRadius=1.5,
    ConeHeight=3,
    CylinderRadius=0.5,
    TipOnPoint=True)
loaddisplay_3 = LoadVisualisationPlus(
    Position=merge_14,
    Load=[X_4, Y_6, Z_7],
    Scale=expr("X/4", lastendarstellungsgrösse),
    ConeRadius=1.5,
    ConeHeight=3,
    CylinderRadius=0.5,
    TipOnPoint=True)
and_5 = GateAnd(A=auflager_kraftreaktionen, B=auflagerreaktionen_werte)
and_6 = GateAnd(A=auflager_momentreaktionen, B=auflagerreaktionen_werte)
eval_3 = Evaluate(
    E="Format(\"[\"&If(x>0,\"+\",\"\")&Round(x,d)&\",\"&If(y>0,\"+\",\"\")&Round(y,d)&\",\"&If(z>0,\"+\",\"\")&Round(z,d)&\"]\")",
    x=pdecon_4.XComponent,
    y=pdecon_5.YComponent,
    z=pdecon_6.ZComponent,
    d=nachkommastellen)
eval_4 = Evaluate(
    E="Format(\"[\"&If(x>0,\"+\",\"\")&Round(x,d)&\",\"&If(y>0,\"+\",\"\")&Round(y,d)&\",\"&If(z>0,\"+\",\"\")&Round(z,d)&\"]\")",
    x=pdecon.XComponent,
    y=pdecon_2.YComponent,
    z=pdecon_3.ZComponent,
    d=nachkommastellen)
filter_20 = StreamFilter(Gate=and_5, Stream1=eval_3)
filter_21 = StreamFilter(Gate=auflager_kraftreaktionen, Stream1=loaddisplay_2)
filter_22 = StreamFilter(Gate=auflager_momentreaktionen, Stream1=loaddisplay_3)
filter_23 = StreamFilter(Gate=and_6, Stream1=eval_4)
tag_10 = TextTag(Location=c_script_9.pt, Text=filter_20, Colour=farbe_reaktionswerte)
tag_11 = TextTag(Location=c_script_9.pt, Text=filter_23, Colour=farbe_reaktionswerte)
preview_25 = CustomPreview(Geometry=filter_21, Material=farbe_kraftreaktionen)
preview_26 = CustomPreview(Geometry=filter_22, Material=farbe_momentreaktionen)

# ----
# Damit die Warnung wegen zu hoher Spannungen richtig angezeigt wird, musst du alle Spannungsergebnisse von allen „BeamOutput+“ und „Cable+“ an diesen Merge anschließen.
merge_15 = Merge(Data1=dedomain.End, Data2=dedomain_2.End, Data3=dedomain_3.End)

# ----
# Hier wird überprüft ob die Spannungen in irgendeinen Element zu groß sind, und deshalb die Wiederstandsfähigkeit nicht überstanden wird.
number_slider_9 = Slider(15, range=0..30)
vp_height = Integer(c_script.H)
panel_18 = Panel("""SPANNUNGEN ZU GROß!!!
Es gibt Elemente mit einem Spannungsratio über 100%. """)
bnd_4 = Bounds(Numbers=merge_15)
division_4 = Division(A=vp_height, B="1000")
dedomain_4 = DeconstructDomain(Domain=bnd_4)  # -> Start, End
multiplication_12 = Multiplication(A=number_slider_9, B=division_4)
textfaktor = Number(division_4)
larger = LargerThan(FirstNumber=dedomain_4.End, SecondNumber="1.0")  # -> LargerThan, OrEqualTo
multiplication_13 = Multiplication(A="30", B=textfaktor)
multiplication_14 = Multiplication(A="60", B=textfaktor)
filter_24 = StreamFilter(Gate=larger.LargerThan, Stream0=" ", Stream1=panel_18)
pt_3 = ConstructPoint(XCoordinate=multiplication_13, YCoordinate=multiplication_14, ZCoordinate=0)
texttoscreen = RenderTextToScreen(
    Text=filter_24,
    Location=pt_3,
    Size=multiplication_12,
    Color=ColourSwatch(SwatchColor=RGB(255, 255, 0)),
    Font="Arial Fett",
    m_scWithvp=False)
