# Grasshopper definition example.gh (Grasshopper 1.0.8)
# plug-ins: K2Engineering (and K2E+), Human

# ---- group: ALLGEMEINES
# Das manchmal auftretende Darstellungsproblem liegt daran, dass die Kamera in Rhino einen "near-clipping-plane" und einen "far-clipping-plane" (https://discourse.mcneel.com/t/modify-camera-near-clipping-plane/190327/3) automatisch definiert um alles zu zeigen was zu zeigen ist.
# 
# Dazu betrachtet Rhino nur die Geometrie die von GH erstellt wurde und die nicht ausgeblendet (preview = off) ist.
# 
# Mit meiner neuen Komponente, die die Linienstärke und Farbe definieren läst, wir leider keine Geometrie in GH dargestellt (alles wird ausgeblendet mit preview = off), denn die neue Komponente zeichnet die Geometrie, anstatt GH, wie üblicherweise.
# 
# Deshalb kann Rhino nicht wissen was für eine Geometrie er darstellen soll, und definiert die "near" und "far" "clipping planes" für eine sehr kleine Geometrie um den Ursprung. Man muss nur einen einzigen Punkt weit weg vom Ursprung erstellen, so dass die Pläne die ganze Geometrie zeigen.
# 
# Deshalb wird hier ein Punkt in (100,100,100) erstellt.
# Mit diesem Teil, den ich aus dem Internet runtergeladen habe, kann man den Typ „wire“ automatisch in „faint“ für die ausgewählten Komponente ändern.
# 
# Ich hab den Code aus dem Internet geändert, damit die „wire“, die manuell auf „hidden“ gesetzt wurden, nicht auf „faint“ geändert werden.
# 
# Das heißt, nur die, die auf ‚default‘ waren, werden auf „faint“ geändert.
# Diese kleine Komponente sorgt dafür, dass das GH-Fenster sofort nach dem Start des Modells minimiert wird.
# 
# Auf diese Weise sehen die Studenten den Code nicht.
# Das Fenster ist nicht geschlossen, nur minimiert. Wenn also jemand den Code sehen (oder sogar ändern) will, können wir nicht verhindern, dass das GH-Fenster über das Symbol in der unteren Leiste der laufenden Programme geöffnet wird.
# 
# Mit dem Schalter kannst man verhindern, dass das Fenster während der Programmierung minimiert wird („debug = true“), aber wenn man mit der Definition des Modells fertig wird, muss man das Modell mit diesem Schalter auf „false“ speichern.
# When Selected = True, only currently selected parameters will be adjusted. There will be no undo record for this operation.
toggle = BooleanToggle(False)
startup = Python3Script(debug=toggle)  # -> out
# ---------- startup: Python ----------
import Rhino
from Rhino.UI import Panels
from System import Guid
import Grasshopper
from System import Windows

Grasshopper.Instances.ShowRemotePanel()

if debug == True:
    Panels.OpenPanel(Guid('b45a29b1-4343-4035-989e-044e8580d9cf'))

    PanelIds = []
    PanelIds = Panels.GetOpenPanelIds()
    for x in PanelIds:
        name = Panels.GetPanel(x, Rhino.RhinoDoc.ActiveDoc)
        print(x)
        print(name)

if debug == False:
    Grasshopper.Instances.ShowRemotePanel()

    if (Grasshopper.Instances.DocumentEditor.WindowState != Windows.Forms.FormWindowState.Minimized):
        Grasshopper.Instances.DocumentEditor.WindowState = Windows.Forms.FormWindowState.Minimized
# ---------- end startup ----------
panel = Panel(startup)
pt = ConstructPoint(XCoordinate="100", YCoordinate="100", ZCoordinate="100")
list = ValueList({"Normal": 1, "Faint": 2, "Hidden": 3}, selected="Faint")
vb = VBScript(wire=list, selected=Toggle(True))  # -> out, A
# ---------- vb: VB usings ----------
Imports System.IO
Imports System.Linq
Imports System.Data
Imports System.Drawing
Imports System.Reflection
Imports System.Windows.Forms
Imports System.Xml
Imports System.Xml.Linq
Imports System.Runtime.InteropServices

Imports Rhino.DocObjects
Imports Rhino.Collections
Imports GH_IO
Imports GH_IO.Serialization
# ---------- vb: VB ----------
    Dim document As GH_Document = owner.OnPingDocument()
    If (document Is Nothing) Then Return

    For Each att As IGH_Attributes In document.Attributes
        Dim param As IGH_Param = TryCast(att.DocObject, IGH_Param)
        If (param Is Nothing) Then Continue For

        If (selected And Not param.Attributes.GetTopLevel.Selected ) Then Continue For

        If param.WireDisplay = GH_ParamWireDisplay.Default Then
            Select Case wire
            Case 2
            param.WireDisplay = GH_ParamWireDisplay.faint
            Case 3
            param.WireDisplay = GH_ParamWireDisplay.hidden
            End Select
        ElseIf param.WireDisplay = GH_ParamWireDisplay.faint Then
            Select Case wire
            Case 3
            param.WireDisplay = GH_ParamWireDisplay.hidden
            End Select
        End If

    Next
# ---------- end vb ----------

# ----
vorzeichen_für_schnittgrössenwerte = BooleanToggle(False)
nur_extremewerte = BooleanToggle(True)

abstraktion = BooleanToggle(False)
_3d_modell_darstellung = BooleanToggle(False)
gelenke_darstellen = BooleanToggle(True)
verformung = BooleanToggle(True)
_3d_modell_verformung = BooleanToggle(False)
_3d_verformung_vereinfacht = BooleanToggle(False)
bewegungswerte_darstellen = BooleanToggle(False)
normalkraft_n_kn = BooleanToggle(False)
querkraft_vy_kn = BooleanToggle(False)
querkraft_vz_kn = BooleanToggle(False)
moment_my_knm = BooleanToggle(False)
moment_mz_knm = BooleanToggle(False)
schnittgrössenwerte_darstellen = BooleanToggle(False)
diagramme_auf_die_verformte_struktur = BooleanToggle(False)
lasten_darstellen = BooleanToggle(True)
lasten_in_der_verformte_struktur = BooleanToggle(True)
kräfte_zerlegt_dargestellt = BooleanToggle(True)
pfeil_zum_punkt = BooleanToggle(True)
_3d_auflager_darstellung = BooleanToggle(True)
auflager_kraftreaktionen = BooleanToggle(False)
auflager_momentreaktionen = BooleanToggle(False)
auflagerreaktionen_werte = BooleanToggle(False)
spannungsratio = BooleanToggle(False)
stiffnessratio = Slider(1, range=0.001..1)
threshold = Slider(15, range=10..20)
liniengrösse_für_die_gelenke = Slider(5, range=0..10)
faktor_verformung = Slider(100, range=1..200)
reduktion_m = Slider(50, range=1..1000)
farbe_n = ColourSwatch(SwatchColor=RGBA(255, 255, 11, 100))
farbe_schnittgrössenwerte = ColourSwatch(SwatchColor=RGB(255, 255, 255))
lastendarstellungsgrösse = Slider(0.15, range=0..1)
grössenfaktor_für_auflagerdarstellung = Slider(0.6, range=0..1)
farbe_auflager = ColourSwatch(SwatchColor=RGB(16, 74, 125))
farbe_reaktionswerte = ColourSwatch(SwatchColor=RGB(255, 255, 255))
nachkommastellen = Slider(0, range=0..3)
linienstärke = Slider(4, range=0..10)
farbe_modelllinie = ColourSwatch(SwatchColor=RGB(64, 64, 64))
grösse_der_kreise_für_die_gelenke = Slider(0.03, range=0..0.2)
farbe_für_die_gelenke = ColourSwatch(SwatchColor=RGB(255, 255, 255))
farbe_verformung = ColourSwatch(SwatchColor=RGB(207, 207, 207))
farbe_bewegungswerte = ColourSwatch(SwatchColor=RGB(0, 0, 0))
reduktion_n = Slider(200, range=1..1000)
reduktion_v = Slider(50, range=1..1000)
farbe_n_2 = ColourSwatch(SwatchColor=RGBA(222, 11, 11, 100))
farbe_v = ColourSwatch(SwatchColor=RGBA(27, 133, 0, 100))
farbe_m = ColourSwatch(SwatchColor=RGBA(11, 67, 222, 100))
farbe_lasten = ColourSwatch(SwatchColor=RGB(255, 163, 0))
farbe_reaktionen = ColourSwatch(SwatchColor=RGB(199, 26, 26))
and = GateAnd(A=verformung, B=_3d_modell_verformung)
multiplication = Multiplication(Stiffness=stiffnessratio, FaktorVerformung=faktor_verformung)
eval = Evaluate(E="10^(-x)", x=threshold)
_0 = Geometry([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])
dx = Geometry([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])
dy = Geometry([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])
rx = Geometry([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])
dyrx = Geometry([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])
dxdyrx = Geometry([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])
ry = Geometry([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])
dyry = Geometry([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])
dxdyry = Geometry([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])
rxry = Geometry([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])
dxrxry = Geometry([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])
dyrxry = Geometry([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])
_0_00 = ColourSwatch(SwatchColor=RGB(0, 0, 255))
_12_5 = ColourSwatch(SwatchColor=RGB(0, 170, 255))
_25_0 = ColourSwatch(SwatchColor=RGB(0, 255, 128))
_37_5 = ColourSwatch(SwatchColor=RGB(128, 255, 0))
_50_0 = ColourSwatch(SwatchColor=RGB(255, 255, 0))
_75_0 = ColourSwatch(SwatchColor=RGB(255, 128, 0))
_87_5 = ColourSwatch(SwatchColor=RGB(255, 0, 0))
_100 = ColourSwatch(SwatchColor=RGB(200, 0, 200))
dxdy = Geometry([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])
dxrx = Geometry([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])
dxry = Geometry([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])
_62_5 = ColourSwatch(SwatchColor=RGB(255, 212, 0))
dxdyrxry = Geometry([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])
panel_2 = Panel("""64, 64, 64, 255
255, 255, 255, 255
207, 207, 207, 255
0, 0, 0, 255
255, 255, 11, 100
222, 11, 11, 100
27, 133, 0, 100
11, 67, 222, 100
255, 255, 255, 255
255, 163, 0, 255
16, 74, 125, 255
199, 26, 26, 255
255, 255, 255, 255""")
reset_konfiguration = Button()
panel_3 = Panel("""False
True
True
False
False
False
False
False
False
False
False
False
False
True
True
True
False
False
False
False""")
panel_4 = Panel("""1.0
15
0
4
5
0.03
100
200
50
50
0.15
0.6""")
auflager_darstellung = Entwine(
    Branch00=_0,
    Branch01=dx,
    Branch02=dy,
    Branch03=dxdy,
    Branch04=rx,
    Branch05=dxrx,
    Branch06=dyrx,
    Branch07=dxdyrx,
    Branch08=ry,
    Branch09=dxry,
    Branch010=dyry,
    Branch011=dxdyry,
    Branch012=rxry,
    Branch013=dxrxry,
    Branch014=dyrxry,
    Branch015=dxdyrxry,
    FlattenInputs=True)  # -> simplify(Result)
merge = Merge(Data1=_0_00, Data2=_12_5, Data3=_25_0, Data4=_37_5, Data5=_50_0, Data6=_62_5, Data7=_75_0, Data8=_87_5, Data9=_100)  # -> flatten(Result)
reset_values = CSharpScript(
    Reset=reset_konfiguration,
    Parameters=[stiffnessratio, threshold, nachkommastellen, linienstärke, liniengrösse_für_die_gelenke, grösse_der_kreise_für_die_gelenke, faktor_verformung, reduktion_n, reduktion_v, reduktion_m, lastendarstellungsgrösse, grössenfaktor_für_auflagerdarstellung],
    Values=panel_4)  # -> flatten(out); inputs Reset: Boolean, Parameters: list, Values: list of Double
# ---------- reset_values: C# ----------
// Grasshopper Script Instance
#region Usings
using System;
using System.Linq;
using System.Collections;
using System.Collections.Generic;
using System.Drawing;

using Rhino;
using Rhino.Geometry;

using Grasshopper;
using Grasshopper.Kernel;
using Grasshopper.Kernel.Data;
using Grasshopper.Kernel.Types;
#endregion

public class Script_Instance : GH_ScriptInstance
{
    #region Notes
    /* 
      Members:
        RhinoDoc RhinoDocument
        GH_Document GrasshopperDocument
        IGH_Component Component
        int Iteration

      Methods (Virtual & overridable):
        Print(string text)
        Print(string format, params object[] args)
        Reflect(object obj)
        Reflect(object obj, string method_name)
    */
    #endregion

    private void RunScript(bool Reset, List<object> Parameters, List<double> Values)
    {
        Grasshopper.Kernel.Special.GH_NumberSlider slider;

        int num_sliders = Parameters.Count();
        int num_values = Values.Count();

        if (num_sliders != num_values)
            Print("Error: Parameters and Values should match in number of elements");
        else
        {    
            int i;

            if (Reset == true)
            {
                Print("Reseting to default values");

                for (i = 0; i < num_sliders ; i++)
                {
                    slider = Component.Params.Input[1].Sources[i] as Grasshopper.Kernel.Special.GH_NumberSlider; //try to cast that thing as a slider

                    if (slider != null)
                    {
                        slider.TrySetSliderValue((decimal) Values[i]);
                    }
                }
            }
        }
    }
}
# ---------- end reset_values ----------
reset_toggles = CSharpScript(
    Reset=reset_konfiguration,
    Parameters=[_3d_modell_darstellung, gelenke_darstellen, verformung, _3d_modell_verformung, _3d_verformung_vereinfacht, bewegungswerte_darstellen, normalkraft_n_kn, querkraft_vy_kn, querkraft_vz_kn, moment_my_knm, moment_mz_knm, schnittgrössenwerte_darstellen, diagramme_auf_die_verformte_struktur, lasten_darstellen, lasten_in_der_verformte_struktur, _3d_auflager_darstellung, auflager_kraftreaktionen, auflager_momentreaktionen, auflagerreaktionen_werte, spannungsratio],
    Values=panel_3)  # -> flatten(out); inputs Reset: Boolean, Parameters: list, Values: list of Boolean
# ---------- reset_toggles: C# ----------
// Grasshopper Script Instance
#region Usings
using System;
using System.Linq;
using System.Collections;
using System.Collections.Generic;
using System.Drawing;

using Rhino;
using Rhino.Geometry;

using Grasshopper;
using Grasshopper.Kernel;
using Grasshopper.Kernel.Data;
using Grasshopper.Kernel.Types;
#endregion

public class Script_Instance : GH_ScriptInstance
{
    #region Notes
    /* 
      Members:
        RhinoDoc RhinoDocument
        GH_Document GrasshopperDocument
        IGH_Component Component
        int Iteration

      Methods (Virtual & overridable):
        Print(string text)
        Print(string format, params object[] args)
        Reflect(object obj)
        Reflect(object obj, string method_name)
    */
    #endregion

    private void RunScript(bool Reset, List<object> Parameters, List<bool> Values)
    {
        Grasshopper.Kernel.Special.GH_BooleanToggle toggle;

        int num_toggles = Parameters.Count();
        int num_values = Values.Count();

        if (num_toggles != num_values)
            Print("Error: Parameters and Values should match in number of elements");
        else
        {    
            int i;

            if (Reset == true)
            {
                Print("Reseting to default values");

                for (i = 0; i < num_toggles ; i++)
                {
                    toggle = Component.Params.Input[1].Sources[i] as Grasshopper.Kernel.Special.GH_BooleanToggle; //try to cast that thing as a toggle

                    if (toggle != null)
                    {
                        toggle.Value = Values[i];
                        toggle.ExpireSolution(true);
                    }
                }
            }
        }
    }
}
# ---------- end reset_toggles ----------
reset_colors = CSharpScript(
    Reset=reset_konfiguration,
    Parameters=[farbe_modelllinie, farbe_für_die_gelenke, farbe_verformung, farbe_bewegungswerte, farbe_n, farbe_n_2, farbe_v, farbe_m, farbe_schnittgrössenwerte, farbe_lasten, farbe_auflager, farbe_reaktionen, farbe_reaktionswerte],
    Values=panel_2)  # -> flatten(out); inputs Reset: Boolean, Parameters: list, Values: list of Color
# ---------- reset_colors: C# ----------
// Grasshopper Script Instance
#region Usings
using System;
using System.Linq;
using System.Collections;
using System.Collections.Generic;
using System.Drawing;

using Rhino;
using Rhino.Geometry;

using Grasshopper;
using Grasshopper.Kernel;
using Grasshopper.Kernel.Data;
using Grasshopper.Kernel.Types;
#endregion

public class Script_Instance : GH_ScriptInstance
{
    #region Notes
    /* 
      Members:
        RhinoDoc RhinoDocument
        GH_Document GrasshopperDocument
        IGH_Component Component
        int Iteration

      Methods (Virtual & overridable):
        Print(string text)
        Print(string format, params object[] args)
        Reflect(object obj)
        Reflect(object obj, string method_name)
    */
    #endregion

    private void RunScript(bool Reset, List<object> Parameters, List<Color> Values)
    {
        Grasshopper.Kernel.Special.GH_ColourSwatch color;

        int num_colors = Parameters.Count();
        int num_values = Values.Count();

        if (num_colors != num_values)
            Print("Error: Parameters and Values should match in number of elements");
        else
        {    
            int i;

            if (Reset == true)
            {
                Print("Reseting to default values");

                for (i = 0; i < num_colors ; i++)
                {
                    color = Component.Params.Input[1].Sources[i] as Grasshopper.Kernel.Special.GH_ColourSwatch; //try to cast that thing as a colour swatch

                    if (color != null)
                    {
                        color.SwatchColour = Values[i];
                        color.ExpireSolution(true);
                    }
                }
            }
        }
    }
}
# ---------- end reset_colors ----------
cfg = ConfigurationPlus(
    StiffnessRatio=stiffnessratio,
    Threshold=eval,
    NumberOfDecimals=nachkommastellen,
    LineThickness=linienstärke,
    ModelColor=farbe_modelllinie,
    _3DModel=_3d_modell_darstellung,
    Hinges=gelenke_darstellen,
    HingeThickness=liniengrösse_für_die_gelenke,
    HingeSize=grösse_der_kreise_für_die_gelenke,
    HingeColor=farbe_für_die_gelenke,
    Deformation=verformung,
    _3DDeformation=_3d_modell_verformung,
    Simplified3DDeformation=_3d_verformung_vereinfacht,
    DeformationColor=farbe_verformung,
    ScaleDeformation=faktor_verformung,
    Displacements=bewegungswerte_darstellen,
    DisplacementColor=farbe_bewegungswerte,
    AxialDiagram=normalkraft_n_kn,
    ScaleAxial=reduktion_n,
    ShearDiagramYSecondary=querkraft_vy_kn,
    ShearDiagramZPrincipal=querkraft_vz_kn,
    ScaleShear=reduktion_v,
    MomentDiagramYPrincipal=moment_my_knm,
    MomentDiagramZSecondary=moment_mz_knm,
    ScaleMoment=reduktion_m,
    PositiveAxialColor=farbe_n,
    NegativeAxialColor=farbe_n_2,
    ShearColor=farbe_v,
    MomentColor=farbe_m,
    DiagramValues=schnittgrössenwerte_darstellen,
    ValuesColor=farbe_schnittgrössenwerte,
    DiagramsOnDeformedShape=diagramme_auf_die_verformte_struktur,
    LoadRepresentation=lasten_darstellen,
    LoadColor=farbe_lasten,
    LoadSize=lastendarstellungsgrösse,
    LoadsOnDeformedShape=lasten_in_der_verformte_struktur,
    LoadsDecomposed=kräfte_zerlegt_dargestellt,
    TipOnPoint=pfeil_zum_punkt,
    SupportRepresentation=_3d_auflager_darstellung,
    SupportSize=grössenfaktor_für_auflagerdarstellung,
    SupportColor=farbe_auflager,
    ForceReactionRepresentation=auflager_kraftreaktionen,
    MomentReactionRepresentation=auflager_momentreaktionen,
    ReactionColor=farbe_reaktionen,
    ReactionValues=auflagerreaktionen_werte,
    ReactionValueColor=farbe_reaktionswerte,
    SaturationRatio=spannungsratio,
    SaturationRatioColors=merge,
    MinimumSegmentLengthInBeams=0.1,
    MaximumSegmentLengthInBeams=1,
    ValuesWithSign=vorzeichen_für_schnittgrössenwerte,
    OnlyMaxValues=nur_extremewerte)
panel_5 = Panel(reset_values)
panel_6 = Panel(reset_toggles)
panel_7 = Panel(reset_colors)

# ---- group: GEOMETRISCHE PARAMETER
träger_innenkante_breite = Slider(19.36, range=5..25)
panel_8 = Panel("""1.21
1.21
2.42
2.42
2.42""")
stützen_innenkante_höhe = Slider(8.66, range=5..20)
ma = MassAddition(Input=panel_8)  # -> Result, PartialResults
division = Division(A=träger_innenkante_breite, B="2")
panel_9 = Panel("""2.5
3.13
3.03""")
division_2 = Division(A=panel_8, B=ma.Result)
ma_2 = MassAddition(Input=panel_9)  # -> Result, PartialResults
multiplication_2 = Multiplication(A=division, B=division_2)
division_3 = Division(A=panel_9, B=ma_2.Result)
panel_10 = Panel(multiplication_2)
multiplication_3 = Multiplication(A=stützen_innenkante_höhe, B=division_3)
panel_11 = Panel(multiplication_3)
item = ListItem(List=panel_10, Index=0, Wrap=True)
item_2 = ListItem(List=panel_10, Index=1, Wrap=True)
item_3 = ListItem(List=panel_10, Index=2, Wrap=True)
item_4 = ListItem(List=panel_10, Index=3, Wrap=True)
item_5 = ListItem(List=panel_10, Index=4, Wrap=True)
stützen_fw_breite = Slider(1.2, range=0.5..3)
item_6 = ListItem(List=panel_11, Index=0, Wrap=True)
item_7 = ListItem(List=panel_11, Index=1, Wrap=True)
item_8 = ListItem(List=panel_11, Index=2, Wrap=True)
abstand = Slider(6.15, range=3..10)
träger_fw_höhe = Slider(2.09, range=0.5..6)
addition = Addition(A=stützen_fw_breite, B=item, C=item_2, D=item_3, E=item_4, F=item_5)
merge_2 = Merge(Data1=stützen_fw_breite, Data2=item, Data3=item_2, Data4=item_3, Data5=item_4, Data6=item_5)  # -> reverse(Result)
addition_2 = Addition(A=item_6, B=item_7, C=item_8, D=träger_fw_höhe)
multiplication_4 = Multiplication(A=addition, B=2)
abstraktion_2 = Number(abstand)
geometrie = Number(abstand)
panel_12 = Panel([panel_11, träger_fw_höhe])
panel_13 = Panel("0.9")
panel_14 = Panel([stützen_fw_breite, item, item_2, item_3, item_4, item_5, merge_2])

# ----
c_script = CSharpScript()  # -> out
# ---------- c_script: C# ----------
// Grasshopper Script Instance
#region Usings
using System;
using System.Linq;
using System.Collections;
using System.Collections.Generic;
using System.Drawing;

using Rhino;
using Rhino.Geometry;

using Grasshopper;
using Grasshopper.Kernel;
using Grasshopper.Kernel.Data;
using Grasshopper.Kernel.Types;
#endregion

public class Script_Instance : GH_ScriptInstance
{
    #region Notes
    /* 
      Members:
        RhinoDoc RhinoDocument
        GH_Document GrasshopperDocument
        IGH_Component Component
        int Iteration

      Methods (Virtual & overridable):
        Print(string text)
        Print(string format, params object[] args)
        Reflect(object obj)
        Reflect(object obj, string method_name)
    */
    #endregion

    private void RunScript()
    {
        string ghName;

        ghName = GrasshopperDocument.DisplayName.ToString();

        string ctrlName;
        int ghNameLength = ghName.Length;

        if (ghNameLength > 2)
            ctrlName = ghName.Substring(0, 3);
        else
            ctrlName = ghName.Substring(0, ghNameLength);

        Print(ghName);
        Print(ctrlName);

        if(ctrlName.Equals("___"))
            locking = false;   
        else
        {
            if (!locking)
            {
                locking = true;

                Grasshopper.Instances.ActiveCanvas.CanvasPaintBegin += CanvasPaintBeginHandler;
            }
        }
    }

    bool locking = false;

    private void CanvasPaintBeginHandler(Grasshopper.GUI.Canvas.GH_Canvas sender)
    {
        if (locking)
        {
            var immutable = new Grasshopper.GUI.Canvas.GH_Viewport(new System.Drawing.Point(100, 100), 10.0f);
            sender.Viewport.Set(immutable);
        }
    }
}
# ---------- end c_script ----------
panel_15 = Panel("""1.2
2.09""")

# ---- group: Geometrie
pt_2 = ConstructPoint(XCoordinate=0, YCoordinate=0, ZCoordinate=0)
Y = UnitY(Factor=1)
division_4 = Division(A=panel_14, B=multiplication_4)
ma_3 = MassAddition(Input=division_4)  # -> Result, PartialResults
line = LineSDL(Start=pt_2, Direction=Y, Length=multiplication_4)
shatter = Shatter(Curve=line, Parameters=ma_3.PartialResults)
Z = UnitZ(Factor=addition_2)
move = Move(Geometry=shatter, Motion=Z)  # -> Geometry, Transform
item_9 = ListItem(List=panel_12, Index=3, Wrap=True)
X = UnitX(Factor=panel_13)
Z_2 = UnitZ(Factor=expr("-x", item_9))
move_2 = Move(Geometry=move.Geometry, Motion=X)  # -> Geometry, Transform
move_3 = Move(Geometry=[move_2.Geometry, move.Geometry], Motion=Z_2)  # -> Geometry, Transform
split = SplitList(List=move_3.Geometry, Index=12)  # -> ListA, ListB
entwine = Entwine(Branch00=move.Geometry, Branch01=move_2.Geometry, Branch02=split.ListA, Branch03=split.ListB, FlattenInputs=True)

pt_3 = ConstructPoint(XCoordinate=0, YCoordinate=0, ZCoordinate=0)
Z_3 = UnitZ(Factor=1)
division_5 = Division(A=panel_12, B=addition_2)
ma_4 = MassAddition(Input=division_5)  # -> Result, PartialResults
line_2 = LineSDL(Start=pt_3, Direction=Z_3, Length=addition_2)
shatter_2 = Shatter(Curve=line_2, Parameters=ma_4.PartialResults)
cull_i = CullIndex(List=shatter_2, Indices=0, Wrap=True)
X_2 = UnitX(Factor=panel_13)
item_10 = ListItem(List=panel_14, Index=0, Wrap=True)
move_4 = Move(Geometry=cull_i, Motion=X_2)  # -> Geometry, Transform
Y_2 = UnitY(Factor=item_10)
move_5 = Move(Geometry=[move_4.Geometry, cull_i], Motion=Y_2)  # -> Geometry, Transform
split_2 = SplitList(List=move_5.Geometry, Index=3)  # -> ListA, ListB
entwine_2 = Entwine(Branch00=cull_i, Branch01=move_4.Geometry, Branch02=split_2.ListA, Branch03=split_2.ListB, FlattenInputs=True)

midpt = CurveMiddle(Curve=line)
Z_4 = UnitZ(Factor=1)
pl = ConstructPlane(Origin=midpt, XAxis=Vector(1, 0, 0), YAxis=Z_4)
mirror = Mirror(Geometry=entwine_2, Plane=pl)  # -> Geometry, Transform
merge_3 = Merge(Data1=entwine_2, Data2=mirror.Geometry)

bang = ExplodeTree(Data=entwine)  # -> Branch0, Branch1, Branch2, Branch3
flip = FlipMatrix(Data=[bang.Branch0, bang.Branch3])
flip_2 = FlipMatrix(Data=[bang.Branch1, bang.Branch2])
end = EndPoints(Curve=simplify(flip))  # -> Start, End
end_2 = EndPoints(Curve=simplify(flip_2))  # -> Start, End
shift = ShiftList(List=end.End, Shift=1, Wrap=True)
shift_2 = ShiftList(List=end_2.End, Shift=1, Wrap=True)
ln = Line(StartPoint=end.Start, EndPoint=shift)
ln_2 = Line(StartPoint=end_2.Start, EndPoint=shift_2)
flip_3 = FlipMatrix(Data=ln)
flip_4 = FlipMatrix(Data=ln_2)
split_3 = SplitList(List=flip_3, Index=6)  # -> ListA, ListB
split_4 = SplitList(List=flip_4, Index=6)  # -> ListA, ListB
merge_4 = Merge(Data1=split_3.ListA, Data2=split_4.ListA)
merge_5 = Merge(Data1=split_3.ListB, Data2=split_4.ListB)
flip_5 = FlipMatrix(Data=merge_4)
flip_6 = FlipMatrix(Data=merge_5)
cull_i_2 = CullIndex(List=flip_6, Indices=0, Wrap=True)
cull_i_3 = CullIndex(List=flip_5, Indices=1, Wrap=True)
merge_6 = Merge(Data1=cull_i_3, Data2=cull_i_2)

flip_7 = FlipMatrix(Data=entwine)
end_3 = EndPoints(Curve=flip_7)  # -> flatten(Start), flatten(End)
cullpt = CullDuplicates(Points=[end_3.Start, end_3.End], Tolerance=0.1, CullMode=3)  # -> Points, Indices, Valence
partition = PartitionList(List=cullpt.Points, Size=4)
shift_3 = ShiftList(List=partition, Shift=1, Wrap=True)
ln_3 = Line(StartPoint=partition, EndPoint=shift_3)
panel_16 = Panel("""1
3""")
cull_i_4 = CullIndex(List=ln_3, Indices=panel_16, Wrap=True)

entwine_3 = Entwine(Branch00=move.Geometry, Branch01=move_2.Geometry, FlattenInputs=True)
flip_8 = FlipMatrix(Data=entwine_3)
end_4 = EndPoints(Curve=simplify(flip_8))  # -> Start, End
shift_4 = ShiftList(List=end_4.End, Shift=1, Wrap=True)
ln_4 = Line(StartPoint=end_4.Start, EndPoint=shift_4)
bang_2 = ExplodeTree(Data=ln_4)  # -> Branch0, Branch1, Branch2, Branch3, Branch4, Branch5, Branch6, Branch7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
entwine_4 = Entwine(
    Branch00=bang_2.Branch1,
    Branch01=bang_2.Branch2,
    Branch02=bang_2.Branch3,
    Branch03=bang_2.Branch4,
    Branch04=bang_2.Branch5,
    Branch05=bang_2.Branch11,
    FlattenInputs=True)
entwine_5 = Entwine(
    Branch00=bang_2.Branch0,
    Branch01=bang_2.Branch6,
    Branch02=bang_2.Branch7,
    Branch03=bang_2.Branch8,
    Branch04=bang_2.Branch9,
    Branch05=bang_2.Branch10,
    FlattenInputs=True)
cull_i_5 = CullIndex(List=entwine_4, Indices=0, Wrap=True)
cull_i_6 = CullIndex(List=entwine_5, Indices=1, Wrap=True)
merge_7 = Merge(Data1=flatten(cull_i_5), Data2=flatten(cull_i_6))

panel_17 = Panel("""0
1
11""")
cull_i_7 = CullIndex(List=entwine, Indices=panel_17, Wrap=True)
end_5 = EndPoints(Curve=cull_i_7)  # -> Start, End
flip_9 = FlipMatrix(Data=end_5.Start)
item_11 = ListItem(List=flip_9, Index=0, Wrap=True)
item_12 = ListItem(List=flip_9, Index=3, Wrap=True)
item_13 = ListItem(List=flip_9, Index=1, Wrap=True)
item_14 = ListItem(List=flip_9, Index=2, Wrap=True)
ln_5 = Line(StartPoint=item_11, EndPoint=item_12)
ln_6 = Line(StartPoint=item_13, EndPoint=item_14)
merge_8 = Merge(Data1=ln_5, Data2=ln_6)

panel_18 = Panel("""0
11
12
23""")
cull_i_8 = CullIndex(List=move_3.Geometry, Indices=panel_18, Wrap=True)
split_5 = SplitList(List=cull_i_8, Index=12)  # -> ListA, ListB
entwine_6 = Entwine(Branch00=move.Geometry, Branch01=move_2.Geometry, Branch02=split_5.ListA, Branch03=split_5.ListB, FlattenInputs=True)

flip_10 = FlipMatrix(Data=merge_3)
end_6 = EndPoints(Curve=flip_10)  # -> flatten(Start), flatten(End)
cullpt_2 = CullDuplicates(Points=[end_6.Start, end_6.End], Tolerance=0.1, CullMode=3)  # -> Points, Indices, Valence
partition_2 = PartitionList(List=cullpt_2.Points, Size=4)
shift_5 = ShiftList(List=partition_2, Shift=1, Wrap=True)
ln_7 = Line(StartPoint=partition_2, EndPoint=shift_5)
panel_19 = Panel("""1
3""")
cull_i_9 = CullIndex(List=ln_7, Indices=panel_19, Wrap=True)  # -> simplify(List)
flip_11 = FlipMatrix(Data=cull_i_9)
panel_20 = Panel("""3
4
6
7""")
cull_i_10 = CullIndex(List=flip_11, Indices=panel_20, Wrap=True)

end_7 = EndPoints(Curve=merge_3)  # -> Start, End
flip_12 = FlipMatrix(Data=end_7.Start)
item_15 = ListItem(List=flip_12, Index=0, Wrap=True)
item_16 = ListItem(List=flip_12, Index=1, Wrap=True)
item_17 = ListItem(List=flip_12, Index=2, Wrap=True)
item_18 = ListItem(List=flip_12, Index=3, Wrap=True)
ln_8 = Line(StartPoint=item_15, EndPoint=item_18)
ln_9 = Line(StartPoint=item_16, EndPoint=item_17)
merge_9 = Merge(Data1=ln_8, Data2=ln_9)
bang_3 = ExplodeTree(Data=merge_9)  # -> Branch0, Branch1, Branch2, Branch3, Branch4, Branch5
merge_10 = Merge(Data1=bang_3.Branch1, Data2=bang_3.Branch2, Data3=bang_3.Branch4, Data4=bang_3.Branch5)
merge_11 = Merge(Data1=bang_3.Branch0, Data2=bang_3.Branch3, Data3=bang_3.Branch1, Data4=bang_3.Branch4)
merge_12 = Merge(Data1=bang_3.Branch0, Data2=bang_3.Branch3)

end_8 = EndPoints(Curve=flip_10)  # -> Start, End
shift_6 = ShiftList(List=end_8.Start, Shift=1, Wrap=True)
ln_10 = Line(StartPoint=end_8.End, EndPoint=shift_6)
panel_21 = Panel("""1
3""")
cull_i_11 = CullIndex(List=ln_10, Indices=panel_21, Wrap=True)  # -> simplify(List)
bang_4 = ExplodeTree(Data=cull_i_11)  # -> Branch0, Branch1, Branch2, Branch3, Branch4, Branch5
split_6 = SplitList(List=[bang_4.Branch2, bang_4.Branch5], Index=1)  # -> ListA, ListB
midpt_2 = CurveMiddle(Curve=split_6.ListB)
Z_5 = UnitZ(Factor=1)
pl_2 = ConstructPlane(Origin=midpt_2, XAxis=Z_5, YAxis=Vector(0, 1, 0))
mirror_2 = Mirror(Geometry=split_6.ListB, Plane=pl_2)  # -> Geometry, Transform
merge_13 = Merge(
    Data1=bang_4.Branch0,
    Data2=bang_4.Branch1,
    Data3=split_6.ListA,
    Data4=bang_4.Branch3,
    Data5=bang_4.Branch4,
    Data6=mirror_2.Geometry)

multiplication_5 = Multiplication(A=ma_4.PartialResults, B=addition_2)
pt_4 = ConstructPoint(XCoordinate=0, YCoordinate=0, ZCoordinate=0)
Z_6 = UnitZ(Factor=multiplication_5)
move_6 = Move(Geometry=pt_4, Motion=Z_6)  # -> Geometry, Transform
multiplication_6 = Multiplication(A=ma_3.PartialResults, B=multiplication_4)
item_19 = ListItem(List=move_6.Geometry, Index=-1, Wrap=True)
Y_3 = UnitY(Factor=multiplication_6)
move_7 = Move(Geometry=item_19, Motion=Y_3)  # -> Geometry, Transform
item_20 = ListItem(List=move_6.Geometry, Index=-2, Wrap=True)
item_21 = ListItem(List=move_7.Geometry, Index=0, Wrap=True)
cull_i_12 = CullIndex(List=move_7.Geometry, Indices=-1, Wrap=True)
item_22 = ListItem(List=move_7.Geometry, Index=-1, Wrap=True)
pdecon = Deconstruct(Point=item_20)  # -> XComponent, YComponent, ZComponent
pdecon_2 = Deconstruct(Point=item_21)  # -> XComponent, YComponent, ZComponent
ln_11 = Line(StartPoint=item_22, EndPoint=item_19)
midpt_3 = CurveMiddle(Curve=ln_11)
pt_5 = ConstructPoint(XCoordinate=pdecon.XComponent, YCoordinate=pdecon_2.YComponent, ZCoordinate=pdecon.ZComponent)
Z_7 = UnitZ(Factor=1)
pl_3 = ConstructPlane(Origin=midpt_3, XAxis=Vector(1, 0, 0), YAxis=Z_7)
mirror_3 = Mirror(Geometry=[move_6.Geometry, pt_5], Plane=pl_3)  # -> Geometry, Transform
merge_14 = Merge(Data1=move_6.Geometry, Data2=cull_i_12, Data3=mirror_3.Geometry, Data4=pt_5)
X_3 = UnitX(Factor=panel_13)
subtraction = Subtraction(A=geometrie, B=panel_13)
X_4 = UnitX(Factor=subtraction)
move_8 = Move(Geometry=merge_14, Motion=X_3)  # -> flatten(Geometry), Transform
move_9 = Move(Geometry=move_8.Geometry, Motion=X_4)  # -> Geometry, Transform
ln_12 = Line(StartPoint=move_8.Geometry, EndPoint=move_9.Geometry)
panel_22 = Panel("""6
7
20
8""")
panel_23 = Panel("""2
3
10
9""")
item_23 = ListItem(List=ln_12, Index=panel_23, Wrap=True)
split_7 = SplitList(List=ln_12, Index="8")  # -> ListA, ListB
item_24 = ListItem(List=ln_12, Index=panel_22, Wrap=True)
split_8 = SplitList(List=split_7.ListB, Index="2")  # -> ListA, ListB
shift_7 = ShiftList(List=item_24, Shift=1, Wrap=True)
panel_24 = Panel("""1
2
-2
-3""")
item_25 = ListItem(List=panel_14, Index=0, Wrap=True)
lng = ListLength(List=split_7.ListA)
item_26 = ListItem(List=split_8.ListB, Index=panel_24, Wrap=True)
divide = DivideCurve(Curve=item_24, Count=4, Kinks=False)  # -> Points, Tangents, Parameters
divide_2 = DivideCurve(Curve=shift_7, Count=4, Kinks=False)  # -> Points, Tangents, Parameters
panel_25 = Panel("""0
-1""")
Y_4 = UnitY(Factor=item_25)
split_9 = SplitList(List=split_7.ListA, Index=expr("x/2", lng))  # -> ListA, ListB
cull_i_13 = CullIndex(List=divide.Points, Indices=panel_25, Wrap=True)
cull_i_14 = CullIndex(List=divide_2.Points, Indices=panel_25, Wrap=True)
neg = Negative(Value=Y_4)
item_27 = ListItem(List=panel_12, Index="-1", Wrap=True)
ln_13 = Line(StartPoint=cull_i_13, EndPoint=cull_i_14)
move_10 = Move(Geometry=split_9.ListB, Motion=neg)  # -> Geometry, Transform
move_11 = Move(Geometry=split_9.ListA, Motion=Y_4)  # -> Geometry, Transform
Z_8 = UnitZ(Factor=item_27)
mirror_4 = Mirror(Geometry=ln_13, Plane=pl_3)  # -> Geometry, Transform
neg_2 = Negative(Value=Z_8)
move_12 = Move(Geometry=item_26, Motion=neg_2)  # -> Geometry, Transform
merge_15 = Merge(Data1=move_11.Geometry, Data2=move_10.Geometry, Data3=move_12.Geometry)
merge_16 = Merge(Data1=ln_12, Data2=ln_13, Data3=mirror_4.Geometry, Data4=merge_15)

end_9 = EndPoints(Curve=merge_12)  # -> Start, End
midpt_4 = CurveMiddle(Curve=merge_12)
pdecon_3 = Deconstruct(Point=midpt_4)  # -> XComponent, YComponent, ZComponent
pt_6 = ConstructPoint(XCoordinate=pdecon_3.XComponent, YCoordinate=pdecon_3.YComponent, ZCoordinate=0)
ln_14 = Line(StartPoint=end_9.Start, EndPoint=pt_6)
ln_15 = Line(StartPoint=end_9.End, EndPoint=pt_6)
merge_17 = Merge(Data1=ln_14, Data2=ln_15)  # -> flatten(Result)

end_10 = EndPoints(Curve=merge_10)  # -> Start, End
midpt_5 = CurveMiddle(Curve=merge_10)
ln_16 = Line(StartPoint=end_10.Start, EndPoint=midpt_5)
ln_17 = Line(StartPoint=end_10.End, EndPoint=midpt_5)
merge_18 = Merge(Data1=ln_16, Data2=ln_17)

end_11 = EndPoints(Curve=merge_11)  # -> Start, End
shift_8 = ShiftList(List=midpt_5, Shift=2, Wrap=True)
ln_18 = Line(StartPoint=end_11.Start, EndPoint=shift_8)
ln_19 = Line(StartPoint=end_11.End, EndPoint=shift_8)
merge_19 = Merge(Data1=ln_18, Data2=ln_19)

# ----
flatten = FlattenTree(Tree=[end_9.Start, end_9.End], Path="{0}")
pdecon_4 = Deconstruct(Point=flatten)  # -> XComponent, YComponent, ZComponent
pt_7 = ConstructPoint(XCoordinate=pdecon_4.XComponent, YCoordinate=pdecon_4.YComponent, ZCoordinate=0)
ln_20 = Line(StartPoint=flatten, EndPoint=pt_7)
end_12 = EndPoints(Curve=ln_20)  # -> Start, End
shift_9 = ShiftList(List=end_12.End, Shift=-2, Wrap=True)
shift_10 = ShiftList(List=end_12.End, Shift=2, Wrap=True)
ln_21 = Line(StartPoint=end_12.Start, EndPoint=shift_9)
ln_22 = Line(StartPoint=end_12.Start, EndPoint=shift_10)
panel_26 = Panel("""0
1
10
11""")
panel_27 = Panel("""4
5
14
15""")
item_28 = ListItem(List=[ln_22, ln_21], Index=panel_26, Wrap=True)
item_29 = ListItem(List=[ln_22, ln_21], Index=panel_27, Wrap=True)

# ---- group: Geometrie
flip_13 = FlipMatrix(Data=merge_6)  # -> simplify(Data)
bang_5 = ExplodeTree(Data=flip_13)  # -> Branch0, Branch1
panel_28 = Panel("""0
6""")
panel_29 = Panel("""5
11""")
cull_i_15 = CullIndex(List=bang_5.Branch0, Indices=panel_28, Wrap=True)
cull_i_16 = CullIndex(List=bang_5.Branch1, Indices=panel_29, Wrap=True)
item_30 = ListItem(List=bang_5.Branch0, Index=panel_28, Wrap=True)
item_31 = ListItem(List=bang_5.Branch1, Index=panel_29, Wrap=True)
merge_20 = Merge(Data1=cull_i_15, Data2=cull_i_16)  # -> flatten(Result)
merge_21 = Merge(Data1=item_30, Data2=item_31)  # -> flatten(Result)

bang_6 = ExplodeTree(Data=merge_18)  # -> Branch0, Branch1, Branch2, Branch3
merge_22 = Merge(Data1=bang_6.Branch0, Data2=bang_6.Branch2)
merge_23 = Merge(Data1=bang_6.Branch1, Data2=bang_6.Branch3)
line_3 = Line(entwine_6)
line_4 = Line(merge_12)
merge_24 = Merge(Data1=line_4, Data2=merge_22)  # -> flatten(Result)
merge_25 = Merge(Data1=line_3, Data2=merge_23)  # -> flatten(Result)

# ----
len = Length(Curve=ln_12)  # disabled
division_6 = Division(A=len, B=4)  # disabled
X_5 = UnitX(Factor=expr("-x", division_6))  # disabled
move_13 = Move(Geometry=merge_14, Motion=X_5)  # -> Geometry, Transform; disabled
ln_23 = Line(StartPoint=merge_14, EndPoint=move_13.Geometry)  # disabled
panel_30 = Panel("""0
1
2
3""")  # disabled
panel_31 = Panel("""4
5
6
7""")  # disabled
panel_32 = Panel("""1
2
3""")  # disabled
panel_33 = Panel("""3
7
21
22
23
24
25
26
27
28
29
30
31""")  # disabled
item_32 = ListItem(List=flatten(move_13.Geometry), Index=panel_30, Wrap=True)  # disabled
item_33 = ListItem(List=flatten(move_13.Geometry), Index=panel_31, Wrap=True)  # disabled
item_34 = ListItem(List=flatten(move_13.Geometry), Index=panel_33, Wrap=True)  # disabled
item_35 = ListItem(List=division_5, Index=panel_32, Wrap=True)  # disabled
ma_5 = MassAddition(Input=item_35)  # -> Result, PartialResults; disabled
ln_24 = Line(StartPoint=item_32, EndPoint=item_33)  # disabled
multiplication_7 = Multiplication(A=ma_5.Result, B=addition_2)  # disabled
Z_9 = UnitZ(Factor=expr("-x", multiplication_7))  # disabled
move_14 = Move(Geometry=item_34, Motion=Z_9)  # -> Geometry, Transform; disabled
ln_25 = Line(StartPoint=item_34, EndPoint=move_14.Geometry)  # disabled
a_4_5 = Multiplication(A=geometrie, _45=4.5)  # disabled
merge_26 = Merge(Data1=ln_23, Data2=ln_24, Data3=ln_25)  # disabled
division_7 = Division(A=panel_13, B=2)  # disabled
addition_3 = Addition(A=a_4_5, B=division_7)  # disabled
pt_8 = ConstructPoint(XCoordinate=addition_3, YCoordinate=0, ZCoordinate=0)  # disabled
Z_10 = UnitZ(Factor=1)  # disabled
pl_4 = ConstructPlane(Origin=pt_8, XAxis=Z_10, YAxis=Vector(0, 1, 0))  # disabled
mirror_5 = Mirror(Geometry=merge_26, Plane=pl_4)  # -> Geometry, Transform; disabled
merge_27 = Merge(Data1=merge_26, Data2=mirror_5.Geometry)  # disabled

# ---- group: AUFLAGER - RESET
reset_auflager = Button()
reset_toggles_2 = CSharpScript(Reset=reset_auflager, Values="True")  # -> flatten(out), flatten(param); inputs Reset: Boolean, Parameters: list, Values: list of Boolean
# ---------- reset_toggles_2: C# ----------
// Grasshopper Script Instance
#region Usings
using System;
using System.Linq;
using System.Collections;
using System.Collections.Generic;
using System.Drawing;

using Rhino;
using Rhino.Geometry;

using Grasshopper;
using Grasshopper.Kernel;
using Grasshopper.Kernel.Data;
using Grasshopper.Kernel.Types;
#endregion

public class Script_Instance : GH_ScriptInstance
{
    #region Notes
    /* 
      Members:
        RhinoDoc RhinoDocument
        GH_Document GrasshopperDocument
        IGH_Component Component
        int Iteration

      Methods (Virtual & overridable):
        Print(string text)
        Print(string format, params object[] args)
        Reflect(object obj)
        Reflect(object obj, string method_name)
    */
    #endregion

    private void RunScript(
		bool Reset,
		List<object> Parameters,
		List<bool> Values,
		ref object param)
    {
        Grasshopper.Kernel.Special.GH_BooleanToggle toggle;
        param = Parameters;
        
        int num_toggles = Parameters.Count();
        int num_values = Values.Count();

        if (num_toggles != num_values)
            Print("Error: Parameters and Values should match in number of elements");
        else
        {    
            int i;

            if (Reset == true)
            {
                Print("Reseting to default values");

                for (i = 0; i < num_toggles ; i++)
                {
                    toggle = Component.Params.Input[1].Sources[i] as Grasshopper.Kernel.Special.GH_BooleanToggle; //try to cast that thing as a toggle

                    if (toggle != null)
                    {
                        toggle.Value = Values[i];
                        toggle.ExpireSolution(true);
                    }
                }
            }
        }
    }
}
# ---------- end reset_toggles_2 ----------
panel_34 = Panel(reset_toggles_2.out)

# ---- group: STRECKENLASTEN IM FACHWERK (AUF BEAM+ ELEMENTE)
streckenlast_träger_qz_kn_m = Slider(5, range=0..20)
streckenlast_durchlaufträger_qz_kn_m = Slider(2, range=0..20)
streckenlast_wind_qy_kn_m = Slider(0, range=0..10)
neg_3 = Negative(Value=streckenlast_träger_qz_kn_m)
neg_4 = Negative(Value=streckenlast_durchlaufträger_qz_kn_m)

# ---- group: LASTEN RESET
reset_lasten = Button()
panel_35 = Panel("""0
5
0""")
reset_values_2 = CSharpScript(
    Reset=reset_lasten,
    Parameters=[streckenlast_wind_qy_kn_m, streckenlast_träger_qz_kn_m, streckenlast_durchlaufträger_qz_kn_m],
    Values=panel_35)  # -> flatten(out), flatten(param); inputs Reset: Boolean, Parameters: list, Values: list of Double
# ---------- reset_values_2: C# ----------
// Grasshopper Script Instance
#region Usings
using System;
using System.Linq;
using System.Collections;
using System.Collections.Generic;
using System.Drawing;

using Rhino;
using Rhino.Geometry;

using Grasshopper;
using Grasshopper.Kernel;
using Grasshopper.Kernel.Data;
using Grasshopper.Kernel.Types;
#endregion

public class Script_Instance : GH_ScriptInstance
{
    #region Notes
    /* 
      Members:
        RhinoDoc RhinoDocument
        GH_Document GrasshopperDocument
        IGH_Component Component
        int Iteration

      Methods (Virtual & overridable):
        Print(string text)
        Print(string format, params object[] args)
        Reflect(object obj)
        Reflect(object obj, string method_name)
    */
    #endregion

    private void RunScript(
		bool Reset,
		List<object> Parameters,
		List<double> Values,
		ref object param)
    {
        Grasshopper.Kernel.Special.GH_NumberSlider slider;
        param = Parameters;
        
        int num_sliders = Parameters.Count();
        int num_values = Values.Count();

        if (num_sliders != num_values)
            Print("Error: Parameters and Values should match in number of elements");
        else
        {    
            int i;

            if (Reset == true)
            {
                Print("Reseting to default values");

                for (i = 0; i < num_sliders ; i++)
                {
                    slider = Component.Params.Input[1].Sources[i] as Grasshopper.Kernel.Special.GH_NumberSlider; //try to cast that thing as a slider

                    if (slider != null)
                    {
                        slider.TrySetSliderValue((decimal) Values[i]);
                    }
                }
            }
        }
    }
}
# ---------- end reset_values_2 ----------
reset_toggles_3 = CSharpScript(Reset=reset_lasten, Values="False")  # -> flatten(out), flatten(param); inputs Reset: Boolean, Parameters: list, Values: list of Boolean; same code as reset_toggles_2
panel_36 = Panel(reset_values_2.out)
panel_37 = Panel(reset_toggles_3.out)

# ----
expression = Expression(x=streckenlast_wind_qy_kn_m, Expression="if(x=0, 0, 1)")

# ---- group: MATERIAL UND QUERSCHNITT DES RAHMENS
number_slider = Slider(90, range=50..400)
number_slider_2 = Slider(4, range=4..30)
number_slider_3 = Slider(80, range=50..400)
number_slider_4 = Slider(4, range=4..30)
width_height_mm = Slider(90, range=50..400)
number_slider_5 = Slider(125, range=50..400)
number_slider_6 = Slider(7, range=4..30)
width_height_mm_2 = Slider(80, range=50..400)
width_height_mm_3 = Slider(125, range=50..400)
number_slider_7 = Slider(100, range=50..400)
number_slider_8 = Slider(8, range=4..30)
panel_38 = Panel("90.4 Orange")
material = Slider(0, range=0..2)
material_grad = Slider(1, range=0..6)
mat = MaterialsPlus(MaterialIndex=material, GradeIndex=material_grad)  # -> MaterialName, MaterialProperties, MaterialNames
width_height_mm_4 = Slider(100, range=50..400)
panel_39 = Panel("125.7 Rot")
panel_40 = Panel("80.3 Gelb")
panel_41 = Panel("100.8 Rosa")
panel_42 = Panel(mat.MaterialName)
panel_43 = Panel(mat.MaterialNames)
hollow_rectangle = RectangularHollowSectionProperties(Width_mm=width_height_mm, Height_mm=width_height_mm, Thickness_mm=number_slider_2, Torsion=False)  # -> Properties, WidthW_m, HeightH_m, GeometryPolylineOfTheCrossSection
hollow_rectangle_2 = RectangularHollowSectionProperties(Width_mm=width_height_mm_3, Height_mm=width_height_mm_3, Thickness_mm=number_slider_6, Torsion=False)  # -> Properties, WidthW_m, HeightH_m, GeometryPolylineOfTheCrossSection
hollow_rectangle_3 = RectangularHollowSectionProperties(Width_mm=width_height_mm_2, Height_mm=width_height_mm_2, Thickness_mm=number_slider_4, Torsion=False)  # -> Properties, WidthW_m, HeightH_m, GeometryPolylineOfTheCrossSection
hollow_rectangle_4 = RectangularHollowSectionProperties(Width_mm=width_height_mm_4, Height_mm=width_height_mm_4, Thickness_mm=number_slider_8, Torsion=False)  # -> Properties, WidthW_m, HeightH_m, GeometryPolylineOfTheCrossSection

# ----
reset_querschnitte = Button()
panel_44 = Panel("""100
100
8
125
125
7
80
80
3
90
90
4""")
reset_values_3 = CSharpScript(
    Reset=reset_querschnitte,
    Parameters=[width_height_mm_4, number_slider_7, number_slider_8, width_height_mm_3, number_slider_5, number_slider_6, width_height_mm_2, number_slider_3, number_slider_4, width_height_mm, number_slider, number_slider_2],
    Values=panel_44)  # -> flatten(out), flatten(param); inputs Reset: Boolean, Parameters: list, Values: list of Double; same code as reset_values_2
panel_45 = Panel(reset_values_3.out)

reset_innere_gelenke = Button()
reset_toggles_4 = CSharpScript(Reset=reset_innere_gelenke)  # -> flatten(out), flatten(param); inputs Reset: Boolean, Parameters: list, Values: list of Boolean; same code as reset_toggles_2
panel_46 = Panel(reset_toggles_4.out)

drehungswinkel_des_trägers_º = Slider(0, range=0..180)
drehungswinkel_der_stützen_º = Slider(90, range=0..180)

merge_28 = Merge()  # -> flatten(Result)

# ---- group: BEAM+ UND STRECKENLASTEN DARSTELLUNG
cfg_2 = ConfigurationPlusTunnel(Config=cfg)  # -> Config, StiffnessRatio, Threshold, NumberOfDecimals, LineThickness, ModelColor, _3DModel, Hinges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
and_2 = GateAnd(A=cfg_2.Deformation, B=cfg_2._3DDeformation)

# ---- group: AUFLAGER UND AUFLAGERREAKTIONEN DARSTELLUNG
cfg_3 = ConfigurationPlusTunnel(Config=cfg)  # -> Config, StiffnessRatio, Threshold, NumberOfDecimals, LineThickness, ModelColor, _3DModel, Hinges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

# ---- group: CABLE+ DARSTELLUNG
cfg_4 = ConfigurationPlusTunnel(Config=cfg)  # -> Config, StiffnessRatio, Threshold, NumberOfDecimals, LineThickness, ModelColor, _3DModel, Hinges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
cableoutput = CableOutputPlus(CableData=merge_28, Config=cfg_4.Config)  # -> IP0, IP1, P0, P1, N, Deformation, AxialDiagramTension, TextPositionD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
saturationratio = CSharpScript(Lines=cableoutput.LineS, satRatio=cableoutput.TensionRatio, b=cfg_4.SaturationRatio)  # -> out, p, l, t, i; inputs Lines: Line, satRatio: Double, b: Boolean
# ---------- saturationratio: C# ----------
// Grasshopper Script Instance
#region Usings
using System;
using System.Linq;
using System.Collections;
using System.Collections.Generic;
using System.Drawing;

using Rhino;
using Rhino.Geometry;
using Rhino.Display;

using Grasshopper;
using Grasshopper.Kernel;
using Grasshopper.Kernel.Data;
using Grasshopper.Kernel.Types;
#endregion

public class Script_Instance : GH_ScriptInstance
{
    #region Notes
    /* 
      Members:
        RhinoDoc RhinoDocument
        GH_Document GrasshopperDocument
        IGH_Component Component
        int Iteration

      Methods (Virtual & overridable):
        Print(string text)
        Print(string format, params object[] args)
        Reflect(object obj)
        Reflect(object obj, string method_name)
    */
    #endregion

    private void RunScript(
		Line Lines,
		double satRatio,
		bool b,
		ref object p,
		ref object l,
		ref object t,
		ref object i)
    {
        if (b == false)
            return;

        if (Lines.Length < 0.1)
            return;

        l = Lines;
                    
        Point3d pm;

        pm = 0.5 * (Lines.From + Lines.To);

        p = pm;

        t = Math.Round(satRatio * 100.0,0).ToString();

        if (satRatio < 0.0)
            i = 0;
        else
            i = Math.Min(8, Math.Floor(satRatio / 0.125));
    }
}
# ---------- end saturationratio ----------
preview_def = CSharpScript(L=flatten(cableoutput.Deformation), T=cfg_4.LineThickness, C=cfg_4.DeformationColor, b=cfg_4._3DDeformation)  # inputs L: list of Line, T: Int32, C: Color, b: Boolean
# ---------- preview_def: C# ----------
// Grasshopper Script Instance
#region Usings
using System;
using System.Linq;
using System.Collections;
using System.Collections.Generic;
using System.Drawing;

using Rhino;
using Rhino.Geometry;

using Grasshopper;
using Grasshopper.Kernel;
using Grasshopper.Kernel.Data;
using Grasshopper.Kernel.Types;
#endregion

public class Script_Instance : GH_ScriptInstance
{
    Color c;
    int t;
    List <Line> l;
    bool draw_it;

    #region Notes
    /* 
      Members:
        RhinoDoc RhinoDocument
        GH_Document GrasshopperDocument
        IGH_Component Component
        int Iteration

      Methods (Virtual & overridable):
        Print(string text)
        Print(string format, params object[] args)
        Reflect(object obj)
        Reflect(object obj, string method_name)
    */
    #endregion

    private void RunScript(List<Line> L, int T, Color C, bool b)
    {
        draw_it = !b;     // Die 3D Darstellung soll nicht gleichzeitig gezeigt werden...
        
        if (L == null || L.Count() < 1)
        {
            draw_it = false;
            return;
        }

        int n = L.Count();
        
        l = new List<Line>();
        l.Clear();

        for (int i = 0; i < n; i++)
            l.Add(L[i]);

        c = C;
        t = T;
    }

    public override BoundingBox ClippingBox => BoundingBox.Empty;

    public override void DrawViewportMeshes(IGH_PreviewArgs args)
    {
        base.DrawViewportWires(args);
        
        if (draw_it == false)
            return;
            
        int n = l.Count();

        for (int i = 0; i < n; i++)
            args.Display.DrawLine(l[i], c, t);
    }

    public override void DrawViewportWires(IGH_PreviewArgs args)
    {

    }
}
# ---------- end preview_def ----------
colors_for_saturation_grade = ListItem(List=cfg_4.SaturationRatioColors, Index=saturationratio.i, Wrap=True)
previewaxial = CustomPreview(Geometry=cableoutput.AxialDiagramTension, Material=cfg_4.PositiveAxialColor)
and_3 = GateAnd(A=cfg_4.Deformation, B=cfg_4._3DDeformation)
bnd = Bounds(Numbers=flatten(cableoutput.TensionRatio))
filter = StreamFilter(Gate=cfg_4.SaturationRatio, Stream1=saturationratio.t)
filter_2 = StreamFilter(Gate=cfg_4.Displacements, Stream1=cableoutput.TextD)
filter_3 = StreamFilter(Gate=cfg_4.DiagramValues, Stream1=cableoutput.TextF)
filter_4 = StreamFilter(Gate=and_3, Stream1=cableoutput._3DGeometry)
dedomain = DeconstructDomain(Domain=bnd)  # -> Start, End
ln_26 = Line(StartPoint=cableoutput.IP0, EndPoint=cableoutput.IP1)
not = GateNot(A=cfg_4.SaturationRatio)
filter_5 = StreamFilter(Gate=not, Stream1=ln_26)
tag = TextTag(Location=saturationratio.p, Text=filter, Colour=colors_for_saturation_grade)
preview_geo = CSharpScript(L=flatten(filter_5), T=cfg_4.LineThickness, C=cfg_4.ModelColor, b=cfg_4._3DModel)  # inputs L: list of Line, T: Int32, C: Color, b: Boolean
# ---------- preview_geo: C# ----------
// Grasshopper Script Instance
#region Usings
using System;
using System.Linq;
using System.Collections;
using System.Collections.Generic;
using System.Drawing;

using Rhino;
using Rhino.Geometry;

using Grasshopper;
using Grasshopper.Kernel;
using Grasshopper.Kernel.Data;
using Grasshopper.Kernel.Types;
#endregion

public class Script_Instance : GH_ScriptInstance
{
    Color c;
    int t;
    List <Line> l;
    bool draw_it;

    #region Notes
    /* 
      Members:
        RhinoDoc RhinoDocument
        GH_Document GrasshopperDocument
        IGH_Component Component
        int Iteration

      Methods (Virtual & overridable):
        Print(string text)
        Print(string format, params object[] args)
        Reflect(object obj)
        Reflect(object obj, string method_name)
    */
    #endregion

    private void RunScript(List<Line> L, int T, Color C, bool b)
    {
        draw_it = !b;     // Die 3D Darstellung soll nicht gleichzeitig gezeigt werden...

        if (L == null || L.Count() < 1)
        {
            draw_it = false;
            return;
        }

        int n = L.Count();
        
        l = new List<Line>();
        l.Clear();
        
        for (int i = 0; i < n; i++)
            l.Add(L[i]);

        c = C;
        t = T;
    }

    public override BoundingBox ClippingBox => BoundingBox.Empty;

    public override void DrawViewportMeshes(IGH_PreviewArgs args)
    {
        base.DrawViewportWires(args);
        
        if (draw_it == false)
            return;
            
        int n = l.Count();

        for (int i = 0; i < n; i++)
            args.Display.DrawLine(l[i], c, t);
    }

    public override void DrawViewportWires(IGH_PreviewArgs args)
    {

    }
}
# ---------- end preview_geo ----------
preview_def3d = CustomPreview(Geometry=filter_4, Material=cfg_4.DeformationColor)
preview_saturation = CustomPreview(Geometry=saturationratio.l, Material=colors_for_saturation_grade)
defvalues = TextTag(Location=cableoutput.TextPositionD, Text=filter_2, Colour=cfg_4.DisplacementColor)
intforcevalues = TextTag(Location=cableoutput.TextPositionF, Text=filter_3, Colour=cfg_4.ValuesColor)

# ---- group: PUNKTLASTEN DARSTELLUNG
cfg_5 = ConfigurationPlusTunnel(Config=cfg)  # -> Config, StiffnessRatio, Threshold, NumberOfDecimals, LineThickness, ModelColor, _3DModel, Hinges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

# ---- group: AUFLAGER UND AUFLAGERREAKTIONEN DARSTELLUNG
ahsl = SplitAHSL(Colour=cfg_3.ReactionColor)  # -> Alpha, Hue, Saturation, Luminance
multiplication_8 = Multiplication(Stiffness=cfg_3.StiffnessRatio, FaktorVerformung=cfg_3.ScaleDeformation)
hsl = ColourHSL(Alpha=ahsl.Alpha, Hue=ahsl.Hue, Saturation=ahsl.Saturation, Luminance=expr("0.67*x", ahsl.Luminance))

# ---- group: PUNKTLASTEN DARSTELLUNG
ahsl_2 = SplitAHSL(Colour=cfg_5.LoadColor)  # -> Alpha, Hue, Saturation, Luminance
multiplication_9 = Multiplication(Stiffness=cfg_5.StiffnessRatio, FaktorVerformung=cfg_5.ScaleDeformation)
hsl_2 = ColourHSL(Alpha=ahsl_2.Alpha, Hue=ahsl_2.Hue, Saturation=ahsl_2.Saturation, Luminance=expr("0.67*x", ahsl_2.Luminance))

# ----
not_2 = GateNot(A=abstraktion)
and_4 = GateAnd(A=not_2, B=gelenke_darstellen)

and_5 = GateAnd(A=abstraktion, B=gelenke_darstellen)

# ---- group: GEOMETRISCHE PARAMETER - RESET
multiplication_10 = Multiplication(A=ma.Result, B="2")
reset_geometrie = Button()
panel_47 = Panel("6.15")

# ---- group: Geometrie
vorne_1 = Curve([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])
hinten = Curve([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])
blau = Curve([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])
vorne_2 = Curve([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])
multiplication_11 = Multiplication(A="9", B=panel_47)
X_6 = UnitX(Factor=multiplication_11)
neg_5 = Negative(Value=X_6)
X_7 = UnitX(Factor=panel_47)
move_15 = Move(Geometry=hinten, Motion=neg_5)  # -> Geometry, Transform
neg_6 = Negative(Value=X_7)
end_13 = EndPoints(Curve=blau)  # -> Start, End
len_2 = Length(Curve=blau)
multiplication_12 = Multiplication(A="9", B=geometrie)
move_16 = Move(Geometry=vorne_2, Motion=neg_6)  # -> Geometry, Transform
yz = YZPlane(Origin=end_13.End)
division_8 = Division(A=geometrie, B=len_2)
X_8 = UnitX(Factor=multiplication_12)
X_9 = UnitX(Factor=geometrie)
scale_nu = ScaleNU(Geometry=blau, Plane=yz, ScaleX=1, ScaleY=1, ScaleZ=division_8)  # -> Geometry, Transform
move_17 = Move(Geometry=move_15.Geometry, Motion=X_8)  # -> Geometry, Transform
move_18 = Move(Geometry=move_16.Geometry, Motion=X_9)  # -> Geometry, Transform
merge_29 = Merge(Data1=scale_nu.Geometry, Data2=vorne_1, Data3=move_17.Geometry, Data4=move_18.Geometry)

träger_innenkante_breite_2 = Number(ma.Result)
stütze_fw_breite_lose = Number(stützen_fw_breite)
kopfseiten = Line(merge_29)
stütze_fw_breite_fest = Number(panel_15)
item_36 = ListItem(List=stütze_fw_breite_fest, Index=0, Wrap=True)
multiplication_13 = Multiplication(A=träger_innenkante_breite_2, B="2")
addition_4 = Addition(A=item_36, B=multiplication_13)
midpt_6 = CurveMiddle(Curve=kopfseiten)
pdecon_5 = Deconstruct(Point=midpt_6)  # -> XComponent, YComponent, ZComponent
smaller = SmallerThan(FirstNumber=pdecon_5.YComponent, SecondNumber=item_36)  # -> SmallerThan, OrEqualTo
pt_9 = ConstructPoint(XCoordinate=0, YCoordinate=addition_4, ZCoordinate=0)
dispatch = Dispatch(List=kopfseiten, DispatchPattern=smaller.OrEqualTo)  # -> ListA, ListB
midpt_7 = CurveMiddle(Curve=dispatch.ListB)
pdecon_6 = Deconstruct(Point=midpt_7)  # -> XComponent, YComponent, ZComponent
larger = LargerThan(FirstNumber=pdecon_6.YComponent, SecondNumber=addition_4)  # -> LargerThan, OrEqualTo
dispatch_2 = Dispatch(List=dispatch.ListB, DispatchPattern=larger.OrEqualTo)  # -> ListA, ListB
xy = XYPlane(Origin=pt_9)
division_9 = Division(A=stütze_fw_breite_lose, B=item_36)
scale_nu_2 = ScaleNU(Geometry=dispatch.ListA, Plane=PlaneXY(0, 0, 0), ScaleX=1, ScaleY=division_9, ScaleZ=1)  # -> Geometry, Transform
scale_nu_3 = ScaleNU(Geometry=dispatch_2.ListA, Plane=xy, ScaleX=1, ScaleY=division_9, ScaleZ=1)  # -> Geometry, Transform
merge_30 = Merge(Data1=dispatch_2.ListB, Data2=scale_nu_3.Geometry)
subtraction_2 = Subtraction(A=stütze_fw_breite_lose, B=item_36)
Y_5 = UnitY(Factor=subtraction_2)
move_19 = Move(Geometry=merge_30, Motion=Y_5)  # -> Geometry, Transform
träger_innenkante_breite_lose = Number(träger_innenkante_breite)
träger_innenkante_breite_fest = Number(multiplication_10)
merge_31 = Merge(Data1=scale_nu_2.Geometry, Data2=move_19.Geometry)  # -> flatten(Result)
midpt_8 = CurveMiddle(Curve=merge_31)
addition_5 = Addition(A=multiplication_13, B=stütze_fw_breite_lose)
pdecon_7 = Deconstruct(Point=midpt_8)  # -> XComponent, YComponent, ZComponent
smaller_2 = SmallerThan(FirstNumber=pdecon_7.YComponent, SecondNumber=stütze_fw_breite_lose)  # -> SmallerThan, OrEqualTo
dispatch_3 = Dispatch(List=merge_31, DispatchPattern=smaller_2.OrEqualTo)  # -> ListA, ListB
midpt_9 = CurveMiddle(Curve=dispatch_3.ListB)
pdecon_8 = Deconstruct(Point=midpt_9)  # -> XComponent, YComponent, ZComponent
larger_2 = LargerThan(FirstNumber=pdecon_8.YComponent, SecondNumber=addition_5)  # -> LargerThan, OrEqualTo
dispatch_4 = Dispatch(List=dispatch_3.ListB, DispatchPattern=larger_2.OrEqualTo)  # -> ListA, ListB
subtraction_3 = Subtraction(A=träger_innenkante_breite_lose, B=träger_innenkante_breite_fest)
pt_10 = ConstructPoint(XCoordinate=0, YCoordinate=stütze_fw_breite_lose, ZCoordinate=0)
division_10 = Division(A=träger_innenkante_breite_lose, B=träger_innenkante_breite_fest)
xy_2 = XYPlane(Origin=pt_10)
Y_6 = UnitY(Factor=subtraction_3)
scale_nu_4 = ScaleNU(Geometry=dispatch_4.ListB, Plane=xy_2, ScaleX=1, ScaleY=division_10, ScaleZ=1)  # -> Geometry, Transform
move_20 = Move(Geometry=dispatch_4.ListA, Motion=Y_6)  # -> Geometry, Transform
merge_32 = Merge(Data1=dispatch_3.ListA, Data2=move_20.Geometry, Data3=scale_nu_4.Geometry)  # -> flatten(Result)
item_37 = ListItem(List=panel_15, Index="-1", Wrap=True)
midpt_10 = CurveMiddle(Curve=merge_32)
pdecon_9 = Deconstruct(Point=midpt_10)  # -> XComponent, YComponent, ZComponent
stützen_innenkante_höhe_lose = Number(stützen_innenkante_höhe)
stützen_innenkante_höhe_fest = Number(ma_2.Result)
träger_fw_höhe_lose = Number(träger_fw_höhe)
träger_fw_höhe_fest = Number(item_37)
smaller_3 = SmallerThan(FirstNumber=pdecon_9.ZComponent, SecondNumber=stützen_innenkante_höhe_fest)  # -> SmallerThan, OrEqualTo
dispatch_5 = Dispatch(List=merge_32, DispatchPattern=smaller_3.OrEqualTo)  # -> ListA, ListB
division_11 = Division(A=stützen_innenkante_höhe_lose, B=stützen_innenkante_höhe_fest)
subtraction_4 = Subtraction(A=stützen_innenkante_höhe_lose, B=stützen_innenkante_höhe_fest)
Z_11 = UnitZ(Factor=subtraction_4)
pt_11 = ConstructPoint(XCoordinate=0, YCoordinate=0, ZCoordinate=stützen_innenkante_höhe_lose)
move_21 = Move(Geometry=dispatch_5.ListB, Motion=Z_11)  # -> Geometry, Transform
scale_nu_5 = ScaleNU(Geometry=dispatch_5.ListA, Plane=PlaneXY(0, 0, 0), ScaleX=1, ScaleY=1, ScaleZ=division_11)  # -> Geometry, Transform
xy_3 = XYPlane(Origin=pt_11)
division_12 = Division(A=träger_fw_höhe_lose, B=träger_fw_höhe_fest)
scale_nu_6 = ScaleNU(Geometry=move_21.Geometry, Plane=xy_3, ScaleX=1, ScaleY=1, ScaleZ=division_12)  # -> Geometry, Transform
merge_33 = Merge(Data1=scale_nu_5.Geometry, Data2=scale_nu_6.Geometry)

# ---- group: GEOMETRISCHE PARAMETER
ganze_breite = Number(multiplication_4)
ganze_höhe = Number(addition_2)
item_38 = ListItem(List=panel_12, Index=3, Wrap=True)
trägerfwhöhe = Number(item_38)
item_39 = ListItem(List=panel_14, Index=0, Wrap=True)
stützenfwhöhe = Number(item_39)
subtraction_5 = Subtraction(A=ganze_breite, B=stützenfwhöhe)
modellbreite_oder_modellspannweite_l = Number(subtraction_5)
division_13 = Division(A=trägerfwhöhe, B=2)
tiefe = Number(panel_13)
subtraction_6 = Subtraction(A=ganze_höhe, B=division_13)
division_14 = Division(A=stützenfwhöhe, B=2)
division_15 = Division(A=tiefe, B=2)
modellhöhe_h = Number(subtraction_6)
addition_6 = Addition(A=division_14, B=modellbreite_oder_modellspannweite_l)
A = ConstructPoint(XCoordinate=division_15, YCoordinate=division_14, ZCoordinate=0)
D = ConstructPoint(XCoordinate=division_15, YCoordinate=addition_6, ZCoordinate=0)
Z_12 = UnitZ(Factor=modellhöhe_h)
B = Move(Geometry=A, Motion=Z_12)  # -> Geometry, Transform
C = Move(Geometry=D, Motion=Z_12)  # -> Geometry, Transform
entwine_7 = Entwine(Branch00=A, Branch01=B.Geometry, FlattenInputs=True)

# ----
rectangle_stützen_rosa = RectangularCS(Width=width_height_mm_4, Height=number_slider_7, Thickness=number_slider_8)  # -> A, Iy, Iz, It; disabled
rectangle_träger_grün = RectangularCS(Width=width_height_mm, Height=number_slider, Thickness=number_slider_2)  # -> A, Iy, Iz, It; disabled
is_mm4 = Evaluate(E="2*(H*H*A/4)*1e6", H=stützenfwhöhe, A=rectangle_stützen_rosa.A)  # disabled
is_mm4_2 = Evaluate(E="2*(H*H*A/4)*1e6", H=trägerfwhöhe, A=rectangle_träger_grün.A)  # disabled
generic = GenericSectionProperties(
    Area_mm2=rectangle_stützen_rosa.A,
    PrincipalInertia_mm4=is_mm4,
    SecondaryInertia_mm4=30000000,
    TorsionalInertia_mm4=1e-12)  # -> Properties, WidthW_m, HeightH_m, GeometryPolylineOfTheCrossSection; disabled
generic_2 = GenericSectionProperties(
    Area_mm2=rectangle_träger_grün.A,
    PrincipalInertia_mm4=is_mm4_2,
    SecondaryInertia_mm4=30000000,
    TorsionalInertia_mm4=1e-12)  # -> Properties, WidthW_m, HeightH_m, GeometryPolylineOfTheCrossSection; disabled

rectangle_träger_weiß = RectangularCS(Width=width_height_mm, Height=number_slider, Thickness=number_slider_2)  # -> A, Iy, Iz, It
rectangle_stützen_rosa_2 = RectangularCS(Width=width_height_mm_4, Height=number_slider_7, Thickness=number_slider_8)  # -> A, Iy, Iz, It
rectangle_träger_orange = RectangularCS(Width=width_height_mm, Height=number_slider, Thickness=number_slider_2)  # -> A, Iy, Iz, It
is_mm4_3 = Evaluate(E="2*(H*H*A/4)*1e6", H=stützenfwhöhe, A=rectangle_stützen_rosa_2.A)
is_mm4_4 = Evaluate(E="2*(H*H*A/4)*1e6", H=trägerfwhöhe, A=rectangle_träger_orange.A)
is_mm4_5 = Evaluate(E="2*(H*H*A/4)*1e6", H=trägerfwhöhe, A=rectangle_träger_weiß.A)
generic_3 = GenericSectionProperties(
    Area_mm2=rectangle_stützen_rosa_2.A,
    PrincipalInertia_mm4=is_mm4_3,
    SecondaryInertia_mm4=30000000,
    TorsionalInertia_mm4=1e-12)  # -> Properties, WidthW_m, HeightH_m, GeometryPolylineOfTheCrossSection
generic_4 = GenericSectionProperties(
    Area_mm2=rectangle_träger_orange.A,
    PrincipalInertia_mm4=is_mm4_4,
    SecondaryInertia_mm4=30000000,
    TorsionalInertia_mm4=1e-12)  # -> Properties, WidthW_m, HeightH_m, GeometryPolylineOfTheCrossSection
generic_5 = GenericSectionProperties(
    Area_mm2=rectangle_träger_weiß.A,
    PrincipalInertia_mm4=is_mm4_5,
    SecondaryInertia_mm4=30000000,
    TorsionalInertia_mm4=1e-12)  # -> Properties, WidthW_m, HeightH_m, GeometryPolylineOfTheCrossSection

# ---- group: GEOMETRISCHE PARAMETER - RESET (continued)
merge_34 = Merge(Data1=multiplication_10, Data2=ma_2.Result, Data3=modellhöhe_h, Data4=modellbreite_oder_modellspannweite_l)
panel_48 = Panel([panel_15, merge_34, "0.5", panel_47])

# ----
panel_49 = Panel("1")  # disabled
item_40 = ListItem(List=panel_14, Index=0, Wrap=True)  # disabled
a_0_1 = Addition(A=item_40, _01=0.1)  # disabled
panel_50 = Panel("6")  # disabled
panel_51 = Panel("""2
3
9
10""")  # disabled
panel_52 = Panel("""1
3""")  # disabled
panel_53 = Panel("""11
13""")  # disabled

abstraktion_breite = Slider(20.56, range=0..50)
abstraktion_höhe = Slider(9.71, range=0..30)
Y_7 = UnitY(Factor=abstraktion_breite)
Z_13 = UnitZ(Factor=abstraktion_höhe)
abstraktion_position_gelenk = Slider(0.5, range=0.1..1.1)

# ---- group: GEOMETRISCHE PARAMETER - RESET (continued)
reset_values_4 = CSharpScript(
    Reset=reset_geometrie,
    Parameters=[stützen_fw_breite, träger_fw_höhe, träger_innenkante_breite, stützen_innenkante_höhe, abstraktion_höhe, abstraktion_breite, abstraktion_position_gelenk, abstand],
    Values=panel_48)  # -> flatten(out), flatten(param); inputs Reset: Boolean, Parameters: list, Values: list of Double; same code as reset_values_2
panel_54 = Panel(reset_values_4.out)

# ---- group: Geometrie
geometrie_komplett = BooleanToggle(False)
X_10 = UnitX(Factor=geometrie)
arrlinear = LinearArray(Geometry=merge_16, Direction=X_10, Count="9")  # -> Geometry, Transform
and_6 = GateAnd(A=geometrie_komplett)
X_11 = UnitX(Factor=Slider(10, range=0..10))

# ---- group: GEOMETRISCHE PARAMETER (continued)
move_22 = Move(Geometry=entwine_7, Motion=X_11)  # -> Geometry, Transform
bang_7 = ExplodeTree(Data=move_22.Geometry)  # -> Branch0, Branch1

# ----
split_10 = SplitTree(Data=arrlinear.Geometry, Masks=flatten("{0;0 to 20}"))  # -> simplify(Positive), flatten(Negative); disabled
partition_3 = PartitionList(List=split_10.Negative, Size="9")  # -> simplify(Chunks); disabled
item_41 = ListItem(List=split_10.Positive, Index=panel_49, Wrap=True)  # -> flatten(Item); disabled
item_42 = ListItem(List=partition_3, Index=panel_49, Wrap=True)  # -> flatten(Item); disabled
partition_4 = PartitionList(List=item_42, Size=panel_50)  # disabled
item_43 = ListItem(List=item_41, Index=panel_51, Wrap=True)  # disabled
split_11 = SplitList(List=partition_4, Index=expr("x/2", panel_50))  # -> ListA, flatten(ListB); disabled
divide_3 = DivideCurve(Curve=item_43, Count=4, Kinks=False)  # -> Points, Tangents, Parameters; disabled
shatter_3 = Shatter(Curve=item_43, Parameters=flatten(divide_3.Parameters))  # disabled
expression_2 = Expression(x=X_10, y=panel_49, Expression="x*(y+0)")  # disabled
expression_3 = Expression(x=X_10, y=panel_49, Expression="x*(y+1)")  # disabled
flip_14 = FlipMatrix(Data=shatter_3)  # disabled
cull_i_17 = CullIndex(List=flip_14, Indices=panel_52, Wrap=True)  # disabled
item_44 = ListItem(List=flip_14, Index=panel_52, Wrap=True)  # disabled

split_12 = SplitList(List=merge_17, Index=4)  # -> ListA, ListB
split_13 = SplitList(List=ln_20, Index=4)  # -> ListA, ListB
entwine_8 = Entwine(Branch00=split_13.ListB, Branch01=item_29, FlattenInputs=True)
entwine_9 = Entwine(Branch00=split_13.ListA, Branch01=item_28, FlattenInputs=True)

move_23 = Move(Geometry=bang_7.Branch0, Motion=Y_7)  # -> Geometry, Transform
move_24 = Move(Geometry=bang_7.Branch0, Motion=Z_13)  # -> Geometry, Transform
move_25 = Move(Geometry=move_23.Geometry, Motion=Z_13)  # -> Geometry, Transform
ln_27 = Line(StartPoint=bang_7.Branch0, EndPoint=move_24.Geometry)
ln_28 = Line(StartPoint=move_24.Geometry, EndPoint=move_25.Geometry)
ln_29 = Line(StartPoint=move_23.Geometry, EndPoint=move_25.Geometry)
shatter_4 = Shatter(Curve=ln_28, Parameters=abstraktion_position_gelenk)
split_14 = SplitList(List=shatter_4, Index=1)  # -> ListA, ListB
end_14 = EndPoints(Curve=split_14.ListB)  # -> Start, End
ln_30 = Line(StartPoint=end_14.Start, EndPoint=end_14.End)
träger = Merge(Data1=split_14.ListA, Data2=ln_30)
end_15 = EndPoints(Curve=ln_27)  # -> Start, End
end_16 = EndPoints(Curve=ln_29)  # -> Start, End

auflager_a = Move(Geometry=end_15.Start, Motion=X_10)  # -> Geometry, Transform; disabled
auflager_b = Move(Geometry=auflager_a.Geometry, Motion=X_10)  # -> Geometry, Transform; disabled
stütze_b = LineSDL(Start=auflager_b.Geometry, Direction=Vector(0, 0, 1), Length=Z_13)  # disabled
stütze_a = LineSDL(Start=auflager_a.Geometry, Direction=Vector(0, 0, 1), Length=Z_13)  # disabled
end_17 = EndPoints(Curve=stütze_a)  # -> Start, End; disabled
end_18 = EndPoints(Curve=stütze_b)  # -> Start, End; disabled
stützen = Merge(Data1=stütze_a, Data2=stütze_b)  # disabled
auflager = Merge(Data1=auflager_a.Geometry, Data2=auflager_b.Geometry)  # disabled
träger_2 = Line(StartPoint=end_17.End, EndPoint=end_18.End)  # disabled

beam_träger = BeamPlus(
    Line=träger_2,
    Material=mat.MaterialProperties,
    Properties=generic_2.Properties,
    Width=generic_2.WidthW_m,
    Height=generic_2.HeightH_m,
    Angle=drehungswinkel_des_trägers_º,
    I_Connection=0,
    J_Connection=0,
    LoadQX=0,
    LoadQY=0,
    LoadQZ=neg_3,
    SelfWeight=False,
    ControlAxial=1e+10,
    ControlBending=1e+10,
    Config=cfg,
    Divisions=True)  # -> StartPlane, EndPlane, flatten(Beam), flatten(FeLoads), _3DGeometry; disabled
beam_stützen = BeamPlus(
    Line=stützen,
    Material=mat.MaterialProperties,
    Properties=generic.Properties,
    Width=generic.WidthW_m,
    Height=generic.HeightH_m,
    Angle=drehungswinkel_der_stützen_º,
    I_Connection=0,
    J_Connection=0,
    LoadQX=0,
    LoadQY=streckenlast_wind_qy_kn_m,
    LoadQZ=0,
    SelfWeight=False,
    ControlAxial=1e+10,
    ControlBending=1e+10,
    Config=cfg,
    Divisions=True)  # -> StartPlane, EndPlane, flatten(Beam), flatten(FeLoads), _3DGeometry; disabled
fachwerk_beam_fachwerkelemente = Merge(Data1=beam_träger.Beam, Data2=beam_stützen.Beam)  # -> flatten(Result); disabled

# ---- group: Geometrie
lng_2 = ListLength(List=merge_21)
lng_3 = ListLength(List=cull_i)
panel_55 = Panel("""0
2""")
panel_56 = Panel("""1
3
4
5
6
7""")

_90_4_orange = Line(flatten([merge_25, merge_8]))
_100_8_rosa = Line(flatten([merge_3, merge_21]))

split_15 = SplitList(List=_100_8_rosa, Index=lng_2)  # -> ListA, ListB
partition_5 = PartitionList(List=split_15.ListB, Size=lng_3)
flip_15 = FlipMatrix(Data=partition_5)
item_45 = ListItem(List=flip_15, Index=panel_55, Wrap=True)  # -> flatten(Item)
item_46 = ListItem(List=flip_15, Index=panel_56, Wrap=True)  # -> flatten(Item)
_100_8_rosa_bar = Merge(Data1=split_15.ListA, Data2=item_46)  # -> flatten(Result)
filter_6 = StreamFilter(Gate=expression, Stream1=item_45)
filter_7 = StreamFilter(Gate=expression, Stream0=_100_8_rosa, Stream1=_100_8_rosa_bar)
_100_8_rosa_bar_2 = Line(flatten(filter_7))
_100_8_rosa_beam = Line(flatten(filter_6))

lng_4 = ListLength(List=merge_25)
split_16 = SplitList(List=_90_4_orange, Index=lng_4)  # -> ListA, ListB
lng_5 = ListLength(List=split_16.ListA)  # -> expr("x/2-2", Length)
split_17 = SplitList(List=split_16.ListA, Index=lng_5)  # -> ListA, ListB
_90_4_orange_beam = Line(flatten(split_17.ListA))
_90_4_orange_bar = Merge(Data1=split_16.ListB, Data2=split_17.ListB)  # -> flatten(Result)

# ----
midpt_11 = CurveMiddle(Curve=_100_8_rosa)  # disabled
midpt_12 = CurveMiddle(Curve=_90_4_orange)  # disabled
pdecon_10 = Deconstruct(Point=midpt_11)  # -> XComponent, YComponent, ZComponent; disabled
pdecon_11 = Deconstruct(Point=midpt_12)  # -> XComponent, YComponent, ZComponent; disabled
smaller_4 = SmallerThan(FirstNumber=pdecon_10.YComponent, SecondNumber=a_0_1)  # -> SmallerThan, OrEqualTo; disabled
smaller_5 = SmallerThan(FirstNumber=pdecon_11.YComponent, SecondNumber=a_0_1)  # -> SmallerThan, OrEqualTo; disabled
cull = CullPattern(List=_100_8_rosa, CullPattern=smaller_4.SmallerThan)  # disabled
cull_2 = CullPattern(List=_90_4_orange, CullPattern=smaller_5.SmallerThan)  # disabled

# ---- group: Geometrie
geometrie_anzeigen = BooleanToggle(True)  # disabled
and_7 = GateAnd(A=geometrie_anzeigen)  # disabled
filter_8 = StreamFilter(Gate=and_7, Stream1=_100_8_rosa)  # disabled
filter_9 = StreamFilter(Gate=and_7, Stream1=_90_4_orange)  # disabled
swatch = ColourSwatch(SwatchColor=RGB(255, 255, 0))  # disabled
swatch_2 = ColourSwatch(SwatchColor=RGB(255, 127, 0))  # disabled
swatch_3 = ColourSwatch(SwatchColor=RGB(255, 0, 0))  # disabled
swatch_4 = ColourSwatch(SwatchColor=RGB(255, 0, 255))  # disabled
preview = CSharpScript(L=flatten(filter_8), T=5, C=swatch_4)  # inputs L: list of Line, T: Int32, C: Color, b: Boolean; disabled
# ---------- preview: C# ----------
// Grasshopper Script Instance
#region Usings
using System;
using System.Linq;
using System.Collections;
using System.Collections.Generic;
using System.Drawing;

using Rhino;
using Rhino.Geometry;

using Grasshopper;
using Grasshopper.Kernel;
using Grasshopper.Kernel.Data;
using Grasshopper.Kernel.Types;
#endregion

public class Script_Instance : GH_ScriptInstance
{
    Color c;
    int t;
    List <Line> l;
    bool draw_it;

    #region Notes
    /* 
      Members:
        RhinoDoc RhinoDocument
        GH_Document GrasshopperDocument
        IGH_Component Component
        int Iteration

      Methods (Virtual & overridable):
        Print(string text)
        Print(string format, params object[] args)
        Reflect(object obj)
        Reflect(object obj, string method_name)
    */
    #endregion

    private void RunScript(List<Line> L, int T, Color C, bool b)
    {
        draw_it = !b;     // Die 3D Darstellung soll nicht gleichzeitig gezeigt werden...

        int n = L.Count();
        
        l = new List<Line>();

        for (int i = 0; i < n; i++)
            l.Add(L[i]);

        c = C;
        t = T;
    }

    public override BoundingBox ClippingBox => BoundingBox.Empty;

    public override void DrawViewportMeshes(IGH_PreviewArgs args)
    {
        base.DrawViewportWires(args);
        
        if (draw_it == false)
            return;
            
        int n = l.Count();

        for (int i = 0; i < n; i++)
            args.Display.DrawLine(l[i], c, t);
    }

    public override void DrawViewportWires(IGH_PreviewArgs args)
    {

    }
}
# ---------- end preview ----------
preview_2 = CSharpScript(L=flatten(filter_9), T=5, C=swatch_2)  # inputs L: list of Line, T: Int32, C: Color, b: Boolean; disabled; same code as preview

# ----
art_der_einspannung = Slider(1, range=1..3)
panel_57 = Panel("""1 Gelenkig
2 Eingespannt
3 Dreigelenk""")
end_19 = EndPoints(Curve=ln_27)  # -> Start, End
end_20 = EndPoints(Curve=ln_29)  # -> Start, End
py3 = Python3Script(A=art_der_einspannung)  # -> toggle1, toggle2, toggle3
# ---------- py3: Python ----------
if A == 1:
    toggle1 = True
    toggle2 = False
    toggle3 = False
    number1 = 0
    number2 = 0
elif A == 2:
    toggle1 = True
    toggle2 = True
    toggle3 = False
    number1 = 0
    number2 = 0
elif A == 3:
    toggle1 = True
    toggle2 = False
    toggle3 = True
    number1 = 0
    number2 = 1
else:
    toggle1 = False
    toggle2 = False
    toggle3 = False
    number1 = 0
    number2 = 0
# ---------- end py3 ----------

filter_10 = StreamFilter(Gate=py3.toggle2, Stream0=split_12.ListB, Stream1=entwine_8)
filter_11 = StreamFilter(Gate=py3.toggle2, Stream0=split_12.ListA, Stream1=entwine_9)
bang_8 = ExplodeTree(Data=filter_10)  # -> Branch0, Branch1
bang_9 = ExplodeTree(Data=filter_11)  # -> Branch0, Branch1

# ---- group: Geometrie (continued)
_80_3_gelb = Line(flatten([merge_24, merge_13, merge_19, merge_7, cull_i_10, cull_i_4, merge_20, bang_9.Branch1, bang_8.Branch1]))
_125_7_rot = Line(flatten([bang_9.Branch0, bang_8.Branch0]))

# ----
midpt_13 = CurveMiddle(Curve=_125_7_rot)  # disabled
midpt_14 = CurveMiddle(Curve=_80_3_gelb)  # disabled
pdecon_12 = Deconstruct(Point=midpt_13)  # -> XComponent, YComponent, ZComponent; disabled
pdecon_13 = Deconstruct(Point=midpt_14)  # -> XComponent, YComponent, ZComponent; disabled
smaller_6 = SmallerThan(FirstNumber=pdecon_12.YComponent, SecondNumber=a_0_1)  # -> SmallerThan, OrEqualTo; disabled
smaller_7 = SmallerThan(FirstNumber=pdecon_13.YComponent, SecondNumber=a_0_1)  # -> SmallerThan, OrEqualTo; disabled
cull_3 = CullPattern(List=_125_7_rot, CullPattern=smaller_6.SmallerThan)  # disabled
cull_4 = CullPattern(List=_80_3_gelb, CullPattern=smaller_7.SmallerThan)  # disabled
entwine_10 = Entwine(Branch00=cull, Branch01=cull_3, Branch02=cull_4, Branch03=cull_2, FlattenInputs=True)  # disabled
move_26 = Move(Geometry=entwine_10, Motion=expression_2)  # -> Geometry, Transform; disabled
move_27 = Move(Geometry=entwine_10, Motion=expression_3)  # -> Geometry, Transform; disabled
merge_35 = Merge(Data1=move_26.Geometry, Data2=move_27.Geometry)  # disabled
bang_10 = ExplodeTree(Data=merge_35)  # -> Branch0, Branch1, Branch2, Branch3; disabled
lng_6 = ListLength(List=bang_10.Branch2)  # disabled
split_18 = SplitList(List=bang_10.Branch2, Index=expr("x/2", lng_6))  # -> ListA, ListB; disabled
entwine_11 = Entwine(Branch00=split_18.ListA, Branch01=split_18.ListB, FlattenInputs=True)  # disabled
item_47 = ListItem(List=entwine_11, Index=panel_53, Wrap=True)  # disabled
cull_i_18 = CullIndex(List=entwine_11, Indices=panel_53, Wrap=True)  # disabled

# ---- group: Geometrie (continued)
merge_36 = Merge(Data1=_100_8_rosa, Data2=_125_7_rot, Data3=_80_3_gelb, Data4=_90_4_orange)
arrlinear_2 = LinearArray(Geometry=merge_36, Direction=X_10, Count="10")  # -> Geometry, Transform
cull_i_19 = CullIndex(List=arrlinear_2.Geometry, Indices=0, Wrap=True)
merge_37 = Merge(Data1=merge_33, Data2=arrlinear.Geometry, Data3=cull_i_19, Data4=merge_36)  # -> flatten(Result)
merge_38 = Merge(Data1=flatten(merge_35), Data2=flatten(item_43), Data3=flatten(split_11.ListB))  # disabled
merge_39 = Merge(Data1=flatten(merge_37), Data2=flatten(merge_36))
midpt_15 = CurveMiddle(Curve=merge_39)  # disabled
midpt_16 = CurveMiddle(Curve=merge_38)  # disabled
cullpt_3 = CullDuplicates(Points=[midpt_15, midpt_16], Tolerance=0.1, CullMode=3)  # -> Points, Indices, Valence; disabled
item_48 = ListItem(List=merge_39, Index=cullpt_3.Indices, Wrap=True)  # disabled
filter_12 = StreamFilter(Gate=and_6, Stream1=merge_39)
filter_13 = StreamFilter(Gate=abstraktion, Stream0=filter_12)
move_28 = Move(Geometry=filter_13, Motion=X_11)  # -> Geometry, Transform
preview_3 = CSharpScript(L=flatten(move_28.Geometry), T=5, C=ColourSwatch(SwatchColor=RGB(255, 254, 255)))  # inputs L: list of Line, T: Int32, C: Color, b: Boolean; same code as preview

filter_14 = StreamFilter(Gate=and_7, Stream1=_125_7_rot)  # disabled
filter_15 = StreamFilter(Gate=and_7, Stream1=_80_3_gelb)  # disabled
preview_4 = CSharpScript(L=flatten(filter_14), T=5, C=swatch_3)  # inputs L: list of Line, T: Int32, C: Color, b: Boolean; disabled; same code as preview
preview_5 = CSharpScript(L=flatten(filter_15), T=5, C=swatch)  # inputs L: list of Line, T: Int32, C: Color, b: Boolean; disabled; same code as preview

split_19 = SplitList(List=_125_7_rot, Index=2)  # -> ListA, ListB
filter_16 = StreamFilter(Gate=expression, Stream1=split_19.ListA)
filter_17 = StreamFilter(Gate=expression, Stream0=_125_7_rot, Stream1=split_19.ListB)
_125_7_rot_beam = Line(filter_16)
_125_7_rot_bar = Line(filter_17)

# ----
filter_18 = StreamFilter(Gate=py3.toggle3, Stream0=ln_28, Stream1=träger)

# ---- group: AUFLAGER BEIM FACHWERK
end_21 = EndPoints(Curve=_125_7_rot)  # -> Start, End
cullpt_4 = CullDuplicates(Points=end_21.End, Tolerance=0.1, CullMode=3)  # -> Points, Indices, Valence
lng_7 = ListLength(List=cullpt_4.Points)  # -> expr("x/2", Length)
split_20 = SplitList(List=cullpt_4.Points, Index=lng_7)  # -> ListA, ListB
support3dof = Support3DOFPlus(SupportPt=split_20.ListB, XFixed=True, YFixed=True, ZFixed=True, Strength=1000000000)
support3dof_2 = Support3DOFPlus(SupportPt=split_20.ListA, XFixed=True, YFixed=True, ZFixed=True, Strength=1000000000)
fachwerk_auflager = Merge(Data1=support3dof, Data2=support3dof_2)  # -> flatten(Result)

# ----
support6dof = Support6DOFPlus(
    SupportPt=auflager,
    XFixed=True,
    YFixed=py3.toggle1,
    ZFixed=True,
    RXFixed=py3.toggle2,
    RYFixed=True,
    RZFixed=True,
    Strength=1000000000)  # disabled

end_22 = EndPoints(Curve=bang_10.Branch1)  # -> Start, End; disabled
cullpt_5 = CullDuplicates(Points=end_22.End, Tolerance=0.1, CullMode=3)  # -> Points, Indices, Valence; disabled
support3dof_3 = Support3DOFPlus(SupportPt=cullpt_5.Points, XFixed=True, YFixed=True, ZFixed=True, Strength=1000000000)  # disabled

item_49 = ListItem(List=filter_18, Index=0, Wrap=True)
item_50 = ListItem(List=filter_18, Index=1, Wrap=True)
entwine_12 = Entwine(Branch00=move_24.Geometry, Branch01=move_25.Geometry, FlattenInputs=True)
smaller_than = SmallerThan(FirstNumber=art_der_einspannung, SecondNumber=3)  # -> SmallerThan, OrEqualTo
X_12 = UnitX(Factor=1)
filter_19 = StreamFilter(Gate=smaller_than.SmallerThan, Stream0=item_50)
line_5 = LineSDL(Start=entwine_12, Direction=X_12, Length=abstraktion_2)
entwine_13 = Entwine(
    Branch00=end_19.Start,
    Branch01=end_20.Start,
    Branch02=ln_27,
    Branch03=ln_29,
    Branch04=item_49,
    Branch05=filter_19,
    FlattenInputs=True)
X_13 = UnitX(Factor=abstraktion_2)
arrlinear_3 = LinearArray(Geometry=line_5, Direction=X_13, Count=expr("x-1", "10"))  # -> flatten(Geometry), Transform
arrlinear_4 = LinearArray(Geometry=entwine_13, Direction=X_13, Count="10")  # -> Geometry, Transform
entwine_14 = Entwine(Branch06=arrlinear_3.Geometry, FlattenInputs=True)  # -> simplify(Result)
cull_i_20 = CullIndex(List=arrlinear_4.Geometry, Indices="0", Wrap=True)  # -> simplify(List)
merge_40 = Merge(Data1=cull_i_20, Data2=entwine_14)
filter_20 = StreamFilter(Gate=geometrie_komplett, Stream1=merge_40)
bang_11 = ExplodeTree(Data=filter_20)  # -> Branch0, Branch1, Branch2, Branch3, Branch4, Branch5, Branch6
clean = CleanTree(RemoveNulls=True, RemoveInvalid=True, RemoveEmpty=False, Tree=bang_11.Branch5)
lng_8 = ListLength(List=clean)
larger_3 = LargerThan(FirstNumber=lng_8, SecondNumber="1")  # -> LargerThan, OrEqualTo
filter_21 = StreamFilter(Gate=larger_3.LargerThan, Stream1=clean)

merge_41 = Merge(Data1=end_20.Start, Data2=bang_11.Branch1)
merge_42 = Merge(Data1=end_19.Start, Data2=bang_11.Branch0)

auflager_2 = Merge(Data1=merge_42, Data2=merge_41)
support6dof_2 = Support6DOFPlus(
    SupportPt=auflager_2,
    XFixed=True,
    YFixed=py3.toggle1,
    ZFixed=True,
    RXFixed=py3.toggle2,
    RYFixed=True,
    RZFixed=True,
    Strength=1000000000)

beam_grün = BeamPlus(
    Line=item_44,
    Material=mat.MaterialProperties,
    Properties=hollow_rectangle_4.Properties,
    Width=hollow_rectangle_4.WidthW_m,
    Height=hollow_rectangle_4.HeightH_m,
    CrossSection=hollow_rectangle_4.GeometryPolylineOfTheCrossSection,
    Angle=0,
    I_Connection=0,
    J_Connection=0,
    LoadQX=0,
    LoadQY=0,
    LoadQZ=neg_3,
    SelfWeight=False,
    ControlAxial=1e+10,
    ControlBending=1e+10,
    Config=cfg,
    Divisions=False)  # -> StartPlane, EndPlane, flatten(Beam), flatten(FeLoads), _3DGeometry; disabled
beam_blau = BeamPlus(
    Line=item_47,
    Material=mat.MaterialProperties,
    Properties=hollow_rectangle_4.Properties,
    Width=hollow_rectangle_4.WidthW_m,
    Height=hollow_rectangle_4.HeightH_m,
    CrossSection=hollow_rectangle_4.GeometryPolylineOfTheCrossSection,
    Angle=0,
    I_Connection=0,
    J_Connection=0,
    LoadQX=0,
    LoadQY=0,
    LoadQZ=neg_3,
    SelfWeight=False,
    ControlAxial=1e+10,
    ControlBending=1e+10,
    Config=cfg,
    Divisions=False)  # -> StartPlane, EndPlane, flatten(Beam), flatten(FeLoads), _3DGeometry; disabled
fachwerk_beam_fachwerkelemente_2 = Merge(Data1=beam_grün.Beam, Data2=beam_blau.Beam)  # -> flatten(Result); disabled

bar_rosa = BarPlus(
    Line=bang_10.Branch0,
    Material=mat.MaterialProperties,
    Properties=hollow_rectangle_4.Properties,
    Width=hollow_rectangle_4.WidthW_m,
    Height=hollow_rectangle_4.HeightH_m,
    CrossSection=hollow_rectangle_4.GeometryPolylineOfTheCrossSection,
    ControlAxial=1e+10,
    ControlStiffness=stiffnessratio)  # -> flatten(StartPlane), flatten(EndPlane), flatten(Bar), _3DGeometry; disabled
bar_rot = BarPlus(
    Line=bang_10.Branch1,
    Material=mat.MaterialProperties,
    Properties=hollow_rectangle_2.Properties,
    Width=hollow_rectangle_2.WidthW_m,
    Height=hollow_rectangle_2.HeightH_m,
    CrossSection=hollow_rectangle_2.GeometryPolylineOfTheCrossSection,
    ControlAxial=1e+10,
    ControlStiffness=stiffnessratio)  # -> flatten(StartPlane), flatten(EndPlane), flatten(Bar), _3DGeometry; disabled
bar_gelb = BarPlus(
    Line=cull_i_18,
    Material=mat.MaterialProperties,
    Properties=hollow_rectangle_3.Properties,
    Width=hollow_rectangle_3.WidthW_m,
    Height=hollow_rectangle_3.HeightH_m,
    CrossSection=hollow_rectangle_3.GeometryPolylineOfTheCrossSection,
    ControlAxial=1e+10,
    ControlStiffness=stiffnessratio)  # -> flatten(StartPlane), flatten(EndPlane), flatten(Bar), _3DGeometry; disabled
bar_orange = BarPlus(
    Line=bang_10.Branch3,
    Material=mat.MaterialProperties,
    Properties=hollow_rectangle.Properties,
    Width=hollow_rectangle.WidthW_m,
    Height=hollow_rectangle.HeightH_m,
    CrossSection=hollow_rectangle.GeometryPolylineOfTheCrossSection,
    ControlAxial=1e+10,
    ControlStiffness=stiffnessratio)  # -> flatten(StartPlane), flatten(EndPlane), flatten(Bar), _3DGeometry; disabled
bar_grün = BarPlus(
    Line=cull_i_17,
    Material=mat.MaterialProperties,
    Properties=hollow_rectangle_4.Properties,
    Width=hollow_rectangle_4.WidthW_m,
    Height=hollow_rectangle_4.HeightH_m,
    CrossSection=hollow_rectangle_4.GeometryPolylineOfTheCrossSection,
    ControlAxial=1e+10,
    ControlStiffness=stiffnessratio)  # -> flatten(StartPlane), flatten(EndPlane), flatten(Bar), _3DGeometry; disabled
bar_blau = BarPlus(
    Line=split_11.ListB,
    Material=mat.MaterialProperties,
    Properties=hollow_rectangle_2.Properties,
    Width=hollow_rectangle_2.WidthW_m,
    Height=hollow_rectangle_2.HeightH_m,
    CrossSection=hollow_rectangle_2.GeometryPolylineOfTheCrossSection,
    ControlAxial=1e+10,
    ControlStiffness=stiffnessratio)  # -> flatten(StartPlane), flatten(EndPlane), flatten(Bar), _3DGeometry; disabled
fachwerk_bar_stabelemente = Merge(Data1=bar_grün.Bar, Data2=bar_blau.Bar, Data3=bar_rosa.Bar, Data4=bar_rot.Bar, Data5=bar_gelb.Bar, Data6=bar_orange.Bar)  # -> flatten(Result); disabled

merge_43 = Merge(Data1=ln_29, Data2=bang_11.Branch3)  # -> flatten(Result)

merge_44 = Merge(Data1=filter_19, Data2=filter_21)  # -> flatten(Result)
merge_45 = Merge(Data1=ln_27, Data2=bang_11.Branch2)  # -> flatten(Result)
merge_46 = Merge(Data1=item_49, Data2=bang_11.Branch4)  # -> flatten(Result)
beam_träger_2 = BeamPlus(
    Line=merge_44,
    Material=mat.MaterialProperties,
    Properties=generic_4.Properties,
    Width=generic_4.WidthW_m,
    Height=generic_4.HeightH_m,
    Angle=drehungswinkel_des_trägers_º,
    I_Connection=py3.toggle3,
    J_Connection=0,
    LoadQX=0,
    LoadQY=0,
    LoadQZ=neg_3,
    SelfWeight=False,
    ControlAxial=1e+10,
    ControlBending=1e+10,
    Config=cfg,
    Divisions=True)  # -> StartPlane, EndPlane, flatten(Beam), flatten(FeLoads), _3DGeometry
beam_träger_3 = BeamPlus(
    Line=merge_46,
    Material=mat.MaterialProperties,
    Properties=generic_4.Properties,
    Width=generic_4.WidthW_m,
    Height=generic_4.HeightH_m,
    Angle=drehungswinkel_des_trägers_º,
    I_Connection=0,
    J_Connection=0,
    LoadQX=0,
    LoadQY=0,
    LoadQZ=neg_3,
    SelfWeight=False,
    ControlAxial=1e+10,
    ControlBending=1e+10,
    Config=cfg,
    Divisions=True)  # -> StartPlane, EndPlane, flatten(Beam), flatten(FeLoads), _3DGeometry
beam_stütze_rechts = BeamPlus(
    Line=merge_45,
    Material=mat.MaterialProperties,
    Properties=generic_3.Properties,
    Width=generic_3.WidthW_m,
    Height=generic_3.HeightH_m,
    Angle=drehungswinkel_der_stützen_º,
    I_Connection=0,
    J_Connection=0,
    LoadQX=0,
    LoadQY=streckenlast_wind_qy_kn_m,
    LoadQZ=0,
    SelfWeight=False,
    ControlAxial=1e+10,
    ControlBending=1e+10,
    Config=cfg,
    Divisions=True)  # -> StartPlane, EndPlane, flatten(Beam), flatten(FeLoads), _3DGeometry
beam_stütze_links = BeamPlus(
    Line=merge_43,
    Material=mat.MaterialProperties,
    Properties=generic_3.Properties,
    Width=generic_3.WidthW_m,
    Height=generic_3.HeightH_m,
    Angle=drehungswinkel_der_stützen_º,
    I_Connection=0,
    J_Connection=0,
    LoadQX=0,
    LoadQY=0,
    LoadQZ=0,
    SelfWeight=False,
    ControlAxial=1e+10,
    ControlBending=1e+10,
    Config=cfg,
    Divisions=True)  # -> StartPlane, EndPlane, flatten(Beam), flatten(FeLoads), _3DGeometry
beam_träger_4 = BeamPlus(
    Line=bang_11.Branch6,
    Material=mat.MaterialProperties,
    Properties=generic_5.Properties,
    Width=generic_5.WidthW_m,
    Height=generic_5.HeightH_m,
    Angle=drehungswinkel_des_trägers_º,
    I_Connection="1",
    J_Connection="1",
    LoadQX=0,
    LoadQY=0,
    LoadQZ=neg_4,
    SelfWeight=False,
    ControlAxial=1e+10,
    ControlBending=1e+10,
    Config=cfg,
    Divisions=True)  # -> StartPlane, EndPlane, flatten(Beam), flatten(FeLoads), _3DGeometry
beam = Merge(
    Data1=beam_stütze_links.Beam,
    Data2=beam_stütze_rechts.Beam,
    Data3=beam_träger_2.Beam,
    Data4=beam_träger_3.Beam,
    Data5=beam_träger_4.Beam)  # -> flatten(Result)

beam_orange = BeamPlus(
    Line=_90_4_orange_beam,
    Material=mat.MaterialProperties,
    Properties=hollow_rectangle.Properties,
    Width=hollow_rectangle.WidthW_m,
    Height=hollow_rectangle.HeightH_m,
    CrossSection=hollow_rectangle.GeometryPolylineOfTheCrossSection,
    Angle=0,
    I_Connection=0,
    J_Connection=0,
    LoadQX=0,
    LoadQY=0,
    LoadQZ=neg_3,
    SelfWeight=False,
    ControlAxial=1e+10,
    ControlBending=1e+10,
    Config=cfg,
    Divisions=False)  # -> StartPlane, EndPlane, flatten(Beam), flatten(FeLoads), _3DGeometry
beam_rosa = BeamPlus(
    Line=_100_8_rosa_beam,
    Material=mat.MaterialProperties,
    Properties=hollow_rectangle_4.Properties,
    Width=hollow_rectangle_4.WidthW_m,
    Height=hollow_rectangle_4.HeightH_m,
    CrossSection=hollow_rectangle_4.GeometryPolylineOfTheCrossSection,
    Angle=0,
    I_Connection=0,
    J_Connection=0,
    LoadQX=0,
    LoadQY=streckenlast_wind_qy_kn_m,
    LoadQZ=0,
    SelfWeight=False,
    ControlAxial=1e+10,
    ControlBending=1e+10,
    Config=cfg,
    Divisions=True)  # -> StartPlane, EndPlane, flatten(Beam), flatten(FeLoads), _3DGeometry
beam_rot = BeamPlus(
    Line=_125_7_rot_beam,
    Material=mat.MaterialProperties,
    Properties=hollow_rectangle_4.Properties,
    Width=hollow_rectangle_4.WidthW_m,
    Height=hollow_rectangle_4.HeightH_m,
    CrossSection=hollow_rectangle_4.GeometryPolylineOfTheCrossSection,
    Angle=0,
    I_Connection=0,
    J_Connection=0,
    LoadQX=0,
    LoadQY=streckenlast_wind_qy_kn_m,
    LoadQZ=0,
    SelfWeight=False,
    ControlAxial=1e+10,
    ControlBending=1e+10,
    Config=cfg,
    Divisions=True)  # -> StartPlane, EndPlane, flatten(Beam), flatten(FeLoads), _3DGeometry
fachwerk_beam_fachwerkelemente_3 = Merge(Data1=beam_rosa.Beam, Data2=beam_rot.Beam, Data3=beam_orange.Beam)  # -> flatten(Result)

bar_rosa_2 = BarPlus(
    Line=_100_8_rosa_bar_2,
    Material=mat.MaterialProperties,
    Properties=hollow_rectangle_4.Properties,
    Width=hollow_rectangle_4.WidthW_m,
    Height=hollow_rectangle_4.HeightH_m,
    CrossSection=hollow_rectangle_4.GeometryPolylineOfTheCrossSection,
    ControlAxial=1e+10,
    ControlStiffness=stiffnessratio)  # -> flatten(StartPlane), flatten(EndPlane), flatten(Bar), _3DGeometry
bar_rot_2 = BarPlus(
    Line=_125_7_rot_bar,
    Material=mat.MaterialProperties,
    Properties=hollow_rectangle_2.Properties,
    Width=hollow_rectangle_2.WidthW_m,
    Height=hollow_rectangle_2.HeightH_m,
    CrossSection=hollow_rectangle_2.GeometryPolylineOfTheCrossSection,
    ControlAxial=1e+10,
    ControlStiffness=stiffnessratio)  # -> flatten(StartPlane), flatten(EndPlane), flatten(Bar), _3DGeometry
bar_gelb_2 = BarPlus(
    Line=_80_3_gelb,
    Material=mat.MaterialProperties,
    Properties=hollow_rectangle_3.Properties,
    Width=hollow_rectangle_3.WidthW_m,
    Height=hollow_rectangle_3.HeightH_m,
    CrossSection=hollow_rectangle_3.GeometryPolylineOfTheCrossSection,
    ControlAxial=1e+10,
    ControlStiffness=stiffnessratio)  # -> flatten(StartPlane), flatten(EndPlane), flatten(Bar), _3DGeometry
bar_orange_2 = BarPlus(
    Line=_90_4_orange_bar,
    Material=mat.MaterialProperties,
    Properties=hollow_rectangle.Properties,
    Width=hollow_rectangle.WidthW_m,
    Height=hollow_rectangle.HeightH_m,
    CrossSection=hollow_rectangle.GeometryPolylineOfTheCrossSection,
    ControlAxial=1e+10,
    ControlStiffness=stiffnessratio)  # -> flatten(StartPlane), flatten(EndPlane), flatten(Bar), _3DGeometry
fachwerk_bar_stabelemente_2 = Merge(Data1=bar_rosa_2.Bar, Data2=bar_rot_2.Bar, Data3=bar_gelb_2.Bar, Data4=bar_orange_2.Bar)  # -> flatten(Result)

# ---- group: 3D GEO DARSTELLUNG
merge_47 = Merge(
    Data1=beam_rosa._3DGeometry,
    Data2=beam_rot._3DGeometry,
    Data3=beam_orange._3DGeometry,
    Data4=bar_rosa_2._3DGeometry,
    Data5=bar_rot_2._3DGeometry,
    Data6=bar_gelb_2._3DGeometry,
    Data7=bar_orange_2._3DGeometry)  # -> flatten(Result)
merge_48 = Merge(
    Data1=beam_grün._3DGeometry,
    Data2=beam_blau._3DGeometry,
    Data3=bar_grün._3DGeometry,
    Data4=bar_blau._3DGeometry,
    Data5=bar_rosa._3DGeometry,
    Data6=bar_rot._3DGeometry,
    Data7=bar_gelb._3DGeometry,
    Data8=bar_orange._3DGeometry)  # -> flatten(Result)
filter_22 = StreamFilter(Gate=_3d_modell_darstellung, Stream1=[merge_47, merge_48])
preview_6 = CustomPreview(Geometry=filter_22, Material=farbe_modelllinie)

merge_49 = Merge(
    Data1=beam_träger_3._3DGeometry,
    Data2=beam_träger_2._3DGeometry,
    Data3=beam_stütze_rechts._3DGeometry,
    Data4=beam_stütze_links._3DGeometry,
    Data5=beam_träger_4._3DGeometry)  # -> flatten(Result)
filter_23 = StreamFilter(Gate=_3d_modell_darstellung, Stream1=merge_49)

# ---- group: ZUSAMMENSETZUNG AUFLAGER UND KRÄFTE
merge_fixed_end_loads = Merge(Data1=beam_träger.FeLoads, Data2=beam_stützen.FeLoads)  # -> flatten(Result); disabled
merge_supports = Merge(Data1=support6dof)  # -> flatten(Result); disabled
merge_point_loads = Merge()  # -> flatten(Result); disabled

merge_fixed_end_loads_2 = Merge(Data1=beam_grün.FeLoads, Data2=beam_blau.FeLoads)  # -> flatten(Result); disabled
merge_supports_2 = Merge(Data1=support3dof_3)  # -> flatten(Result); disabled
merge_point_loads_2 = Merge()  # -> flatten(Result); disabled

merge_supports_3 = Merge(Data1=support6dof_2)  # -> flatten(Result)
merge_fixed_end_loads_3 = Merge(
    Data1=beam_träger_2.FeLoads,
    Data2=beam_stütze_rechts.FeLoads,
    Data3=beam_stütze_links.FeLoads,
    Data4=beam_träger_3.FeLoads,
    Data5=beam_träger_4.FeLoads)  # -> flatten(Result)
merge_point_loads_3 = Merge()  # -> flatten(Result)

merge_fixed_end_loads_4 = Merge(Data1=beam_rosa.FeLoads, Data2=beam_rot.FeLoads, Data3=beam_orange.FeLoads)  # -> flatten(Result)
merge_supports_4 = Merge(Data1=fachwerk_auflager)  # -> flatten(Result)
merge_point_loads_4 = Merge()  # -> flatten(Result)

# ----
fachwerk_bar_stabelemente_3 = Merge(Data1=fachwerk_bar_stabelemente_2, Data2=fachwerk_bar_stabelemente)  # -> flatten(Result)
fachwerk_beam_fachwerkelemente_4 = Merge(Data1=fachwerk_beam_fachwerkelemente_3, Data2=fachwerk_beam_fachwerkelemente_2)  # -> flatten(Result)
merge_supports_5 = Merge(Data1=merge_supports_4, Data2=merge_supports_2)  # -> flatten(Result)
merge_fixed_end_loads_5 = Merge(Data1=merge_fixed_end_loads_4, Data2=merge_fixed_end_loads_2)  # -> flatten(Result)
merge_point_loads_5 = Merge(Data1=merge_point_loads_4, Data2=merge_point_loads_2)  # -> flatten(Result)

fachwerk_beam_fachwerkelemente_5 = Merge(Data1=beam, Data2=fachwerk_beam_fachwerkelemente)  # -> flatten(Result)
merge_supports_6 = Merge(Data1=merge_supports_3, Data2=merge_supports)  # -> flatten(Result)
merge_fixed_end_loads_6 = Merge(Data1=merge_fixed_end_loads_3, Data2=merge_fixed_end_loads)  # -> flatten(Result)
merge_point_loads_6 = Merge(Data1=merge_point_loads_3, Data2=merge_point_loads)  # -> flatten(Result)

filter_fixed_end_loads = StreamFilter(Gate=abstraktion, Stream0=merge_fixed_end_loads_5, Stream1=merge_fixed_end_loads_6)
filter_supports = StreamFilter(Gate=abstraktion, Stream0=merge_supports_5, Stream1=merge_supports_6)
filter_point_loads = StreamFilter(Gate=abstraktion, Stream0=merge_point_loads_5, Stream1=merge_point_loads_6)
filter_bar = StreamFilter(Gate=abstraktion, Stream0=fachwerk_bar_stabelemente_3)
filter_beam = StreamFilter(Gate=abstraktion, Stream0=fachwerk_beam_fachwerkelemente_4, Stream1=fachwerk_beam_fachwerkelemente_5)

# ---- group: Fixierung in X-Richtung
merge_50 = Merge(
    Data1=beam_rosa.StartPlane,
    Data2=beam_rosa.EndPlane,
    Data3=beam_rot.StartPlane,
    Data4=beam_rot.EndPlane,
    Data5=beam_orange.StartPlane,
    Data6=beam_orange.EndPlane,
    Data7=bar_rosa_2.StartPlane,
    Data8=bar_rosa_2.EndPlane,
    Data9=bar_rot_2.StartPlane,
    Data10=bar_rot_2.EndPlane,
    Data11=bar_gelb_2.StartPlane,
    Data12=bar_gelb_2.EndPlane,
    Data13=bar_orange_2.StartPlane,
    Data14=bar_orange_2.EndPlane)
duppt = RemoveDuplicatePts(Points=merge_50, Tolerance=0.01)
support3dof_4 = Support3DOFPlus(SupportPt=duppt, XFixed=True, YFixed=False, ZFixed=False, Strength=1000000000)

# ---- group: Fixierung in Y-Richtung
merge_51 = Merge(Data1=end_17.Start, Data2=end_17.End, Data3=end_18.Start, Data4=end_18.End)  # disabled
merge_52 = Merge(
    Data1=beam_grün.StartPlane,
    Data2=beam_grün.EndPlane,
    Data3=beam_blau.StartPlane,
    Data4=beam_blau.EndPlane,
    Data5=bar_grün.StartPlane,
    Data6=bar_grün.EndPlane,
    Data7=bar_blau.StartPlane,
    Data8=bar_blau.EndPlane,
    Data9=bar_rosa.StartPlane,
    Data10=bar_rosa.EndPlane,
    Data11=bar_rot.StartPlane,
    Data12=bar_rot.EndPlane,
    Data13=bar_gelb.StartPlane,
    Data14=bar_gelb.EndPlane,
    Data15=bar_orange.StartPlane,
    Data16=bar_orange.EndPlane,
    Data17=merge_51)  # disabled
duppt_2 = RemoveDuplicatePts(Points=merge_52, Tolerance=0.01)  # disabled
support3dof_5 = Support3DOFPlus(SupportPt=duppt_2, XFixed=False, YFixed=True, ZFixed=False, Strength=1000000000)  # disabled

# ----
fixierung = Merge(Data1=support3dof_5, Data2=support3dof_4)  # -> flatten(Result)

# ---- group: SOLVER MODUL
merge_53 = Merge(
    Data1=reset_values_4.param,
    Data2=reset_toggles_2.param,
    Data3=reset_values_2.param,
    Data4=reset_toggles_3.param,
    Data5=reset_values_3.param,
    Data6=reset_toggles_4.param,
    Data7=py3.toggle2,
    Data8=abstraktion,
    Data9=art_der_einspannung,
    Data10=geometrie_komplett)
py3_2 = Python3Script(CurrentValue=merge_53)  # -> out, SavedValue, isNewValue; inputs CurrentValue: list
# ---------- py3_2: Python ----------
# Instantiate or reset persistent data 
if "savedValue" not in globals():
    savedValue = CurrentValue

# Check current value persistent data
if CurrentValue == savedValue:
    isNewValue = False
else:
    isNewValue = True
    savedValue = CurrentValue
    ghenv.Component.ExpireSolution(True)

# Output to GH
SavedValue = savedValue
# ---------- end py3_2 ----------
entwine_15 = Entwine(
    Branch00=filter_supports,
    Branch02=filter_fixed_end_loads,
    Branch03=filter_beam,
    Branch04=fixierung,
    Branch05=filter_bar,
    FlattenInputs=True)
reset = Button()
pause = BooleanToggle(False)

# ----
or = GateOr(A=py3_2.isNewValue, B=reset)
signal_verlängern = Python3Script(Reset=or, Delay="5")  # -> ElapsedTime, Boolean; inputs Reset: Boolean, Delay: Double; disabled
# ---------- signal_verlängern: Python ----------
import time
import Grasshopper as gh

def updateComponent():
    """ Updates this component, similar to using a grasshopper timer """
    def callBack(e):
        ghenv.Component.ExpireSolution(False)
    ghDoc = ghenv.Component.OnPingDocument()
    ghDoc.ScheduleSolution(1, gh.Kernel.GH_Document.GH_ScheduleDelegate(callBack))

# Startzeit zurücksetzen, wenn nötig
if "startTime" not in globals() or Reset:
    startTime = time.time()

# Zeit berechnen
rawElapsed = time.time() - startTime

# Zeit einfrieren, wenn Delay überschritten
ElapsedTime = min(rawElapsed, Delay)

# Timer läuft nur, solange ElapsedTime < Delay
if rawElapsed <= Delay:
    Boolean = False
    updateComponent()  # nur solange triggern
else:
    Boolean = True
    # kein updateComponent() mehr → bleibt stehen
# ---------- end signal_verlängern ----------
or_2 = GateOr(A=signal_verlängern.Boolean, B=pause)
panel_58 = Panel([signal_verlängern.ElapsedTime, signal_verlängern.Boolean])

# ---- group: SOLVER MODUL (continued)
not_3 = GateNot(A=or_2)
solver = Solver(GoalObjects=entwine_15, Reset=or, Threshold=eval, Tolerance=1e-05, On=not_3)  # -> I, V, O
bang_12 = ExplodeTree(Data=solver.O)  # -> Branch0, Branch1, Branch2, Branch3, Branch4, Branch5

# ----
merge_54 = Merge(Data1=bang_12.Branch2)  # -> flatten(Result)
merge_55 = Merge(Data1=bang_12.Branch4)  # -> flatten(Result)

# ---- group: BAR+ DARSTELLUNG
cfg_6 = ConfigurationPlusTunnel(Config=cfg)  # -> Config, StiffnessRatio, Threshold, NumberOfDecimals, LineThickness, ModelColor, _3DModel, Hinges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
baroutput = BarOutputPlus(BarData=merge_55, Config=cfg_6.Config)  # -> IP0, IP1, P0, P1, N, Deformation, AxialDiagramCompression, AxialDiagramTension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
saturationratio_2 = CSharpScript(Lines=baroutput.LineS, satRatio=baroutput.TensionRatio, b=cfg_6.SaturationRatio)  # -> out, p, l, t, i; inputs Lines: Line, satRatio: Double, b: Boolean
# ---------- saturationratio_2: C# ----------
// Grasshopper Script Instance
#region Usings
using System;
using System.Linq;
using System.Collections;
using System.Collections.Generic;
using System.Drawing;

using Rhino;
using Rhino.Geometry;
using Rhino.Display;

using Grasshopper;
using Grasshopper.Kernel;
using Grasshopper.Kernel.Data;
using Grasshopper.Kernel.Types;
#endregion

public class Script_Instance : GH_ScriptInstance
{
    #region Notes
    /* 
      Members:
        RhinoDoc RhinoDocument
        GH_Document GrasshopperDocument
        IGH_Component Component
        int Iteration

      Methods (Virtual & overridable):
        Print(string text)
        Print(string format, params object[] args)
        Reflect(object obj)
        Reflect(object obj, string method_name)
    */
    #endregion

    private void RunScript(
		Line Lines,
		double satRatio,
		bool b,
		ref object p,
		ref object l,
		ref object t,
		ref object i)
    {
        if (b == false)
            return;

        if (Lines.Length < 0.1)
            return;

        l = Lines;
                    
        Point3d pm;

        pm = 0.5 * (Lines.From + Lines.To);

        p = pm;

        t = Math.Round(satRatio *100.0, 0).ToString();

        if (satRatio < 0.0)
            i = 0;
        else if (satRatio >= 1.0)
            i = 8;
        else
            i = Math.Min(8, Math.Floor(satRatio / 0.125));
    }
}
# ---------- end saturationratio_2 ----------
bnd_2 = Bounds(Numbers=flatten(baroutput.TensionRatio))
preview_def_2 = CSharpScript(L=flatten(baroutput.Deformation), T=cfg_6.LineThickness, C=cfg_6.DeformationColor, b=cfg_6._3DDeformation)  # inputs L: list of Line, T: Int32, C: Color, b: Boolean
# ---------- preview_def_2: C# ----------
// Grasshopper Script Instance
#region Usings
using System;
using System.Linq;
using System.Collections;
using System.Collections.Generic;
using System.Drawing;

using Rhino;
using Rhino.Geometry;

using Grasshopper;
using Grasshopper.Kernel;
using Grasshopper.Kernel.Data;
using Grasshopper.Kernel.Types;
#endregion

public class Script_Instance : GH_ScriptInstance
{
    Color c;
    int t;
    List <Line> l;
    bool draw_it;

    #region Notes
    /* 
      Members:
        RhinoDoc RhinoDocument
        GH_Document GrasshopperDocument
        IGH_Component Component
        int Iteration

      Methods (Virtual & overridable):
        Print(string text)
        Print(string format, params object[] args)
        Reflect(object obj)
        Reflect(object obj, string method_name)
    */
    #endregion

    private void RunScript(List<Line> L, int T, Color C, bool b)
    {
        draw_it = !b;     // Die 3D Darstellung soll nicht gleichzeitig gezeigt werden...

        if (L == null || L.Count() < 1)
        {
            draw_it = false;
            return;
        }

        int n = L.Count();
        
        l = new List<Line>();
        l.Clear();

        for (int i = 0; i < n; i++)
            l.Add(L[i]);

        c = C;
        t = T;
    }

    public override BoundingBox ClippingBox => BoundingBox.Empty;

    public override void DrawViewportMeshes(IGH_PreviewArgs args)
    {
        base.DrawViewportWires(args);
        
        if (draw_it == false)
            return;
            
        int n = l.Count();

        for (int i = 0; i < n; i++)
            args.Display.DrawLine(l[i], c, t);
    }

    public override void DrawViewportWires(IGH_PreviewArgs args)
    {

    }
}
# ---------- end preview_def_2 ----------
previewaxial_2 = CustomPreview(Geometry=baroutput.AxialDiagramCompression, Material=cfg_6.NegativeAxialColor)
previewaxial_3 = CustomPreview(Geometry=baroutput.AxialDiagramTension, Material=cfg_6.PositiveAxialColor)
dedomain_2 = DeconstructDomain(Domain=bnd_2)  # -> Start, End
colors_for_saturation_grade_2 = ListItem(List=cfg_6.SaturationRatioColors, Index=saturationratio_2.i, Wrap=True)
not_4 = GateNot(A=cfg_6.SaturationRatio)
ln_31 = Line(StartPoint=baroutput.IP0, EndPoint=baroutput.IP1)
and_8 = GateAnd(A=cfg_6.Deformation, B=cfg_6._3DDeformation)
filter_24 = StreamFilter(Gate=cfg_6.Displacements, Stream1=baroutput.TextD)
filter_25 = StreamFilter(Gate=cfg_6.DiagramValues, Stream1=baroutput.TextF)
filter_26 = StreamFilter(Gate=cfg_6.SaturationRatio, Stream1=saturationratio_2.t)
filter_27 = StreamFilter(Gate=not_4, Stream1=ln_31)
filter_28 = StreamFilter(Gate=and_8, Stream1=baroutput._3DGeometry)
tag_2 = TextTag(Location=saturationratio_2.p, Text=filter_26, Colour=colors_for_saturation_grade_2)
hingedraw = CSharpScript(x=baroutput.IP0, y=baroutput.IP1, color=cfg_6.HingeColor, thickness=cfg_6.HingeThickness, size=cfg_6.HingeSize, b=and_4)  # inputs x: list of Plane, y: list of Plane, color: Color, thickness: Int32, size: Double, b: Boolean
# ---------- hingedraw: C# ----------
// Grasshopper Script Instance
#region Usings
using System;
using System.Linq;
using System.Collections;
using System.Collections.Generic;
using System.Drawing;

using Rhino;
using Rhino.Geometry;

using Grasshopper;
using Grasshopper.Kernel;
using Grasshopper.Kernel.Data;
using Grasshopper.Kernel.Types;
#endregion

public class Script_Instance : GH_ScriptInstance
{
    Color c;
    double s;
    int t;
    List <Plane> p; 
    bool draw_it;
    
    #region Notes
    /* 
      Members:
        RhinoDoc RhinoDocument
        GH_Document GrasshopperDocument
        IGH_Component Component
        int Iteration

      Methods (Virtual & overridable):
        Print(string text)
        Print(string format, params object[] args)
        Reflect(object obj)
        Reflect(object obj, string method_name)
    */
    #endregion

    private void RunScript(
		List<Plane> x,
		List<Plane> y,
		Color color,
		int thickness,
		double size,
		bool b)
    {
        draw_it = b;

        if (x == null || y == null)
        {
            return;
        }


        int n = x.Count();

        if (n != y.Count())
        {
            return;
        }
        p = new List<Plane>();

        for (int i = 0; i < n; i++)
        {
            p.Add(new Plane(x[i].Origin, x[i].XAxis));
            p.Add(new Plane(y[i].Origin, y[i].XAxis));
            p.Add(new Plane(x[i].Origin, x[i].YAxis));
            p.Add(new Plane(y[i].Origin, y[i].YAxis));
        }

        c = color;
        s = size;
        t = thickness;
    }

    public override BoundingBox ClippingBox => BoundingBox.Empty;

    public override void DrawViewportMeshes(IGH_PreviewArgs args)
    {
        base.DrawViewportMeshes(args);

        if (draw_it == false)
            return;

        int n = p.Count();

        Circle ci;

        for (int i = 0; i < n; i++)
        {
            ci = new Circle(p[i], s);
            args.Display.DrawCircle(ci, c, t);
        }
    }

    public override void DrawViewportWires(IGH_PreviewArgs args)
    {
    }
}
# ---------- end hingedraw ----------
preview_geo_2 = CSharpScript(L=flatten(filter_27), T=cfg_6.LineThickness, C=cfg_6.ModelColor, b=cfg_6._3DModel)  # inputs L: list of Line, T: Int32, C: Color, b: Boolean; same code as preview_def_2
defvalues_2 = TextTag(Location=baroutput.TextPositionD, Text=filter_24, Colour=cfg_6.DisplacementColor)
preview_saturation_2 = CustomPreview(Geometry=saturationratio_2.l, Material=colors_for_saturation_grade_2)
intforcevalues_2 = TextTag(Location=baroutput.TextPositionF, Text=filter_25, Colour=cfg_6.ValuesColor)
preview_def3d_2 = CustomPreview(Geometry=filter_28, Material=cfg_6.DeformationColor)

# ---- group: BEAM+ UND STRECKENLASTEN DARSTELLUNG / BEAM+ DARSTELLUNG
beamoutput = BeamOutputPlus(BeamData=merge_54, Config=cfg_2.Config)  # -> IP0, IP1, P0, P1, N, Vy, Vz, Mt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
saturationratio_3 = CSharpScript(Lines=beamoutput.LineS, satRatio=beamoutput.TensionRatio, b=cfg_2.SaturationRatio)  # -> out, p, l, t, i; inputs Lines: Line, satRatio: Double, b: Boolean
# ---------- saturationratio_3: C# ----------
// Grasshopper Script Instance
#region Usings
using System;
using System.Linq;
using System.Collections;
using System.Collections.Generic;
using System.Drawing;

using Rhino;
using Rhino.Geometry;
using Rhino.Display;

using Grasshopper;
using Grasshopper.Kernel;
using Grasshopper.Kernel.Data;
using Grasshopper.Kernel.Types;
#endregion

public class Script_Instance : GH_ScriptInstance
{
    #region Notes
    /* 
      Members:
        RhinoDoc RhinoDocument
        GH_Document GrasshopperDocument
        IGH_Component Component
        int Iteration

      Methods (Virtual & overridable):
        Print(string text)
        Print(string format, params object[] args)
        Reflect(object obj)
        Reflect(object obj, string method_name)
    */
    #endregion

    private void RunScript(
		Line Lines,
		double satRatio,
		bool b,
		ref object p,
		ref object l,
		ref object t,
		ref object i)
    {
        if (b == false)
            return;

        if (Lines.Length < 0.1)
            return;

        l = Lines;
                    
        Point3d pm;

        pm = 0.5 * (Lines.From + Lines.To);

        p = pm;

        t = Math.Round(satRatio * 100.0, 0).ToString();

        if (satRatio < 0.0)
            i = 0;
        else if (satRatio >= 1.0)
            i = 8;
        else
            i = Math.Min(8, Math.Floor(satRatio / 0.125));
    }
}
# ---------- end saturationratio_3 ----------
bnd_3 = Bounds(Numbers=flatten(beamoutput.TensionRatio))
preview_def_3 = CSharpScript(L=flatten(beamoutput.Deformation), T=cfg_2.LineThickness, C=cfg_2.DeformationColor, b=cfg_2._3DDeformation)  # inputs L: list of Line, T: Int32, C: Color, b: Boolean
# ---------- preview_def_3: C# ----------
// Grasshopper Script Instance
#region Usings
using System;
using System.Linq;
using System.Collections;
using System.Collections.Generic;
using System.Drawing;

using Rhino;
using Rhino.Geometry;

using Grasshopper;
using Grasshopper.Kernel;
using Grasshopper.Kernel.Data;
using Grasshopper.Kernel.Types;
#endregion

public class Script_Instance : GH_ScriptInstance
{
    Color c;
    int t;
    List <Line> l;
    bool draw_it;

    #region Notes
    /* 
      Members:
        RhinoDoc RhinoDocument
        GH_Document GrasshopperDocument
        IGH_Component Component
        int Iteration

      Methods (Virtual & overridable):
        Print(string text)
        Print(string format, params object[] args)
        Reflect(object obj)
        Reflect(object obj, string method_name)
    */
    #endregion

    private void RunScript(List<Line> L, int T, Color C, bool b)
    {
        draw_it = !b;     // Die 3D Darstellung soll nicht gleichzeitig gezeigt werden...

        if (L == null || L.Count() < 1)
        {
            draw_it = false;
            return;
        }
        
        int n = L.Count();
        
        l = new List<Line>();
        l.Clear();

        for (int i = 0; i < n; i++)
            l.Add(L[i]);

        c = C;
        t = T;
    }

    public override BoundingBox ClippingBox => BoundingBox.Empty;

    public override void DrawViewportMeshes(IGH_PreviewArgs args)
    {
        base.DrawViewportWires(args);
        
        if (draw_it == false)
            return;
            
        int n = l.Count();

        for (int i = 0; i < n; i++)
            args.Display.DrawLine(l[i], c, t);
    }

    public override void DrawViewportWires(IGH_PreviewArgs args)
    {

    }
}
# ---------- end preview_def_3 ----------
dedomain_3 = DeconstructDomain(Domain=bnd_3)  # -> Start, End
colors_for_saturation_grade_3 = ListItem(List=cfg_2.SaturationRatioColors, Index=saturationratio_3.i, Wrap=True)
previewaxial_4 = CustomPreview(Geometry=beamoutput.AxialDiagramCompression, Material=cfg_2.NegativeAxialColor)
previewaxial_5 = CustomPreview(Geometry=beamoutput.AxialDiagramTension, Material=cfg_2.PositiveAxialColor)
previewshear = CustomPreview(Geometry=[beamoutput.ShearDiagramYSecondary, beamoutput.ShearDiagramZPrincipal], Material=cfg_2.ShearColor)
previewmoment = CustomPreview(Geometry=[beamoutput.MomentDiagramYPrincipal, beamoutput.MomentDiagramZSecondary], Material=cfg_2.MomentColor)
filter_29 = StreamFilter(Gate=cfg_2.SaturationRatio, Stream1=saturationratio_3.t)
not_5 = GateNot(A=cfg_2.SaturationRatio)
ln_32 = Line(StartPoint=beamoutput.IP0, EndPoint=beamoutput.IP1)
filter_30 = StreamFilter(Gate=not_5, Stream1=ln_32)
tag_3 = TextTag(Location=saturationratio_3.p, Text=filter_29, Colour=colors_for_saturation_grade_3)
filter_31 = StreamFilter(Gate=cfg_2.Displacements, Stream1=beamoutput.TextD)
filter_32 = StreamFilter(Gate=cfg_2.DiagramValues, Stream1=beamoutput.TextF)
filter_33 = StreamFilter(Gate=and_2, Stream1=beamoutput._3DGeometry)
hingedraw_2 = CSharpScript(
    x=beamoutput.IP0,
    y=beamoutput.IP1,
    color=cfg_2.HingeColor,
    thickness=cfg_2.HingeThickness,
    size=cfg_2.HingeSize,
    b=and_5,
    iEnd=beamoutput.IEnd,
    jEnd=beamoutput.JEnd)  # inputs x: list of Plane, y: list of Plane, color: Color, thickness: Int32, size: Double, b: Boolean, iEnd: list of Int32, jEnd: list of Int32
# ---------- hingedraw_2: C# ----------
// Grasshopper Script Instance
#region Usings
using System;
using System.Linq;
using System.Collections;
using System.Collections.Generic;
using System.Drawing;

using Rhino;
using Rhino.Geometry;

using Grasshopper;
using Grasshopper.Kernel;
using Grasshopper.Kernel.Data;
using Grasshopper.Kernel.Types;
#endregion

public class Script_Instance : GH_ScriptInstance
{
    Color c;
    double s;
    int t;
    List <Plane> p; 
    bool draw_it;
    
    #region Notes
    /* 
      Members:
        RhinoDoc RhinoDocument
        GH_Document GrasshopperDocument
        IGH_Component Component
        int Iteration

      Methods (Virtual & overridable):
        Print(string text)
        Print(string format, params object[] args)
        Reflect(object obj)
        Reflect(object obj, string method_name)
    */
    #endregion

    private void RunScript(
		List<Plane> x,
		List<Plane> y,
		Color color,
		int thickness,
		double size,
		bool b,
		List<int> iEnd,
		List<int> jEnd)
    {
        draw_it = b;

        if (x == null || y == null)
        {
            return;
        }


        int n = x.Count();

        if (n != y.Count() || n!= iEnd.Count() || n!= jEnd.Count())
        {
            return;
        }
        p = new List<Plane>();

        for (int i = 0; i < n; i++)
        {
            switch(iEnd[i])
            {
                case 0:
                    break;
                case 1:
                    p.Add(new Plane(x[i].Origin, x[i].XAxis));
                    p.Add(new Plane(x[i].Origin, x[i].YAxis));
                    break;
                case 2:
                    p.Add(new Plane(x[i].Origin, x[i].XAxis));
                    break;
                case 3:
                    p.Add(new Plane(x[i].Origin, x[i].YAxis));
                    break;
            }
            
            switch(jEnd[i])
            {
                case 0:
                    break;
                case 1:
                    p.Add(new Plane(y[i].Origin, y[i].XAxis));
                    p.Add(new Plane(y[i].Origin, y[i].YAxis));
                    break;
                case 2:
                    p.Add(new Plane(y[i].Origin, y[i].XAxis));
                    break;
                case 3:
                    p.Add(new Plane(y[i].Origin, y[i].YAxis));
                    break;
            }
        }

        c = color;
        s = size;
        t = thickness;
    }

    public override BoundingBox ClippingBox => BoundingBox.Empty;

    public override void DrawViewportMeshes(IGH_PreviewArgs args)
    {
        base.DrawViewportMeshes(args);

        if (draw_it == false)
            return;

        int n = p.Count();

        Circle ci;

        for (int i = 0; i < n; i++)
        {
            ci = new Circle(p[i], s);
            args.Display.DrawCircle(ci, c, t);
        }
    }

    public override void DrawViewportWires(IGH_PreviewArgs args)
    {
    }
}
# ---------- end hingedraw_2 ----------
preview_geo_3 = CSharpScript(L=flatten(filter_30), T=cfg_2.LineThickness, C=cfg_2.ModelColor, b=cfg_2._3DModel)  # inputs L: list of Line, T: Int32, C: Color, b: Boolean; same code as preview_def_2
preview_def3d_3 = CustomPreview(Geometry=filter_33, Material=cfg_2.DeformationColor)
preview_saturation_3 = CustomPreview(Geometry=saturationratio_3.l, Material=colors_for_saturation_grade_3)
intforcevalues_3 = TextTag(Location=beamoutput.TextPositionF, Text=filter_32, Colour=cfg_2.ValuesColor)
defvalues_3 = TextTag(Location=beamoutput.TextPositionD, Text=filter_31, Colour=cfg_2.DisplacementColor)

# ---- group: AUFLAGER UND AUFLAGERREAKTIONEN DARSTELLUNG / AUFLAGER DARSTELLUNG
supportoutput = Support6DOFOutputPlus(Support6DOFData=bang_12.Branch0)  # -> SupportPlaneIni, SupportPlaneDef, ReactionForce, ReactionMoment, FixedComponents
geo = Geometry(auflager_darstellung)
c_script_2 = CSharpScript(
    pI=supportoutput.SupportPlaneIni,
    pD=supportoutput.SupportPlaneDef,
    k=multiplication_8,
    s=supportoutput.FixedComponents,
    x=geo)  # -> out, pt, simplify(i); inputs pI: Plane, pD: Plane, k: Double, s: String, x: tree
# ---------- c_script_2: C# ----------
// Grasshopper Script Instance
#region Usings
using System;
using System.Linq;
using System.Collections;
using System.Collections.Generic;
using System.Drawing;

using Rhino;
using Rhino.Geometry;

using Grasshopper;
using Grasshopper.Kernel;
using Grasshopper.Kernel.Data;
using Grasshopper.Kernel.Types;

#endregion

public class Script_Instance : GH_ScriptInstance
{
    #region Notes
    /* 
      Members:
        RhinoDoc RhinoDocument
        GH_Document GrasshopperDocument
        IGH_Component Component
        int Iteration

      Methods (Virtual & overridable):
        Print(string text)
        Print(string format, params object[] args)
        Reflect(object obj)
        Reflect(object obj, string method_name)
    */
    #endregion

    private void RunScript(
		Plane pI,
		Plane pD,
		double k,
		string s,
		DataTree<object> x,
		ref object pt,
		ref object i)
    {
        // Write your logic here
        i = null;
        
        // b = [dx, dy, dz, rx, ry, rz]
        // The visualization supposes an array of 16 differente
        // types of support, considering always dz=true and rz = true.
        // Only dx, dy, rx and ry are relevant.
        
        // The index is calculated from the binary values of
        // the corresponing indices
        
        int[] v = new int[4];

        if (s[0] == '1')
            v[0] = 1;
        else
            v[0] = 0;
        if (s[1] == '1')
            v[1] = 1;
        else
            v[1] = 0;
       if (s[3] == '1')
            v[2] = 1;
        else
            v[2] = 0;
       if (s[4] == '1')
            v[3] = 1;
        else
            v[3] = 0;
              
        int n = (int) (1 * v[0] + 2 * v[1] + 4 * v[2] + 8 * v[3]);
        i = x.Branch(n);

        Vector3d def = pD.Origin - pI.Origin;
        def *= k;
        pt = pI.Origin + def;
    }


}
# ---------- end c_script_2 ----------
scale = Scale(Geometry=c_script_2.i, Center=Point(0, 0, 0), Factor=cfg_3.SupportSize)  # -> Geometry, Transform
move_29 = Move(Geometry=scale.Geometry, Motion=graft(c_script_2.pt))  # -> Geometry, Transform
filter_34 = StreamFilter(Gate=cfg_3.SupportRepresentation, Stream1=move_29.Geometry)
preview_7 = CustomPreview(Geometry=filter_34, Material=cfg_3.SupportColor)

# ---- group: PUNKTLASTEN DARSTELLUNG / PUNKTLASTEN (KRÄFTE UND MOMENTE) DARSTELLUNG
loadoutput = LoadOutputPlus(LoadData=bang_12.Branch1)  # -> InitialPosition, FinalPosition, Load, IsMoment, IsVisible
and_9 = GateAnd(A=cfg_5.Deformation, B=cfg_5.LoadsOnDeformedShape)
c_script_3 = CSharpScript(
    pI=loadoutput.InitialPosition,
    pF=loadoutput.FinalPosition,
    L=loadoutput.Load,
    isM=loadoutput.IsMoment,
    kStiff=multiplication_9,
    bOnDef=and_9,
    bDecom=cfg_5.LoadsDecomposed,
    bVis=loadoutput.IsVisible)  # -> out, pt, load, bM, num; inputs pI: list of Point3d, pF: list of Point3d, L: list of Vector3d, isM: list of Boolean, kStiff: Double, bOnDef: Boolean, bDecom: Boolean, bVis: list of Boolean
# ---------- c_script_3: C# ----------
// Grasshopper Script Instance
#region Usings
using System;
using System.Linq;
using System.Collections;
using System.Collections.Generic;
using System.Drawing;

using Rhino;
using Rhino.Geometry;

using Grasshopper;
using Grasshopper.Kernel;
using Grasshopper.Kernel.Data;
using Grasshopper.Kernel.Types;
#endregion

public class Script_Instance : GH_ScriptInstance
{
    #region Notes
    /* 
      Members:
        RhinoDoc RhinoDocument
        GH_Document GrasshopperDocument
        IGH_Component Component
        int Iteration

      Methods (Virtual & overridable):
        Print(string text)
        Print(string format, params object[] args)
        Reflect(object obj)
        Reflect(object obj, string method_name)
    */
    #endregion

    private void RunScript(
		List<Point3d> pI,
		List<Point3d> pF,
		List<Vector3d> L,
		List<bool> isM,
		double kStiff,
		bool bOnDef,
		bool bDecom,
		List<bool> bVis,
		ref object pt,
		ref object load,
		ref object bM,
		ref object num)
    {
        int numLoads = pI.Count();
        Vector3d def;
        int i, j;
        int n = 0;
        int nf = 0;
        int nm = 0;
        int naf = 0;
        int nam = 0;
        Point3d ap;
        Vector3d af;
        Vector3d afd;
        Vector3d am;
        Vector3d amd;

        if (numLoads < 1)
            return;

        if (pF.Count() == numLoads && L.Count() == numLoads && isM.Count() == numLoads && bVis.Count() == numLoads)
        {
            // First of all, divide the list in forces and moments
            Point3d[] pIf = new Point3d[numLoads];
            Point3d[] pIm = new Point3d[numLoads];
            Point3d[] pFf = new Point3d[numLoads];
            Point3d[] pFm = new Point3d[numLoads];
            Vector3d[] lf = new Vector3d[numLoads];
            Vector3d[] lm = new Vector3d[numLoads];

            // Copy the input points and loads (in separate arrays), to manage later the accummulation of loads
            for (i = 0; i < numLoads; i++)
            {
                if (bVis[i])
                {
                    if (isM[i] == true)
                    {
                        pIm[nm] = pI[i];
                        pFm[nm] = pF[i];
                        lm[nm] = L[i];
                        nm += 1;
                    }
                    else
                    {
                        pIf[nf] = pI[i];
                        pFf[nf] = pF[i];
                        lf[nf] = L[i];
                        nf += 1;
                    }                
                }
            }

            // Now, let's accummulate all the forces acting on the same point
            naf = 0;
            for (i = 0; i < nf; i++)
            {
                // The load lf may be null, if it is already accummulated on previous point
                if (lf[i].Length > 0.1)     // 0.1kN is the minimum force to consider
                {
                    ap = pIf[i];
                    
                    for (j = i + 1; j < nf; j++)
                    {
                        if (ap.DistanceTo(pIf[j]) < 0.01)    // 1cm tolerance
                        {
                            lf[i] = lf[i] + lf[j];

                            // As it has been already accummulated, make it null
                            lf[j].X = 0.0;
                            lf[j].Y = 0.0;
                            lf[j].Z = 0.0;
                            
                            // Increment one accummulation
                            naf += 1;
                        }
                    }
                }
            }

            // Now, let's accummulate all the moments acting on the same point
            nam = 0;
            for (i = 0; i < nm; i++)
            {
                // The load lf may be null, if it is already accummulated on previous point
                if (lm[i].Length > 0.1)     // 0.1kN is the minimum force to consider
                {
                    ap = pIm[i];

                    for (j = i + 1; j < nm; j++)
                    {
                        if (ap.DistanceTo(pIm[j]) < 0.01)    // 1cm tolerance
                        {
                            lm[i] = lm[i] + lm[j];

                            // As it has been already accummulated, make it null
                            lm[j].X = 0.0;
                            lm[j].Y = 0.0;
                            lm[j].Z = 0.0;

                            // Increment one accummulation
                            nam += 1;
                        }
                    }
                }
            }

            Print("nF " + (nf-naf).ToString());
            Print("nM " + (nm-nam).ToString());

            for (i = 0; i < nf; i++)
                Print("F(" + i + ") = " + lf[i]);

            // Now, we have all the forces accummulated in nf points, and all the moments accummulated in nm points

            List<Point3d> pts = new List<Point3d>();
            List<Vector3d> loads = new List<Vector3d>();
            List<bool> isMoment = new List<bool>();
            
            // Generate the forces, and when decomposed, generate the necessary components
            for (i = 0; i < nf; i++)
            {
                if (lf[i].Length > 0.1)     // 0.1kN is the minimum force to consider
                {
                    if (bOnDef)
                    {
                        // Draw Load at deformed shape
                        def = pFf[i] - pIf[i];
                        def = def * kStiff;
                    }
                    else
                    {
                        // Draw Load at original shape
                        def = new Vector3d(0.0, 0.0, 0.0);
                    }
                            
                    if (bDecom)
                    {
                        // Decompose vector in 3 directions,if neccesary
                        afd = lf[i];

                        if (Math.Abs(lf[i].X) > 0.1)
                        {
                            afd.X = lf[i].X;
                            afd.Y = 0.0;
                            afd.Z = 0.0;

                            pts.Add(pIf[i] + def);
                            loads.Add(afd);
                            isMoment.Add(false);
                            n = n + 1;
                        }
                        
                        if (Math.Abs(lf[i].Y) > 0.1)
                        {
                            afd.X = 0.0;
                            afd.Y = lf[i].Y;
                            afd.Z = 0.0;

                            pts.Add(pIf[i] + def);
                            loads.Add(afd);
                            isMoment.Add(false);
                            n = n + 1;
                        }

                        if (Math.Abs(lf[i].Z) > 0.1)
                        {
                            afd.X = 0.0;
                            afd.Y = 0.0;
                            afd.Z = lf[i].Z;

                            pts.Add(pIf[i] + def);
                            loads.Add(afd);
                            isMoment.Add(false);
                            n = n + 1;
                        }
                    }
                    else
                    {
                        pts.Add(pIf[i] + def);
                        loads.Add(lf[i]);
                        isMoment.Add(false);
                        n = n + 1;
                    }
                }
            }

            pt = pts;
            load = loads;

            // Generate the moments, and when decomposed, generate the necessary components
            for (i = 0; i < nm; i++)
            {
                if (lm[i].Length > 0.1)     // 0.1kNm is the minimum moment to consider
                {
                    if (bOnDef)
                    {
                        // Draw Load at deformed shape
                        def = pFm[i] - pIm[i];
                        def = def * kStiff;
                    }
                    else
                    {
                        // Draw Load at original shape
                        def = new Vector3d(0.0, 0.0, 0.0);
                    }
                            
                    if (bDecom)
                    {
                        // Decompose vector in 3 directions,if neccesary
                        amd = lm[i];

                        if (Math.Abs(lm[i].X) > 0.1)
                        {
                            amd.X = lm[i].X;
                            amd.Y = 0.0;
                            amd.Z = 0.0;

                            pts.Add(pIm[i] + def);
                            loads.Add(amd);
                            isMoment.Add(true);
                            n = n + 1;
                        }
                        
                        if (Math.Abs(lm[i].Y) > 0.1)
                        {
                            amd.X = 0.0;
                            amd.Y = lm[i].Y;
                            amd.Z = 0.0;

                            pts.Add(pIm[i] + def);
                            loads.Add(amd);
                            isMoment.Add(true);
                            n = n + 1;
                        }

                        if (Math.Abs(lm[i].Z) > 0.1)
                        {
                            amd.X = 0.0;
                            amd.Y = 0.0;
                            amd.Z = lm[i].Z;

                            pts.Add(pIm[i] + def);
                            loads.Add(amd);
                            isMoment.Add(true);
                            n = n + 1;
                        }
                    }
                    else
                    {
                        pts.Add(pIm[i] + def);
                        loads.Add(lm[i]);
                        isMoment.Add(true);
                        n = n + 1;
                    }
                }
            }

            pt = pts;
            load = loads;
            bM = isMoment;
        }

        num = n;
    }
}
# ---------- end c_script_3 ----------
loaddisplay = LoadVisualisationPlus(
    Position=c_script_3.pt,
    Load=c_script_3.load,
    Scale=cfg_5.LoadSize,
    ConeRadius=0.25,
    ConeHeight=0.5,
    CylinderRadius=0.075,
    TipOnPoint=cfg_5.TipOnPoint,
    IsMoment=c_script_3.bM)  # -> Loads, LoadsMoments
filter_35 = StreamFilter(Gate=cfg_5.LoadRepresentation, Stream1=loaddisplay.LoadsMoments)
filter_36 = StreamFilter(Gate=cfg_5.LoadRepresentation, Stream1=loaddisplay.Loads)
preview_8 = CustomPreview(Geometry=filter_35, Material=hsl_2)
preview_9 = CustomPreview(Geometry=filter_36, Material=cfg_5.LoadColor)

# ---- group: AUFLAGER UND AUFLAGERREAKTIONEN DARSTELLUNG / AUFLAGER REAKTIONEN DARSTELLUNG
X_14 = UnitX(Factor=1)
Y_8 = UnitY(Factor=1)
Z_14 = UnitZ(Factor=1)
and_10 = GateAnd(A=cfg_3.Deformation, B=cfg_3.LoadsOnDeformedShape)
and_11 = GateAnd(A=cfg_3.Deformation, B=cfg_3.LoadsOnDeformedShape)
X_15 = UnitX(Factor=1)
Y_9 = UnitY(Factor=1)
Z_15 = UnitZ(Factor=1)
multiplication_14 = Multiplication(A=supportoutput.ReactionMoment, B=Y_8)
multiplication_15 = Multiplication(A=supportoutput.ReactionMoment, B=Z_14)
multiplication_16 = Multiplication(A=supportoutput.ReactionMoment, B=X_14)
c_script_4 = CSharpScript(pI=supportoutput.SupportPlaneIni, pF=supportoutput.SupportPlaneDef, k=multiplication_8, b=and_10)  # -> out, pt; inputs pI: Point3d, pF: Point3d, k: Double, b: Boolean
# ---------- c_script_4: C# ----------
// Grasshopper Script Instance
#region Usings
using System;
using System.Linq;
using System.Collections;
using System.Collections.Generic;
using System.Drawing;

using Rhino;
using Rhino.Geometry;

using Grasshopper;
using Grasshopper.Kernel;
using Grasshopper.Kernel.Data;
using Grasshopper.Kernel.Types;
#endregion

public class Script_Instance : GH_ScriptInstance
{
    #region Notes
    /* 
      Members:
        RhinoDoc RhinoDocument
        GH_Document GrasshopperDocument
        IGH_Component Component
        int Iteration

      Methods (Virtual & overridable):
        Print(string text)
        Print(string format, params object[] args)
        Reflect(object obj)
        Reflect(object obj, string method_name)
    */
    #endregion

    private void RunScript(Point3d pI, Point3d pF, double k, bool b, ref object pt)
    {
        if (b)
        {
            Vector3d def = pF - pI;
            def = def * k;
            pt = pI + def;
        }
        else
            pt = pI;
    }
}
# ---------- end c_script_4 ----------
c_script_5 = CSharpScript(pI=supportoutput.SupportPlaneIni, pF=supportoutput.SupportPlaneDef, k=multiplication_8, b=and_11)  # -> out, pt; inputs pI: Point3d, pF: Point3d, k: Double, b: Boolean; same code as c_script_4
multiplication_17 = Multiplication(A=supportoutput.ReactionForce, B=X_15)
multiplication_18 = Multiplication(A=supportoutput.ReactionForce, B=Y_9)
multiplication_19 = Multiplication(A=supportoutput.ReactionForce, B=Z_15)
X_16 = UnitX(Factor=multiplication_16)
Y_10 = UnitY(Factor=multiplication_14)
Z_16 = UnitZ(Factor=multiplication_15)
X_17 = UnitX(Factor=multiplication_17)
Y_11 = UnitY(Factor=multiplication_18)
Z_17 = UnitZ(Factor=multiplication_19)
merge_56 = Merge(Data1=c_script_5.pt, Data2=c_script_5.pt, Data3=c_script_5.pt)
merge_57 = Merge(Data1=c_script_4.pt, Data2=c_script_4.pt, Data3=c_script_4.pt)
pdecon_14 = Deconstruct(Point=X_16)  # -> XComponent, YComponent, ZComponent
pdecon_15 = Deconstruct(Point=Y_10)  # -> XComponent, YComponent, ZComponent
pdecon_16 = Deconstruct(Point=Z_16)  # -> XComponent, YComponent, ZComponent
pdecon_17 = Deconstruct(Point=X_17)  # -> XComponent, YComponent, ZComponent
pdecon_18 = Deconstruct(Point=Y_11)  # -> XComponent, YComponent, ZComponent
pdecon_19 = Deconstruct(Point=Z_17)  # -> XComponent, YComponent, ZComponent
loaddisplay_2 = LoadVisualisationPlus(
    Position=merge_57,
    Load=[X_17, Z_17, Y_11],
    Scale=cfg_3.LoadSize,
    ConeRadius=0.25,
    ConeHeight=0.5,
    CylinderRadius=0.075,
    TipOnPoint=cfg_3.TipOnPoint,
    IsMoment=False)  # -> Loads, LoadsMoments
loaddisplay_3 = LoadVisualisationPlus(
    Position=merge_56,
    Load=[X_16, Z_16, Y_10],
    Scale=cfg_3.LoadSize,
    ConeRadius=0.25,
    ConeHeight=0.5,
    CylinderRadius=0.075,
    TipOnPoint=cfg_3.TipOnPoint,
    IsMoment=True)  # -> Loads, LoadsMoments
and_12 = GateAnd(A=cfg_3.ForceReactionRepresentation, B=cfg_3.ReactionValues)
and_13 = GateAnd(A=cfg_3.MomentReactionRepresentation, B=cfg_3.ReactionValues)
eval_2 = Evaluate(
    E="Format(\"[\"&If(x>0,\"+\",\"\")&Round(x,d)&\",\"&If(y>0,\"+\",\"\")&Round(y,d)&\",\"&If(z>0,\"+\",\"\")&Round(z,d)&\"]\")",
    x=pdecon_17.XComponent,
    y=pdecon_18.YComponent,
    z=pdecon_19.ZComponent,
    d=cfg_3.NumberOfDecimals)
eval_3 = Evaluate(
    E="Format(\"[\"&If(x>0,\"+\",\"\")&Round(x,d)&\",\"&If(y>0,\"+\",\"\")&Round(y,d)&\",\"&If(z>0,\"+\",\"\")&Round(z,d)&\"]\")",
    x=pdecon_14.XComponent,
    y=pdecon_15.YComponent,
    z=pdecon_16.ZComponent,
    d=cfg_3.NumberOfDecimals)
filter_37 = StreamFilter(Gate=and_12, Stream1=eval_2)
filter_38 = StreamFilter(Gate=cfg_3.ForceReactionRepresentation, Stream1=loaddisplay_2.Loads)
filter_39 = StreamFilter(Gate=cfg_3.MomentReactionRepresentation, Stream1=loaddisplay_3.LoadsMoments)
filter_40 = StreamFilter(Gate=and_13, Stream1=eval_3)
tag_4 = TextTag(Location=c_script_4.pt, Text=filter_37, Colour=cfg_3.ReactionValueColor)
tag_5 = TextTag(Location=c_script_4.pt, Text=filter_40, Colour=cfg_3.ReactionValueColor)
preview_10 = CustomPreview(Geometry=filter_38, Material=cfg_3.ReactionColor)
preview_11 = CustomPreview(Geometry=filter_39, Material=hsl)

# ---- group: BEAM+ UND STRECKENLASTEN DARSTELLUNG / STRECKENLASTEN BEI BEAM+ DARSTELLUNG
ahsl_3 = SplitAHSL(Colour=cfg_2.LoadColor)  # -> Alpha, Hue, Saturation, Luminance
hsl_3 = ColourHSL(Alpha=ahsl_3.Alpha, Hue=ahsl_3.Hue, Saturation=ahsl_3.Saturation, Luminance=expr("0.67*x", ahsl_3.Luminance))
hsl_4 = ColourHSL(
    Alpha=expr("0.33*x", ahsl_3.Alpha),
    Hue=ahsl_3.Hue,
    Saturation=ahsl_3.Saturation,
    Luminance=expr("0.67*x", ahsl_3.Luminance))
previewload_arrows = CSharpScript(L=flatten(beamoutput.ArrowsInLoadRepresentation), T=cfg_2.LineThickness, C=hsl_3)  # inputs L: list of Line, T: Int32, C: Color, b: Boolean; same code as preview
previewload_surface = CustomPreview(Geometry=beamoutput.LoadRepresentation, Material=hsl_4)

# ---- group: STÜTZLINIE DES RAHMENS
vz = Number(beamoutput.Vz)  # disabled
my0 = Number(beamoutput.My0)  # disabled
my1 = Number(beamoutput.My1)  # disabled
streckenlast_im_träger = Number(streckenlast_träger_qz_kn_m)  # disabled
ptc = Point(end_15.End)  # disabled
pta = Point(end_15.Start)  # disabled
ptb = Point(end_16.Start)  # disabled
ptd = Point(end_16.End)  # disabled
item_51 = ListItem(List=flatten(my0), Index=0, Wrap=True)  # disabled
item_52 = ListItem(List=flatten(my0), Index=1, Wrap=True)  # disabled
item_53 = ListItem(List=flatten(my1), Index=0, Wrap=True)  # disabled
item_54 = ListItem(List=flatten(my1), Index=1, Wrap=True)  # disabled
item_55 = ListItem(List=vz, Index=0, Wrap=True)  # disabled
item_56 = ListItem(List=vz, Index=1, Wrap=True)  # disabled
anzahl_von_segmente_der_stützlinie = Slider(32, range=16..64)  # disabled
quea = Number(item_55)  # disabled
queb = Number(item_56)  # disabled
neg_7 = Negative(Value=item_51)  # disabled
neg_8 = Negative(Value=item_54)  # disabled
stützlinie_darstellen = BooleanToggle(True)  # disabled
addition_7 = Addition(A=quea, B=queb)  # disabled
momb = Number(item_52)  # disabled
momc = Number(item_53)  # disabled
momd = Number(neg_8)  # disabled
moma = Number(neg_7)  # disabled
c_stützlinie_in_xz_ebene = CSharpScript(
    A=pta,
    B=ptb,
    C=ptc,
    D=ptd,
    sumH=addition_7,
    Ma=moma,
    Mb=momb,
    Mc=momc,
    Md=momd,
    q=streckenlast_im_träger,
    segmente=anzahl_von_segmente_der_stützlinie)  # -> out, n, lines; inputs A: Point3d, B: Point3d, C: Point3d, D: Point3d, sumH: Double, Ma: Double, Mb: Double, Mc: Double, Md: Double, q: Double, segmente: Int32; disabled
# ---------- c_stützlinie_in_xz_ebene: C# ----------
// Grasshopper Script Instance
#region Usings
using System;
using System.Linq;
using System.Collections;
using System.Collections.Generic;
using System.Drawing;

using Rhino;
using Rhino.Geometry;

using Grasshopper;
using Grasshopper.Kernel;
using Grasshopper.Kernel.Data;
using Grasshopper.Kernel.Types;
#endregion

public class Script_Instance : GH_ScriptInstance
{
    #region Notes
    /* 
      Members:
        RhinoDoc RhinoDocument
        GH_Document GrasshopperDocument
        IGH_Component Component
        int Iteration

      Methods (Virtual & overridable):
        Print(string text)
        Print(string format, params object[] args)
        Reflect(object obj)
        Reflect(object obj, string method_name)
    */
    #endregion

    private void RunScript(
		Point3d A,
		Point3d B,
		Point3d C,
		Point3d D,
		double sumH,
		double Ma,
		double Mb,
		double Mc,
		double Md,
		double q,
		int segmente,
		ref object n,
		ref object lines)
    {
        n = null;

        if (Math.Abs(sumH) > 5.0)
        {
            n = 0;
            Print("Es kann keine Stützlinine berechnet werden, weil horizontale Lasten vorhanden sind.");
            return;
        }
        
        if (Math.Abs(Ma) < 1.0)
            Ma = 0.0;
        
        if (Math.Abs(Mb) < 1.0)
            Mb = 0.0;

        double[] x = new double[4];
        double[] y = new double[4];
        bool[] valid = new bool[4];
        double l;
        double k;
        int np = 0;
        Point3d[] px = new Point3d[4];

        // Zuerst berechnen wir der Schnittpunkt an der linken Stütze
        l = A.DistanceTo(C);
        // Wir gehen davon aus, dass Ma positiv, und Mc negativ ist
        k = Ma / (Ma - Mc);

        if (k < -0.0001 || k > 1.0001)
            valid[0] = false;
        else
        {
            px[0].X = A.X + k * (C.X - A.X);
            px[0].Y = A.Y + k * (C.Y - A.Y);
            px[0].Z = A.Z + k * (C.Z - A.Z);

            valid[0] = true;
            np = np + 1;
        }

        // Dann der Schnittpunkt an der rechten Stütze
        l = B.DistanceTo(D);
        // Wir gehen davon aus, dass Mb positiv, und Md negativ ist
        k = Mb / (Mb - Md);

        if (k < -0.0001 || k > 1.0001)
            valid[1] = false;
        else
        {
            px[1].X = B.X + k * (D.X - B.X);
            px[1].Y = B.Y + k * (D.Y - B.Y);
            px[1].Z = B.Z + k * (D.Z - B.Z);

            valid[1] = true;
            np = np + 1;
        }

        if (np < 2)
        {
            n = np;
            Print("Nicht die notwendige Schnittpunkte der Momentenlinie an den Stützen gedunden.");
            return;
        }

        // Jetzt müssen wir die Parabelformel erstellen, um die Schnittpunkte der Parabel zu berechnen
        l = C.DistanceTo(D);
        double a = 0.0;
        double b = Mc;
        double c = l / 2.0;
        double d = (Mc + Md) / 2.0 + q * l * l / 8.0;
        double e = l;
        double f = Md;

        double den1 = (a * a - a * (c + e) + c * e) * (e - c);
        double den2 = c - e;

        double x1;
        double x2;
        double pa;
        double pb;
        double pc;

        if (Math.Abs(den1) > 0.00001 && Math.Abs(den2) > 0.00001)
        {
            pa = a * (d - f) + b * (e - c) + c * f - d * e;
            pa = pa / den1;

            pb = a * a * (d - f) + b * (c + e) * (e - c) + c * c * f - d * e * e;
            pb = -pb / den1;

            pc = c * e * (a * (d - f) + b * (e - c) + c * f - d * e);
            pc = pc / den1;
            pc = pc + e * (f - d) / (c - e) + f;

            // Jetzt kann man die Nullstellen der Parabel des Momentes
            x1 = (- pb - Math.Sqrt(pb * pb - 4 * pa * pc)) / (2 * pa);
            x2 = (- pb + Math.Sqrt(pb * pb - 4 * pa * pc)) / (2 * pa);

            if (x1 > x2)
            {
                double t = x2;
                x2 = x1;
                x1 = t;
            }

            k = x1 / l;

            if (k < -0.0001 || k > 1.0001)
                valid[2] = false;
            else
            {
                px[2].X = C.X + k * (D.X - C.X);
                px[2].Y = C.Y + k * (D.Y - C.Y);
                px[2].Z = C.Z + k * (D.Z - C.Z);

                valid[2] = true;
                np = np + 1;
            }        

            k = x2 / l;

            if (k < -0.0001 || k > 1.0001)
                valid[3] = false;
            else
            {
                px[3].X = C.X + k * (D.X - C.X);
                px[3].Y = C.Y + k * (D.Y - C.Y);
                px[3].Z = C.Z + k * (D.Z - C.Z);

                valid[3] = true;
                np = np + 1;
            }        
        }
        else
        {
            n = np;
            Print("Es ist ein Fehler aufgetreten. Mann kann die Stützlinie nicht berechnen.");
            return;
        }

        // Jetzt haben wir die Schnittpunkte. Wir brauchen 3 um die Parabel der Stützlinie (Bogen) zu berechnen.

        if (np >= 3)
        {
            // Jetzt berechnen wir die Parabel der Stüzlinie
            // Wir gehen davon aus, dass der Rahmen (und deshalb, die Stützlinie) im XZ Ebene liegt
            int i = 0;
            int j = 0;

            double[] xv = new double[4];
            double[] zv = new double[4];

            double x_min = 999.99;
            double x_max = -999.99;

            // Wir brauchen die erste drei korrekte Schnittpunkte
            for (i = 0; i < 4; i++)
            {
                if (valid[i])
                {
                    // Wir gehen davon aus, dass der Rahmen (und deshalb, die Stützlinie) im XZ Ebene liegt
                    xv[j] = px[i].X;
                    zv[j] = px[i].Z;
                    j = j + 1;

                    x_min = Math.Min(x_min, xv[i]);
                    x_max = Math.Max(x_max, xv[i]);
                }
            }

            a = xv[0];
            b = zv[0];
            c = xv[1];
            d = zv[1];
            e = xv[2];
            f = zv[2];

            den1 = (a * a - a * (c + e) + c * e) * (e - c);
            den2 = c - e;

            if (Math.Abs(den1) > 0.00001 && Math.Abs(den2) > 0.00001)
            {
                pa = a * (d - f) + b * (e - c) + c * f - d * e;
                pa = pa / den1;

                pb = a * a * (d - f) + b * (c + e) * (e - c) + c * c * f - d * e * e;
                pb = -pb / den1;

                pc = c * e * (a * (d - f) + b * (e - c) + c * f - d * e);
                pc = pc / den1;
                pc = pc + e * (f - d) / (c - e) + f;

                // Das sind die Gleichungen für die Tangenten an beiden Enden der Stützlinie
                double m1 = 2.0 * pa * xv[0] + pb;
                double m2 = 2.0 * pa * xv[1] + pb;
                double b1 = zv[0] - m1 * xv[0];
                double b2 = zv[1] - m2 * xv[1];

                // Jetzt berechnen wir die "Bodenlinie", das ist die Linie die
                // beide Auflager verbindet (normallerweise der X-Achse)
                double m3 = (B.Z - A.Z) / (B.X - A.X);
                double b3 = B.Z - m3 * B.X;

                // Die Schnittpunkte zwischen den Tangenten und die Bodelinie 
                double xx1;
                double zz1;
                double xx2;
                double zz2;

                // Wir gehen davon aus, dass der Rahmen (und deshalb, die Stützlinie) im XZ Ebene liegt
                // oder parallel zur globallen XZ Ebene
                double yyy = A.Y;

                xx1 = (b3 - b1) / (m1 - m3);
                zz1 = m1 * xx1 + b1;

                xx2 = (b3 - b2) / (m2 - m3);
                zz2 = m2 * xx2 + b2;

                Line[] sLine = new Line[segmente + 2];

                sLine[0].From = new Point3d(xx1, yyy, zz1);
                sLine[0].To = new Point3d(xv[0], yyy, zv[0]);
                sLine[1].From = new Point3d(xx2, yyy, zz2);
                sLine[1].To = new Point3d(xv[1], yyy, zv[1]);

                double xxx;
                double stepX = (x_max - x_min) / segmente;

                xxx = x_min;
                for (i = 0; i < segmente; i++)
                {
                    sLine[i + 2].From = new Point3d(xxx, yyy, pa * xxx * xxx + pb * xxx + pc);
                    xxx += stepX;
                    sLine[i + 2].To = new Point3d(xxx, yyy, pa * xxx * xxx + pb * xxx + pc);
                }

                lines = sLine;
                n = np;
            }
            else
            {
                Print("Es ist ein Fehler aufgetreten. Mann kann die Stützlinie nicht berechnen.");
                n = np;
                return;
            }
        }        
    }
}
# ---------- end c_stützlinie_in_xz_ebene ----------
swatch_5 = ColourSwatch(SwatchColor=RGB(3, 81, 194))  # disabled
liniengrösse = Slider(5, range=0..10)  # disabled
panel_59 = Panel(c_stützlinie_in_xz_ebene.out)  # disabled
filter_41 = StreamFilter(Gate=stützlinie_darstellen, Stream1=c_stützlinie_in_xz_ebene.lines)  # disabled
preview_geo_4 = CSharpScript(L=flatten(filter_41), T=liniengrösse, C=swatch_5, b=False)  # inputs L: list of Line, T: Int32, C: Color, b: Boolean; disabled; same code as preview

vz_2 = Number(beamoutput.Vz)
my0_2 = Number(beamoutput.My0)
my1_2 = Number(beamoutput.My1)
pta_2 = Point(end_15.Start)
ptb_2 = Point(end_16.Start)
ptc_2 = Point(end_15.End)
ptd_2 = Point(end_16.End)
entwine_16 = Entwine(Branch00=vz_2, Branch01=my0_2, Branch02=my1_2, FlattenInputs=True)  # -> simplify(Result)
cluster_cull_round = ClusterCullRound(X=entwine_16)  # disabled
bang_13 = ExplodeTree(Data=simplify(cluster_cull_round))  # -> Branch0, reverse(Branch1), Branch2; disabled
entwine_17 = Entwine(Branch00=bang_13.Branch0, Branch01=bang_13.Branch1, Branch02=bang_13.Branch2, FlattenInputs=True)  # -> simplify(Result); disabled
and_14 = GateAnd(A=abstraktion, B=geometrie_komplett)
streckenlast_im_träger_2 = Number(streckenlast_träger_qz_kn_m)
filter_42 = StreamFilter(Gate=and_14, Stream0=entwine_16, Stream1=entwine_17)
bang_14 = ExplodeTree(Data=filter_42)  # -> Branch0, Branch1, Branch2
item_57 = ListItem(List=flatten(bang_14.Branch1), Index=0, Wrap=True)
item_58 = ListItem(List=flatten(bang_14.Branch1), Index=1, Wrap=True)
item_59 = ListItem(List=flatten(bang_14.Branch2), Index=0, Wrap=True)
item_60 = ListItem(List=flatten(bang_14.Branch2), Index=1, Wrap=True)
item_61 = ListItem(List=bang_14.Branch0, Index=0, Wrap=True)
item_62 = ListItem(List=bang_14.Branch0, Index=1, Wrap=True)
anzahl_von_segmente_der_stützlinie_2 = Slider(32, range=16..64)
queb_2 = Number(item_62)
quea_2 = Number(item_61)
neg_9 = Negative(Value=item_57)
neg_10 = Negative(Value=item_60)
stützlinie_darstellen_2 = BooleanToggle(False)
addition_8 = Addition(A=quea_2, B=queb_2)
momc_2 = Number(item_59)
momb_2 = Number(item_58)
momd_2 = Number(neg_10)
moma_2 = Number(neg_9)
c_stützlinie_in_yz_ebene = CSharpScript(
    A=pta_2,
    B=ptb_2,
    C=ptc_2,
    D=ptd_2,
    sumH=addition_8,
    Ma=moma_2,
    Mb=momb_2,
    Mc=momc_2,
    Md=momd_2,
    q=streckenlast_im_träger_2,
    segmente=anzahl_von_segmente_der_stützlinie_2)  # -> out, n, lines; inputs A: Point3d, B: Point3d, C: Point3d, D: Point3d, sumH: Double, Ma: Double, Mb: Double, Mc: Double, Md: Double, q: Double, segmente: Int32
# ---------- c_stützlinie_in_yz_ebene: C# ----------
// Grasshopper Script Instance
#region Usings
using System;
using System.Linq;
using System.Collections;
using System.Collections.Generic;
using System.Drawing;

using Rhino;
using Rhino.Geometry;

using Grasshopper;
using Grasshopper.Kernel;
using Grasshopper.Kernel.Data;
using Grasshopper.Kernel.Types;
#endregion

public class Script_Instance : GH_ScriptInstance
{
    #region Notes
    /* 
      Members:
        RhinoDoc RhinoDocument
        GH_Document GrasshopperDocument
        IGH_Component Component
        int Iteration

      Methods (Virtual & overridable):
        Print(string text)
        Print(string format, params object[] args)
        Reflect(object obj)
        Reflect(object obj, string method_name)
    */
    #endregion

    private void RunScript(
		Point3d A,
		Point3d B,
		Point3d C,
		Point3d D,
		double sumH,
		double Ma,
		double Mb,
		double Mc,
		double Md,
		double q,
		int segmente,
		ref object n,
		ref object lines)
    {
        n = null;

        if (Math.Abs(sumH) > 5.0)
        {
            n = 0;
            Print("Es kann keine Stützlinine berechnet werden, weil horizontale Lasten vorhanden sind.");
            return;
        }

        double[] x = new double[4];
        double[] y = new double[4];
        bool[] valid = new bool[4];
        double l;
        double k;
        int np = 0;
        Point3d[] px = new Point3d[4];

        if (Math.Abs(Ma) < 1.0)
            Ma = 0.0;
        
        if (Math.Abs(Mb) < 1.0)
            Mb = 0.0;

        // Zuerst berechnen wir der Schnittpunkt an der linken Stütze
        l = A.DistanceTo(C);
        // Wir gehen davon aus, dass Ma positiv, und Mc negativ ist
        k = Ma / (Ma - Mc);

        if (k < -0.0001 || k > 1.0001)
            valid[0] = false;
        else
        {
            px[0].X = A.X + k * (C.X - A.X);
            px[0].Y = A.Y + k * (C.Y - A.Y);
            px[0].Z = A.Z + k * (C.Z - A.Z);

            valid[0] = true;
            np = np + 1;
        }

        // Dann der Schnittpunkt an der rechten Stütze
        l = B.DistanceTo(D);
        // Wir gehen davon aus, dass Mb positiv, und Md negativ ist
        k = Mb / (Mb - Md);

        if (k < -0.0001 || k > 1.0001)
            valid[1] = false;
        else
        {
            px[1].X = B.X + k * (D.X - B.X);
            px[1].Y = B.Y + k * (D.Y - B.Y);
            px[1].Z = B.Z + k * (D.Z - B.Z);

            valid[1] = true;
            np = np + 1;
        }

        if (np < 2)
        {
            n = np;
            Print("Nicht die notwendige Schnittpunkte der Momentenlinie an den Stützen gedunden.");
            return;
        }

        // Jetzt müssen wir die Parabelformel erstellen, um die Schnittpunkte der Parabel zu berechnen
        l = C.DistanceTo(D);
        double a = 0.0;
        double b = Mc;
        double c = l / 2.0;
        double d = (Mc + Md) / 2.0 + q * l * l / 8.0;
        double e = l;
        double f = Md;

        double den1 = (a * a - a * (c + e) + c * e) * (e - c);
        double den2 = c - e;

        double x1;
        double x2;
        double pa;
        double pb;
        double pc;

        if (Math.Abs(den1) > 0.00001 && Math.Abs(den2) > 0.00001)
        {
            pa = a * (d - f) + b * (e - c) + c * f - d * e;
            pa = pa / den1;

            pb = a * a * (d - f) + b * (c + e) * (e - c) + c * c * f - d * e * e;
            pb = -pb / den1;

            pc = c * e * (a * (d - f) + b * (e - c) + c * f - d * e);
            pc = pc / den1;
            pc = pc + e * (f - d) / (c - e) + f;

            // Jetzt kann man die Nullstellen der Parabel des Momentes
            x1 = (- pb - Math.Sqrt(pb * pb - 4 * pa * pc)) / (2 * pa);
            x2 = (- pb + Math.Sqrt(pb * pb - 4 * pa * pc)) / (2 * pa);

            if (x1 > x2)
            {
                double t = x2;
                x2 = x1;
                x1 = t;
            }

            k = x1 / l;

            if (k < -0.0001 || k > 1.0001)
                valid[2] = false;
            else
            {
                px[2].X = C.X + k * (D.X - C.X);
                px[2].Y = C.Y + k * (D.Y - C.Y);
                px[2].Z = C.Z + k * (D.Z - C.Z);

                valid[2] = true;
                np = np + 1;
            }        

            k = x2 / l;

            if (k < -0.0001 || k > 1.0001)
                valid[3] = false;
            else
            {
                px[3].X = C.X + k * (D.X - C.X);
                px[3].Y = C.Y + k * (D.Y - C.Y);
                px[3].Z = C.Z + k * (D.Z - C.Z);

                valid[3] = true;
                np = np + 1;
            }        
        }
        else
        {
            n = np;
            Print("Es ist ein Fehler aufgetreten. Mann kann die Stützlinie nicht berechnen.");
            return;
        }

        // Jetzt haben wir die Schnittpunkte. Wir brauchen 3 um die Parabel der Stützlinie (Bogen) zu berechnen.

        if (np >= 3)
        {
            // Jetzt berechnen wir die Parabel der Stüzlinie
            // Wir gehen davon aus, dass der Rahmen (und deshalb, die Stützlinie) im YZ Ebene liegt
            int i = 0;
            int j = 0;

            double[] yv = new double[4];
            double[] zv = new double[4];

            double y_min = 999.99;
            double y_max = -999.99;

            // Wir brauchen die erste drei korrekte Schnittpunkte
            for (i = 0; i < 4; i++)
            {
                if (valid[i])
                {
                    // Wir gehen davon aus, dass der Rahmen (und deshalb, die Stützlinie) im XZ Ebene liegt
                    yv[j] = px[i].Y;
                    zv[j] = px[i].Z;
                    j = j + 1;

                    y_min = Math.Min(y_min, yv[i]);
                    y_max = Math.Max(y_max, yv[i]);
                }
            }

            a = yv[0];
            b = zv[0];
            c = yv[1];
            d = zv[1];
            e = yv[2];
            f = zv[2];

            den1 = (a * a - a * (c + e) + c * e) * (e - c);
            den2 = c - e;

            if (Math.Abs(den1) > 0.00001 && Math.Abs(den2) > 0.00001)
            {
                pa = a * (d - f) + b * (e - c) + c * f - d * e;
                pa = pa / den1;

                pb = a * a * (d - f) + b * (c + e) * (e - c) + c * c * f - d * e * e;
                pb = -pb / den1;

                pc = c * e * (a * (d - f) + b * (e - c) + c * f - d * e);
                pc = pc / den1;
                pc = pc + e * (f - d) / (c - e) + f;

                // Das sind die Gleichungen für die Tangenten an beiden Enden der Stützlinie
                double m1 = 2.0 * pa * yv[0] + pb;
                double m2 = 2.0 * pa * yv[1] + pb;
                double b1 = zv[0] - m1 * yv[0];
                double b2 = zv[1] - m2 * yv[1];

                // Jetzt berechnen wir die "Bodenlinie", das ist die Linie die
                // beide Auflager verbindet (normallerweise der X-Achse)
                double m3 = (B.Z - A.Z) / (B.Y - A.Y);
                double b3 = B.Z - m3 * B.Y;

                // Die Schnittpunkte zwischen den Tangenten und die Bodelinie 
                double yy1;
                double zz1;
                double yy2;
                double zz2;

                // Wir gehen davon aus, dass der Rahmen (und deshalb, die Stützlinie) im YZ Ebene liegt
                // oder parallel zur globallen YZ Ebene
                double xxx = A.X;

                yy1 = (b3 - b1) / (m1 - m3);
                zz1 = m1 * yy1 + b1;

                yy2 = (b3 - b2) / (m2 - m3);
                zz2 = m2 * yy2 + b2;

                Line[] sLine = new Line[segmente + 2];

                sLine[0].From = new Point3d(xxx, yy1, zz1);
                sLine[0].To = new Point3d(xxx, yv[0], zv[0]);
                sLine[1].From = new Point3d(xxx, yy2, zz2);
                sLine[1].To = new Point3d(xxx, yv[1], zv[1]);

                double yyy;
                double stepY = (y_max - y_min) / segmente;

                yyy = y_min;
                for (i = 0; i < segmente; i++)
                {
                    sLine[i + 2].From = new Point3d(xxx, yyy, pa * yyy * yyy + pb * yyy + pc);
                    yyy += stepY;
                    sLine[i + 2].To = new Point3d(xxx, yyy, pa * yyy * yyy + pb * yyy + pc);
                }

                lines = sLine;
                n = np;
            }
            else
            {
                Print("Es ist ein Fehler aufgetreten. Mann kann die Stützlinie nicht berechnen.");
                n = np;
                return;
            }
        }        
    }
}
# ---------- end c_stützlinie_in_yz_ebene ----------
liniengrösse_2 = Slider(5, range=0..10)
panel_60 = Panel(c_stützlinie_in_yz_ebene.out)
filter_43 = StreamFilter(Gate=stützlinie_darstellen_2, Stream1=c_stützlinie_in_yz_ebene.lines)
preview_geo_5 = CSharpScript(L=flatten(filter_43), T=liniengrösse_2, C=ColourSwatch(SwatchColor=RGB(3, 81, 194)), b=False)  # inputs L: list of Line, T: Int32, C: Color, b: Boolean; same code as preview

# ---- group: SPANNUNGSRATIO
mergesaturations = Merge(Data1=dedomain_3.End, Data2=dedomain.End, Data3=dedomain_2.End)
panel_61 = Panel("""SPANNUNGEN ZU GROß!!!
Es gibt Elemente mit einem Spannungsratio über 100%. """)
bnd_4 = Bounds(Numbers=mergesaturations)
dedomain_4 = DeconstructDomain(Domain=bnd_4)  # -> Start, End
larger_4 = LargerThan(FirstNumber=dedomain_4.End, SecondNumber="1.0")  # -> LargerThan, OrEqualTo
panel_62 = Panel(" ")
filter_44 = StreamFilter(Gate=larger_4.LargerThan, Stream0=panel_62, Stream1=panel_61)

# ----
str2img = DeserializeImageFromString(ImageString=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)
logos = BooleanToggle(True)
trigger = Trigger(Interval=2000, TimerInterval=2000, Target=c_script_6)
c_script_6 = CSharpScript()  # -> out, a, W, H
# ---------- c_script_6: C# ----------
// Grasshopper Script Instance
#region Usings
using System;
using System.Linq;
using System.Collections;
using System.Collections.Generic;
using System.Drawing;

using Rhino;
using Rhino.Geometry;

using Grasshopper;
using Grasshopper.Kernel;
using Grasshopper.Kernel.Data;
using Grasshopper.Kernel.Types;
#endregion

using System.IO;
using System.Data;
using System.Reflection;
using System.Windows.Forms;
using System.Xml;
using System.Xml.Linq;
using System.Runtime.InteropServices;

using Rhino.DocObjects;
using Rhino.Collections;

public class Script_Instance : GH_ScriptInstance
{
    #region Notes
    /* 
      Members:
        RhinoDoc RhinoDocument
        GH_Document GrasshopperDocument
        IGH_Component Component
        int Iteration

      Methods (Virtual & overridable):
        Print(string text)
        Print(string format, params object[] args)
        Reflect(object obj)
        Reflect(object obj, string method_name)
    */
    #endregion

    private void RunScript(ref object a, ref object W, ref object H)
    {
        var view = RhinoDoc.ActiveDoc.Views.ActiveView;
        H = view.ActiveViewport.Bounds.Height;
        W = view.ActiveViewport.Bounds.Width;
    }
}
# ---------- end c_script_6 ----------
int = Integer(c_script_6.H)
subtraction_7 = Subtraction(A=c_script_6.W, B="30")
subtraction_8 = Subtraction(A=c_script_6.H, B="30")
multiplication_20 = Multiplication(A=c_script_6.W, B=".12")
pt_12 = ConstructPoint(XCoordinate=subtraction_7, YCoordinate=subtraction_8, ZCoordinate=0)

# ---- group: SPANNUNGSRATIO (continued)
vp_height = Integer(int)
division_16 = Division(A=vp_height, B="1000")
multiplication_21 = Multiplication(A=Slider(15, range=0..30), B=division_16)
textfaktor = Number(division_16)
multiplication_22 = Multiplication(A="30", B=textfaktor)
multiplication_23 = Multiplication(A="60", B=textfaktor)
pt_13 = ConstructPoint(XCoordinate=multiplication_22, YCoordinate=multiplication_23, ZCoordinate=0)
texttoscreen = RenderTextToScreen(
    Text=filter_44,
    Location=pt_13,
    Size=multiplication_21,
    Color=ColourSwatch(SwatchColor=RGB(255, 255, 0)),
    Font="Arial Fett",
    m_scWithvp=False)

# ----
bitmap = BitmapFromFile(BitmapPath=str2img)  # -> Bitmap, Width, Height

filter_45 = StreamFilter(Gate=logos, Stream1=bitmap.Bitmap)
c_script_7 = CSharpScript(Tx=filter_45, P=pt_12, w=multiplication_20)  # -> out, a; inputs P: Point3d, w: Double
# ---------- c_script_7: C# ----------
// Grasshopper Script Instance
#region Usings
using System;
using System.Linq;
using System.Collections;
using System.Collections.Generic;
using System.Drawing;

using Rhino;
using Rhino.Geometry;
using Rhino.DocObjects;
using Rhino.Collections;

using Grasshopper;
using Grasshopper.Kernel;
using Grasshopper.Kernel.Data;
using Grasshopper.Kernel.Types;
#endregion

using System;
using System.Drawing;
using System.Drawing.Drawing2D;
using System.Drawing.Imaging;
using System.IO;

public class Script_Instance : GH_ScriptInstance
{
    #region Notes
    /* 
      Members:
        RhinoDoc RhinoDocument
        GH_Document GrasshopperDocument
        IGH_Component Component
        int Iteration

      Methods (Virtual & overridable):
        Print(string text)
        Print(string format, params object[] args)
        Reflect(object obj)
        Reflect(object obj, string method_name)
    */
    #endregion

    private void RunScript(object Tx, Point3d P, double w, ref object a)
    {
        Bitmap texture = Tx as Bitmap;
        if (texture == null) return;

        int width = texture.Width;
        int height = texture.Height;

        double scale = w / ((double) width);

        texture = ResizeImage(texture, (int) (scale * width), (int) (scale * height));

        if (_bitmap == null)
            _bitmap = new Rhino.Display.DisplayBitmap(texture);

        _point.X = P.X - scale * width;
        _point.Y = P.Y - scale * height;
        _point.Z = 0.0;
    }

    private Rhino.Display.DisplayBitmap _bitmap;
    private Point3d _point;    
 
    public override void BeforeRunScript()
    {
        if (_bitmap != null)
        {
            _bitmap.Dispose();
            _bitmap = null;
        }
    }

    //Draw all meshes in this method.
    public override void DrawViewportMeshes(IGH_PreviewArgs args)
    {
        if (_bitmap == null) return;
 
        int x = (int) (_point.X);
        int y = (int) (_point.Y);
        args.Display.DrawBitmap(_bitmap, x, y);
    }

    /// Resize the image to the specified width and height.
    /// </summary>
    /// <param name="image">The image to resize.</param>
    /// <param name="width">The width to resize to.</param>
    /// <param name="height">The height to resize to.</param>
    /// <returns>The resized image.</returns>
    public static Bitmap ResizeImage(Image image, int width, int height)
    {
        var destRect = new Rectangle(0, 0, width, height);
        var destImage = new Bitmap(width, height);

        destImage.SetResolution(image.HorizontalResolution, image.VerticalResolution);

        using (var graphics = Graphics.FromImage(destImage))
        {
            graphics.CompositingMode = CompositingMode.SourceCopy;
            graphics.CompositingQuality = CompositingQuality.HighQuality;
            graphics.InterpolationMode = InterpolationMode.HighQualityBicubic;
            graphics.SmoothingMode = SmoothingMode.HighQuality;
            graphics.PixelOffsetMode = PixelOffsetMode.HighQuality;

            using (var wrapMode = new ImageAttributes())
            {
                wrapMode.SetWrapMode(WrapMode.TileFlipXY);
                graphics.DrawImage(image, destRect, 0, 0, image.Width,image.Height, GraphicsUnit.Pixel, wrapMode);
            }
        }

        return destImage;
    }    
}
# ---------- end c_script_7 ----------

vp_height_2 = Integer(int)
panel_63 = Panel("""STÜTZLINIE NICHT SICHTBAR!!!
Schalte "Abstraktion" ein und mache "Geometrie komplett" aus.""")
division_17 = Division(A=vp_height_2, B="1000")
multiplication_24 = Multiplication(A=Slider(15, range=0..30), B=division_17)
textfaktor_2 = Number(division_17)
not_6 = GateNot(A=abstraktion)
or_3 = GateOr(A=geometrie_komplett, B=not_6)
filter_46 = StreamFilter(Gate=larger_4.LargerThan, Stream0="60", Stream1="130")
and_15 = GateAnd(A=stützlinie_darstellen_2, B=or_3)
multiplication_25 = Multiplication(A="30", B=textfaktor_2)
multiplication_26 = Multiplication(A=filter_46, B=textfaktor_2)
filter_47 = StreamFilter(Gate=and_15, Stream0=panel_62, Stream1=panel_63)
pt_14 = ConstructPoint(XCoordinate=multiplication_25, YCoordinate=multiplication_26, ZCoordinate=0)
texttoscreen_2 = RenderTextToScreen(
    Text=filter_47,
    Location=pt_14,
    Size=multiplication_24,
    Color=ColourSwatch(SwatchColor=RGB(255, 255, 0)),
    Font="Arial Fett",
    m_scWithvp=False)

or_4 = GateOr(A=larger_4.LargerThan, B=and_15)
and_16 = GateAnd(A=larger_4.LargerThan, B=and_15)

panel_64 = Panel("""AUF ABSTAKTION WECHSELN!!!
Diese Option ist nicht beim Bespiel verwendbar. Es wird der Zweigelenkbogen angezeigt.""")
vp_height_3 = Integer(int)
division_18 = Division(A=vp_height_3, B="1000")
multiplication_27 = Multiplication(A=Slider(15, range=0..30), B=division_18)
textfaktor_3 = Number(division_18)
not_7 = GateNot(A=abstraktion)
and_17 = GateAnd(A=py3.toggle3, B=not_7)
filter_48 = StreamFilter(Gate=and_17, Stream0=" ", Stream1=panel_64)
filter_49 = StreamFilter(Gate=or_4, Stream0="60", Stream1="130")
multiplication_28 = Multiplication(A="30", B=textfaktor_3)

filter_50 = StreamFilter(Gate=and_16, Stream0=filter_49, Stream1="200")

multiplication_29 = Multiplication(A=filter_50, B=textfaktor_3)
pt_15 = ConstructPoint(XCoordinate=multiplication_28, YCoordinate=multiplication_29, ZCoordinate=0)
texttoscreen_3 = RenderTextToScreen(
    Text=filter_48,
    Location=pt_15,
    Size=multiplication_27,
    Color=ColourSwatch(SwatchColor=RGB(255, 255, 0)),
    Font="Arial Fett",
    m_scWithvp=False)

# ==== cluster ClusterCullRound

# ---- group: Cull
X = ClusterInput()
pt = ConstructPoint(XCoordinate=X, YCoordinate=0, ZCoordinate=0)
cullpt = CullDuplicates(Points=pt, Tolerance=0.1, CullMode=3)  # -> Points, Indices, Valence
pdecon = Deconstruct(Point=cullpt.Points)  # -> XComponent, YComponent, ZComponent

# ---- group: Round
multiplication = Multiplication(A=pdecon.XComponent, B="1000")
round = Round(Number=multiplication)  # -> Nearest, Floor, Ceiling
division = Division(A=round.Nearest, B="1000")

# ----
X_2 = ClusterOutput(pdecon.XComponent)
